# Grasshopper definition 01_fabtory_robot_model_rh8.ghx (Grasshopper 1.0.8)
# plug-ins: RhinoCodePluginGH

# ----
# PATHS
path = IronPython2Script()  # -> HERE, DATA, ROBOT_DESCRIPTION, ASSEMBLY
# ---------- path: IronPython ----------
import os

HERE = os.path.dirname(ghdoc.Path)
DATA = os.path.abspath(os.path.join(HERE, "..", "data"))
ROBOT_DESCRIPTION = os.path.abspath(os.path.join(DATA, "robot_description"))
ASSEMBLY = os.path.abspath(os.path.join(DATA, "assembly"))

#print(HERE)
#print(DATA)
#print(ROBOT_DESCRIPTION)
#print(ASSEMBLY)
# ---------- end path ----------

connect = Button()
close = Button()

# ----
# Model
load = Button()
list = ValueList({"abb_fabtory"}, selected="abb_fabtory")
load_model_local = IronPython2Script(path=path.ROBOT_DESCRIPTION, package=list, urdf_name="abb_fabtory.urdf", srdf_name="abb_fabtory.srdf", load=load)  # -> out, robot; inputs path: String, urdf_name: String, srdf_name: String
# ---------- load_model_local: IronPython ----------
import os
from scriptcontext import sticky as st

import compas
import compas_fab
import compas_robots

from compas_robots import RobotModel
from compas_robots.resources import LocalPackageMeshLoader

from compas_fab.robots import Robot
from compas_fab.robots import RobotSemantics

from compas_robots.scene import BaseRobotModelObject
from compas.scene import SceneObject

packages = ["abb_irb6700_support", "abb_end_effectors", "abb_fabtory"]
loaders = []

for package in packages:
    loaders.append(LocalPackageMeshLoader(path, package))

#path directory
package_path = os.path.join(path, package)
#print(package_path)

urdf_filename = os.path.join(package_path, "urdf", urdf_name)
srdf_filename = os.path.join(package_path, srdf_name)

assert os.path.isfile(urdf_filename)
assert os.path.isfile(srdf_filename)

compas.PRECISION = '12f'

# store robot in component
guid = str(ghenv.Component.InstanceGuid)
robot_key = "robot_" + guid
robot_model_key = "robot_model_" + guid

if robot_key not in st:
    st[robot_key] = None
    st[robot_model_key] = None

#load robot model from urdf
if load:

    # Create robot model from URDF
    model = RobotModel.from_urdf_file(urdf_filename)
    model.load_geometry(*loaders, precision=12)

    semantics = RobotSemantics.from_srdf_file(srdf_filename, model)
    scene_object = SceneObject(model)
    robot = Robot(model=model, scene_object=scene_object, semantics=semantics, client=None)
    
    st[robot_key] = robot
    st[robot_model_key] = model

robot = st[robot_key]
robot_model = st[robot_model_key]

if robot:
    print(robot.info())

    #print robot.get_end_effector_link_name(robot.main_group_name)
# ---------- end load_model_local ----------

# ----
# Clients
ros_ip = ValueList({"127.0.0.1"}, selected="127.0.0.1")
ros_port = ValueList({"9090"}, selected="9090")
clients = IronPython2Script(ip=ros_ip, port=ros_port, connect=connect, close=close)  # -> out, ros_client, abb_client, is_connected
# ---------- clients: IronPython ----------
from scriptcontext import sticky as st

import compas_rrc as rrc
from compas_fab.backends import RosClient

if 'ros_client' not in st:
    st['ros_client'] = None
    st['abb_client'] = None
    st['is_connected'] = False

if close:
    st['ros_client'].close()
    st['ros_client'] = None
    st['abb_client'] = None
    st['is_connected'] = False

if connect:
    ros_client = RosClient(ip, port)
    try:
        ros_client.run(2)
    except:
        print('Cannot connect to ROS Client')
    
    
    st['is_connected'] = ros_client.is_connected if ros_client else False

    if st['is_connected']:
        abb_client = rrc.AbbClient(ros_client, '/rob1')

        st['ros_client'] = ros_client
        st['abb_client'] = abb_client

is_connected = st['is_connected']
ros_client = st['ros_client']
abb_client = st['abb_client']

print('ROS Client: ', ros_client)
print('ABB Client: ', abb_client)
print('is connected: ', is_connected)
# ---------- end clients ----------
is_connected = Panel(clients.is_connected)
set = IronPython2Script(robot=load_model_local.robot, ros_client=clients.ros_client, abb_client=clients.abb_client)  # -> out, robot, main_group_name
# ---------- set: IronPython ----------
if robot and ros_client and abb_client:
    robot.ros_client = robot.client = ros_client
    robot.abb_client = abb_client
    main_group_name = robot.main_group_name
# ---------- end set ----------

# ----
# Unload Python
# modules
button = Button()
unload = IronPython2Script(unload=button)  # -> out
# ---------- unload: IronPython ----------
from compas_rhino import unload_modules

unload_modules('climate_active_envelopes_design')
unload_modules('climate_active_envelopes_design.assembly')
unload_modules('climate_active_envelopes_design.part')

unload_modules("assembly_information_model")

unload_modules('climate_active_envelopes_fabrication')

unload_modules("abb_fabrication_control")
unload_modules("extruder_control")
unload_modules("fabrication_manager")
# ---------- end unload ----------

reload = Button()
py3 = Python3Script()  # -> HERE, DATA, ROBOT_DESCRIPTION
# ---------- py3: Python ----------
import os

HERE = os.path.dirname(ghdoc.Path)
DATA = os.path.abspath(os.path.join(HERE, "..", "data"))
ROBOT_DESCRIPTION = os.path.abspath(os.path.join(DATA, "robot_description"))

print(HERE)
print(DATA)
print(ROBOT_DESCRIPTION)
# ---------- end py3 ----------
py3_2 = Python3Script(reload=reload)
# ---------- py3_2: Python ----------
if reload:
    from compas_ghpython import unload_modules
    unload_modules("compas")
    unload_modules("compas_fab")
    unload_modules("abb_fabrication_control")
    unload_modules("compas_rrc")
    unload_modules("extruder_control")

    unload_modules("fabrication_manager")
    #unload_modules("assembly_information_model")
    unload_modules('climate_aware_robotic_envelope')
# ---------- end py3_2 ----------

# ----
# Tool
list_2 = ValueList({"measurement_tool": 0, "concrete_extruder": 1}, selected="measurement_tool")
panel = Panel("Attach a custom tool")
tools = Tools(G=list_2)
remove = Button()
add = Button()
attach_remove = PythonScript(tool=tools, attach=add, remove=remove)  # -> out, bang; disabled
# ---------- attach_remove: Python ----------
if attach:
    robot.attach_tool(tool)
if remove:
    robot.detach_tool()
# ---------- end attach_remove ----------

# ----
# Robot Model
panel_2 = Panel("abb_fabtory.srdf")

tools_2 = Tools_2()  # -> tool_9, tool_10, tool_2, tool_6, tool_4
attach = Button()

# ----
# Robot
panel_3 = Panel(load_model_local.out)
robot = Data(set.robot)

# ----
# Attach and remove tools
list_3 = ValueList({"mortar_extruder": 0, "measurement_tool": 1, "perpendicular_gripper": 2, "perpendicular_gripper_update": 3, "mortar_extruder_2": 4}, selected="perpendicular_gripper_update")
detach = Button()
filter = StreamFilter(
    Gate=list_3,
    Stream0=tools_2.tool_9,
    Stream1=tools_2.tool_10,
    Stream2=tools_2.tool_2,
    Stream3=tools_2.tool_6,
    Stream4=tools_2.tool_4)
attach_tool = IronPython2Script(tool=filter, robot=robot, group=set.main_group_name, attach=attach, detach=detach)  # -> out, update; inputs attach: Boolean, detach: Boolean
# ---------- attach_tool: IronPython ----------
if robot and robot.client and robot.client.is_connected and tool:

    if attach:
        robot.attach_tool(tool, group)
    if detach:
        robot.detach_tool()
# ---------- end attach_tool ----------

# ----
# forward kinematics
number_slider = Slider(0, range=-90..150)
# Configuration
number_slider_2 = Slider(3.611, range=0..4.2)
reset_button = Button()
configuration = IronPython2Script(
    reset=reset_button,
    robot=load_model_local.robot,
    a_cart=number_slider_2,
    a_a1=Slider(-90, range=-180..180),
    a_a2=number_slider,
    a_a3=Slider(30, range=-180..180),
    a_a4=Slider(0, range=-400..400),
    a_a5=Slider(0, range=-125..120),
    a_a6=Slider(0, range=-400..400))  # -> out, fk_configuration
# ---------- configuration: IronPython ----------
import math
import Grasshopper

import Rhino
import scriptcontext as sc

from compas_robots.model import Joint
from compas_robots import Configuration

#reset = True
if reset:
    cart = 2.0
    joint_values = [-90,0,30,0,0,0]
    configuration_values = [cart] + joint_values

    j = 0
    for i in range(ghenv.Component.Params.Input.Count):
        nslider = ghenv.Component.Params.Input[i].Sources[0]
        if nslider.GetType() == Grasshopper.Kernel.Special.GH_NumberSlider:
            nslider.TrySetSliderValue(configuration_values[j])
            j += 1


if robot:
    joint_positions = [a_cart, a_a1, a_a2, a_a3, a_a4, a_a5, a_a6]
    print ("joint positions: ", joint_positions)
    joint_types = robot.model.get_joint_types()
    print("joint types: ", joint_types)
    joint_names = robot.model.get_configurable_joint_names()
    print("joint names: ", joint_names)

    for i, joint_type in enumerate(joint_types):
        if joint_type == Joint.REVOLUTE:
            joint_positions[i] = math.radians(joint_positions[i])
        if joint_type == Joint.PRISMATIC:
            joint_positions[i] = joint_positions[i]
    
    fk_configuration = Configuration(joint_positions, joint_types, joint_names)
    print ("configuration: ", fk_configuration)
# ---------- end configuration ----------

# ----
# inverse kinematics
x_axis = Curve(<curve referenced from the Rhino model>)
x_axis_2 = Curve(<curve referenced from the Rhino model>)
y_axis = Curve(<curve referenced from the Rhino model>)
y_axis_2 = Curve(<curve referenced from the Rhino model>)
plane = Python3Script(plane_axes=[x_axis_2, y_axis])  # -> out, plane; inputs plane_axes: list of Curve
# ---------- plane: Python ----------
import Rhino.Geometry as rg

x_axis, y_axis = plane_axes

x_axis = rg.Line(x_axis.PointAtStart, x_axis.PointAtEnd)
y_axis = rg.Line(y_axis.PointAtStart, y_axis.PointAtEnd)

if x_axis.From.DistanceTo(y_axis.From) < 0.01:
    origin = x_axis.From
    xvec = x_axis.Direction
    yvec = y_axis.Direction
elif x_axis.To.DistanceTo(y_axis.To) < 0.01:
    origin = x_axis.To
    xvec = -x_axis.Direction
    yvec = -y_axis.Direction
elif x_axis.From.DistanceTo(y_axis.To) < 0.01:
    origin = x_axis.From
    xvec = x_axis.Direction
    yvec = -y_axis.Direction
elif x_axis.To.DistanceTo(y_axis.From) < 0.01:
    origin = x_axis.To
    xvec = -x_axis.Direction
    yvec = y_axis.Direction

plane = rg.Plane(origin, xvec, yvec)
# ---------- end plane ----------
plane_2 = Python3Script(plane_axes=[x_axis, y_axis_2])  # -> out, plane; inputs plane_axes: list of Curve; same code as plane
set_start_config_from_fk = Button()
list_4 = ValueList({"manipulator", "manipulator with axis": "manipulator_axis"}, selected="manipulator with axis")
list_5 = ValueList({"from plane": 0, "from assembly": 1, "from pick up": 2}, selected="from plane")
filter_2 = StreamFilter(Gate=list_5, Stream0=plane.plane, Stream2=plane_2.plane)
compute_ik = Button()
inverse_kinematcs = IronPython2Script(
    compute=compute_ik,
    robot=robot,
    target_plane=filter_2,
    start_configuration=configuration.fk_configuration,
    start_config_from_fk=set_start_config_from_fk,
    group=list_4)  # -> out, ik_configuration; inputs target_plane: Plane, group: String
# ---------- inverse_kinematcs: IronPython ----------
from scriptcontext import sticky as st

from compas_rhino.conversions import plane_to_compas_frame
import compas_fab

if "ik_configuration" not in st or start_config_from_fk:
    st["ik_configuration"] = start_configuration

#print(group)
if robot and robot.client and robot.client.is_connected and target_plane and compute:
    
    target_frame = plane_to_compas_frame(target_plane)
    ik_configuration = robot.inverse_kinematics(target_frame, st["ik_configuration"], group)
    
    st["ik_configuration"] = ik_configuration

ik_configuration = st["ik_configuration"]
#print(ik_configuration)
# ---------- end inverse_kinematcs ----------
draw = Python3Script(planes=filter_2, scale=Slider(0.2, range=0..1))  # -> out, P, V, C, W; inputs planes: list of Plane
# ---------- draw: Python ----------
from System.Drawing import Color


print(planes)

red = Color.FromArgb(255, 0, 0)
green = Color.FromArgb(0, 255, 0)
blue = Color.FromArgb(0, 0, 255)

P = []
V = []
C = []

scale = float(scale)

for plane in planes:
    if not plane:
        continue
    P += [plane.Origin] * 3
    V.append(plane.XAxis * scale)
    V.append(plane.YAxis * scale)
    V.append(plane.ZAxis * scale)
    C += [red, green, blue]

W = 3
# ---------- end draw ----------
vdisex = VectorDisplayEx(Point=draw.P, Vector=draw.V, Colour=draw.C, Width=draw.W)

# ----
# Robot Instructions
robot_2 = Data(robot)

set_tool = Button()

# ----
# forward kinematics
number_slider_3 = Slider(34.9, range=-180..180)

# ----
# Motion
# Hello robot!
print = Button()
print_2 = IronPython2Script(robot=robot_2, send_text=print)  # -> out, a; inputs send_text: Boolean
# ---------- print_2: IronPython ----------
from abb_fabrication_control.commands import print_text

if send_text and robot.abb_client:
    print_text(robot, 'Hello Robot!!!')
# ---------- end print_2 ----------

# ----
# Digital Output
extruder_start = Button()
open_gripper = Button()
close_gripper = Button()
# Position Feedback
extruder_stop = Button()
set_do = Button()
list_6 = ValueList({"grippper": 'Ausgang_100_0'}, selected="grippper")
list_7 = ValueList({"0", "1"}, selected="1")
set_digital_output = IronPython2Script(
    robot=robot_2,
    digital_out_name=list_6,
    digital_out_state=list_7,
    send_set_digital_out=set_do,
    send_gripper_open=open_gripper,
    send_gripper_close=close_gripper,
    send_extruder_start=extruder_start,
    send_extruder_stop=extruder_stop)  # -> out; inputs digital_out_name: String
# ---------- set_digital_output: IronPython ----------
from abb_fabrication_control.commands import set_digital_out, open_gripper, close_gripper

if send_set_digital_out and robot.abb_client:
    set_digital_out(robot, digital_out_name, output_state=digital_out_state, send_and_wait=False)

if send_gripper_open and robot.abb_client:
    open_gripper(robot)

if send_gripper_close and robot.abb_client:
    close_gripper(robot)

if send_extruder_start and robot.abb_client:
    pass #TODO

if send_extruder_stop and robot.abb_client:
    pass #TODO
# ---------- end set_digital_output ----------

get_robtarget = Button()
get_frame = Button()
get_joints = Button()
feedback = IronPython2Script(robot=robot_2, send_get_frame=get_frame, send_get_robtarget=get_robtarget, send_get_joints=get_joints)  # -> out, current_plane, current_axis_value, current_configuration
# ---------- feedback: IronPython ----------
from scriptcontext import sticky as st
from abb_fabrication_control.commands import set_tool, move_to_frame, move_to_robtarget, get_frame, get_robtarget, get_joints
from compas_rhino.conversions import frame_to_rhino


if "current_frame_key" not in st:
    st["current_frame_key"] = None

if "current_robtarget_key" not in st:
    st["current_robtarget_key"] = None

if "current_configuration_key" not in st:
    st["current_configuration_key"] = None


# get values from ABB robot controller
if send_get_frame:
    current_frame = get_frame(robot, scalefactor=0.001)
    st["current_frame_key"] = current_frame

if send_get_robtarget:
    current_robtarget = get_robtarget(robot, scalefactor=0.001)
    st["current_robtarget_key"] = current_robtarget


if send_get_joints:
    current_configuration = get_joints(robot, scalefactor=0.001)
    st["current_configuration_key"] = current_configuration



# sticky
current_frame = st["current_frame_key"]
if current_frame:
    current_plane = frame_to_rhino(current_frame)
else:
    current_plane = []


current_robtarget = st["current_robtarget_key"]
if current_robtarget:
    current_frame, current_axis_value = current_robtarget
    current_plane = frame_to_rhino(current_frame)
else: 
    current_plane, current_axis_value = [], 0

current_configuration = st["current_configuration_key"]
if st["current_configuration_key"]:
    current_configuration = st["current_configuration_key"]
else:
    if robot:
        current_configuration = robot.model.zero_configuration()
    else:
        current_configuration = None
# ---------- end feedback ----------
draw_2 = Python3Script(planes=feedback.current_plane, scale=Slider(0.2, range=0..1))  # -> out, P, V, C, W; inputs planes: list of Plane; same code as draw
vdisex_2 = VectorDisplayEx(Point=draw_2.P, Vector=draw_2.V, Colour=draw_2.C, Width=draw_2.W)

pick_configuration_01 = Data("Grasshopper.Kernel.Types.GH_ObjectWrapper")

# ----
# Visualisation
show_end_effector_frame = BooleanToggle(True)
show_base_frame = BooleanToggle(True)
show_collision = BooleanToggle(False)
show_frames = BooleanToggle(True)
show_visual = BooleanToggle(True)
show_acm = BooleanToggle(False)
show_cm = BooleanToggle(False)
list_8 = ValueList({"0 forward_kinematics": 0, "1 inverse_kinematics": 1, "2 from_robot": 2, "3 from_saved_configs": 3}, selected="1 inverse_kinematics")
filter_3 = StreamFilter(
    Gate=list_8,
    Stream0=configuration.fk_configuration,
    Stream1=inverse_kinematcs.ik_configuration,
    Stream2=feedback.current_configuration,
    Stream3=pick_configuration_01)
visualise = IronPython2Script(
    robot=robot,
    group=set.main_group_name,
    configuration=filter_3,
    update_vis=attach_tool.update,
    show_visual=show_visual,
    show_collision=show_collision,
    show_frames=show_frames,
    show_base_frame=show_base_frame,
    show_end_effector_frame=show_end_effector_frame,
    show_cm=show_cm,
    show_acm=show_acm)  # -> out, visual, collision, attached_meshes, joint_planes, base_plane, ee_plane; inputs show_visual: Boolean, show_collision: Boolean, show_frames: Boolean, show_base_frame: Boolean, show_end_effector_frame: Boolean, show_cm: Boolean, show_acm: Boolean
# ---------- visualise: IronPython ----------
"""
Visualizes the robot.

COMPAS FAB v1.0.2
"""

import time

from compas.geometry import Frame
from compas.geometry import Transformation
from compas.scene import SceneObject

from compas_rhino.conversions import frame_to_rhino_plane
from scriptcontext import sticky as st

from compas_fab.backends import BackendFeatureNotSupportedError
from compas_fab.robots import PlanningScene


joint_planes, base_plane, ee_plane = [], [], []


if robot:
    configuration = configuration or robot.zero_configuration()
    robot.update(configuration, visual=show_visual, collision=show_collision)
    joint_frames = robot.transformed_frames(configuration, group)

    if show_frames:
        joint_planes = [frame_to_rhino_plane(a) for a in joint_frames]
    
    if show_base_frame:
        base_frame = joint_frames[0]
        base_plane = frame_to_rhino_plane(base_frame)
    
    if show_end_effector_frame:
        options = dict(solver="model")
        if robot.attached_tool:
            options["link"] = robot.attached_tool.connected_to
        ee_frame = robot.forward_kinematics(configuration, group, options=options)
        ee_plane = frame_to_rhino_plane(ee_frame)

    if show_visual:
        visual = robot.scene_object.draw_visual()
        #print(visual)

    if show_collision:
        collision = robot.scene_object.draw_collision()





"""

    cached_scene_key = "cached_scene"

    if show_cm or show_acm:
        cached_scene = st.get(cached_scene_key)
        if not cached_scene:
            cached_scene = {"time": 0}

        # expire cache if the component has not been executed in the last 2 seconds
        # this allows to slide through a list of configurations
        # without triggering refreshes of the scene in the middle of it
        if time.time() - cached_scene["time"] > 2:
            update_scene = True
        else:
            update_scene = False

        if update_scene:
            scene = PlanningScene(robot)
            try:
                scene = robot.client.get_planning_scene()
            except BackendFeatureNotSupportedError:
                print(
                    "The selected backend does not support collision meshes. If you need collision mesh support, use a different backend."
                )
                scene = None
                show_cm = False
                show_acm = False

        if update_scene and show_cm:
            collision_meshes = []

            for co in scene.world.collision_objects:
                header = co.header
                frame_id = header.frame_id
                cms = co.to_collision_meshes()

                for cm in cms:
                    if cm.frame != Frame.worldXY():
                        t = Transformation.from_frame(cm.frame)
                        mesh = cm.mesh.transformed(t)
                    else:
                        mesh = cm.mesh

                    collision_meshes.extend(SceneObject(mesh).draw())

                cached_scene["cm"] = collision_meshes

        collision_meshes = cached_scene.get("cm", [])

        if update_scene and show_acm:
            attached_meshes = []

            for aco in scene.robot_state.attached_collision_objects:
                for acm in aco.to_attached_collision_meshes():
                    frame_id = aco.object["header"]["frame_id"]
                    frame = robot.forward_kinematics(configuration, options=dict(link=frame_id))
                    t = Transformation.from_frame(frame)

                    # Local CM frame
                    if acm.collision_mesh.frame and acm.collision_mesh.frame != Frame.worldXY():
                        t = t * Transformation.from_frame(acm.collision_mesh.frame)

                    mesh = acm.collision_mesh.mesh.transformed(t)

                    attached_meshes.extend(SceneObject(mesh).draw())

            cached_scene["acm"] = attached_meshes

        attached_meshes = cached_scene.get("acm", [])

        cached_scene["time"] = time.time()
        st[cached_scene_key] = cached_scene
"""
# ---------- end visualise ----------
mesh = Mesh(visualise.visual)
mesh_2 = Mesh(visualise.collision)
pln = Plane(flatten([visualise.joint_planes, visualise.base_plane, visualise.ee_plane]))
preview = CustomPreview(Geometry=[mesh, mesh_2], Shader=ColourSwatch(SwatchColor=RGBA(207, 157, 160, 157)))
draw_3 = Python3Script(planes=pln, scale=Slider(0.2, range=0..1))  # -> out, P, V, C, W; inputs planes: list of Plane; same code as draw
vdisex_3 = VectorDisplayEx(Point=draw_3.P, Vector=draw_3.V, Colour=draw_3.C, Width=draw_3.W)

# ----
# Move Cartesian
cart = IronPython2Script(configuration=filter_3)  # -> out, linear_axis_value
# ---------- cart: IronPython ----------
if configuration:
    linear_axis_value = (configuration.joint_values[0])
else:
    linear_axis_value = 0
# ---------- end cart ----------
tcp_speed = Slider(75, range=0..250)
to_robtarget = Button()
to_frame = Button()
set_tool_2 = Button()
target_planes = Plane(filter_2)
move_linear = IronPython2Script(
    robot=robot_2,
    target_planes=target_planes,
    linear_axis_value=cart.linear_axis_value,
    speed=tcp_speed,
    send_set_tool_attached=set_tool_2,
    send_move_to_frame=to_frame,
    send_move_to_robtarget=to_robtarget,
    send_set_tool=set_tool)  # -> out; inputs target_planes: list, linear_axis_value: Double, send_set_tool_attached: Boolean
# ---------- move_linear: IronPython ----------
from abb_fabrication_control.commands import set_tool, set_tool_attached, move_to_frame, move_to_robtarget
from compas_rhino.conversions import plane_to_compas_frame
import compas_rrc as rrc
target_frames = [plane_to_compas_frame(target_plane) for target_plane in target_planes] # convert target plane (Rhino plane) into target frame (compas frame)
scalefactor = 1000 # m to mm conversion for ABB robot controller
print(scalefactor)
if robot: print(robot.abb_client)

if send_set_tool and robot.abb_client:
    success = set_tool(robot, tool_name="perpendicular_gripper_updated",send_and_wait=False)

# set tool in RobotStudio
if send_set_tool_attached and robot.abb_client:
    success = set_tool_attached(robot, send_and_wait=False)

# move linear to frame
if send_move_to_frame and robot.abb_client:

    for i, target_frame in enumerate(target_frames):
        if i < len(target_frames)-1:
            zone = rrc.Zone.Z50
        else:
            zone = rrc.Zone.FINE

        success = move_to_frame(robot, target_frame, speed=speed, zone=zone, scalefactor=scalefactor, send_and_wait=False)

# move linear to robtarget
if send_move_to_robtarget and robot.abb_client :
    
    for i, target_frame in enumerate(target_frames):
        if i < len(target_frames)-1:
            zone = rrc.Zone.Z50
        else:
            zone = rrc.Zone.FINE

        success = move_to_robtarget(robot, target_frame, linear_axis_value, speed=speed, zone=zone, scalefactor=scalefactor, send_and_wait=False)
# ---------- end move_linear ----------

target_configuration = Data(filter_3)

# ----
# Move Joints
tcp_speed_2 = Slider(75, range=0..250)
to_joints = Button()
move_joints = IronPython2Script(robot=robot_2, configurations=target_configuration, speed=tcp_speed_2, send_move_to_joints=to_joints)  # -> out; inputs configurations: list
# ---------- move_joints: IronPython ----------
from abb_fabrication_control.commands import move_to_joints
import compas_rrc as rrc
scalefactor = 1000 # m to mm conversion for ABB robot controller

# move to joints
if send_move_to_joints and robot.abb_client:
    
    for i, configuration in enumerate(configurations):
        if i < len(configurations)-1:
            zone = rrc.Zone.Z200
        else:
            zone = rrc.Zone.FINE
        #print(zone)
        success = move_to_joints(robot, configuration, speed=speed, zone=zone, scalefactor=scalefactor, send_and_wait=False)
        #print("SENDING")
# ---------- end move_joints ----------

pln_2 = Plane(feedback.current_plane)

# ----
# Load robot from local package
load_2 = Button()
list_9 = ValueList({"abb_fabtory"}, selected="abb_fabtory")

load_robot_model = Python3Script(path=py3.ROBOT_DESCRIPTION, package=list_9, urdf_name="abb_fabtory.urdf", srdf_name=panel_2, load=load_2)  # -> out, robot_model
# ---------- load_robot_model: Python ----------
import os
from scriptcontext import sticky as st

import compas
import compas_fab

from compas_robots import RobotModel
from compas_robots.resources import LocalPackageMeshLoader

from compas_fab.robots import Robot

from compas_robots.scene import BaseRobotModelObject

# from compas_robots.ghpython.scene import RobotModelObject


#from compas_fab.robots import Robot
#from compas_fab.robots import RobotSemantics
#from compas_fab.ghpython import RobotArtist

packages = ["abb_irb6700_support", "abb_end_effectors", "abb_fabtory"]
loaders = []

for package in packages:
    loaders.append(LocalPackageMeshLoader(path, package))

#path directory
package_path = os.path.join(path, package)
print(package_path)

urdf_filename = os.path.join(package_path, "urdf", urdf_name)
srdf_filename = os.path.join(package_path, srdf_name)

assert os.path.isfile(urdf_filename)
assert os.path.isfile(srdf_filename)

compas.PRECISION = '12f'

# store robot in component
guid = str(ghenv.Component.InstanceGuid)
robot_key = "robot_" + guid

if robot_key not in st:
    st[robot_key] = None

#load robot model from urdf
if load:

    # Create robot model from URDF
    model = RobotModel.from_urdf_file(urdf_filename)
    model.load_geometry(*loaders, precision=12)
    
    st[robot_key] = model

robot_model = st[robot_key]
# ---------- end load_robot_model ----------

robot_model = Data(load_robot_model.robot_model)

info = Python3Script(robot_model=robot_model)  # -> out, a
# ---------- info: Python ----------
if robot_model:
    print(robot_model)
# ---------- end info ----------

# ----
# Info
panel_4 = Panel(info.out)

# ----
# Configuration
forward_kinematics = Python3Script(
    model=robot_model,
    a_cart=Slider(1.828, range=0..4.2),
    a_a1=number_slider_3,
    a_a2=Slider(-46.3, range=-90..150),
    a_a3=Slider(46.9, range=-180..180),
    a_a4=Slider(-94.2, range=-400..400),
    a_a5=Slider(36, range=-125..120),
    a_a6=Slider(-400, range=-400..400))  # -> configuration
# ---------- forward_kinematics: Python ----------
import math

from compas_robots.model import Joint
from compas_robots import Configuration


if model:
    joint_positions = [a_cart, a_a1, a_a2, a_a3, a_a4, a_a5, a_a6]
    print (joint_positions)
    joint_types = model.get_joint_types()
    print(joint_types)
    joint_names = model.get_configurable_joint_names()
    print(joint_names)

    for i, joint_type in enumerate(joint_types):
        if joint_type == Joint.REVOLUTE:
            joint_positions[i] = math.radians(joint_positions[i])
        if joint_type == Joint.PRISMATIC:
            joint_positions[i] = joint_positions[i]
    
    configuration = Configuration(joint_positions, joint_types, joint_names)
    print (configuration)
# ---------- end forward_kinematics ----------

# ----
# Visualisation
show_frames_2 = BooleanToggle(True)
show_visual_2 = BooleanToggle(True)
show_collision_2 = BooleanToggle(True)
show_base_frame_2 = BooleanToggle(True)
show_end_effector_frame_2 = BooleanToggle(True)
show_acm_2 = BooleanToggle(True)
visualise_2 = Python3Script(
    model=robot_model,
    configuration=forward_kinematics,
    show_frames=show_frames_2,
    show_visual_meshes=show_visual_2,
    show_collision_meshes=show_collision_2,
    show_base_frame=show_base_frame_2,
    show_end_effector_frame=show_end_effector_frame_2,
    show_attached_collision_meshes=show_acm_2)  # -> out, joint_planes, visual_meshes, collision_meshes, base_plane, end_effector_plane, attched_collision_meshes
# ---------- visualise_2: Python ----------
from compas.geometry import Frame
from compas.geometry import Transformation
from compas_rhino.conversions import frame_to_rhino

if show_frames == True: 
    #print(configuration)
    joint_frames = model.transformed_frames(configuration)
    joint_planes = [frame_to_rhino(a) for a in joint_frames]

if show_base_frame == True:
    show_base_frame = model.forward_kinematics(configuration, model.get_base_link_name())
    #print(show_base_frame)
    base_plane = frame_to_rhino(show_base_frame) 

if show_end_effector_frame == True:
    end_effector_frame = model.forward_kinematics(configuration, model.get_end_effector_link_name())
    #print(end_effector_frame)
    end_effector_plane = frame_to_rhino(end_effector_frame) 

if show_visual_meshes == True:
    pass

if show_collision_meshes == True:
    pass

if show_attached_collision_meshes == True:
    pass
# ---------- end visualise_2 ----------
pln_3 = Plane(visualise_2.joint_planes)
pln_4 = Plane(visualise_2.end_effector_plane)
pln_5 = Plane(visualise_2.base_plane)

# ----
# Visualisation
show_end_effector_frame_3 = BooleanToggle(True)
show_base_frame_3 = BooleanToggle(False)
show_collision_3 = BooleanToggle(False)
show_frames_3 = BooleanToggle(False)
show_visual_3 = BooleanToggle(True)
show_acm_3 = BooleanToggle(False)
robot_visualize = RobotVisualize(
    model=robot_model,
    configuration=forward_kinematics,
    redraw=attach_remove.bang,
    show_visual=show_visual_3,
    show_collision=show_collision_3,
    show_frames=show_frames_3,
    show_base_frame=show_base_frame_3,
    show_end_effector_frame=show_end_effector_frame_3,
    show_acm=show_acm_3)  # -> visual, collision, attached_meshes, frames, base_frame, ee_frame; inputs redraw: list, show_visual: Boolean, show_collision: Boolean, show_frames: Boolean, show_base_frame: Boolean, show_end_effector_frame: Boolean, show_acm: Boolean; disabled
#   port configuration: The robot's full configuration.
#   port redraw: A list of attached collision meshes.
#   port show_visual: Whether or not to show the robot's visual meshes.
#   port show_collision: Whether or not to show the robot's collision meshes.
#   port show_frames: Whether or not to show the robot's joint frames.
#   port show_base_frame: Whether or not to show the robot's base frame.
#   port show_end_effector_frame: Whether or not to show the robot's end-effector frame.
#   port show_acm: Whether or not to show the attached collision meshes (if any).
#   port visual: The robot's visual Rhino meshes (if any).
#   port collision: The robot's collision Rhino meshes (if any).
#   port attached_meshes: The attached collision Rhino meshes (if any).
#   port frames: The robot's joint frames as Rhino planes (if any).
#   port base_frame: The robot's base frame as a Rhino plane (if any).
#   port ee_frame: The robot's end-effector frame as a Rhino plane (if any).
# ---------- robot_visualize: Python ----------
"""
Visualizes the robot.

COMPAS FAB v0.19.1
"""
from compas.geometry import Frame
from compas.geometry import Transformation
from compas_ghpython.artists import Artist
from ghpythonlib.componentbase import executingcomponent as component


class RobotVisualize(component):
    def RunScript(self, robot, group, configuration, attached_collision_meshes, show_visual, show_collision,
                  show_frames, show_base_frame, show_end_effector_frame, show_acm):

        visual = None
        collision = None
        attached_meshes = None
        frames = None
        base_frame = None
        ee_frame = None

        if robot:
            show_visual = True if show_visual is None else show_visual
            configuration = configuration or robot.zero_configuration()

            robot.update(configuration, visual=show_visual, collision=show_collision)
            compas_frames = robot.transformed_frames(configuration, group)

            if show_visual:               
                visual = robot.artist.draw_visual()
                

            if show_collision:
                collision = robot.artist.draw_collision()

            if show_base_frame:
                base_compas_frame = compas_frames[0]
                base_frame = Artist(base_compas_frame).draw()

            if show_end_effector_frame:
                ee_compas_frame = robot.forward_kinematics(configuration, group, options=dict(solver='model'))
                ee_frame = Artist(ee_compas_frame).draw()

            if show_frames:
                frames = []
                for compas_frame in compas_frames[1:]:
                    frame = Artist(compas_frame).draw()
                    frames.append(frame)

            if show_acm:
                attached_meshes = []
                for acm in attached_collision_meshes:
                    frame = robot.forward_kinematics(configuration, options=dict(solver='model', link_name=acm.link_name))
                    T = Transformation.from_frame_to_frame(Frame.worldXY(), frame)
                    mesh = acm.collision_mesh.mesh.transformed(T)
                    attached_meshes.append(Artist(mesh).draw())

        return (visual, collision, attached_meshes, frames, base_frame, ee_frame)
# ---------- end robot_visualize ----------
draw_4 = GhPythonScript(frames=[robot_visualize.frames, robot_visualize.base_frame, robot_visualize.ee_frame], scale=Slider(0.2, range=0..1))  # -> P, V, C, W; inputs frames: list
# ---------- draw_4: Python ----------
from System.Drawing import Color
from compas_ghpython.artists import FrameArtist

red = Color.FromArgb(255, 0, 0)
green = Color.FromArgb(0, 255, 0)
blue = Color.FromArgb(0, 0, 255)

P = []
V = []
C = []

scale = float(scale)

for plane in frames:
    if not plane:
        continue
    P += [plane.Origin] * 3
    V.append(plane.XAxis * scale)
    V.append(plane.YAxis * scale)
    V.append(plane.ZAxis * scale)
    C += [red, green, blue]

W = 3
# ---------- end draw_4 ----------
geo = Geometry([robot_visualize.visual, robot_visualize.collision, robot_visualize.attached_meshes])
preview_2 = CustomPreview(Geometry=geo, Shader=ColourSwatch(SwatchColor=RGB(207, 157, 160)))
vdisex_4 = VectorDisplayEx(Point=draw_4.P, Vector=draw_4.V, Colour=draw_4.C, Width=draw_4.W)

# ==== cluster Tools

# ---- group: measurement tool
geo = Geometry(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)
mesh = Mesh(geo)
mjoin = MeshJoin(Meshes=mesh)
xaxis_line = Curve(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)
yaxis_line = Curve(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)
tool = PythonScript(rhmesh=mjoin, xline=xaxis_line, yline=yaxis_line)  # -> tool; inputs rhmesh: Mesh
# ---------- tool: Python ----------
import Rhino.Geometry as rg
import os, math
from compas.geometry import Frame, Rotation
from compas.datastructures import Mesh
from compas_ghpython.artists import MeshArtist
from compas_fab.robots import Tool
from compas_rhino.geometry import RhinoMesh

xaxis = rg.Line(xline.PointAtStart, xline.PointAtEnd)
yaxis = rg.Line(yline.PointAtStart, yline.PointAtEnd)

if xaxis.From.DistanceTo(yaxis.From) < 0.01:
    origin = xaxis.From
    xaxis = xaxis.Direction
    yaxis = yaxis.Direction
elif xaxis.To.DistanceTo(yaxis.To) < 0.01:
    origin = xaxis.To
    xaxis = -xaxis.Direction
    yaxis = -yaxis.Direction
elif xaxis.From.DistanceTo(yaxis.To) < 0.01:
    origin = xaxis.From
    xaxis = xaxis.Direction
    yaxis = -yaxis.Direction
elif xaxis.To.DistanceTo(yaxis.From) < 0.01:
    origin = xaxis.To
    xaxis = -xaxis.Direction
    yaxis = yaxis.Direction

xaxis.Unitize()
yaxis.Unitize()

ee_frame = Frame(origin, xaxis, yaxis)
ee_mesh = RhinoMesh.from_geometry(rhmesh).to_compas()

tool = Tool(ee_mesh, ee_frame)
# ---------- end tool ----------

# ---- group: concrete extruder tool
geo_2 = Geometry(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)
mesh_2 = Mesh(geo_2)
mjoin_2 = MeshJoin(Meshes=mesh_2)
yaxis_line_2 = Curve(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)
xaxis_line_2 = Curve(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)

# ----
tool_2 = PythonScript(rhmesh=mjoin_2, xline=xaxis_line_2, yline=yaxis_line_2)  # -> tool; inputs rhmesh: Mesh; same code as tool
G = ClusterInput()
filter = StreamFilter(Gate=G, Stream0=tool, Stream1=tool_2)
s_0 = ClusterOutput(filter)

# ==== cluster Tools_2

# ----
# perpendicular gripper with mortar extruder
panel = Panel("perpendicular_gripper")
mesh = Mesh([<mesh referenced from the Rhino model> x24])
mesh_2 = Mesh([<mesh referenced from the Rhino model> x24])
xaxis_line = Curve(<curve referenced from the Rhino model>)
yaxis_line = Curve(<curve referenced from the Rhino model>)
show = BooleanToggle(True)
mjoin = MeshJoin(Meshes=mesh)
mjoin_2 = MeshJoin(Meshes=mesh_2)
tool = IronPython2Script(name=panel, visual_mesh=mjoin, collision_mesh=mjoin_2, xline=xaxis_line, yline=yaxis_line, show=show)  # -> out, tool, tool_plane, tool_geometry, tool_frame_rs; inputs name: String, visual_mesh: Mesh, xline: Curve, yline: Curve
# ---------- tool: IronPython ----------
from __future__ import print_function

import Rhino.Geometry as rg
import os, math
from compas.geometry import Frame, Rotation
from compas.datastructures import Mesh
from compas_fab.robots import Tool


from compas_rhino.conversions import plane_to_compas_frame, mesh_to_compas, mesh_to_rhino

xaxis = rg.Line(xline.PointAtStart, xline.PointAtEnd)
yaxis = rg.Line(yline.PointAtStart, yline.PointAtEnd)

if xaxis.From.DistanceTo(yaxis.From) < 0.01:
    origin = xaxis.From
    xaxis = xaxis.Direction
    yaxis = yaxis.Direction
elif xaxis.To.DistanceTo(yaxis.To) < 0.01:
    origin = xaxis.To
    xaxis = -xaxis.Direction
    yaxis = -yaxis.Direction
elif xaxis.From.DistanceTo(yaxis.To) < 0.01:
    origin = xaxis.From
    xaxis = xaxis.Direction
    yaxis = -yaxis.Direction
elif xaxis.To.DistanceTo(yaxis.From) < 0.01:
    origin = xaxis.To
    xaxis = -xaxis.Direction
    yaxis = yaxis.Direction

xaxis.Unitize()
yaxis.Unitize()

plane = rg.Plane(origin, xaxis, yaxis)

frame = plane_to_compas_frame(plane) # convert to copmas frame
c_visual_mesh = mesh_to_compas(visual_mesh) # convert to compas mesh

# create Tool
# tool = Tool(c_visual_mesh, frame, name=name, connected_to="tool0")
tool = Tool(c_visual_mesh, frame, name=name)

# create values for Robot Studio tool (in mm and quaternion format)
tool_frame_rs = [[entry*1000 for entry in list(frame.point)], list(frame.quaternion)]

# round values
tool_frame_rs = str([[round(v, 5) for v in tool_frame_rs[0]], [round(v, 5) for v in tool_frame_rs[1]]])


if show:
    #print(("The tool {} will be connected to {}").format(tool.name, tool.connected_to))
    tool_plane = plane
    tool_geometry = mesh_to_rhino(c_visual_mesh)
else: 
    tool_plane = []
    tool_geometry = []
# ---------- end tool ----------
values_for_abb_robot_studio = Panel(tool.tool_frame_rs)
mesh_3 = Mesh(tool.tool_geometry)
tool_2 = ClusterOutput(tool.tool)
preview = CustomPreview(Geometry=mesh_3, Shader=ColourSwatch(SwatchColor=RGBA(207, 157, 160, 157)))
draw = Python3Script(planes=tool.tool_plane, scale=Slider(0.2, range=0..1))  # -> out, P, V, C, W; inputs planes: list of Plane
# ---------- draw: Python ----------
from System.Drawing import Color

red = Color.FromArgb(255, 0, 0)
green = Color.FromArgb(0, 255, 0)
blue = Color.FromArgb(0, 0, 255)

P = []
V = []
C = []

scale = float(scale)

for plane in planes:
    if not plane:
        continue
    P += [plane.Origin] * 3
    V.append(plane.XAxis * scale)
    V.append(plane.YAxis * scale)
    V.append(plane.ZAxis * scale)
    C += [red, green, blue]

W = 3
# ---------- end draw ----------
vdisex = VectorDisplayEx(Point=draw.P, Vector=draw.V, Colour=draw.C, Width=draw.W)

# ----
# perpendicular gripper with mortar extruder
panel_2 = Panel("mortar_extruder_2")
xaxis_line_2 = Curve(<curve referenced from the Rhino model>)
yaxis_line_2 = Curve(<curve referenced from the Rhino model>)
mesh_4 = Mesh([<mesh referenced from the Rhino model> x24])
mesh_5 = Mesh([<mesh referenced from the Rhino model> x24])
show_2 = BooleanToggle(False)
mjoin_3 = MeshJoin(Meshes=mesh_4)
mjoin_4 = MeshJoin(Meshes=mesh_5)
tool_3 = IronPython2Script(name=panel_2, visual_mesh=mjoin_3, collision_mesh=mjoin_4, xline=xaxis_line_2, yline=yaxis_line_2, show=show_2)  # -> out, tool, tool_plane, tool_geometry, tool_frame_rs; inputs name: String, visual_mesh: Mesh, xline: Curve, yline: Curve; same code as tool
values_for_abb_robot_studio_2 = Panel(tool_3.tool_frame_rs)
tool_4 = ClusterOutput(tool_3.tool)
mesh_6 = Mesh(tool_3.tool_geometry)
preview_2 = CustomPreview(Geometry=mesh_6, Shader=ColourSwatch(SwatchColor=RGBA(207, 157, 160, 157)))
draw_2 = Python3Script(planes=tool_3.tool_plane, scale=Slider(0.2, range=0..1))  # -> out, P, V, C, W; inputs planes: list of Plane; same code as draw
vdisex_2 = VectorDisplayEx(Point=draw_2.P, Vector=draw_2.V, Colour=draw_2.C, Width=draw_2.W)

# ----
# perpendicular gripper updated
panel_3 = Panel("perpendicular_gripper_updated")
mesh_7 = Mesh([<mesh referenced from the Rhino model> x25])
mesh_8 = Mesh([<mesh referenced from the Rhino model> x25])
show_3 = BooleanToggle(True)
mjoin_5 = MeshJoin(Meshes=mesh_7)
mjoin_6 = MeshJoin(Meshes=mesh_8)
xaxis_line_3 = Curve(<curve referenced from the Rhino model>)
yaxis_line_3 = Curve(<curve referenced from the Rhino model>)
tool_5 = IronPython2Script(name=panel_3, visual_mesh=mjoin_5, collision_mesh=mjoin_6, xline=xaxis_line_3, yline=yaxis_line_3, show=show_3)  # -> out, tool, tool_plane, tool_geometry, tool_frame_rs; inputs name: String, visual_mesh: Mesh, xline: Curve, yline: Curve; same code as tool
values_for_abb_robot_studio_3 = Panel(tool_5.tool_frame_rs)
mesh_9 = Mesh(tool_5.tool_geometry)
tool_6 = ClusterOutput(tool_5.tool)
preview_3 = CustomPreview(Geometry=mesh_9, Shader=ColourSwatch(SwatchColor=RGBA(207, 157, 160, 157)))
draw_3 = Python3Script(planes=tool_5.tool_plane, scale=Slider(0.2, range=0..1))  # -> out, P, V, C, W; inputs planes: list of Plane; same code as draw
vdisex_3 = VectorDisplayEx(Point=draw_3.P, Vector=draw_3.V, Colour=draw_3.C, Width=draw_3.W)

geo = Geometry(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)
yaxis_line_4 = Curve(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)
xaxis_line_4 = Curve(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)
mesh_10 = Mesh(geo)
mjoin_7 = MeshJoin(Meshes=mesh_10)
mesh_11 = Mesh(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)
mesh_12 = Mesh(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)

# ----
# Tools
# measurement tool
# other tools ...
panel_4 = Panel("mortar_extruder")
show_4 = BooleanToggle(False)
tool_7 = IronPython2Script(name=panel_4, visual_mesh=mjoin_7, xline=xaxis_line_4, yline=yaxis_line_4, show=show_4)  # -> out, tool, tool_plane, tool_geometry, tool_frame_rs; inputs name: String, visual_mesh: Mesh, xline: Curve, yline: Curve; same code as tool
values_for_abb_robot_studio_4 = Panel(tool_7.tool_frame_rs)
mesh_13 = Mesh(tool_7.tool_geometry)
preview_4 = CustomPreview(Geometry=mesh_13, Shader=ColourSwatch(SwatchColor=RGBA(207, 157, 160, 157)))
draw_4 = Python3Script(planes=tool_7.tool_plane, scale=Slider(0.2, range=0..1))  # -> out, P, V, C, W; inputs planes: list of Plane; same code as draw
vdisex_4 = VectorDisplayEx(Point=draw_4.P, Vector=draw_4.V, Colour=draw_4.C, Width=draw_4.W)

# ----
# mortar extruder
panel_5 = Panel("mortar_extruder")
show_5 = BooleanToggle(False)
xaxis_line_5 = Curve(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)
yaxis_line_5 = Curve(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)
tool_8 = IronPython2Script(name=panel_5, visual_mesh=mesh_11, collision_mesh=mesh_12, xline=xaxis_line_5, yline=yaxis_line_5, show=show_5)  # -> out, tool, tool_plane, tool_geometry, tool_frame_rs; inputs name: String, visual_mesh: Mesh, collision_mesh: Mesh, xline: Curve, yline: Curve
# ---------- tool_8: IronPython ----------
from __future__ import print_function

import Rhino.Geometry as rg
import os, math
from compas.geometry import Frame, Rotation
from compas.datastructures import Mesh
from compas_fab.robots import Tool


from compas_rhino.conversions import plane_to_compas_frame, mesh_to_compas, mesh_to_rhino

xaxis = rg.Line(xline.PointAtStart, xline.PointAtEnd)
yaxis = rg.Line(yline.PointAtStart, yline.PointAtEnd)

if xaxis.From.DistanceTo(yaxis.From) < 0.01:
    origin = xaxis.From
    xaxis = xaxis.Direction
    yaxis = yaxis.Direction
elif xaxis.To.DistanceTo(yaxis.To) < 0.01:
    origin = xaxis.To
    xaxis = -xaxis.Direction
    yaxis = -yaxis.Direction
elif xaxis.From.DistanceTo(yaxis.To) < 0.01:
    origin = xaxis.From
    xaxis = xaxis.Direction
    yaxis = -yaxis.Direction
elif xaxis.To.DistanceTo(yaxis.From) < 0.01:
    origin = xaxis.To
    xaxis = -xaxis.Direction
    yaxis = yaxis.Direction

xaxis.Unitize()
yaxis.Unitize()

plane = rg.Plane(origin, xaxis, yaxis)

frame = plane_to_compas_frame(plane) # convert to copmas frame
c_visual_mesh = mesh_to_compas(visual_mesh) # convert to compas mesh
c_collision_mesh = mesh_to_compas(collision_mesh) # convert to compas mesh

# create Tool
# tool = Tool(c_visual_mesh, frame, name=name, connected_to="tool0")
tool = Tool(c_visual_mesh, frame, collision=c_collision_mesh, name=name)



# create values for Robot Studio tool (in mm and quaternion format)
tool_frame_rs = [[entry*1000 for entry in list(frame.point)], list(frame.quaternion)]

# round values
tool_frame_rs = str([[round(v, 5) for v in tool_frame_rs[0]], [round(v, 5) for v in tool_frame_rs[1]]])


if show:
    #print(("The tool {} will be connected to {}").format(tool.name, tool.connected_to))
    tool_plane = plane
    tool_geometry = mesh_to_rhino(c_visual_mesh)
else: 
    tool_plane = []
    tool_geometry = []
# ---------- end tool_8 ----------
values_for_abb_robot_studio_5 = Panel(tool_8.tool_frame_rs)
mesh_14 = Mesh(tool_8.tool_geometry)
preview_5 = CustomPreview(Geometry=mesh_14, Shader=ColourSwatch(SwatchColor=RGBA(207, 157, 160, 157)))
draw_5 = Python3Script(planes=tool_8.tool_plane, scale=Slider(0.2, range=0..1))  # -> out, P, V, C, W; inputs planes: list of Plane; same code as draw
vdisex_5 = VectorDisplayEx(Point=draw_5.P, Vector=draw_5.V, Colour=draw_5.C, Width=draw_5.W)

tool_9 = ClusterOutput(tool_8.tool)
tool_10 = ClusterOutput(tool_7.tool)
