# Grasshopper definition 03_fabtory_moveit_simulation_robot_control_rh8_autosave.ghx (Grasshopper 1.0.8)
# plug-ins: RhinoCodePluginGH

unload = Button()
path = Python3Script()  # -> HERE, DATA, ROBOT_DESCRIPTION
# ---------- path: Python ----------
import os

HERE = os.path.dirname(ghdoc.Path)
DATA = os.path.abspath(os.path.join(HERE, "..", "data"))
ROBOT_DESCRIPTION = os.path.abspath(os.path.join(DATA, "robot_description"))

print(HERE)
print(DATA)
print(ROBOT_DESCRIPTION)
# ---------- end path ----------
py3 = Python3Script(unload=unload)
# ---------- py3: Python ----------
if reload:
    from compas_ghpython import unload_modules
    unload_modules("compas")
    unload_modules("compas_fab")
    unload_modules("abb_fabrication_control")
    unload_modules("compas_rrc")
    unload_modules("extruder_control")

    unload_modules("fabrication_manager")
    unload_modules("assembly_information_model")
    unload_modules('climate_active_envelopes_design')
    unload_modules('climate_active_envelopes_fabrication')
# ---------- end py3 ----------

reload = Button()
path_2 = PythonScript()  # -> HERE, DATA, ROBOT_DESCRIPTION; same code as path
py = PythonScript(reload=reload)
# ---------- py: Python ----------
if reload:
    from compas_ghpython import unload_modules
    unload_modules("compas")
    unload_modules("compas_fab")
    unload_modules("abb_fabrication_control")
    unload_modules("compas_rrc")
    unload_modules("extruder_control")

    unload_modules("fabrication_manager")
    #unload_modules("assembly_information_model")
    unload_modules('climate_aware_robotic_envelope')
# ---------- end py ----------

# ----
# planes from curve
div_len = Slider(0.1, range=0..1)  # disabled
crv = Curve(<curve referenced from the Rhino model>)  # disabled
curve_def = GhPythonScript(crv=crv, div_len=div_len)  # -> planes; inputs crv: Curve; disabled
# ---------- curve_def: Python ----------
import rhinoscriptsyntax as rs
from compas.geometry import Frame, Line, Vector
from compas_ghpython import draw_frame

# dividing curve
pts = rs.DivideCurveLength(crv, div_len)
frames = [Frame([pt.X, pt.Y, pt.Z], [90, -1, 0], [-1, 0, 0]) for pt in pts]
print frames

# for vizualization
planes = []
for frame in frames:
    planes.append(draw_frame(frame))
# ---------- end curve_def ----------

layers_count = Slider(5, range=1..100)  # disabled
length_m = Slider(1, range=0..3)  # disabled
layer_height_m = Slider(0.01, range=0..0.4)  # disabled
wave = BooleanToggle(True)  # disabled
amplitude_factor = Slider(0.085, range=0..1)  # disabled
waves_count = Slider(1, range=0..5)  # disabled

# ----
# planes from am_model
base_point = Point(Point(1.376474623, -1.951755765, 0.6648682508))  # disabled
straight_line_cos_wave = GhPythonScript(
    length=length_m,
    layers=layers_count,
    layer_height=layer_height_m,
    base_point=base_point,
    wavy=wave,
    amplitude=amplitude_factor,
    waves=waves_count)  # -> out, points; inputs layers: Int32, base_point: Point3d, wavy: Boolean, waves: Int32; disabled
# ---------- straight_line_cos_wave: Python ----------
from compas.geometry import Point
import math
import ghpythonlib.components as gh


def straight_line(length, height, base_point):
    
    start = Point(base_point.x,base_point.y,base_point.z)
    end = Point(base_point.x+length,base_point.y,base_point.z+height)
    
    return(start, end)



def cos_wave(length, height, amplitude, waves, base_point):
    
    points= []
    waves = waves*10
    div = 50
    
    for i in range(div):
        
        x_point = length/div*i
        y_point = amplitude*math.cos(x_point*waves)
        
        points.append(Point(base_point.x+x_point,base_point.y+y_point,base_point.z+height))
        
    return(points)



points = []
base_point = Point(gh.Deconstruct(base_point)[0], gh.Deconstruct(base_point)[1], gh.Deconstruct(base_point)[2])

for i in range(layers):
    
    if wavy == True:
        
        curve = cos_wave(length, i*layer_height, amplitude, waves, base_point)
        
        if i%2 == 0:
            curve.reverse()
            
        for pt in curve:
            points.append(pt)
        
    else:
        
        curve = straight_line(length, i*layer_height, base_point)
        
        if i%2 == 0:
            curve = reversed(curve)
            
        for pt in curve:
            points.append(pt)
# ---------- end straight_line_cos_wave ----------
show = BooleanToggle(True)  # disabled
layer_def = GhPythonScript(points=straight_line_cos_wave.points, layers=layers_count)  # -> out, layer, am_model, planes; inputs points: list, layers: Int32; disabled
# ---------- layer_def: Python ----------
import ghpythonlib.components as gh
import os
import sys
import json

from compas.geometry import Frame
from compas.geometry import Line
from compas.geometry import Vector

from compas_ghpython import draw_frame

from am_information_model.model import Node
from am_information_model.model import Layer
from am_information_model.model import AMModel



def _radius_between_frames(from_frame, via_frame, to_frame, max_radius):
        in_line = Line(from_frame.point, via_frame.point)
        out_line = Line(via_frame.point, to_frame.point)
        r = min(max_radius, in_line.length/2, out_line.length/2)
        return r

# nodes
max_r = 10
frames = [Frame([pt.x, pt.y, pt.z], [90, -1, 0], [-1, 0, 0]) for pt in points]

print max_r

nodes = []
for i,frame in enumerate(frames):
    r = _radius_between_frames(frames[max(0,i-1)], frame, frames[min(i+1, len(frames)-1)], max_r)
    nodes.append(Node(frame, radius=r))



# Create the print_layer: 

def partition(lst, size):
    for i in range(0, len(lst), size):
        yield lst[i : i+size]

count = int(len(nodes)/layers)
nodes_layer = list(partition(nodes, count))


layer = []


for i in range(layers):
    
    layer_loc = Layer.from_nodes(nodes_layer[i])
    layer.append(layer_loc)



# Create AM Model: 

am_model = AMModel()

for i in range(len(layer)):
    layer_new = layer[i]
    am_model.add_layer(layer_new)
    
planes = []
for l, layer in am_model.layers():
    for k, node in layer.nodes():
        planes.append(draw_frame(node.frame))
# ---------- end layer_def ----------
draw_curve = PythonScript(layer=layer_def.layer, points=straight_line_cos_wave.points, show=show)  # -> C; inputs points: list; disabled
# ---------- draw_curve: Python ----------
from compas.geometry import Transformation, Point
from compas.geometry import Frame
from compas.datastructures import mesh_transformed
from compas_ghpython.artists import MeshArtist
from compas_ghpython import draw_frame
import ghpythonlib.components as gh



if show:
    points_gh = []
    
    for pt in points:
        
        points_gh.append(gh.ConstructPoint(pt.x, pt.y, pt.z))
    
    C = gh.PolyLine(points_gh, False)



if show:
    F = [draw_frame(node.frame) for key, node in layer.nodes()]
# ---------- end draw_curve ----------
curve = Curve(draw_curve)  # disabled
planes = Plane(layer_def.planes)  # disabled

# ----
# Robot Model
# Load robot from local package
load = Button()
list = ValueList({"abb_fabtory"}, selected="abb_fabtory")
load_robot_model = Python3Script(path=path.ROBOT_DESCRIPTION, package=list, urdf_name="abb_fabtory.urdf", srdf_name="abb_fabtory.srdf", load=load)  # -> out, robot_model
# ---------- load_robot_model: Python ----------
import os
from scriptcontext import sticky as st

import compas
import compas_fab

from compas_robots import RobotModel
from compas_robots.resources import LocalPackageMeshLoader

from compas_fab.robots import Robot

from compas_robots.scene import BaseRobotModelObject

# from compas_robots.ghpython.scene import RobotModelObject


#from compas_fab.robots import Robot
#from compas_fab.robots import RobotSemantics
#from compas_fab.ghpython import RobotArtist

packages = ["abb_irb6700_support", "abb_end_effectors", "abb_fabtory"]
loaders = []

for package in packages:
    loaders.append(LocalPackageMeshLoader(path, package))

#path directory
package_path = os.path.join(path, package)
print(package_path)

urdf_filename = os.path.join(package_path, "urdf", urdf_name)
srdf_filename = os.path.join(package_path, srdf_name)

assert os.path.isfile(urdf_filename)
assert os.path.isfile(srdf_filename)

compas.PRECISION = '12f'

# store robot in component
guid = str(ghenv.Component.InstanceGuid)
robot_key = "robot_" + guid

if robot_key not in st:
    st[robot_key] = None

#load robot model from urdf
if load:

    # Create robot model from URDF
    model = RobotModel.from_urdf_file(urdf_filename)
    model.load_geometry(*loaders, precision=12)
    
    st[robot_key] = model

robot_model = st[robot_key]
# ---------- end load_robot_model ----------

# ----
# Tool
list_2 = ValueList({"measurement_tool": 0, "concrete_extruder": 1}, selected="measurement_tool")
panel = Panel("Attach a custom tool")
tools = Tools(G=list_2)
remove = Button()
add = Button()
attach_remove = PythonScript(tool=tools, attach=add, remove=remove)  # -> out, bang; disabled
# ---------- attach_remove: Python ----------
if attach:
    robot.attach_tool(tool)
if remove:
    robot.detach_tool()
# ---------- end attach_remove ----------

connect = Button()
close = Button()

# ----
# ROS & ABB client
ros_ip = ValueList({"127.0.0.1"}, selected="127.0.0.1")
ros_port = ValueList({"9090"}, selected="9090")
clients = Python3Script(ip=ros_ip, port=ros_port, connect=connect, close=close)  # -> out, ros_client, abb_client, is_connected
# ---------- clients: Python ----------
from scriptcontext import sticky as st

import compas_rrc as rrc
from compas_fab.backends import RosClient

if 'ros_client' not in st:
    st['ros_client'] = None
    st['abb_client'] = None
    st['is_connected'] = False

if close:
    st['ros_client'].close()
    st['ros_client'] = None
    st['abb_client'] = None
    st['is_connected'] = False

if connect:
    ros_client = RosClient(ip, port)
    try:
        ros_client.run(2)
    except:
        print('Cannot connect to ROS Client')
    
    
    st['is_connected'] = ros_client.is_connected if ros_client else False

    if st['is_connected']:
        abb_client = rrc.AbbClient(ros_client, '/rob1')

        st['ros_client'] = ros_client
        st['abb_client'] = abb_client

is_connected = st['is_connected']
ros_client = st['ros_client']
abb_client = st['abb_client']

print('ROS Client: ', ros_client)
print('ABB Client: ', abb_client)
print('is connected: ', is_connected)
# ---------- end clients ----------
is_connected = Panel(clients.is_connected)
set = Python3Script(robot_model=load_robot_model.robot_model, ros_client=clients.ros_client, abb_client=clients.abb_client)  # -> out, robot_model, main_group_name; disabled
# ---------- set: Python ----------
if robot and ros_client and abb_client:
    robot.ros_client = ros_client
    robot.abb_client = abb_client

    robot.info()
    main_group_name = robot.main_group_name
    print(robot.info)
# ---------- end set ----------

# ----
# single plane
x_axis = Curve(<curve referenced from the Rhino model>)
y_axis = Curve(<curve referenced from the Rhino model>)
plane = PythonScript(plane_axes=[x_axis, y_axis])  # -> plane; inputs plane_axes: list of Curve
# ---------- plane: Python ----------
import Rhino.Geometry as rg

x_axis, y_axis = plane_axes

x_axis = rg.Line(x_axis.PointAtStart, x_axis.PointAtEnd)
y_axis = rg.Line(y_axis.PointAtStart, y_axis.PointAtEnd)

if x_axis.From.DistanceTo(y_axis.From) < 0.01:
    origin = x_axis.From
    xvec = x_axis.Direction
    yvec = y_axis.Direction
elif x_axis.To.DistanceTo(y_axis.To) < 0.01:
    origin = x_axis.To
    xvec = -x_axis.Direction
    yvec = -y_axis.Direction
elif x_axis.From.DistanceTo(y_axis.To) < 0.01:
    origin = x_axis.From
    xvec = x_axis.Direction
    yvec = -y_axis.Direction
elif x_axis.To.DistanceTo(y_axis.From) < 0.01:
    origin = x_axis.To
    xvec = -x_axis.Direction
    yvec = y_axis.Direction

plane = rg.Plane(origin, xvec, yvec)
# ---------- end plane ----------

# ----
# Input
list_3 = ValueList({"single plane": 0, "planes from curve": 1, "planes from am_model": 2}, selected="single plane")  # disabled
filter = StreamFilter(Gate=list_3, Stream0=plane, Stream1=curve_def, Stream2=layer_def.am_model)  # disabled

robot_model = Data(load_robot_model.robot_model)

# ----
# Info
info = Python3Script(robot_model=robot_model)  # -> out, a
# ---------- info: Python ----------
if robot_model:
    print(robot_model)
# ---------- end info ----------
panel_2 = Panel(info.out)

plane_2 = Plane(planes)  # disabled

# ----
# Hello ABB
button = Button()
hello_world = Python3Script(abb_client=clients.abb_client, send_welcome=button)  # -> out, a
# ---------- hello_world: Python ----------
import compas_rrc as rrc

if send_welcome and abb_client:
    abb_client.send(rrc.PrintText('Hello World'))
# ---------- end hello_world ----------

reset_button = Button()

# ----
# Configuration
# forward kinematics
number_slider = Slider(2.12, range=0..4.2)
forward_kinematics = Python3Script(
    reset=reset_button,
    model=robot_model,
    a_cart=number_slider,
    a_a1=Slider(-26.4, range=-180..180),
    a_a2=Slider(-23.7, range=-90..150),
    a_a3=Slider(27.7, range=-180..180),
    a_a4=Slider(38.8, range=-400..400),
    a_a5=Slider(-12, range=-125..120),
    a_a6=Slider(0, range=-400..400))  # -> configuration
# ---------- forward_kinematics: Python ----------
import math
import Grasshopper

import Rhino
import scriptcontext as sc


from compas_robots.model import Joint
from compas_robots import Configuration


def reset_sliders():
    # Get all number sliders in the document
    sliders = [comp for comp in sc.doc.Objects if isinstance(comp, Rhino.DocObjects.ObjRef) and isinstance(comp.Geometry(), Rhino.Geometry.NurbsCurve) and comp.Attributes.Name == "Number Slider"]
    
    # Loop through sliders and set their values to zero
    for slider in sliders:
        slider.Geometry().SetUserString("Value", "0")

# Check if the toggle button is toggled on
if reset_sliders:
    reset_sliders()


if model:
    joint_positions = [a_cart, a_a1, a_a2, a_a3, a_a4, a_a5, a_a6]
    print (joint_positions)
    joint_types = model.get_joint_types()
    print(joint_types)
    joint_names = model.get_configurable_joint_names()
    print(joint_names)

    for i, joint_type in enumerate(joint_types):
        if joint_type == Joint.REVOLUTE:
            joint_positions[i] = math.radians(joint_positions[i])
        if joint_type == Joint.PRISMATIC:
            joint_positions[i] = joint_positions[i]
    
    configuration = Configuration(joint_positions, joint_types, joint_names)
    print (configuration)
# ---------- end forward_kinematics ----------

# ----
# inverse kinematics
ik = Python3Script(robot=set.robot_model)  # -> configuration; unedited script template
list_4 = ValueList({"fk_configuration": 0, "robot_configuration": 1}, selected="robot_configuration")
fk_configuration = Data(forward_kinematics)
go_to_start_configuration = BooleanToggle(False)
avoid_collisions = BooleanToggle(False)
filter_2 = StreamFilter(Gate=list_4, Stream0=fk_configuration, Stream1=ik)
inverse_kinematics = Python3Script(
    compute=Toggle(True),
    model=set.robot_model,
    start_configuration=filter_2,
    go_to_start_configuration=go_to_start_configuration,
    avoid_collisions=avoid_collisions)  # -> out, ik_configuration, t0cp
# ---------- inverse_kinematics: Python ----------
from __future__ import print_function
import logging
from compas.geometry import Frame
from scriptcontext import sticky as st
from compas_ghpython.utilities import draw_frame

LOGGER = logging.getLogger('roslibpy')

#vizualize t0cf
if robot.attached_tool:
    t0cf = Frame(plane.Origin, plane.XAxis, plane.YAxis)
    t0cp = draw_frame(t0cf)
    print (t0cf)


if compute:
    robot.client = robot.ros_client
    if go_to_start_configuration:
        ik_configuration = start_configuration
    else:
        tool_frame = Frame(plane.Origin, plane.XAxis, plane.YAxis)
        ik_configuration = robot.inverse_kinematics(tool_frame,
                                                    start_configuration,
                                                    group=group,
                                                    options={
                                                      'avoid_collisions':avoid_collisions,
                                                      'return_full_configuration':True,
                                                    })        
#group_configuration = robot.get_group_configuration(group, ik_configuration)
#print (group_configuration)
st["ik_configuration"] = ik_configuration

ik_configuration = st["ik_configuration"] 
print(ik_configuration)
# ---------- end inverse_kinematics ----------
panel_3 = Panel(inverse_kinematics.out)
draw = Python3Script(planes=inverse_kinematics.t0cp, scale=Slider(0.2, range=0..1))  # -> P, V, C, W
# ---------- draw: Python ----------
from System.Drawing import Color
from compas_ghpython.artists import FrameArtist

red = Color.FromArgb(255, 0, 0)
green = Color.FromArgb(0, 255, 0)
blue = Color.FromArgb(0, 0, 255)

P = []
V = []
C = []

scale = float(scale)

for plane in planes:
    if not plane:
        continue
    P += [plane.Origin] * 3
    V.append(plane.XAxis * scale)
    V.append(plane.YAxis * scale)
    V.append(plane.ZAxis * scale)
    C += [red, green, blue]

W = 3
# ---------- end draw ----------
vdisex = VectorDisplayEx(Point=draw.P, Vector=draw.V, Colour=draw.C, Width=draw.W)

# ----
# Move Joints
tcp_speed = Slider(250, range=0..1000)
move_to_joints = Button()
movej = Python3Script(abb_client=clients.abb_client, configuration=forward_kinematics, speed=tcp_speed, move_to_joints=move_to_joints)  # -> out
# ---------- movej: Python ----------
import compas_rrc as rrc

# get the values from the configuration
ext_axes = rrc.ExternalAxes.from_configuration(configuration) #store all robot values from configuration
cart = rrc.ExternalAxes(ext_axes.values[0]) #store cart values from robot values as ExternalAxes
joints = rrc.RobotJoints(ext_axes.values[1:]) #store joint values from robot values as RobotJoints

if move_to_joints and abb_client is not None:
    abb_client.send(rrc.MoveToJoints(joints, cart, speed, rrc.Zone.FINE))
# ---------- end movej ----------

toggle = BooleanToggle(False)

# ----
# Visualisation
list_5 = ValueList({"0 forward_kinematics": 0, "1 inverse_kinematics": 1}, selected="0 forward_kinematics")
show_frames = BooleanToggle(True)
show_visual = BooleanToggle(True)
show_collision = BooleanToggle(True)
show_base_frame = BooleanToggle(True)
show_end_effector_frame = BooleanToggle(True)
show_acm = BooleanToggle(True)
fk_configuration_2 = Data(forward_kinematics)
ik_configuration = Data(inverse_kinematics.ik_configuration)
filter_3 = StreamFilter(Gate=list_5, Stream0=fk_configuration_2, Stream1=ik_configuration)
visualise = Python3Script(
    model=robot_model,
    group=set.main_group_name,
    configuration=[forward_kinematics, filter_3],
    redraw=attach_remove.bang,
    show_frames=show_frames,
    show_visual_meshes=show_visual,
    show_collision_meshes=show_collision,
    show_base_frame=show_base_frame,
    show_end_effector_frame=show_end_effector_frame,
    show_attached_collision_meshes=show_acm)  # -> out, joint_planes, visual_meshes, collision_meshes, base_plane, end_effector_plane, attched_collision_meshes
# ---------- visualise: Python ----------
from compas.geometry import Frame
from compas.geometry import Transformation
from compas_rhino.conversions import frame_to_rhino

if show_frames == True: 
    #print(configuration)
    joint_frames = model.transformed_frames(configuration)
    joint_planes = [frame_to_rhino(a) for a in joint_frames]

if show_base_frame == True:
    show_base_frame = model.forward_kinematics(configuration, model.get_base_link_name())
    #print(show_base_frame)
    base_plane = frame_to_rhino(show_base_frame) 

if show_end_effector_frame == True:
    end_effector_frame = model.forward_kinematics(configuration, model.get_end_effector_link_name())
    #print(end_effector_frame)
    end_effector_plane = frame_to_rhino(end_effector_frame) 

if show_visual_meshes == True:
    pass

if show_collision_meshes == True:
    pass

if show_attached_collision_meshes == True:
    pass
# ---------- end visualise ----------
pln = Plane(visualise.joint_planes)
pln_2 = Plane(visualise.base_plane)
pln_3 = Plane(visualise.end_effector_plane)
geo = Geometry([visualise.collision_meshes, visualise.attched_collision_meshes, visualise.visual_meshes])
draw_2 = Python3Script(frames=[visualise.end_effector_plane, visualise.joint_planes, visualise.base_plane], scale=Slider(0.2, range=0..1))  # -> P, V, C, W
# ---------- draw_2: Python ----------
from System.Drawing import Color
from compas_ghpython.artists import FrameArtist

red = Color.FromArgb(255, 0, 0)
green = Color.FromArgb(0, 255, 0)
blue = Color.FromArgb(0, 0, 255)

P = []
V = []
C = []

scale = float(scale)

for plane in frames:
    if not plane:
        continue
    P += [plane.Origin] * 3
    V.append(plane.XAxis * scale)
    V.append(plane.YAxis * scale)
    V.append(plane.ZAxis * scale)
    C += [red, green, blue]

W = 3
# ---------- end draw_2 ----------
preview = CustomPreview(Geometry=geo, Shader=ColourSwatch(SwatchColor=RGB(207, 157, 160)))
vdisex_2 = VectorDisplayEx(Point=draw_2.P, Vector=draw_2.V, Colour=draw_2.C, Width=draw_2.W)

tcp_speed_2 = Slider(250, range=0..1000)
tcp_speed_3 = Slider(250, range=0..1000)

to_robtarget = Button()
to_frame = Button()

to_single_joints = Button()
to_joints = Button()

set_tool = Button()
set_tool_2 = Button()
target_plane = Plane(plane)

# ----
# Set Motor Data
speed = Slider(24505.6, range=0..51200)
max_speed = Slider(45277.56, range=0..51200)
send = Button()
value = BooleanToggle(True)
extruder_data = PythonScript(motor_state=value, max_speed=max_speed, speed=speed, send=send)  # -> out; inputs motor_state: Boolean
# ---------- extruder_data: Python ----------
import time
from scriptcontext import sticky as st
from extruder_control.concrete_extruderclient import ExtruderClient

ext_ip = st["ext_ip"]
ext_port = st["ext_port"]

ec = ExtruderClient(ext_ip, ext_port)
wait_for_response = False

if send:
    ec.connect()
    time.sleep(0.2)
    ec.send_motordata(motor_state, max_speed, speed, wait_for_response)
    #ec.get_msg_arduino_info(wait_for_response)
    time.sleep(0.2)
    ec.close()
# ---------- end extruder_data ----------
data_recorder = DataRecorder(extruder_data, DataLimit=-10, RecordData=True)
out = Panel(data_recorder)

# ----
# extruder control
# Toggle Digital Output
value_2 = BooleanToggle(True)
send_2 = Button()
list_6 = ValueList({"1", "2", "3", "4", "5", "6", "7", "8", "9", "10", "11", "12", "13"}, selected="10")
digital_out = PythonScript(pin=list_6, state=value_2, send=send_2)  # -> out; inputs pin: Int32, state: Boolean
# ---------- digital_out: Python ----------
import time
from scriptcontext import sticky as st
from extruder_control.concrete_extruderclient import ExtruderClient

ext_ip = st["ext_ip"]
ext_port = st["ext_port"]

ec = ExtruderClient(ext_ip, ext_port)
wait_for_response = False


if send:
    ec.connect()
    time.sleep(0.2)
    ec.send_set_do(pin, int(state), wait_for_response)
    time.sleep(0.2)
    ec.close()
# ---------- end digital_out ----------
data_recorder_2 = DataRecorder(digital_out, DataLimit=-10, RecordData=True)
out_2 = Panel(data_recorder_2)

get_frame = Button()
get_robtarget = Button()
get_joints = Button()

# ----
# State Viewer
trigger = Trigger(Interval=100, TimerInterval=100, Target=fabrication_state)
fabrication_state = PythonScript()  # -> out, state, num_tasks, num_current_task, num_tasks_left, log_messages
# ---------- fabrication_state: Python ----------
from scriptcontext import sticky as st

fabrication = st["fabrication"]

if hasattr(fabrication, "task_thread"):
    if fabrication.task_thread.is_alive():
        state = "THREAD RUNNING"
    else:
        state = "THREAD STOPPED"

num_tasks = len(fabrication.tasks)
if fabrication.current_task_key is not None:
    num_current_task = fabrication.current_task_key+1
else:
    num_current_task = 0
num_tasks_left = num_tasks-num_current_task
log_messages = fabrication.log_messages
# ---------- end fabrication_state ----------
state = Panel(fabrication_state.state)
num_tasks = Panel(fabrication_state.num_tasks)
num_current_task = Panel(fabrication_state.num_current_task)
log_messages = Panel(fabrication_state.log_messages)

# ----
# Toggle Motor State
value_3 = BooleanToggle(True)
send_3 = Button()
extruder_state = PythonScript(state=value_3, send=send_3)  # -> out; inputs state: Boolean
# ---------- extruder_state: Python ----------
import time
from scriptcontext import sticky as st
from extruder_control.concrete_extruderclient import ExtruderClient

ext_ip = st["ext_ip"]
ext_port = st["ext_port"]

ec = ExtruderClient(ext_ip, ext_port)
wait_for_response = False

if send:
    ec.connect()
    time.sleep(0.2)
    ec.send_motorstate(int(state), wait_for_response)
    time.sleep(0.2)
    ec.close()
# ---------- end extruder_state ----------

# ----
# Stop ALL
stop = Button()
stop_2 = PythonScript(stop=stop)  # -> out
# ---------- stop_2: Python ----------
import time
from scriptcontext import sticky as st
from extruder_control.concrete_extruderclient import ExtruderClient

ext_ip = st["ext_ip"]
ext_port = st["ext_port"]

ec = ExtruderClient(ext_ip, ext_port)
wait_for_response = False

if stop:
    ec.connect()
    time.sleep(0.2)
    ec.send_stop(wait_for_response)
    time.sleep(0.2)
    ec.close()
# ---------- end stop_2 ----------

# ----
# Concrete Extruder
ext_ip = ValueList({"192.168.125.220", "192.168.125.60"}, selected="192.168.125.220")
ext_port = ValueList({"50003", "50004"}, selected="50004")  # disabled
# Concrete Pump
ext_ip_2 = ValueList({"192.168.125.10"}, selected="192.168.125.10")  # disabled
ext_port_2 = ValueList({"50003", "50004", "50001"}, selected="50004")
data_recorder_3 = DataRecorder(stop_2, DataLimit=-10, RecordData=True)
data_recorder_4 = DataRecorder(extruder_state, DataLimit=-10, RecordData=True)
out_3 = Panel(data_recorder_3)
out_4 = Panel(data_recorder_4)

# ----
# --> Set controller IP address
button_2 = Button()  # disabled
globals = PythonScript(ext_ip=ext_ip_2, ext_port=ext_port, clear=button_2)  # disabled
# ---------- globals: Python ----------
from scriptcontext import sticky as st

#st["server_address"] = server_address
#st["server_port"] = server_port

st["ext_ip"] = ext_ip
st["ext_port"] = ext_port


if clear:
    st.clear()
# ---------- end globals ----------

# ----
# --> Set controller IP address
button_3 = Button()
globals_2 = PythonScript(ext_ip=ext_ip, ext_port=ext_port_2, clear=button_3)  # same code as globals

ping = Button()
py_2 = PythonScript(ip=ext_ip, ping=ping)  # -> out, trigger
# ---------- py_2: Python ----------
import os
from scriptcontext import sticky as st

guid = str(ghenv.Component.InstanceGuid)
txt_key = "txt_" + guid
if txt_key not in st:
    st[txt_key] = ""

def is_available(ip):
    syscall = "ping -r 1 -n 1 %s"
    response = os.system(syscall % ip)
    if response == 0:
        return True
    else:
        return False

if ping:
    available = is_available(ip)
    
    if available:
        st[txt_key] = "%s is up!" % ip
        trigger = True
    else:
        st[txt_key] = "%s is down!" % ip
        trigger = False

print(st[txt_key])
# ---------- end py_2 ----------
panel_4 = Panel(py_2.out)

ping_2 = Button()  # disabled
py_3 = PythonScript(ip=ext_ip_2, ping=ping_2)  # -> out, trigger; disabled; same code as py_2
panel_5 = Panel(py_3.out)  # disabled

# ----
# Reset
# Reset turns on the extruder
send_4 = Button()
digital_out_2 = PythonScript(send=send_4)  # -> out
# ---------- digital_out_2: Python ----------
import time
from scriptcontext import sticky as st
from extruder_control.concrete_extruderclient import ExtruderClient

ext_ip = st["ext_ip"]
ext_port = st["ext_port"]

ec = ExtruderClient(ext_ip, ext_port)

    
if send:
    ec.connect()
    time.sleep(0.2)
    ec.send_reset()
    time.sleep(0.2)
    ec.close()
# ---------- end digital_out_2 ----------

# ----
# Tool
list_7 = ValueList({"concrete_extruder": 0, "parallel_gripper_with_clay_extruder": 1}, selected="parallel_gripper_with_clay_extruder")
list_8 = ValueList({"nozzle": "t_nozzle", "gripper_625": "t_gripper_625"}, selected="gripper_625")
show_2 = BooleanToggle(True)
py_4 = PythonScript()  # -> DATA
# ---------- py_4: Python ----------
import os

#package_path = os.path.dirname(mobile_fabrication_control.__file__)
#DATA = os.path.abspath(os.path.join(package_path,"../../data"))

package_path = ghdoc.Path
# package_path = os.path.dirname(ur_fabrication_control.__file__)
#DATA = os.path.abspath(os.path.join(package_path,"../../data"))

# .stl files not stored in am_hackathon repo. but in mobile_fabrication_control
DATA = os.path.abspath(os.path.join(package_path,"../../../fabtory_fabrication_control/data"))

print(package_path)
print(DATA)
# ---------- end py_4 ----------
tools_2 = PythonScript(data_path=py_4, tool=list_7, tcp_frame=list_8, show=show_2)  # -> values_for_RS, tool, M
# ---------- tools_2: Python ----------
import os, math
from compas.geometry import Frame, Rotation
from compas.datastructures import Mesh
from compas.datastructures import Mesh
from compas_ghpython.artists import MeshArtist
from compas_fab.robots import Tool
from compas_ghpython.utilities import draw_frame

tolerance = 0

if tool == 0:
    filename = 'concrete_extruder.stl'
    ee_frame = Frame([0.159, 0.050, 0.131], [1, 0, 0], [0, 1, 0])

elif tool == 1:
    filename = 'parallel_gripper_with_clay_extruder.stl'

    if tcp_frame == "t_nozzle":
        ee_frame = Frame([0.30, 0.00, 0.175], [1, 0, 0], [0, 1, 0])
    elif tcp_frame == "t_gripper_625":
        ee_frame = Frame([0.0, 0.52, 0.10], [0, 0, 1], [1, 0, 0])

data_path = os.path.join(data_path, "tool_geometry")
fullfilename = os.path.join(data_path, filename)

ee_mesh = Mesh.from_stl(fullfilename)

if show:
    artist = MeshArtist(ee_mesh)
    M = artist.draw()

tool = Tool(ee_mesh, ee_frame)
ee_plane = draw_frame(ee_frame)

values_for_robotstudio = [[round(entry*1000, 5) for entry in list(ee_frame.point)], list(ee_frame.quaternion)]
print values_for_robotstudio
# ---------- end tools_2 ----------
mesh = Mesh(tools_2.M)
values_for_robotstudio = Panel(tools_2.values_for_RS)
remove_2 = Button()
add_2 = Button()

# ----
# ROS & ABB client
ros_ip_2 = ValueList({"127.0.0.1"}, selected="127.0.0.1")
ros_port_2 = ValueList({"9090"}, selected="9090")
ros = ROSConnect(ip=ros_ip_2, port=ros_port_2, connect=Toggle(True))  # -> ros_client, is_connected; inputs port: Int32, connect: Boolean
#   port ip: The ip address ROS. Defaults to 127.0.0.1.
#   port port: The port of ROS. Defaults to 9090.
#   port connect: If True, connects to ROS. If False, disconnects from ROS. Defaults to False.
#   port ros_client: The ROS client.
#   port is_connected: True if connection established.
# ---------- ros: Python ----------
"""
Connect or disconnect to ROS.

COMPAS FAB v0.19.1
"""
from ghpythonlib.componentbase import executingcomponent as component
from scriptcontext import sticky as st

from compas_fab.backends import RosClient
from compas_fab.ghpython.components import create_id


class ROSConnect(component):
    def RunScript(self, ip, port, connect):
        ros_client = None

        ip = ip or '127.0.0.1'
        port = port or 9090

        key = create_id(self, 'ros_client')
        ros_client = st.get(key, None)

        if ros_client:
            st[key].close()
        if connect:
            st[key] = RosClient(ip, port)
            st[key].run(5)

        ros_client = st.get(key, None)
        is_connected = ros_client.is_connected if ros_client else False
        return (ros_client, is_connected)
# ---------- end ros ----------
is_connected_2 = Panel(ros.is_connected)
abb = GhPythonScript(ros_client=ros.ros_client, connect=Toggle(True))  # -> out, abb_client; inputs connect: Boolean
# ---------- abb: Python ----------
import compas_rrc as rrc

if ros_client:
    if ros_client.is_connected and connect: 
        # Create ABB Client
        abb_client = rrc.AbbClient(ros_client, '/rob1')
# ---------- end abb ----------

# ----
# Load Model
# Load robot from local package
load_2 = Button()
units = ValueList({"m": 1, "cm": 100, "mm": 1000}, selected="m")
list_9 = ValueList({"abb_fabtory"}, selected="abb_fabtory")

# ----
# Robot Model
panel_7 = Panel("abb_fabtory.srdf")

load_model = PythonScript(
    path=path_2.ROBOT_DESCRIPTION,
    package=list_9,
    urdf_name="abb_fabtory.urdf",
    srdf_name=panel_7,
    scale_factor=units,
    load=load_2)  # -> robot
# ---------- load_model: Python ----------
import os
from scriptcontext import sticky as st
import compas
from compas.robots import RobotModel
from compas.robots import LocalPackageMeshLoader
from compas_fab.robots import Robot
from compas_fab.robots import RobotSemantics
from compas_fab.ghpython import RobotArtist

packages = ["abb_irb6700_support", "abb_end_effectors", "abb_fabtory"]
loaders = []

for package in packages:
    loaders.append(LocalPackageMeshLoader(path, package))

#path directory
package_path = os.path.join(path, package)
print(package_path)

urdf_filename = os.path.join(package_path, "urdf", urdf_name)
srdf_filename = os.path.join(package_path, srdf_name)

assert os.path.isfile(urdf_filename)
assert os.path.isfile(srdf_filename)

compas.PRECISION = '12f'

# store robot in component
guid = str(ghenv.Component.InstanceGuid)
robot_key = "robot_" + guid

if robot_key not in st:
    st[robot_key] = None

#load robot model from urdf
if load:
    model = RobotModel.from_urdf_file(urdf_filename)
    model.load_geometry(*loaders)
    artist = RobotArtist(model)
    semantics = RobotSemantics.from_srdf_file(srdf_filename, model)
    robot = Robot(model, artist, semantics, client=None)

    st[robot_key] = robot
robot = st[robot_key]

#vizualize robot in the right scale of your environment
robot.scale(scale_factor)
# ---------- end load_model ----------

set_2 = PythonScript(robot=load_model, ros_client=ros.ros_client, abb_client=abb.abb_client)  # -> out, robot, main_group_name
# ---------- set_2: Python ----------
if robot and ros_client and abb_client:
    robot.ros_client = ros_client
    robot.abb_client = abb_client

    robot.info()
    main_group_name = robot.main_group_name
    print robot.info
# ---------- end set_2 ----------

robot_info = Panel(set_2.out)

attach_remove_2 = PythonScript(robot=load_model, tool=tools_2.tool, attach=add_2, remove=remove_2)  # -> bang
# ---------- attach_remove_2: Python ----------
if attach:
    robot.attach_tool(tool)

    
if remove:
    robot.detach_tool()
# ---------- end attach_remove_2 ----------

# ----
# forward kinematics
number_slider_2 = Slider(0, range=-400..400)
# Configuration
number_slider_3 = Slider(0, range=0..4.2)
jp = GhPythonScript()  # -> configuration_values
# ---------- jp: Python ----------
import math
joint_values = [-3.136, -0.328, -1.218, 3.129, 0.852, 0.008]
#joint_values = [math.degrees(j) for j in joint_values]
#joint_positions = [0] * 6

cart = 0
joint_values = [0,0,0,0,0,0]

configuration_values = [cart] + joint_values
# ---------- end jp ----------
forward_kinematics_2 = PythonScript(
    robot=set_2.robot,
    reset_configuration=Button(),
    configuration_values=jp,
    a_cart=number_slider_3,
    a_a1=Slider(0, range=-180..180),
    a_a2=Slider(0, range=-90..150),
    a_a3=Slider(0, range=-180..180),
    a_a4=Slider(0, range=-400..400),
    a_a5=Slider(0, range=-125..120),
    a_a6=number_slider_2)  # -> full_configuration; inputs reset_configuration: Boolean, configuration_values: list
# ---------- forward_kinematics_2: Python ----------
import math
import Grasshopper
import copy
from compas.robots import Joint
from compas_fab.robots import Configuration





if reset_configuration:
    j = 0
    for i in range(ghenv.Component.Params.Input.Count):
        nslider = ghenv.Component.Params.Input[i].Sources[0]
        if nslider.GetType() == Grasshopper.Kernel.Special.GH_NumberSlider:
            nslider.TrySetSliderValue(configuration_values[j])
            j += 1


if robot:
    joint_positions = [a_cart, a_a1, a_a2, a_a3, a_a4, a_a5, a_a6]
    #print joint_positions
    joint_positions_degrees = copy.deepcopy(joint_positions)
    joint_types = robot.get_configurable_joint_types()
    #print(joint_types)
    for i, joint_type in enumerate(joint_types):
        if joint_type == Joint.REVOLUTE:
            joint_positions[i] = math.radians(joint_positions[i])
        if joint_type == Joint.PRISMATIC:
            joint_positions[i] = joint_positions[i]
    full_configuration = Configuration(joint_positions, joint_types)
    #print full_configuration
# ---------- end forward_kinematics_2 ----------

# ----
# inverse kinematics
ik_2 = PythonScript(robot=set_2.robot)  # -> configuration
# ---------- ik_2: Python ----------
from compas_fab.robots import Configuration

if robot:
    types = robot.get_configurable_joint_types()
    values = [0] * len(types)
    configuration = Configuration(values, types)
    print configuration
    print robot.get_configurable_joint_names()
# ---------- end ik_2 ----------
list_10 = ValueList({"fk_configuration": 0, "robot_configuration": 1}, selected="robot_configuration")
fk_configuration_3 = Data(forward_kinematics_2)
go_to_start_configuration_2 = BooleanToggle(False)
avoid_collisions_2 = BooleanToggle(False)
filter_4 = StreamFilter(Gate=list_10, Stream0=fk_configuration_3, Stream1=ik_2)
inverse_kinematics_2 = GhPythonScript(
    compute=Toggle(True),
    robot=set_2.robot,
    plane=plane,
    start_configuration=filter_4,
    go_to_start_configuration=go_to_start_configuration_2,
    avoid_collisions=avoid_collisions_2,
    group=set_2.main_group_name)  # -> out, ik_configuration, t0cp; inputs plane: Plane; same code as inverse_kinematics
draw_3 = GhPythonScript(planes=inverse_kinematics_2.t0cp, scale=Slider(0.2, range=0..1))  # -> P, V, C, W; inputs planes: list; same code as draw
out_5 = Panel(inverse_kinematics_2.out)
vdisex_3 = VectorDisplayEx(Point=draw_3.P, Vector=draw_3.V, Colour=draw_3.C, Width=draw_3.W)

list_11 = ValueList({"0 forward_kinematics": 0, "1 inverse_kinematics": 1}, selected="0 forward_kinematics")
fk_configuration_4 = Data(forward_kinematics_2)
ik_configuration_2 = Data(inverse_kinematics_2.ik_configuration)
filter_5 = StreamFilter(Gate=list_11, Stream0=fk_configuration_4, Stream1=ik_configuration_2)

# ----
# Visualisation
show_end_effector_frame_2 = BooleanToggle(True)
show_base_frame_2 = BooleanToggle(False)
show_collision_2 = BooleanToggle(False)
show_frames_2 = BooleanToggle(False)
show_visual_2 = BooleanToggle(True)
show_acm_2 = BooleanToggle(False)
robot_visualize = RobotVisualize(
    robot=set_2.robot,
    group=set_2.main_group_name,
    configuration=filter_5,
    redraw=attach_remove_2,
    show_visual=show_visual_2,
    show_collision=show_collision_2,
    show_frames=show_frames_2,
    show_base_frame=show_base_frame_2,
    show_end_effector_frame=show_end_effector_frame_2,
    show_acm=show_acm_2)  # -> visual, collision, attached_meshes, frames, base_frame, ee_frame; inputs redraw: list, show_visual: Boolean, show_collision: Boolean, show_frames: Boolean, show_base_frame: Boolean, show_end_effector_frame: Boolean, show_acm: Boolean
#   port group: The planning group used for end-effector and base visualization.
#   port configuration: The robot's full configuration.
#   port redraw: A list of attached collision meshes.
#   port show_visual: Whether or not to show the robot's visual meshes.
#   port show_collision: Whether or not to show the robot's collision meshes.
#   port show_frames: Whether or not to show the robot's joint frames.
#   port show_base_frame: Whether or not to show the robot's base frame.
#   port show_end_effector_frame: Whether or not to show the robot's end-effector frame.
#   port show_acm: Whether or not to show the attached collision meshes (if any).
#   port visual: The robot's visual Rhino meshes (if any).
#   port collision: The robot's collision Rhino meshes (if any).
#   port attached_meshes: The attached collision Rhino meshes (if any).
#   port frames: The robot's joint frames as Rhino planes (if any).
#   port base_frame: The robot's base frame as a Rhino plane (if any).
#   port ee_frame: The robot's end-effector frame as a Rhino plane (if any).
# ---------- robot_visualize: Python ----------
"""
Visualizes the robot.

COMPAS FAB v0.19.1
"""
from compas.geometry import Frame
from compas.geometry import Transformation
from compas_ghpython.artists import Artist
from ghpythonlib.componentbase import executingcomponent as component


class RobotVisualize(component):
    def RunScript(self, robot, group, configuration, attached_collision_meshes, show_visual, show_collision,
                  show_frames, show_base_frame, show_end_effector_frame, show_acm):

        visual = None
        collision = None
        attached_meshes = None
        frames = None
        base_frame = None
        ee_frame = None

        if robot:
            show_visual = True if show_visual is None else show_visual
            configuration = configuration or robot.zero_configuration()

            robot.update(configuration, visual=show_visual, collision=show_collision)
            compas_frames = robot.transformed_frames(configuration, group)

            if show_visual:               
                visual = robot.artist.draw_visual()
                

            if show_collision:
                collision = robot.artist.draw_collision()

            if show_base_frame:
                base_compas_frame = compas_frames[0]
                base_frame = Artist(base_compas_frame).draw()

            if show_end_effector_frame:
                ee_compas_frame = robot.forward_kinematics(configuration, group, options=dict(solver='model', link="tool0"))
                #if robot.attached_tool:
                    #ee_compas_frame = robot.from_t0cf_to_tcf([ee_compas_frame])[0]
                ee_frame = Artist(ee_compas_frame).draw()

            if show_frames:
                frames = []
                for compas_frame in compas_frames[1:]:
                    frame = Artist(compas_frame).draw()
                    frames.append(frame)

            if show_acm:
                attached_meshes = []
                for acm in attached_collision_meshes:
                    frame = robot.forward_kinematics(configuration, options=dict(solver='model', link_name=acm.link_name))
                    T = Transformation.from_frame_to_frame(Frame.worldXY(), frame)
                    mesh = acm.collision_mesh.mesh.transformed(T)
                    attached_meshes.append(Artist(mesh).draw())

        return (visual, collision, attached_meshes, frames, base_frame, ee_frame)
# ---------- end robot_visualize ----------
draw_4 = GhPythonScript(frames=[robot_visualize.frames, robot_visualize.base_frame, robot_visualize.ee_frame], scale=Slider(0.2, range=0..1))  # -> P, V, C, W; inputs frames: list; same code as draw_2
geo_2 = Geometry([robot_visualize.visual, robot_visualize.collision, robot_visualize.attached_meshes])
vdisex_4 = VectorDisplayEx(Point=draw_4.P, Vector=draw_4.V, Colour=draw_4.C, Width=draw_4.W)
# Move Control
preview_2 = CustomPreview(Geometry=geo_2, Shader=ColourSwatch(SwatchColor=RGB(207, 157, 160)))

# ----
# Digital Output
button_4 = Button()
send_digital_signal = GhPythonScript(robot=set_2.robot, close_gripper=button_4, release_gripper=Button())  # -> out
# ---------- send_digital_signal: Python ----------
import abb_fabrication_control as ffc

if close_gripper:
    ffc.commands.close(robot)

if release_gripper:
    ffc.commands.release(robot)
# ---------- end send_digital_signal ----------
out_6 = Panel(send_digital_signal)

# ----
# Move Joints
tcp_speed_4 = Slider(250, range=0..1000)
movej_command = GhPythonScript(
    robot=set_2.robot,
    configuration=filter_5,
    speed=tcp_speed_4,
    move_to_joints=to_joints,
    move_single_joints=to_single_joints)  # -> out; inputs move_to_joints: Boolean
# ---------- movej_command: Python ----------
import abb_fabrication_control as ffc
import compas_rrc as rrc
#import fabtory_fabrication_control as abb

from compas.geometry import Scale
from compas.robots import Joint
import math



# Print text on FlexPenant
# robot.abb_client.send(rrc.PrintText('Welcome TUM to COMPAS_RRC! ;)'))

#print configuration

if move_to_joints:
    ffc.commands.move_to_joints(robot, configuration, speed=speed, zone=rrc.Zone.FINE)
    #ffc.commands.move_to_joints_2(robot, configuration, speed=speed, zone=rrc.Zone.FINE)


#ext_axes = rrc.ExternalAxes.from_configuration(configuration) #store all robot values from configuration
#cart = rrc.ExternalAxes(ext_axes.values[0]) #store cart values from robot values
#joints = rrc.RobotJoints(ext_axes.values[1:]) #store joint values from robot values
#robot.abb_client.send(rrc.MoveToJoints(joints, cart, speed, zone)) #send move to joints command



#joint_goal = movejoints.get_current_joint_values()
#print joint_goal


if move_single_joints:
    pass
    # TODO
# ---------- end movej_command ----------
data_recorder_5 = DataRecorder(movej_command, DataLimit=-10, RecordData=True)
out_7 = Panel(data_recorder_5)

# ----
# Fabrication Control
# Fabrication Process Control
# 3>
tcp_speed_5 = Slider(250, range=0..1000)
create = Button()
tasks = GhPythonScript(create=create, robot=set_2.robot, speed=tcp_speed_5, configuration=filter_5)  # -> out, tasks, configurations
# ---------- tasks: Python ----------
import abb_fabrication_control as ffc
import compas_rrc as rrc
import time
from fabrication_manager.task import Task
from compas.geometry import Frame
from scriptcontext import sticky as st
from compas.geometry import Frame


class MoveRobTargets(Task):
    def __init__(self, name):
        self.name = name
        self.robot = None
        self.is_completed = False
        self.is_running = False
        self._stop_flag = True
        self.frames = []
        self.configurations = []
        self.speeds = []
        self.log_messages = []
        self.key = None
        self.parallelizable = False
    
    def set_robot(self, robot):
        self.robot = robot

    def run(self, _stop_flag):
        self.log("{}: started".format(self.name))
        #if self.robot.attached_tool:
            #tool_name = self.robot.attached_tool.name
            #self.robot.abb_client.send(rrc.SetTool(tool_name))
        #else:
            #self.robot.abb_client.send(rrc.SetTool("tool0"))
        
        for i, f in enumerate(self.frames):
            #if _stop_flag():
                #self.is_running = False
                #break
            if i < len(self.frames)-1:
                zone = rrc.Zone.Z50
            else:
                zone = rrc.Zone.FINE
            #store cart value from configuration
            cart = (self.configurations[i].joint_values[0])

            #send move to robtarget command
            if i<len(self.frames)-1:
                ffc.commands.move_to_robtarget(self.robot, f, cart, speed=self.speeds[i], zone=zone, scalefactor=1000, send_and_wait = False)
            else:
                ffc.commands.move_to_robtarget(self.robot, f, cart, speed=self.speeds[i], zone=zone, scalefactor=1000, send_and_wait = True)
        
        self.is_completed = True
        return True

    def add_frame(self, frame, config, spd):
        #self.robot.client = self.robot.ros_client
        #if self.robot.attached_tool:
            #tool_frame = self.robot.from_tcf_to_t0cf([frame])[0]
        #else:
            #tool_frame = frame
        self.frames.append(frame)
        self.speeds.append(spd)
        self.configurations.append(config)


if create:
    tasks = []
    for j, layer in am_model.layers():
        new_task = MoveRobTargets(name="LAYER_{}".format(j))
        new_task.robot = robot
        for i, node in layer.nodes():
            new_task.add_frame(node.frame, configuration, speed)
        tasks.append(new_task)
    st["tasks"]= tasks
    
tasks = st["tasks"]
# ---------- end tasks ----------
list_item = ListItem(List=tasks.configurations, Index=Slider(0, range=0..10), Wrap=True)
stop_fabrication = Button()
start_fabrication = Button()
next_task = Button()
set_tasks = Button()
init = Button()
fabricationmanager = PythonScript(
    tasks=tasks.tasks,
    init=init,
    parallelize=Toggle(False),
    set_tasks=set_tasks,
    start=start_fabrication,
    stop=stop_fabrication,
    next_task=next_task)  # -> out, server; inputs tasks: list
# ---------- fabricationmanager: Python ----------
from scriptcontext import sticky as st
from fabrication_manager.fabrication import FabricationManager

if init:
    fabrication = FabricationManager()
    fabrication.parallelize = parallelize
    st["fabrication"] = fabrication

fabrication = st["fabrication"]

if set_tasks:
    print "setting tasks"    
    fabrication.clear_tasks()
    fabrication.set_tasks(tasks)

if start:
    #if robot.is_connected(): #and arduino.is_connected():
    print "starting process"
    fabrication.start()

if stop:
    print "stopping process"
    fabrication.stop()
    
if reset:
    print "resetting process"
    fabrication.reset()

if next_task:
    t = fabrication.get_next_task()
    task_state_set(True, t)
    
if reset_task:
    t = fabrication.get_next_task()
    task_state_set(False, t)

if prev_task:
    t = fabrication.get_next_task()
    task_state_set(False, t)
    t = fabrication.tasks[fabrication.current_task_key-1]
    task_state_set(False, t)
    fabrication.get_next_task()

def task_state_set(state, t):
    t.is_completed = state
    t.is_running = False
# ---------- end fabricationmanager ----------
num_tasks_left = Panel(fabrication_state.num_tasks_left)

jp_2 = GhPythonScript(robot=set_2.robot)  # -> full_configurations
# ---------- jp_2: Python ----------
import math
import Grasshopper
import copy
from compas.robots import Joint
from compas_fab.robots import Configuration




"""
joint_values = [-3.136, -0.328, -1.218, 3.129, 0.852, 0.008]
#joint_values = [math.degrees(j) for j in joint_values]
#joint_positions = [0] * 6

configurations_values = []

cart = 0
joint_values = [0,0,0,0,0,0]
configuration_values = [cart] + joint_values

configurations_values.append(configuration_values)

full_configurations = []

for configuration_values in configurations_values:

    joint_positions_degrees = copy.deepcopy(configuration_values)
    joint_types = robot.get_configurable_joint_types()
    #print(joint_types)
    for i, joint_type in enumerate(joint_types):
        if joint_type == Joint.REVOLUTE:
            joint_positions[i] = math.radians(joint_positions[i])
        if joint_type == Joint.PRISMATIC:
            joint_positions[i] = joint_positions[i]
    full_configurations.append(Configuration(joint_positions, joint_types))


if move_to_joints:
    #ffc.commands.move_to_joints(robot, configuration, speed=speed, zone=rrc.Zone.FINE)
    ffc.commands.move_to_joints_2(robot, configuration, speed=speed, zone=rrc.Zone.FINE)
"""





full_configurations = []

c = Configuration((0.937, -1.328, 0.277, 0.786, 0.276, -1.079, -0.134), (2, 0, 0, 0, 0, 0, 0), ('axis_joint', 'joint_1', 'joint_2', 'joint_3', 'joint_4', 'joint_5', 'joint_6'))
full_configurations.append(c)

c = Configuration((1.691, -2.350, -0.365, 0.800, -0.258, -0.483, 0.197), (2, 0, 0, 0, 0, 0, 0), ('axis_joint', 'joint_1', 'joint_2', 'joint_3', 'joint_4', 'joint_5', 'joint_6'))
full_configurations.append(c)

c = Configuration((1.679, -1.497, 0.538, -0.330, -0.150, -1.191, 0.272), (2, 0, 0, 0, 0, 0, 0), ('axis_joint', 'joint_1', 'joint_2', 'joint_3', 'joint_4', 'joint_5', 'joint_6'))
full_configurations.append(c)
# ---------- end jp_2 ----------

# ----
# Move Joints from List
tcp_speed_6 = Slider(250, range=0..1000)
to_joints_2 = Button()
movej_command_2 = GhPythonScript(robot=set_2.robot, configurations=jp_2, speed=tcp_speed_6, move_to_joints=to_joints_2)  # -> out; inputs configurations: list, move_to_joints: Boolean
# ---------- movej_command_2: Python ----------
import abb_fabrication_control as ffc
import compas_rrc as rrc


if move_to_joints:
    for configuration in configurations:
        ffc.commands.move_to_joints_2(robot, configuration, speed=speed, zone=rrc.Zone.Z200)
# ---------- end movej_command_2 ----------
data_recorder_6 = DataRecorder(movej_command_2, DataLimit=-10, RecordData=True)
out_8 = Panel(data_recorder_6)

# ----
# Move Cartesian from List
to_robtargets = Button()
to_frames = Button()
movel_command = GhPythonScript(
    robot=set_2.robot,
    configuration=filter_5,
    speed=tcp_speed_3,
    target_planes=plane_2,
    move_to_frames=to_frames,
    move_to_robtargets=to_robtargets,
    set_tool=set_tool_2)  # -> out; inputs target_planes: list of Plane, move_to_frames: Boolean, move_to_robtargets: Boolean
# ---------- movel_command: Python ----------
import compas_rrc as rrc
import abb_fabrication_control as ffc
from compas.geometry import Frame

#set tool in RobotStudio
if set_tool:
    if robot.attached_tool:
        tool_name = robot.attached_tool.name
        done = robot.abb_client.send(rrc.SetTool(tool_name))
        print done
    else:
        robot.abb_client.send(rrc.SetTool("tool0"))

if move_to_frames:
    #transform target plane into target frame
    
    for i, target_plane in enumerate(target_planes):
        if i < len(target_planes)-1:
            zone = rrc.Zone.Z50
        else:
            zone = rrc.Zone.FINE
        print zone
        target_frame = Frame(target_plane.Origin, target_plane.XAxis, target_plane.YAxis)
        #send move to frame command
        ffc.commands.move_to_frame(robot, target_frame, speed=speed, zone=zone, scalefactor=1000)

if move_to_robtargets:
    for i, target_plane in enumerate(target_planes):
        if i < len(target_planes)-1:
            zone = rrc.Zone.Z50
        else:
            zone = rrc.Zone.FINE
        print zone
        #transform target plane into target frame
        target_frame = Frame(target_plane.Origin, target_plane.XAxis, target_plane.YAxis)
        #store cart value from configuration
        cart = (configuration.joint_values[0])
        #send move to robtarget command
        ffc.commands.move_to_robtarget(robot, target_frame, cart, speed=speed, zone=zone, scalefactor=1000)
# ---------- end movel_command ----------
data_recorder_7 = DataRecorder(movel_command, DataLimit=-10, RecordData=True)
out_9 = Panel(data_recorder_7)

# ----
# Move Cartesian
movel_command_2 = GhPythonScript(
    robot=set_2.robot,
    configuration=filter_5,
    speed=tcp_speed_2,
    target_plane=target_plane,
    move_to_frame=to_frame,
    move_to_robtarget=to_robtarget,
    set_tool=set_tool)  # -> out; inputs target_plane: Plane, move_to_frame: Boolean, move_to_robtarget: Boolean
# ---------- movel_command_2: Python ----------
import compas_rrc as rrc
import abb_fabrication_control as ffc
from compas.geometry import Frame

#set tool in RobotStudio
if set_tool:
    if robot.attached_tool:
        tool_name = robot.attached_tool.name
        done = robot.abb_client.send(rrc.SetTool(tool_name))
        print done
    else:
        robot.abb_client.send(rrc.SetTool("tool0"))

if move_to_frame:
    #transform target plane into target frame
    target_frame = Frame(target_plane.Origin, target_plane.XAxis, target_plane.YAxis)
    #send move to frame command
    ffc.commands.move_to_frame(robot, target_frame, speed=speed, zone=rrc.Zone.FINE, scalefactor=1000)

if move_to_robtarget:
    #transform target plane into target frame
    target_frame = Frame(target_plane.Origin, target_plane.XAxis, target_plane.YAxis)
    #store cart value from configuration
    cart = (configuration.joint_values[0])
    #send move to robtarget command
    ffc.commands.move_to_robtarget(robot, target_frame, cart, speed=speed, zone=rrc.Zone.FINE, scalefactor=1000)
# ---------- end movel_command_2 ----------
data_recorder_8 = DataRecorder(movel_command_2, DataLimit=-10, RecordData=True)
out_10 = Panel(data_recorder_8)

# ----
# Get Robot Configurations
get_joints_2 = GhPythonScript(robot=set_2.robot, get_frame=get_frame, get_robtarget=get_robtarget, get_joints=get_joints)  # -> joint, current_plane
# ---------- get_joints_2: Python ----------
from compas_ghpython.artists import FrameArtist
from scriptcontext import sticky as st
import abb_fabrication_control as ffc
import os

# store robot in component
guid = str(ghenv.Component.InstanceGuid)
current_frame_key = "current_frame_" + guid
current_robtarget_key = "current_robtarget_" + guid
current_configuration_key = "current_configuration_" + guid

if current_frame_key not in st:
    st[current_frame_key] = None

if current_robtarget_key not in st:
    st[current_robtarget_key] = None

if current_configuration_key not in st:
    st[current_configuration_key] = None


#get commands
if get_frame:
    current_frame = ffc.feedback.get_frame(robot, scalefactor=0.001)
    st[current_frame_key] = current_frame

if get_robtarget:
    current_robtarget = ffc.feedback.get_robtarget(robot, scalefactor=0.001)
    print current_robtarget
    st[current_robtarget_key] = current_robtarget


if get_joints:
    current_configuration = ffc.feedback.get_joints(robot)
    st[current_configuration_key] = current_configuration
    print current_configuration

# sticky
if st[current_frame_key]:
    current_frame = st[current_frame_key]
    artist = FrameArtist(current_frame)
    current_plane = artist.draw()

if st[current_robtarget_key]:
    current_robtarget = st[current_robtarget_key]

if st[current_configuration_key]:
    current_configuration = st[current_configuration_key]
    print current_configuration
# ---------- end get_joints_2 ----------
data_recorder_9 = DataRecorder(get_joints_2.joint, DataLimit=-10, RecordData=True)
draw_5 = GhPythonScript(plane=get_joints_2.current_plane, scale=Slider(0.2, range=0..1))  # -> P, V, C, W; inputs plane: Plane
# ---------- draw_5: Python ----------
from System.Drawing import Color
from compas_ghpython.artists import FrameArtist

red = Color.FromArgb(255, 0, 0)
green = Color.FromArgb(0, 255, 0)
blue = Color.FromArgb(0, 0, 255)

P = []
V = []
C = []

scale = float(scale)


if plane:
    P += [plane.Origin] * 3
    V.append(plane.XAxis * scale)
    V.append(plane.YAxis * scale)
    V.append(plane.ZAxis * scale)
    C += [red, green, blue]
    
    W = 3
# ---------- end draw_5 ----------
joint_values = Panel(data_recorder_9)
vdisex_5 = VectorDisplayEx(Point=draw_5.P, Vector=draw_5.V, Colour=draw_5.C, Width=draw_5.W)

# ==== cluster Tools

# ---- group: measurement tool
geo = Geometry(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)
mesh = Mesh(geo)
mjoin = MeshJoin(Meshes=mesh)
xaxis_line = Curve(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)
yaxis_line = Curve(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)
tool = PythonScript(rhmesh=mjoin, xline=xaxis_line, yline=yaxis_line)  # -> tool; inputs rhmesh: Mesh
# ---------- tool: Python ----------
import Rhino.Geometry as rg
import os, math
from compas.geometry import Frame, Rotation
from compas.datastructures import Mesh
from compas_ghpython.artists import MeshArtist
from compas_fab.robots import Tool
from compas_rhino.geometry import RhinoMesh

xaxis = rg.Line(xline.PointAtStart, xline.PointAtEnd)
yaxis = rg.Line(yline.PointAtStart, yline.PointAtEnd)

if xaxis.From.DistanceTo(yaxis.From) < 0.01:
    origin = xaxis.From
    xaxis = xaxis.Direction
    yaxis = yaxis.Direction
elif xaxis.To.DistanceTo(yaxis.To) < 0.01:
    origin = xaxis.To
    xaxis = -xaxis.Direction
    yaxis = -yaxis.Direction
elif xaxis.From.DistanceTo(yaxis.To) < 0.01:
    origin = xaxis.From
    xaxis = xaxis.Direction
    yaxis = -yaxis.Direction
elif xaxis.To.DistanceTo(yaxis.From) < 0.01:
    origin = xaxis.To
    xaxis = -xaxis.Direction
    yaxis = yaxis.Direction

xaxis.Unitize()
yaxis.Unitize()

ee_frame = Frame(origin, xaxis, yaxis)
ee_mesh = RhinoMesh.from_geometry(rhmesh).to_compas()

tool = Tool(ee_mesh, ee_frame)
# ---------- end tool ----------

# ---- group: concrete extruder tool
geo_2 = Geometry(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)
mesh_2 = Mesh(geo_2)
mjoin_2 = MeshJoin(Meshes=mesh_2)
yaxis_line_2 = Curve(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)
xaxis_line_2 = Curve(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)

# ----
tool_2 = PythonScript(rhmesh=mjoin_2, xline=xaxis_line_2, yline=yaxis_line_2)  # -> tool; inputs rhmesh: Mesh; same code as tool
G = ClusterInput()
filter = StreamFilter(Gate=G, Stream0=tool, Stream1=tool_2)
s_0 = ClusterOutput(filter)
