# Grasshopper definition 03_fabtory_moveit_simulation_robot_control_rh8_py27.ghx (Grasshopper 1.0.8)
# plug-ins: RhinoCodePluginGH

# ----
# Unload Python
# modules
button = Button()
unload = IronPython2Script(unload=button)  # -> out
# ---------- unload: IronPython ----------
from compas_rhino import unload_modules

unload_modules("abb_fabrication_control")
unload_modules("extruder_control")
unload_modules("fabrication_manager")
# ---------- end unload ----------

# ----
# PATHS
path = IronPython2Script()  # -> out, HERE, DATA, ROBOT_DESCRIPTION
# ---------- path: IronPython ----------
import os

HERE = os.path.dirname(ghdoc.Path)
DATA = os.path.abspath(os.path.join(HERE, "..", "data"))
ROBOT_DESCRIPTION = os.path.abspath(os.path.join(DATA, "robot_description"))

#print(HERE)
#print(DATA)
#print(ROBOT_DESCRIPTION)
# ---------- end path ----------

# ----
# Model
load = Button()
list = ValueList({"abb_fabtory"}, selected="abb_fabtory")
load_model_local = IronPython2Script(path=path.ROBOT_DESCRIPTION, package=list, urdf_name="abb_fabtory.urdf", srdf_name="abb_fabtory.srdf", load=load)  # -> out, robot; inputs path: String, urdf_name: String, srdf_name: String
# ---------- load_model_local: IronPython ----------
import os
from scriptcontext import sticky as st

import compas
import compas_fab
import compas_robots

from compas_robots import RobotModel
from compas_robots.resources import LocalPackageMeshLoader

from compas_fab.robots import Robot
from compas_fab.robots import RobotSemantics

from compas_robots.scene import BaseRobotModelObject
from compas.scene import SceneObject

packages = ["abb_irb6700_support", "abb_end_effectors", "abb_fabtory"]
loaders = []

for package in packages:
    loaders.append(LocalPackageMeshLoader(path, package))

#path directory
package_path = os.path.join(path, package)
#print(package_path)

urdf_filename = os.path.join(package_path, "urdf", urdf_name)
srdf_filename = os.path.join(package_path, srdf_name)

assert os.path.isfile(urdf_filename)
assert os.path.isfile(srdf_filename)

compas.PRECISION = '12f'

# store robot in component
guid = str(ghenv.Component.InstanceGuid)
robot_key = "robot_" + guid
robot_model_key = "robot_model_" + guid

if robot_key not in st:
    st[robot_key] = None
    st[robot_model_key] = None

#load robot model from urdf
if load:

    # Create robot model from URDF
    model = RobotModel.from_urdf_file(urdf_filename)
    model.load_geometry(*loaders, precision=12)

    semantics = RobotSemantics.from_srdf_file(srdf_filename, model)
    scene_object = SceneObject(model)
    robot = Robot(model=model, scene_object=scene_object, semantics=semantics, client=None)
    
    st[robot_key] = robot
    st[robot_model_key] = model

robot = st[robot_key]
robot_model = st[robot_model_key]

if robot:
    print(robot.info())

    #print robot.get_end_effector_link_name(robot.main_group_name)
# ---------- end load_model_local ----------

connect = Button()
close = Button()

# ----
# Clients
ros_ip = ValueList({"127.0.0.1"}, selected="127.0.0.1")
ros_port = ValueList({"9090"}, selected="9090")
clients = IronPython2Script(ip=ros_ip, port=ros_port, connect=connect, close=close)  # -> out, ros_client, abb_client, is_connected
# ---------- clients: IronPython ----------
from scriptcontext import sticky as st

import compas_rrc as rrc
from compas_fab.backends import RosClient

if 'ros_client' not in st:
    st['ros_client'] = None
    st['abb_client'] = None
    st['is_connected'] = False

if close:
    st['ros_client'].close()
    st['ros_client'] = None
    st['abb_client'] = None
    st['is_connected'] = False

if connect:
    ros_client = RosClient(ip, port)
    try:
        ros_client.run(2)
    except:
        print('Cannot connect to ROS Client')
    
    
    st['is_connected'] = ros_client.is_connected if ros_client else False

    if st['is_connected']:
        abb_client = rrc.AbbClient(ros_client, '/rob1')

        st['ros_client'] = ros_client
        st['abb_client'] = abb_client

is_connected = st['is_connected']
ros_client = st['ros_client']
abb_client = st['abb_client']

print('ROS Client: ', ros_client)
print('ABB Client: ', abb_client)
print('is connected: ', is_connected)
# ---------- end clients ----------
is_connected = Panel(clients.is_connected)
set = IronPython2Script(robot=load_model_local.robot, ros_client=clients.ros_client, abb_client=clients.abb_client)  # -> out, robot, main_group_name
# ---------- set: IronPython ----------
if robot and ros_client and abb_client:
    robot.ros_client = robot.client = ros_client
    robot.abb_client = abb_client
    main_group_name = robot.main_group_name
# ---------- end set ----------

# ----
# Robot
panel = Panel(load_model_local.out)

tools = Tools()  # -> tool_3, tool_4
attach = Button()
set_start_config_from_fk = Button()
list_2 = ValueList({"manipulator", "manipulator with axis": "manipulator_axis"}, selected="manipulator with axis")

robot = Data(set.robot)

# ----
# Attach and remove tools
list_3 = ValueList({"mortar_extruder": 0, "measurement_tool": 1, "gripper_with_mortar_extruder": 2, "gripper_timber": 3}, selected="mortar_extruder")
detach = Button()
filter = StreamFilter(Gate=list_3, Stream0=tools.tool_3, Stream1=tools.tool_4)
attach_tool = IronPython2Script(tool=filter, robot=robot, group=set.main_group_name, attach=attach, detach=detach)  # -> out, update; inputs attach: Boolean, detach: Boolean
# ---------- attach_tool: IronPython ----------
if robot and robot.client and robot.client.is_connected and tool:

    if attach:
        robot.attach_tool(tool, group)
    if detach:
        robot.detach_tool()
# ---------- end attach_tool ----------

# ----
# forward kinematics
number_slider = Slider(30, range=-180..180)
# Configuration
number_slider_2 = Slider(2, range=0..4.2)
reset_button = Button()
configuration = IronPython2Script(
    reset=reset_button,
    robot=load_model_local.robot,
    a_cart=number_slider_2,
    a_a1=Slider(-90, range=-180..180),
    a_a2=Slider(0, range=-90..150),
    a_a3=number_slider,
    a_a4=Slider(0, range=-400..400),
    a_a5=Slider(0, range=-125..120),
    a_a6=Slider(0, range=-400..400))  # -> out, fk_configuration
# ---------- configuration: IronPython ----------
import math
import Grasshopper

import Rhino
import scriptcontext as sc

from compas_robots.model import Joint
from compas_robots import Configuration

#reset = True
if reset:
    cart = 2.0
    joint_values = [-90,0,30,0,0,0]
    configuration_values = [cart] + joint_values

    j = 0
    for i in range(ghenv.Component.Params.Input.Count):
        nslider = ghenv.Component.Params.Input[i].Sources[0]
        if nslider.GetType() == Grasshopper.Kernel.Special.GH_NumberSlider:
            nslider.TrySetSliderValue(configuration_values[j])
            j += 1


if robot:
    joint_positions = [a_cart, a_a1, a_a2, a_a3, a_a4, a_a5, a_a6]
    print ("joint positions: ", joint_positions)
    joint_types = robot.model.get_joint_types()
    print("joint types: ", joint_types)
    joint_names = robot.model.get_configurable_joint_names()
    print("joint names: ", joint_names)

    for i, joint_type in enumerate(joint_types):
        if joint_type == Joint.REVOLUTE:
            joint_positions[i] = math.radians(joint_positions[i])
        if joint_type == Joint.PRISMATIC:
            joint_positions[i] = joint_positions[i]
    
    fk_configuration = Configuration(joint_positions, joint_types, joint_names)
    print ("configuration: ", fk_configuration)
# ---------- end configuration ----------

# ----
# inverse kinematics
x_axis = Curve(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)
y_axis = Curve(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)
plane = Python3Script(plane_axes=[x_axis, y_axis])  # -> out, plane; inputs plane_axes: list of Curve
# ---------- plane: Python ----------
import Rhino.Geometry as rg

x_axis, y_axis = plane_axes

x_axis = rg.Line(x_axis.PointAtStart, x_axis.PointAtEnd)
y_axis = rg.Line(y_axis.PointAtStart, y_axis.PointAtEnd)

if x_axis.From.DistanceTo(y_axis.From) < 0.01:
    origin = x_axis.From
    xvec = x_axis.Direction
    yvec = y_axis.Direction
elif x_axis.To.DistanceTo(y_axis.To) < 0.01:
    origin = x_axis.To
    xvec = -x_axis.Direction
    yvec = -y_axis.Direction
elif x_axis.From.DistanceTo(y_axis.To) < 0.01:
    origin = x_axis.From
    xvec = x_axis.Direction
    yvec = -y_axis.Direction
elif x_axis.To.DistanceTo(y_axis.From) < 0.01:
    origin = x_axis.To
    xvec = -x_axis.Direction
    yvec = y_axis.Direction

plane = rg.Plane(origin, xvec, yvec)
# ---------- end plane ----------
compute_ik = Button()
inverse_kinematcs = IronPython2Script(
    compute=compute_ik,
    robot=robot,
    target_plane=plane.plane,
    start_configuration=configuration.fk_configuration,
    start_config_from_fk=set_start_config_from_fk,
    group=list_2)  # -> out, ik_configuration; inputs target_plane: Plane, group: String
# ---------- inverse_kinematcs: IronPython ----------
from scriptcontext import sticky as st

from compas_rhino.conversions import plane_to_compas_frame


if "ik_configuration" not in st or start_config_from_fk:
    st["ik_configuration"] = start_configuration

#print(group)
if robot and robot.client and robot.client.is_connected and target_plane and compute:
    
    target_frame = plane_to_compas_frame(target_plane)
    ik_configuration = robot.inverse_kinematics(target_frame, st["ik_configuration"], group)
    
    st["ik_configuration"] = ik_configuration

ik_configuration = st["ik_configuration"]
#print(ik_configuration)
# ---------- end inverse_kinematcs ----------
draw = Python3Script(planes=plane.plane, scale=Slider(0.2, range=0..1))  # -> out, P, V, C, W; inputs planes: list of Plane
# ---------- draw: Python ----------
from System.Drawing import Color


print(planes)

red = Color.FromArgb(255, 0, 0)
green = Color.FromArgb(0, 255, 0)
blue = Color.FromArgb(0, 0, 255)

P = []
V = []
C = []

scale = float(scale)

for plane in planes:
    if not plane:
        continue
    P += [plane.Origin] * 3
    V.append(plane.XAxis * scale)
    V.append(plane.YAxis * scale)
    V.append(plane.ZAxis * scale)
    C += [red, green, blue]

W = 3
# ---------- end draw ----------
vdisex = VectorDisplayEx(Point=draw.P, Vector=draw.V, Colour=draw.C, Width=draw.W)

# ----
# Visualisation
show_end_effector_frame = BooleanToggle(True)
list_4 = ValueList({"0 forward_kinematics": 0, "1 inverse_kinematics": 1}, selected="0 forward_kinematics")
show_base_frame = BooleanToggle(True)
show_collision = BooleanToggle(False)
show_frames = BooleanToggle(True)
show_visual = BooleanToggle(True)
show_acm = BooleanToggle(False)
show_cm = BooleanToggle(False)
filter_2 = StreamFilter(Gate=list_4, Stream0=configuration.fk_configuration, Stream1=inverse_kinematcs.ik_configuration)
visualise = IronPython2Script(
    robot=robot,
    group=set.main_group_name,
    configuration=filter_2,
    update_vis=attach_tool.update,
    show_visual=show_visual,
    show_collision=show_collision,
    show_frames=show_frames,
    show_base_frame=show_base_frame,
    show_end_effector_frame=show_end_effector_frame,
    show_cm=show_cm,
    show_acm=show_acm)  # -> out, visual, collision, attached_meshes, joint_planes, base_plane, ee_plane; inputs show_visual: Boolean, show_collision: Boolean, show_frames: Boolean, show_base_frame: Boolean, show_end_effector_frame: Boolean, show_cm: Boolean, show_acm: Boolean
# ---------- visualise: IronPython ----------
"""
Visualizes the robot.

COMPAS FAB v1.0.2
"""

import time

from compas.geometry import Frame
from compas.geometry import Transformation
from compas.scene import SceneObject

from compas_rhino.conversions import frame_to_rhino_plane
from scriptcontext import sticky as st

from compas_fab.backends import BackendFeatureNotSupportedError
from compas_fab.robots import PlanningScene


joint_planes, base_plane, ee_plane = [], [], []


if robot:
    configuration = configuration or robot.zero_configuration()
    robot.update(configuration, visual=show_visual, collision=show_collision)
    joint_frames = robot.transformed_frames(configuration, group)

    if show_frames:
        joint_planes = [frame_to_rhino_plane(a) for a in joint_frames]
    
    if show_base_frame:
        base_frame = joint_frames[0]
        base_plane = frame_to_rhino_plane(base_frame)
    
    if show_end_effector_frame:
        options = dict(solver="model")
        if robot.attached_tool:
            options["link"] = robot.attached_tool.connected_to
        ee_frame = robot.forward_kinematics(configuration, group, options=options)
        ee_plane = frame_to_rhino_plane(ee_frame)

    if show_visual:
        visual = robot.scene_object.draw_visual()
        #print(visual)

    if show_collision:
        collision = robot.scene_object.draw_collision()





"""

    cached_scene_key = "cached_scene"

    if show_cm or show_acm:
        cached_scene = st.get(cached_scene_key)
        if not cached_scene:
            cached_scene = {"time": 0}

        # expire cache if the component has not been executed in the last 2 seconds
        # this allows to slide through a list of configurations
        # without triggering refreshes of the scene in the middle of it
        if time.time() - cached_scene["time"] > 2:
            update_scene = True
        else:
            update_scene = False

        if update_scene:
            scene = PlanningScene(robot)
            try:
                scene = robot.client.get_planning_scene()
            except BackendFeatureNotSupportedError:
                print(
                    "The selected backend does not support collision meshes. If you need collision mesh support, use a different backend."
                )
                scene = None
                show_cm = False
                show_acm = False

        if update_scene and show_cm:
            collision_meshes = []

            for co in scene.world.collision_objects:
                header = co.header
                frame_id = header.frame_id
                cms = co.to_collision_meshes()

                for cm in cms:
                    if cm.frame != Frame.worldXY():
                        t = Transformation.from_frame(cm.frame)
                        mesh = cm.mesh.transformed(t)
                    else:
                        mesh = cm.mesh

                    collision_meshes.extend(SceneObject(mesh).draw())

                cached_scene["cm"] = collision_meshes

        collision_meshes = cached_scene.get("cm", [])

        if update_scene and show_acm:
            attached_meshes = []

            for aco in scene.robot_state.attached_collision_objects:
                for acm in aco.to_attached_collision_meshes():
                    frame_id = aco.object["header"]["frame_id"]
                    frame = robot.forward_kinematics(configuration, options=dict(link=frame_id))
                    t = Transformation.from_frame(frame)

                    # Local CM frame
                    if acm.collision_mesh.frame and acm.collision_mesh.frame != Frame.worldXY():
                        t = t * Transformation.from_frame(acm.collision_mesh.frame)

                    mesh = acm.collision_mesh.mesh.transformed(t)

                    attached_meshes.extend(SceneObject(mesh).draw())

            cached_scene["acm"] = attached_meshes

        attached_meshes = cached_scene.get("acm", [])

        cached_scene["time"] = time.time()
        st[cached_scene_key] = cached_scene
"""
# ---------- end visualise ----------
mesh = Mesh(visualise.visual)
mesh_2 = Mesh(visualise.collision)
pln = Plane(flatten([visualise.joint_planes, visualise.base_plane, visualise.ee_plane]))
preview = CustomPreview(Geometry=[mesh, mesh_2], Shader=ColourSwatch(SwatchColor=RGBA(207, 157, 160, 157)))
draw_2 = Python3Script(planes=pln, scale=Slider(0.2, range=0..1))  # -> out, P, V, C, W; inputs planes: list of Plane; same code as draw
vdisex_2 = VectorDisplayEx(Point=draw_2.P, Vector=draw_2.V, Colour=draw_2.C, Width=draw_2.W)

# ----
# Move Cartesian
cart = IronPython2Script(configuration=filter_2)  # -> out, linear_axis_value
# ---------- cart: IronPython ----------
if configuration:
    linear_axis_value = (configuration.joint_values[0])
else:
    linear_axis_value = 0
# ---------- end cart ----------
tcp_speed = Slider(250, range=0..250)
to_robtarget = Button()
to_frame = Button()
set_tool = Button()
target_planes = Plane(plane.plane)
move_linear = IronPython2Script(
    robot=robot,
    target_planes=target_planes,
    linear_axis_value=cart.linear_axis_value,
    speed=tcp_speed,
    send_set_tool_attached=set_tool,
    send_move_to_frame=to_frame,
    send_move_to_robtarget=to_robtarget)  # -> out; inputs target_planes: list, linear_axis_value: Double, send_set_tool_attached: Boolean
# ---------- move_linear: IronPython ----------
from abb_fabrication_control.commands import set_tool, set_tool_attached, move_to_frame, move_to_robtarget
from compas_rhino.conversions import plane_to_compas_frame

target_frames = [plane_to_compas_frame(target_plane) for target_plane in target_planes] # convert target plane (Rhino plane) into target frame (compas frame)
scalefactor = 1000 # m to mm conversion for ABB robot controller

if robot: print(robot.abb_client)

# set tool in RobotStudio
if send_set_tool_attached and robot.abb_client:
    success = set_tool_attached(robot, send_and_wait=False)

# move linear to frame
if send_move_to_frame and robot.abb_client:

    for i, target_frame in enumerate(target_frames):
        if i < len(target_frames)-1:
            zone = rrc.Zone.Z50
        else:
            zone = rrc.Zone.FINE

        success = move_to_frame(robot, target_frame, speed=speed, zone=zone, scalefactor=scalefactor, send_and_wait=False)

# move linear to robtarget
if send_move_to_robtarget and robot.abb_client :
    
    for i, target_frame in enumerate(target_frames):
        if i < len(target_frames)-1:
            zone = rrc.Zone.Z50
        else:
            zone = rrc.Zone.FINE

        success = move_to_robtarget(robot, target_frame, linear_axis_value, speed=speed, zone=zone, scalefactor=scalefactor, send_and_wait=False)
# ---------- end move_linear ----------

target_configuration = Data(filter_2)

# ----
# Move Joints
tcp_speed_2 = Slider(250, range=0..250)
to_joints = Button()
move_joints = IronPython2Script(robot=robot, configurations=target_configuration, speed=tcp_speed_2, send_move_to_joints=to_joints)  # -> out; inputs configurations: list
# ---------- move_joints: IronPython ----------
from abb_fabrication_control.commands import move_to_joints

scalefactor = 1000 # m to mm conversion for ABB robot controller

# move to joints
if send_move_to_joints and robot.abb_client:

    for i, configuration in enumerate(configurations):
        if i < len(configurations)-1:
            zone = rrc.Zone.Z200
        else:
            zone = rrc.Zone.FINE
        success = move_to_joints(robot, configuration, speed=speed, zone=zone, scalefactor=scalefactor, send_and_wait=False)
# ---------- end move_joints ----------

# ----
# Robot Instructions
# Motion
# Hello robot!
print = Button()
print_2 = IronPython2Script(robot=robot, send_text=print)  # -> out, a; inputs send_text: Boolean
# ---------- print_2: IronPython ----------
from abb_fabrication_control.commands import print_text

if send_text and robot.abb_client:
    print_text(robot, 'Hello Robot!!!')
# ---------- end print_2 ----------

# ----
# Digital Output
extruder_start = Button()
open_gripper = Button()
close_gripper = Button()
# Position Feedback
extruder_stop = Button()
set_do = Button()
list_5 = ValueList({"grippper": 'Ausgang_100_0'}, selected="grippper")
list_6 = ValueList({"0", "1"}, selected="0")
set_digital_output = IronPython2Script(
    robot=robot,
    digital_out_name=list_5,
    digital_out_state=list_6,
    send_set_digital_out=set_do,
    send_gripper_open=open_gripper,
    send_gripper_close=close_gripper,
    send_extruder_start=extruder_start,
    send_extruder_stop=extruder_stop)  # -> out; inputs digital_out_name: String
# ---------- set_digital_output: IronPython ----------
from abb_fabrication_control.commands import set_digital_out, open_gripper, open_gripper

if send_set_digital_out and robot.abb_client:
    set_digital_out(robot, digital_out_name, output_state=digital_out_state, send_and_wait=False)

if send_gripper_open and robot.abb_client:
    open_gripper(robot)

if send_gripper_close and robot.abb_client:
    close_gripper(robot)

if send_extruder_start and robot.abb_client:
    pass #TODO

if send_extruder_stop and robot.abb_client:
    pass #TODO
# ---------- end set_digital_output ----------

get_robtarget = Button()
get_frame = Button()
get_joints = Button()
feedback = IronPython2Script(robot=robot, send_get_frame=get_frame, send_get_robtarget=get_robtarget, send_get_joints=get_joints)  # -> out, current_plane, current_axis_value, current_configuration
# ---------- feedback: IronPython ----------
from scriptcontext import sticky as st
from abb_fabrication_control.commands import set_tool, move_to_frame, move_to_robtarget
from compas_rhino.conversions import frame_to_rhino


if "current_frame_key" not in st:
    st["current_frame_key"] = None

if "current_robtarget_key" not in st:
    st["current_robtarget_key"] = None

if "current_configuration_key" not in st:
    st["current_configuration_key"] = None


# get values from ABB robot controller
if send_get_frame:
    current_frame = get_frame(robot, scalefactor=0.001)
    st["current_frame_key"] = current_frame

if send_get_robtarget:
    current_robtarget = get_robtarget(robot, scalefactor=0.001)
    st["current_robtarget_key"] = current_robtarget


if send_get_joints:
    current_configuration = get_joints(robot, scalefactor=0.001)
    st["current_configuration_key"] = current_configuration



# sticky
current_frame = st["current_frame_key"]
if current_frame:
    current_plane = frame_to_rhino(current_frame)
else:
    current_plane = []


current_robtarget = st["current_robtarget_key"]
if current_robtarget:
    current_frame, current_axis_value = current_robtarget
    current_plane = frame_to_rhino(current_frame)
else: 
    current_plane, current_axis_value = [], 0

current_configuration = st["current_configuration_key"]
if st["current_configuration_key"]:
    current_configuration = st["current_configuration_key"]
else:
    if robot:
        current_configuration = robot.model.zero_configuration()
    else:
        current_configuration = None
# ---------- end feedback ----------
draw_3 = Python3Script(planes=feedback.current_plane, scale=Slider(0.2, range=0..1))  # -> out, P, V, C, W; inputs planes: list of Plane; same code as draw
vdisex_3 = VectorDisplayEx(Point=draw_3.P, Vector=draw_3.V, Colour=draw_3.C, Width=draw_3.W)

# ==== cluster Tools
# other tools ...
yaxis_line = Curve(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)
xaxis_line = Curve(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)

# ----
# measurement tool
geo = Geometry(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)
mesh = Mesh(geo)
show = BooleanToggle(False)
mjoin = MeshJoin(Meshes=mesh)
xaxis_line_2 = Curve(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)
yaxis_line_2 = Curve(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)
tool = IronPython2Script(name="mortar_extruder", visual_mesh=mjoin, xline=xaxis_line, yline=yaxis_line, show=show)  # -> out, tool, tool_plane, tool_geometry, tool_frame_rs; inputs name: String, visual_mesh: Mesh, xline: Curve, yline: Curve
# ---------- tool: IronPython ----------
from __future__ import print_function

import Rhino.Geometry as rg
import os, math
from compas.geometry import Frame, Rotation
from compas.datastructures import Mesh
from compas_fab.robots import Tool


from compas_rhino.conversions import plane_to_compas_frame, mesh_to_compas, mesh_to_rhino

xaxis = rg.Line(xline.PointAtStart, xline.PointAtEnd)
yaxis = rg.Line(yline.PointAtStart, yline.PointAtEnd)

if xaxis.From.DistanceTo(yaxis.From) < 0.01:
    origin = xaxis.From
    xaxis = xaxis.Direction
    yaxis = yaxis.Direction
elif xaxis.To.DistanceTo(yaxis.To) < 0.01:
    origin = xaxis.To
    xaxis = -xaxis.Direction
    yaxis = -yaxis.Direction
elif xaxis.From.DistanceTo(yaxis.To) < 0.01:
    origin = xaxis.From
    xaxis = xaxis.Direction
    yaxis = -yaxis.Direction
elif xaxis.To.DistanceTo(yaxis.From) < 0.01:
    origin = xaxis.To
    xaxis = -xaxis.Direction
    yaxis = yaxis.Direction

xaxis.Unitize()
yaxis.Unitize()

plane = rg.Plane(origin, xaxis, yaxis)

frame = plane_to_compas_frame(plane) # convert to copmas frame
c_visual_mesh = mesh_to_compas(visual_mesh) # convert to compas mesh

# create Tool
# tool = Tool(c_visual_mesh, frame, name=name, connected_to="tool0")
tool = Tool(c_visual_mesh, frame, name=name)

# create values for Robot Studio tool (in mm and quaternion format)
tool_frame_rs = [[entry*1000 for entry in list(frame.point)], list(frame.quaternion)]

# round values
tool_frame_rs = str([[round(v, 5) for v in tool_frame_rs[0]], [round(v, 5) for v in tool_frame_rs[1]]])


if show:
    #print(("The tool {} will be connected to {}").format(tool.name, tool.connected_to))
    tool_plane = plane
    tool_geometry = mesh_to_rhino(c_visual_mesh)
else: 
    tool_plane = []
    tool_geometry = []
# ---------- end tool ----------
values_for_abb_robot_studio = Panel(tool.tool_frame_rs)
mesh_2 = Mesh(tool.tool_geometry)
preview = CustomPreview(Geometry=mesh_2, Shader=ColourSwatch(SwatchColor=RGBA(207, 157, 160, 157)))
draw = Python3Script(planes=tool.tool_plane, scale=Slider(0.2, range=0..1))  # -> out, P, V, C, W; inputs planes: list of Plane
# ---------- draw: Python ----------
from System.Drawing import Color

red = Color.FromArgb(255, 0, 0)
green = Color.FromArgb(0, 255, 0)
blue = Color.FromArgb(0, 0, 255)

P = []
V = []
C = []

scale = float(scale)

for plane in planes:
    if not plane:
        continue
    P += [plane.Origin] * 3
    V.append(plane.XAxis * scale)
    V.append(plane.YAxis * scale)
    V.append(plane.ZAxis * scale)
    C += [red, green, blue]

W = 3
# ---------- end draw ----------
vdisex = VectorDisplayEx(Point=draw.P, Vector=draw.V, Colour=draw.C, Width=draw.W)

mesh_3 = Mesh(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)
mesh_4 = Mesh(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)

# ----
# Tools
# mortar extruder
panel = Panel("mortar_extruder")
show_2 = BooleanToggle(False)
yaxis_line_3 = Curve(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)
xaxis_line_3 = Curve(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)
tool_2 = IronPython2Script(name=panel, visual_mesh=mesh_3, collision_mesh=mesh_4, xline=xaxis_line_3, yline=yaxis_line_3, show=show_2)  # -> out, tool, tool_plane, tool_geometry, tool_frame_rs; inputs name: String, visual_mesh: Mesh, collision_mesh: Mesh, xline: Curve, yline: Curve
# ---------- tool_2: IronPython ----------
from __future__ import print_function

import Rhino.Geometry as rg
import os, math
from compas.geometry import Frame, Rotation
from compas.datastructures import Mesh
from compas_fab.robots import Tool


from compas_rhino.conversions import plane_to_compas_frame, mesh_to_compas, mesh_to_rhino

xaxis = rg.Line(xline.PointAtStart, xline.PointAtEnd)
yaxis = rg.Line(yline.PointAtStart, yline.PointAtEnd)

if xaxis.From.DistanceTo(yaxis.From) < 0.01:
    origin = xaxis.From
    xaxis = xaxis.Direction
    yaxis = yaxis.Direction
elif xaxis.To.DistanceTo(yaxis.To) < 0.01:
    origin = xaxis.To
    xaxis = -xaxis.Direction
    yaxis = -yaxis.Direction
elif xaxis.From.DistanceTo(yaxis.To) < 0.01:
    origin = xaxis.From
    xaxis = xaxis.Direction
    yaxis = -yaxis.Direction
elif xaxis.To.DistanceTo(yaxis.From) < 0.01:
    origin = xaxis.To
    xaxis = -xaxis.Direction
    yaxis = yaxis.Direction

xaxis.Unitize()
yaxis.Unitize()

plane = rg.Plane(origin, xaxis, yaxis)

frame = plane_to_compas_frame(plane) # convert to copmas frame
c_visual_mesh = mesh_to_compas(visual_mesh) # convert to compas mesh
c_collision_mesh = mesh_to_compas(collision_mesh) # convert to compas mesh

# create Tool
# tool = Tool(c_visual_mesh, frame, name=name, connected_to="tool0")
tool = Tool(c_visual_mesh, frame, collision=c_collision_mesh, name=name)



# create values for Robot Studio tool (in mm and quaternion format)
tool_frame_rs = [[entry*1000 for entry in list(frame.point)], list(frame.quaternion)]

# round values
tool_frame_rs = str([[round(v, 5) for v in tool_frame_rs[0]], [round(v, 5) for v in tool_frame_rs[1]]])


if show:
    #print(("The tool {} will be connected to {}").format(tool.name, tool.connected_to))
    tool_plane = plane
    tool_geometry = mesh_to_rhino(c_visual_mesh)
else: 
    tool_plane = []
    tool_geometry = []
# ---------- end tool_2 ----------
values_for_abb_robot_studio_2 = Panel(tool_2.tool_frame_rs)
mesh_5 = Mesh(tool_2.tool_geometry)
preview_2 = CustomPreview(Geometry=mesh_5, Shader=ColourSwatch(SwatchColor=RGBA(207, 157, 160, 157)))
draw_2 = Python3Script(planes=tool_2.tool_plane, scale=Slider(0.2, range=0..1))  # -> out, P, V, C, W; inputs planes: list of Plane; same code as draw
vdisex_2 = VectorDisplayEx(Point=draw_2.P, Vector=draw_2.V, Colour=draw_2.C, Width=draw_2.W)

tool_3 = ClusterOutput(tool_2.tool)
tool_4 = ClusterOutput(tool.tool)
