# Grasshopper definition 03_fabtory_moveit_simulation_robot_control_rh8_py27_EK.gh (Grasshopper 1.0.8)
# plug-ins: RhinoCodePluginGH

# ----
# Unload Python
# modules
button = Button()
unload = IronPython2Script(unload=button)  # -> out
# ---------- unload: IronPython ----------
from compas_rhino import unload_modules

unload_modules("abb_fabrication_control")
unload_modules("extruder_control")
unload_modules("fabrication_manager")
# ---------- end unload ----------

# ----
# PATHS
path = IronPython2Script()  # -> out, HERE, DATA, ROBOT_DESCRIPTION
# ---------- path: IronPython ----------
import os

HERE = os.path.dirname(ghdoc.Path)
DATA = os.path.abspath(os.path.join(HERE, "..", "data"))
ROBOT_DESCRIPTION = os.path.abspath(os.path.join(DATA, "robot_description"))

#print(HERE)
#print(DATA)
#print(ROBOT_DESCRIPTION)
# ---------- end path ----------

# ----
# Model
load = Button()
list = ValueList({"abb_fabtory"}, selected="abb_fabtory")
load_model_local = IronPython2Script(path=path.ROBOT_DESCRIPTION, package=list, urdf_name="abb_fabtory.urdf", srdf_name="abb_fabtory.srdf", load=load)  # -> out, robot; inputs path: String, urdf_name: String, srdf_name: String
# ---------- load_model_local: IronPython ----------
import os
from scriptcontext import sticky as st

import compas
import compas_fab
import compas_robots

from compas_robots import RobotModel
from compas_robots.resources import LocalPackageMeshLoader

from compas_fab.robots import Robot
from compas_fab.robots import RobotSemantics

from compas_robots.scene import BaseRobotModelObject
from compas.scene import SceneObject

packages = ["abb_irb6700_support", "abb_end_effectors", "abb_fabtory"]
loaders = []

for package in packages:
    loaders.append(LocalPackageMeshLoader(path, package))

#path directory
package_path = os.path.join(path, package)
#print(package_path)

urdf_filename = os.path.join(package_path, "urdf", urdf_name)
srdf_filename = os.path.join(package_path, srdf_name)

assert os.path.isfile(urdf_filename)
assert os.path.isfile(srdf_filename)

compas.PRECISION = '12f'

# store robot in component
guid = str(ghenv.Component.InstanceGuid)
robot_key = "robot_" + guid
robot_model_key = "robot_model_" + guid

if robot_key not in st:
    st[robot_key] = None
    st[robot_model_key] = None

#load robot model from urdf
if load:

    # Create robot model from URDF
    model = RobotModel.from_urdf_file(urdf_filename)
    model.load_geometry(*loaders, precision=12)

    semantics = RobotSemantics.from_srdf_file(srdf_filename, model)
    scene_object = SceneObject(model)
    robot = Robot(model=model, scene_object=scene_object, semantics=semantics, client=None)
    
    st[robot_key] = robot
    st[robot_model_key] = model

robot = st[robot_key]
robot_model = st[robot_model_key]

if robot:
    print(robot.info())

    #print robot.get_end_effector_link_name(robot.main_group_name)
# ---------- end load_model_local ----------

connect = Button()
close = Button()

# ----
# Clients
ros_ip = ValueList({"127.0.0.1"}, selected="127.0.0.1")
ros_port = ValueList({"9090"}, selected="9090")
clients = IronPython2Script(ip=ros_ip, port=ros_port, connect=connect, close=close)  # -> out, ros_client, abb_client, is_connected
# ---------- clients: IronPython ----------
from scriptcontext import sticky as st

import compas_rrc as rrc
from compas_fab.backends import RosClient

if 'ros_client' not in st:
    st['ros_client'] = None
    st['abb_client'] = None
    st['is_connected'] = False

if close:
    st['ros_client'].close()
    st['ros_client'] = None
    st['abb_client'] = None
    st['is_connected'] = False

if connect:
    ros_client = RosClient(ip, port)
    try:
        ros_client.run(2)
    except:
        print('Cannot connect to ROS Client')
    
    
    st['is_connected'] = ros_client.is_connected if ros_client else False

    if st['is_connected']:
        abb_client = rrc.AbbClient(ros_client, '/rob1')

        st['ros_client'] = ros_client
        st['abb_client'] = abb_client

is_connected = st['is_connected']
ros_client = st['ros_client']
abb_client = st['abb_client']

print('ROS Client: ', ros_client)
print('ABB Client: ', abb_client)
print('is connected: ', is_connected)
# ---------- end clients ----------
is_connected = Panel(clients.is_connected)
set = IronPython2Script(robot=load_model_local.robot, ros_client=clients.ros_client, abb_client=clients.abb_client)  # -> out, robot, main_group_name
# ---------- set: IronPython ----------
if robot and ros_client and abb_client:
    robot.ros_client = robot.client = ros_client
    robot.abb_client = abb_client
    main_group_name = robot.main_group_name
# ---------- end set ----------

# ----
# Robot
panel = Panel(load_model_local.out)

tools = Tools()  # -> tool_5, tool_6, tool_4
attach = Button()
set_start_config_from_fk = Button()
list_2 = ValueList({"manipulator", "manipulator with axis": "manipulator_axis"}, selected="manipulator with axis")

robot = Data(set.robot)

# ----
# Attach and remove tools
list_3 = ValueList({"mortar_extruder": 0, "measurement_tool": 1, "earth_stamper": 2, "gripper_with_mortar_extruder": 2, "gripper_timber": 3}, selected="earth_stamper")
detach = Button()
filter = StreamFilter(Gate=list_3, Stream0=tools.tool_5, Stream1=tools.tool_6, Stream2=tools.tool_4)
attach_tool = IronPython2Script(tool=filter, robot=robot, group=set.main_group_name, attach=attach, detach=detach)  # -> out, update; inputs attach: Boolean, detach: Boolean
# ---------- attach_tool: IronPython ----------
if robot and robot.client and robot.client.is_connected and tool:

    if attach:
        robot.attach_tool(tool, group)
    if detach:
        robot.detach_tool()
# ---------- end attach_tool ----------

# ----
# forward kinematics
number_slider = Slider(30, range=-180..180)
# Configuration
number_slider_2 = Slider(3.902, range=0..4.2)
reset_button = Button()
configuration = IronPython2Script(
    reset=reset_button,
    robot=load_model_local.robot,
    a_cart=number_slider_2,
    a_a1=Slider(-90, range=-180..180),
    a_a2=Slider(0, range=-90..150),
    a_a3=number_slider,
    a_a4=Slider(0, range=-400..400),
    a_a5=Slider(0, range=-125..120),
    a_a6=Slider(0, range=-400..400))  # -> out, fk_configuration
# ---------- configuration: IronPython ----------
import math
import Grasshopper

import Rhino
import scriptcontext as sc

from compas_robots.model import Joint
from compas_robots import Configuration

#reset = True
if reset:
    cart = 2.0
    joint_values = [-90,0,30,0,0,0]
    configuration_values = [cart] + joint_values

    j = 0
    for i in range(ghenv.Component.Params.Input.Count):
        nslider = ghenv.Component.Params.Input[i].Sources[0]
        if nslider.GetType() == Grasshopper.Kernel.Special.GH_NumberSlider:
            nslider.TrySetSliderValue(configuration_values[j])
            j += 1


if robot:
    joint_positions = [a_cart, a_a1, a_a2, a_a3, a_a4, a_a5, a_a6]
    print ("joint positions: ", joint_positions)
    joint_types = robot.model.get_joint_types()
    print("joint types: ", joint_types)
    joint_names = robot.model.get_configurable_joint_names()
    print("joint names: ", joint_names)

    for i, joint_type in enumerate(joint_types):
        if joint_type == Joint.REVOLUTE:
            joint_positions[i] = math.radians(joint_positions[i])
        if joint_type == Joint.PRISMATIC:
            joint_positions[i] = joint_positions[i]
    
    fk_configuration = Configuration(joint_positions, joint_types, joint_names)
    print ("configuration: ", fk_configuration)
# ---------- end configuration ----------

pt = ConstructPoint(XCoordinate=0, YCoordinate=0, ZCoordinate=0)
pt_2 = Point(<point referenced from the Rhino model>)
vec2pt = Vector2Pt(PointA=pt, PointB=pt_2, Unitize=False)  # -> Vector, Length

# ----
# Component
number_slider_3 = Slider(39, range=0..100)
mesh = Mesh(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)
move_component = MoveComponent(G=mesh, X=Slider(35, range=0..100), Y=number_slider_3, Z=Slider(8, range=0..100), D=Slider(0, range=0..100))

# ----
# Robot Instructions
# Motion
# Hello robot!
print = Button()
print_2 = IronPython2Script(robot=robot, send_text=print)  # -> out, a; inputs send_text: Boolean
# ---------- print_2: IronPython ----------
from abb_fabrication_control.commands import print_text

if send_text and robot.abb_client:
    print_text(robot, 'Hello Robot!!!')
# ---------- end print_2 ----------

# ----
# Digital Output
close_extruder = Button()
# Position Feedback
open_extruder = Button()
set_digital_out = Button()
single_stamp = Button()
list_4 = ValueList({"1": 'Ausgang_100_1', "2": 'Ausgang_100_2', "3": 'Ausgang_100_3', "4": 'Ausgang_100_4', "5": 'Ausgang_100_5', "6": 'Ausgang_100_6', "7": 'Ausgang_100_7'}, selected="5")
list_5 = ValueList({"0", "1"}, selected="0")
set_digital_output = IronPython2Script(
    robot=robot,
    digital_out_name=list_4,
    digital_out_state=list_5,
    send_set_digital_out=set_digital_out,
    send_single_stamp=single_stamp,
    send_extruder_open=close_extruder,
    send_extruder_close=open_extruder)  # -> out; inputs digital_out_name: String
# ---------- set_digital_output: IronPython ----------
from abb_fabrication_control.commands.input_output import set_digital_out, open_extruder, close_extruder, single_stamp
import compas_rrc as rrc

if send_set_digital_out and robot.abb_client:
    set_digital_out(robot, output_name=digital_out_name, output_state=digital_out_state, send_and_wait=False)

if send_extruder_open and robot.abb_client:
    open_extruder(robot, send_and_wait=False)

if send_extruder_close and robot.abb_client:
    close_extruder(robot, send_and_wait=False)

if send_single_stamp and robot.abb_client:
    single_stamp(robot, send_and_wait=False)

#print(robot.attached_tool.name)
# ---------- end set_digital_output ----------

get_robtarget = Button()
get_frame = Button()
get_joints = Button()
feedback = IronPython2Script(robot=robot, send_get_frame=get_frame, send_get_robtarget=get_robtarget, send_get_joints=get_joints)  # -> out, current_plane, current_axis_value, current_configuration
# ---------- feedback: IronPython ----------
from scriptcontext import sticky as st
from abb_fabrication_control.commands import set_tool, move_to_frame, move_to_robtarget
from compas_rhino.conversions import frame_to_rhino


if "current_frame_key" not in st:
    st["current_frame_key"] = None

if "current_robtarget_key" not in st:
    st["current_robtarget_key"] = None

if "current_configuration_key" not in st:
    st["current_configuration_key"] = None


# get values from ABB robot controller
if send_get_frame:
    current_frame = get_frame(robot, scalefactor=0.001)
    st["current_frame_key"] = current_frame

if send_get_robtarget:
    current_robtarget = get_robtarget(robot, scalefactor=0.001)
    st["current_robtarget_key"] = current_robtarget


if send_get_joints:
    current_configuration = get_joints(robot, scalefactor=0.001)
    st["current_configuration_key"] = current_configuration



# sticky
current_frame = st["current_frame_key"]
if current_frame:
    current_plane = frame_to_rhino(current_frame)
else:
    current_plane = []


current_robtarget = st["current_robtarget_key"]
if current_robtarget:
    current_frame, current_axis_value = current_robtarget
    current_plane = frame_to_rhino(current_frame)
else: 
    current_plane, current_axis_value = [], 0

current_configuration = st["current_configuration_key"]
if st["current_configuration_key"]:
    current_configuration = st["current_configuration_key"]
else:
    if robot:
        current_configuration = robot.model.zero_configuration()
    else:
        current_configuration = None
# ---------- end feedback ----------
draw = Python3Script(planes=feedback.current_plane, scale=Slider(0.2, range=0..1))  # -> out, P, V, C, W; inputs planes: list of Plane
# ---------- draw: Python ----------
from System.Drawing import Color


print(planes)

red = Color.FromArgb(255, 0, 0)
green = Color.FromArgb(0, 255, 0)
blue = Color.FromArgb(0, 0, 255)

P = []
V = []
C = []

scale = float(scale)

for plane in planes:
    if not plane:
        continue
    P += [plane.Origin] * 3
    V.append(plane.XAxis * scale)
    V.append(plane.YAxis * scale)
    V.append(plane.ZAxis * scale)
    C += [red, green, blue]

W = 3
# ---------- end draw ----------
vdisex = VectorDisplayEx(Point=draw.P, Vector=draw.V, Colour=draw.C, Width=draw.W)

# ----
# Generate ✳
filament_width = Slider(20, range=0..30)
generate_toolpath = Button()
layer_height = Slider(10, range=0..20)

number_slider_4 = Slider(0.001, range=0..0.001)
number_slider_5 = Slider(1, range=0..100)

# ----
# Particle bed
number_slider_6 = Slider(701, range=0..1200)
length = Slider(741, range=0..1200)
width = Slider(938, range=0..1200)
particle_bed = ParticleBed(B_2=width, B=length, H=number_slider_6)

scale = Scale(Geometry=particle_bed, Center=Point(0, 0, 0), Factor=number_slider_4)  # -> Geometry, Transform
move = Move(Geometry=scale.Geometry, Motion=vec2pt.Vector)  # -> Geometry, Transform

preview = CustomPreview(Geometry=move.Geometry, Material=ColourSwatch(SwatchColor=RGBA(159, 139, 224, 26)))

# ----
# inverse kinematics
x_axis = Curve(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)
y_axis = Curve(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)
plane = Python3Script(plane_axes=[x_axis, y_axis])  # -> out, plane; inputs plane_axes: list of Curve
# ---------- plane: Python ----------
import Rhino.Geometry as rg

x_axis, y_axis = plane_axes

x_axis = rg.Line(x_axis.PointAtStart, x_axis.PointAtEnd)
y_axis = rg.Line(y_axis.PointAtStart, y_axis.PointAtEnd)

if x_axis.From.DistanceTo(y_axis.From) < 0.01:
    origin = x_axis.From
    xvec = x_axis.Direction
    yvec = y_axis.Direction
elif x_axis.To.DistanceTo(y_axis.To) < 0.01:
    origin = x_axis.To
    xvec = -x_axis.Direction
    yvec = -y_axis.Direction
elif x_axis.From.DistanceTo(y_axis.To) < 0.01:
    origin = x_axis.From
    xvec = x_axis.Direction
    yvec = -y_axis.Direction
elif x_axis.To.DistanceTo(y_axis.From) < 0.01:
    origin = x_axis.To
    xvec = -x_axis.Direction
    yvec = y_axis.Direction

plane = rg.Plane(origin, xvec, yvec)
# ---------- end plane ----------
compute_ik = Button()
draw_2 = Python3Script(planes=plane.plane, scale=Slider(0.2, range=0..1))  # -> out, P, V, C, W; inputs planes: list of Plane; same code as draw
vdisex_2 = VectorDisplayEx(Point=draw_2.P, Vector=draw_2.V, Colour=draw_2.C, Width=draw_2.W)

# ----
# Create tasks
# Start fabrication
# State viewer
create = Button()
start_fabrication = Button()
stop_fabrication = Button()
preview_task = Button()
reset_task = Button()
next_task = Button()
set_tasks = Button()
reset = Button()
init = Button()
trigger = Trigger(Interval=1000, TimerInterval=1000, Target=fabrication_state)  # disabled
fabrication_state = IronPython2Script()  # -> out, state, num_tasks, num_current_task, num_tasks_left, log_messages
# ---------- fabrication_state: IronPython ----------
from scriptcontext import sticky as st

fabrication = st["fabrication"]

if hasattr(fabrication, "task_thread"):
    if fabrication.task_thread.is_alive():
        state = "THREAD RUNNING"
    else:
        state = "THREAD STOPPED"
print(fabrication.current_task_key)
num_tasks = len(fabrication.tasks)
if fabrication.current_task_key is not None:
    num_current_task = fabrication.current_task_key-1
else:
    num_current_task = 0

num_tasks_left = num_tasks-num_current_task
log_messages = fabrication.log_messages
# ---------- end fabrication_state ----------
state = Panel(fabrication_state.state)
num_tasks = Panel(fabrication_state.num_tasks)
num_current_task = Panel(fabrication_state.num_current_task)
num_tasks_left = Panel(fabrication_state.num_tasks_left)
log_messages = Panel(fabrication_state.log_messages)

# ----
# Move Cartesian
tcp_speed = Slider(250, range=0..250)
to_robtarget = Button()
to_frame = Button()
set_tool = Button()
target_planes = Plane(plane.plane)

# ----
# Move Joints
tcp_speed_2 = Slider(105, range=0..250)
to_joints = Button()

# ----
# Visualisation
show_end_effector_frame = BooleanToggle(True)
list_6 = ValueList({"0 forward_kinematics": 0, "1 inverse_kinematics": 1}, selected="1 inverse_kinematics")
show_base_frame = BooleanToggle(True)
show_collision = BooleanToggle(False)
show_frames = BooleanToggle(True)
show_visual = BooleanToggle(True)
show_acm = BooleanToggle(False)
show_cm = BooleanToggle(False)

# ----
# Slicer
contour = Contour(geometry=move_component, layer_height=layer_height)
toolpath_generator = Python3Script(generate=generate_toolpath, contour_curves=contour, filament_width=filament_width)  # -> toolpath_curves; inputs generate: Boolean, contour_curves: list, filament_width: Double
# ---------- toolpath_generator: Python ----------
import Rhino
import rhinoscriptsyntax as rs
from scriptcontext import sticky as st
from Rhino.Geometry import Plane, Point3d, Vector3d, Mesh, CurveOrientation, Polyline, CurveOffsetCornerStyle, Curve

if generate:
    # Initialize variables
    toolpath_curves = []  # List of all curves

    # Process each boundary curve and offset it
    for contour_curve in contour_curves:
        
        points = []

        previous_curve = contour_curve  # Start with the boundary curve
                
        l = 0.5 # The first curve is offset with half of filament width

        while previous_curve:
            
            if previous_curve != contour_curve:
                point_parameters = previous_curve.DivideByLength(filament_width, True)
                
                if point_parameters:
                    for i in point_parameters:
                        points.append(previous_curve.PointAt(i))
                    points.pop()  # Remove last point to avoid overlap

            k = 1 if previous_curve.ClosedCurveOrientation() == CurveOrientation(1) else -1  # Determine offset direction
            
            # Offset the curve to create the next one
            offset_curve = previous_curve.Offset(Plane.WorldXY, -k*l*filament_width, 0.1, CurveOffsetCornerStyle(3))
            
            l = 1 # All the other curves are offset with a full filament width
            
            if offset_curve:

                # Find the closest point to continue the seam for a closed curve
                p = offset_curve[0].ClosestPoint(previous_curve.PointAtStart)[1]
                previous_curve = offset_curve[0]
                previous_curve.ChangeClosedCurveSeam(p)  # Adjust the seam 
            
            else:
                # If offset fails, finish the layer by creating a polyline curve from points
                if points:
                    toolpath_curves.append(Polyline(points))  # Create and store a polyline for each layer
                    st['toolpath_curves'] = toolpath_curves
                break
            
 
toolpath_curves = st['toolpath_curves']
# ---------- end toolpath_generator ----------
layer = Slider(43, range=0..100)

scale_2 = Scale(Geometry=contour, Center=Point(0, 0, 0), Factor=number_slider_4)  # -> Geometry, Transform
scale_3 = Scale(Geometry=toolpath_generator, Center=Point(0, 0, 0), Factor=number_slider_4)  # -> Geometry, Transform
move_2 = Move(Geometry=scale_2.Geometry, Motion=vec2pt.Vector)  # -> Geometry, Transform
move_3 = Move(Geometry=scale_3.Geometry, Motion=vec2pt.Vector)  # -> Geometry, Transform

item = ListItem(List=move_3.Geometry, Index=number_slider_5, Wrap=True)
preview_2 = CustomPreview(Geometry=move_2.Geometry, Material=ColourSwatch(SwatchColor=RGBA(237, 237, 159, 73)))
preview_3 = CustomPreview(Geometry=item, Material=ColourSwatch(SwatchColor=RGB(161, 22, 140)))

frames = Python3Script(generate_frames=Toggle(True), offset_curves=move_3.Geometry, layer_number=number_slider_5)  # -> out, all_frame_layers, offset_curves, all_frames, one_frame_layer; inputs generate_frames: Boolean, offset_curves: list of Curve, layer_number: Int32
# ---------- frames: Python ----------
from compas_rhino.conversions import plane_to_rhino
from compas.geometry import Frame
import Rhino
from Rhino.Geometry.Intersect import Intersection
from Rhino.Geometry import Plane, Point3d, Vector3d, Curve, Brep, CurveOffsetCornerStyle, Polyline, Mesh, CurveOrientation

all_frame_layers = []

all_points = []

if generate_frames:
    for curve in offset_curves:
        if curve.GetLength() < 0.015:
            offset_curves.remove(curve)
            #points.append(curve.PointAtStart)
            #points.append(curve.PointAtEnd)

    for curve in offset_curves:
        points = []
        point_parameters = curve.DivideByLength(0.015, True)
        if point_parameters:
            for i in point_parameters:
                points.append(curve.PointAt(i))
                all_points.append(curve.PointAt(i))

        # Create a list of frames for each layer
        planes = [Plane(Point3d(pt.X, pt.Y, pt.Z),Vector3d(1, 0, 0), Vector3d(0, -1, 0)) for pt in points] #normal orientation
        all_frames = [Plane(Point3d(pt.X, pt.Y, pt.Z),Vector3d(1, 0, 0), Vector3d(0, -1, 0)) for pt in all_points]
        #frames = [Frame([pt.X, pt.Y, pt.Z], [1, 1, 0], [1, -1, 0]) for pt in points]  #Rotated 45 degrees
        all_frame_layers.append(planes) 
        

one_frame_layer = all_frame_layers[layer_number]
# ---------- end frames ----------
geo = Geometry(frames.all_frames)
item_2 = ListItem(List=frames.one_frame_layer, Index=Slider(57, range=0..100), Wrap=True)

inverse_kinematcs = IronPython2Script(
    compute=compute_ik,
    robot=robot,
    target_plane=item_2,
    start_configuration=configuration.fk_configuration,
    start_config_from_fk=set_start_config_from_fk,
    group=list_2)  # -> out, ik_configuration; inputs target_plane: Plane, group: String
# ---------- inverse_kinematcs: IronPython ----------
from scriptcontext import sticky as st

from compas_rhino.conversions import plane_to_compas_frame


if "ik_configuration" not in st or start_config_from_fk:
    st["ik_configuration"] = start_configuration

#print(group)
if robot and robot.client and robot.client.is_connected and target_plane and compute:
    
    target_frame = plane_to_compas_frame(target_plane)
    ik_configuration = robot.inverse_kinematics(target_frame, st["ik_configuration"], group)
    
    st["ik_configuration"] = ik_configuration

ik_configuration = st["ik_configuration"]
#print(ik_configuration)
# ---------- end inverse_kinematcs ----------

filter_2 = StreamFilter(Gate=list_6, Stream0=configuration.fk_configuration, Stream1=inverse_kinematcs.ik_configuration)
visualise = IronPython2Script(
    robot=robot,
    group=set.main_group_name,
    configuration=filter_2,
    update_vis=attach_tool.update,
    show_visual=show_visual,
    show_collision=show_collision,
    show_frames=show_frames,
    show_base_frame=show_base_frame,
    show_end_effector_frame=show_end_effector_frame,
    show_cm=show_cm,
    show_acm=show_acm)  # -> out, visual, collision, attached_meshes, joint_planes, base_plane, ee_plane; inputs show_visual: Boolean, show_collision: Boolean, show_frames: Boolean, show_base_frame: Boolean, show_end_effector_frame: Boolean, show_cm: Boolean, show_acm: Boolean
# ---------- visualise: IronPython ----------
"""
Visualizes the robot.

COMPAS FAB v1.0.2
"""

import time

from compas.geometry import Frame
from compas.geometry import Transformation
from compas.scene import SceneObject

from compas_rhino.conversions import frame_to_rhino_plane
from scriptcontext import sticky as st

from compas_fab.backends import BackendFeatureNotSupportedError
from compas_fab.robots import PlanningScene


joint_planes, base_plane, ee_plane = [], [], []


if robot:
    configuration = configuration or robot.zero_configuration()
    robot.update(configuration, visual=show_visual, collision=show_collision)
    joint_frames = robot.transformed_frames(configuration, group)

    if show_frames:
        joint_planes = [frame_to_rhino_plane(a) for a in joint_frames]
    
    if show_base_frame:
        base_frame = joint_frames[0]
        base_plane = frame_to_rhino_plane(base_frame)
    
    if show_end_effector_frame:
        options = dict(solver="model")
        if robot.attached_tool:
            options["link"] = robot.attached_tool.connected_to
        ee_frame = robot.forward_kinematics(configuration, group, options=options)
        ee_plane = frame_to_rhino_plane(ee_frame)

    if show_visual:
        visual = robot.scene_object.draw_visual()
        #print(visual)

    if show_collision:
        collision = robot.scene_object.draw_collision()





"""

    cached_scene_key = "cached_scene"

    if show_cm or show_acm:
        cached_scene = st.get(cached_scene_key)
        if not cached_scene:
            cached_scene = {"time": 0}

        # expire cache if the component has not been executed in the last 2 seconds
        # this allows to slide through a list of configurations
        # without triggering refreshes of the scene in the middle of it
        if time.time() - cached_scene["time"] > 2:
            update_scene = True
        else:
            update_scene = False

        if update_scene:
            scene = PlanningScene(robot)
            try:
                scene = robot.client.get_planning_scene()
            except BackendFeatureNotSupportedError:
                print(
                    "The selected backend does not support collision meshes. If you need collision mesh support, use a different backend."
                )
                scene = None
                show_cm = False
                show_acm = False

        if update_scene and show_cm:
            collision_meshes = []

            for co in scene.world.collision_objects:
                header = co.header
                frame_id = header.frame_id
                cms = co.to_collision_meshes()

                for cm in cms:
                    if cm.frame != Frame.worldXY():
                        t = Transformation.from_frame(cm.frame)
                        mesh = cm.mesh.transformed(t)
                    else:
                        mesh = cm.mesh

                    collision_meshes.extend(SceneObject(mesh).draw())

                cached_scene["cm"] = collision_meshes

        collision_meshes = cached_scene.get("cm", [])

        if update_scene and show_acm:
            attached_meshes = []

            for aco in scene.robot_state.attached_collision_objects:
                for acm in aco.to_attached_collision_meshes():
                    frame_id = aco.object["header"]["frame_id"]
                    frame = robot.forward_kinematics(configuration, options=dict(link=frame_id))
                    t = Transformation.from_frame(frame)

                    # Local CM frame
                    if acm.collision_mesh.frame and acm.collision_mesh.frame != Frame.worldXY():
                        t = t * Transformation.from_frame(acm.collision_mesh.frame)

                    mesh = acm.collision_mesh.mesh.transformed(t)

                    attached_meshes.extend(SceneObject(mesh).draw())

            cached_scene["acm"] = attached_meshes

        attached_meshes = cached_scene.get("acm", [])

        cached_scene["time"] = time.time()
        st[cached_scene_key] = cached_scene
"""
# ---------- end visualise ----------
mesh_2 = Mesh(visualise.visual)
mesh_3 = Mesh(visualise.collision)
pln = Plane(flatten([visualise.joint_planes, visualise.base_plane, visualise.ee_plane]))
preview_4 = CustomPreview(Geometry=[mesh_2, mesh_3], Shader=ColourSwatch(SwatchColor=RGBA(207, 157, 160, 157)))
draw_3 = Python3Script(planes=pln, scale=Slider(0.2, range=0..1))  # -> out, P, V, C, W; inputs planes: list of Plane; same code as draw
vdisex_3 = VectorDisplayEx(Point=draw_3.P, Vector=draw_3.V, Colour=draw_3.C, Width=draw_3.W)

cart = IronPython2Script(configuration=filter_2)  # -> out, linear_axis_value
# ---------- cart: IronPython ----------
if configuration:
    linear_axis_value = (configuration.joint_values[0])
else:
    linear_axis_value = 0
# ---------- end cart ----------
move_linear = IronPython2Script(
    robot=robot,
    target_planes=target_planes,
    linear_axis_value=cart.linear_axis_value,
    speed=tcp_speed,
    send_set_tool_attached=set_tool,
    send_move_to_frame=to_frame,
    send_move_to_robtarget=to_robtarget)  # -> out; inputs target_planes: list, linear_axis_value: Double, send_set_tool_attached: Boolean
# ---------- move_linear: IronPython ----------
from abb_fabrication_control.commands import set_tool, set_tool_attached, move_to_frame, move_to_robtarget
from compas_rhino.conversions import plane_to_compas_frame

target_frames = [plane_to_compas_frame(target_plane) for target_plane in target_planes] # convert target plane (Rhino plane) into target frame (compas frame)
scalefactor = 1000 # m to mm conversion for ABB robot controller

if robot: print(robot.abb_client)

# set tool in RobotStudio
if send_set_tool_attached and robot.abb_client:
    success = set_tool_attached(robot, send_and_wait=False)

# move linear to frame
if send_move_to_frame and robot.abb_client:

    for i, target_frame in enumerate(target_frames):
        if i < len(target_frames)-1:
            zone = rrc.Zone.Z50
        else:
            zone = rrc.Zone.FINE

        success = move_to_frame(robot, target_frame, speed=speed, zone=zone, scalefactor=scalefactor, send_and_wait=False)

# move linear to robtarget
if send_move_to_robtarget and robot.abb_client :
    
    for i, target_frame in enumerate(target_frames):
        if i < len(target_frames)-1:
            zone = rrc.Zone.Z50
        else:
            zone = rrc.Zone.FINE

        success = move_to_robtarget(robot, target_frame, linear_axis_value, speed=speed, zone=zone, scalefactor=scalefactor, send_and_wait=False)
# ---------- end move_linear ----------

target_configuration = Data(filter_2)

tasks = IronPython2Script(create=create, robot=robot, configuration=filter_2)  # -> tasks; inputs place_frames: list
# ---------- tasks: IronPython ----------
from scriptcontext import sticky as st
from compas_robots import Configuration
from compas.geometry import Translation, Vector, Frame, Point
from fabrication_manager.task import Task
from abb_fabrication_control.tasks.abbtask import PickTask, PlaceTask, StartConfigurationTask, SetToolTask

place_frames = []
pick_frame = Frame(Point(0, 0, 0), Vector(1, 0, 0), Vector(0, 1, 0))
frame1 = Frame(Point(0, 3, 4), Vector(1, 0, 0), Vector(0, 1, 0))
frame2 = Frame(Point(0, 5, 5), Vector(1, 0, 0), Vector(0, 1, 0))

place_frames.append(frame1)
place_frames.append(frame2)
if create:
    
    cart = configuration.joint_values[0]
    print cart
    tasks = []
        
    #Go to start configuration
    task = StartConfigurationTask(robot, configuration, key=len(tasks))
    tasks.append(task)
    
    #Set the tool
    task = SetToolTask(robot, tool_name='t_earthextruder', key=len(tasks)) 
    tasks.append(task)         

    for place_frame in place_frames:

        #Pick a brick
        task = PickTask(robot, pick_frame=pick_frame, key=len(tasks)) 
        tasks.append(task)

        #Place a brick
        task = PlaceTask(robot, place_frame=place_frame, key=len(tasks)) 
        tasks.append(task)

    st['tasks'] = tasks
    print tasks

tasks = st['tasks']
# ---------- end tasks ----------
fabrication_manager = IronPython2Script(
    tasks=tasks,
    init=init,
    set_tasks=set_tasks,
    start=start_fabrication,
    stop=stop_fabrication,
    reset=reset,
    next_task=next_task,
    reset_task=reset_task,
    prev_task=preview_task)  # -> out, server; inputs tasks: list
# ---------- fabrication_manager: IronPython ----------
from scriptcontext import sticky as st
from fabrication_manager.fabrication import FabricationManager

if init:
    fabrication = FabricationManager()
    if "fabrication" in st:
        del st["fabrication"]
    st["fabrication"] = fabrication

fabrication = st["fabrication"]

if set_tasks:
    print "setting tasks"    
    fabrication.clear_tasks()
    fabrication.set_tasks(tasks)

if start:
    #if robot.is_connected(): #and arduino.is_connected():
    print "starting process"
    fabrication.start()

if stop:
    print "stopping process"
    fabrication.stop()
    
if reset:
    print "resetting process"
    fabrication.reset()

if next_task:
    t = fabrication.get_next_task()
    task_state_set(True, t)
    
if reset_task:
    t = fabrication.get_next_task()
    task_state_set(False, t)

if prev_task:
    t = fabrication.get_next_task()
    task_state_set(False, t)
    t = fabrication.tasks[fabrication.current_task_key-1]
    task_state_set(False, t)
    fabrication.get_next_task()

def task_state_set(state, t):
    t.is_completed = state
    t.is_running = False
# ---------- end fabrication_manager ----------
data_recorder = DataRecorder(fabrication_manager.out, DataLimit=-10, RecordData=True)
out = Panel(data_recorder)

move_joints = IronPython2Script(robot=robot, configurations=target_configuration, speed=tcp_speed_2, send_move_to_joints=to_joints)  # -> out; inputs configurations: list
# ---------- move_joints: IronPython ----------
from abb_fabrication_control.commands import move_to_joints
import compas_rrc as rrc

scalefactor = 1000 # m to mm conversion for ABB robot controller

# move to joints
if send_move_to_joints and robot.abb_client:

    for i, configuration in enumerate(configurations):
        if i < len(configurations)-1:
            zone = rrc.Zone.Z200
        else:
            zone = rrc.Zone.FINE
        success = move_to_joints(robot, configuration, speed=speed, zone=zone, scalefactor=scalefactor, send_and_wait=False)
# ---------- end move_joints ----------

# ==== cluster Tools
geo = Geometry([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])
# other tools ...
yaxis_line = Curve(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)
xaxis_line = Curve(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)

# ----
# measurement tool
geo_2 = Geometry(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)
mesh = Mesh(geo_2)
show = BooleanToggle(False)
mjoin = MeshJoin(Meshes=mesh)
xaxis_line_2 = Curve(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)
yaxis_line_2 = Curve(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)
tool = IronPython2Script(name="mortar_extruder", visual_mesh=mjoin, xline=xaxis_line, yline=yaxis_line, show=show)  # -> out, tool, tool_plane, tool_geometry, tool_frame_rs; inputs name: String, visual_mesh: Mesh, xline: Curve, yline: Curve
# ---------- tool: IronPython ----------
from __future__ import print_function

import Rhino.Geometry as rg
import os, math
from compas.geometry import Frame, Rotation
from compas.datastructures import Mesh
from compas_fab.robots import Tool


from compas_rhino.conversions import plane_to_compas_frame, mesh_to_compas, mesh_to_rhino

xaxis = rg.Line(xline.PointAtStart, xline.PointAtEnd)
yaxis = rg.Line(yline.PointAtStart, yline.PointAtEnd)

if xaxis.From.DistanceTo(yaxis.From) < 0.01:
    origin = xaxis.From
    xaxis = xaxis.Direction
    yaxis = yaxis.Direction
elif xaxis.To.DistanceTo(yaxis.To) < 0.01:
    origin = xaxis.To
    xaxis = -xaxis.Direction
    yaxis = -yaxis.Direction
elif xaxis.From.DistanceTo(yaxis.To) < 0.01:
    origin = xaxis.From
    xaxis = xaxis.Direction
    yaxis = -yaxis.Direction
elif xaxis.To.DistanceTo(yaxis.From) < 0.01:
    origin = xaxis.To
    xaxis = -xaxis.Direction
    yaxis = yaxis.Direction

xaxis.Unitize()
yaxis.Unitize()

plane = rg.Plane(origin, xaxis, yaxis)

frame = plane_to_compas_frame(plane) # convert to copmas frame
c_visual_mesh = mesh_to_compas(visual_mesh) # convert to compas mesh

# create Tool
# tool = Tool(c_visual_mesh, frame, name=name, connected_to="tool0")
tool = Tool(c_visual_mesh, frame, name=name)

# create values for Robot Studio tool (in mm and quaternion format)
tool_frame_rs = [[entry*1000 for entry in list(frame.point)], list(frame.quaternion)]

# round values
tool_frame_rs = str([[round(v, 5) for v in tool_frame_rs[0]], [round(v, 5) for v in tool_frame_rs[1]]])


if show:
    #print(("The tool {} will be connected to {}").format(tool.name, tool.connected_to))
    tool_plane = plane
    tool_geometry = mesh_to_rhino(c_visual_mesh)
else: 
    tool_plane = []
    tool_geometry = []
# ---------- end tool ----------
values_for_abb_robot_studio = Panel(tool.tool_frame_rs)
mesh_2 = Mesh(tool.tool_geometry)
preview = CustomPreview(Geometry=mesh_2, Shader=ColourSwatch(SwatchColor=RGBA(207, 157, 160, 157)))
draw = Python3Script(planes=tool.tool_plane, scale=Slider(0.2, range=0..1))  # -> out, P, V, C, W; inputs planes: list of Plane
# ---------- draw: Python ----------
from System.Drawing import Color

red = Color.FromArgb(255, 0, 0)
green = Color.FromArgb(0, 255, 0)
blue = Color.FromArgb(0, 0, 255)

P = []
V = []
C = []

scale = float(scale)

for plane in planes:
    if not plane:
        continue
    P += [plane.Origin] * 3
    V.append(plane.XAxis * scale)
    V.append(plane.YAxis * scale)
    V.append(plane.ZAxis * scale)
    C += [red, green, blue]

W = 3
# ---------- end draw ----------
vdisex = VectorDisplayEx(Point=draw.P, Vector=draw.V, Colour=draw.C, Width=draw.W)

yaxis_line_3 = Curve(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)
xaxis_line_3 = Curve(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)

# ----
# earth extruder
panel = Panel("t_earthstamper")
mesh_3 = Mesh(geo)
show_2 = BooleanToggle(False)
mjoin_2 = MeshJoin(Meshes=mesh_3)
tool_2 = IronPython2Script(name=panel, visual_mesh=mjoin_2, xline=xaxis_line_3, yline=yaxis_line_3, show=show_2)  # -> out, tool, tool_plane, tool_geometry, tool_frame_rs; inputs name: String, visual_mesh: Mesh, xline: Curve, yline: Curve; same code as tool
values_for_abb_robot_studio_2 = Panel(tool_2.tool_frame_rs)
mesh_4 = Mesh(tool_2.tool_geometry)
preview_2 = CustomPreview(Geometry=mesh_4, Shader=ColourSwatch(SwatchColor=RGBA(207, 157, 160, 157)))
draw_2 = Python3Script(planes=tool_2.tool_plane, scale=Slider(0.2, range=0..1))  # -> out, P, V, C, W; inputs planes: list of Plane; same code as draw
vdisex_2 = VectorDisplayEx(Point=draw_2.P, Vector=draw_2.V, Colour=draw_2.C, Width=draw_2.W)

mesh_5 = Mesh(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)
mesh_6 = Mesh(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)

# ----
# Tools
# mortar extruder
panel_2 = Panel("mortar_extruder")
show_3 = BooleanToggle(False)
yaxis_line_4 = Curve(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)
xaxis_line_4 = Curve(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)
tool_3 = IronPython2Script(name=panel_2, visual_mesh=mesh_5, collision_mesh=mesh_6, xline=xaxis_line_4, yline=yaxis_line_4, show=show_3)  # -> out, tool, tool_plane, tool_geometry, tool_frame_rs; inputs name: String, visual_mesh: Mesh, collision_mesh: Mesh, xline: Curve, yline: Curve
# ---------- tool_3: IronPython ----------
from __future__ import print_function

import Rhino.Geometry as rg
import os, math
from compas.geometry import Frame, Rotation
from compas.datastructures import Mesh
from compas_fab.robots import Tool


from compas_rhino.conversions import plane_to_compas_frame, mesh_to_compas, mesh_to_rhino

xaxis = rg.Line(xline.PointAtStart, xline.PointAtEnd)
yaxis = rg.Line(yline.PointAtStart, yline.PointAtEnd)

if xaxis.From.DistanceTo(yaxis.From) < 0.01:
    origin = xaxis.From
    xaxis = xaxis.Direction
    yaxis = yaxis.Direction
elif xaxis.To.DistanceTo(yaxis.To) < 0.01:
    origin = xaxis.To
    xaxis = -xaxis.Direction
    yaxis = -yaxis.Direction
elif xaxis.From.DistanceTo(yaxis.To) < 0.01:
    origin = xaxis.From
    xaxis = xaxis.Direction
    yaxis = -yaxis.Direction
elif xaxis.To.DistanceTo(yaxis.From) < 0.01:
    origin = xaxis.To
    xaxis = -xaxis.Direction
    yaxis = yaxis.Direction

xaxis.Unitize()
yaxis.Unitize()

plane = rg.Plane(origin, xaxis, yaxis)

frame = plane_to_compas_frame(plane) # convert to copmas frame
c_visual_mesh = mesh_to_compas(visual_mesh) # convert to compas mesh
c_collision_mesh = mesh_to_compas(collision_mesh) # convert to compas mesh

# create Tool
# tool = Tool(c_visual_mesh, frame, name=name, connected_to="tool0")
tool = Tool(c_visual_mesh, frame, collision=c_collision_mesh, name=name)



# create values for Robot Studio tool (in mm and quaternion format)
tool_frame_rs = [[entry*1000 for entry in list(frame.point)], list(frame.quaternion)]

# round values
tool_frame_rs = str([[round(v, 5) for v in tool_frame_rs[0]], [round(v, 5) for v in tool_frame_rs[1]]])


if show:
    #print(("The tool {} will be connected to {}").format(tool.name, tool.connected_to))
    tool_plane = plane
    tool_geometry = mesh_to_rhino(c_visual_mesh)
else: 
    tool_plane = []
    tool_geometry = []
# ---------- end tool_3 ----------
values_for_abb_robot_studio_3 = Panel(tool_3.tool_frame_rs)
mesh_7 = Mesh(tool_3.tool_geometry)
preview_3 = CustomPreview(Geometry=mesh_7, Shader=ColourSwatch(SwatchColor=RGBA(207, 157, 160, 157)))
draw_3 = Python3Script(planes=tool_3.tool_plane, scale=Slider(0.2, range=0..1))  # -> out, P, V, C, W; inputs planes: list of Plane; same code as draw
vdisex_3 = VectorDisplayEx(Point=draw_3.P, Vector=draw_3.V, Colour=draw_3.C, Width=draw_3.W)

tool_4 = ClusterOutput(tool_2.tool)
tool_5 = ClusterOutput(tool_3.tool)
tool_6 = ClusterOutput(tool.tool)

# ==== cluster ParticleBed
B = ClusterInput()
B_2 = ClusterInput()
dom = ConstructDomain(DomainStart=0, DomainEnd=B)
dom_2 = ConstructDomain(DomainStart=0, DomainEnd=B_2)
rectangle = Rectangle(Plane=PlaneXY(0, 0, 0), XSize=dom_2, YSize=dom, Radius=0)  # -> Rectangle, Length
H = ClusterInput()
boxrec = BoxRectangle(Rectangle=rectangle.Rectangle, Height=H)
B_3 = ClusterOutput(boxrec)

# ==== cluster MoveComponent
X = ClusterInput()
Y = ClusterInput()
Z = ClusterInput()
G = ClusterInput()
vec = VectorXYZ(XComponent=X, YComponent=Y, ZComponent=Z)  # -> Vector, Length
move = Move(Geometry=G, Motion=vec.Vector)  # -> Geometry, Transform
D = ClusterInput()
bbox = BoundingBox(Content=move.Geometry, Plane=PlaneXY(0, 0, 0))  # -> Box, Box_2
rad = Radians(Degrees=D)
boxprop = BoxProperties(Box=bbox.Box)  # -> Center, Diagonal, Area, Volume, Degeneracy
rotate = Rotate(Geometry=move.Geometry, Angle=rad, Plane=boxprop.Center)  # -> Geometry, Transform
G_2 = ClusterOutput(rotate.Geometry)

# ==== cluster Contour
geometry = ClusterInput()
layer_height = ClusterInput()
contour = Contour(Geometry=geometry, Point=Point(0, 0, 0), Direction=Vector(0, 0, 1), LayerHeight=layer_height)  # -> flatten(Contours)
smoothpline = SmoothPolyline(Polyline=contour, Strength=1, Times=3)
P = ClusterOutput(smoothpline)
