# Grasshopper definition 03_fabtory_moveit_simulation_robot_control_rh8_py39_GD.ghx (Grasshopper 1.0.8)
# plug-ins: RhinoCodePluginGH

# ----
# Unload Python
# modules
button = Button()
unload = Python3Script(unload=button)  # -> out, a
# ---------- unload: Python ----------
from compas_rhino import unload_modules


unload_modules("abb_fabrication_control")
unload_modules("extruder_control")
unload_modules("fabrication_manager")
# ---------- end unload ----------

# ----
# Clients
ros_ip = ValueList({"127.0.0.1"}, selected="127.0.0.1")
ros_port = ValueList({"9090"}, selected="9090")
connect = Button()
close = Button()
clients = Python3Script(ip=ros_ip, port=ros_port, connect=connect, close=close)  # -> out, ros_client, abb_client, is_connected
# ---------- clients: Python ----------
from scriptcontext import sticky as st

import compas_rrc as rrc
from compas_fab.backends import RosClient

if 'ros_client' not in st:
    st['ros_client'] = None
    st['abb_client'] = None
    st['is_connected'] = False

if close:
    st['ros_client'].close()
    st['ros_client'] = None
    st['abb_client'] = None
    st['is_connected'] = False

if connect:
    ros_client = RosClient(ip, port)
    try:
        ros_client.run(2)
    except:
        print('Cannot connect to ROS Client')
    
    
    st['is_connected'] = ros_client.is_connected if ros_client else False

    if st['is_connected']:
        abb_client = rrc.AbbClient(ros_client, '/rob1')

        st['ros_client'] = ros_client
        st['abb_client'] = abb_client

is_connected = st['is_connected']
ros_client = st['ros_client']
abb_client = st['abb_client']

print('ROS Client: ', ros_client)
print('ABB Client: ', abb_client)
print('is connected: ', is_connected)
# ---------- end clients ----------
is_connected = Panel(clients.is_connected)

# ----
# Hello ABB
button_2 = Button()
hello_world = Python3Script(abb_client=clients.abb_client, send_welcome=button_2)  # -> out, a
# ---------- hello_world: Python ----------
import compas_rrc as rrc

if send_welcome and abb_client:
    abb_client.send(rrc.PrintText('Hello World'))
# ---------- end hello_world ----------

reset_button = Button()
pln = Plane(Plane(origin=(1.228516815, -1.815864517, 0.9386438171), x=(1, 0, 0), y=(0, -1, 0)))

to_robtarget = Button()
to_frame = Button()
set_tool = Button()

get_frame = Button()
get_robtarget = Button()
get_joints = Button()

# ----
# Tool
list = ValueList({"measurement_tool": 0, "concrete_extruder": 1}, selected="measurement_tool")
panel = Panel("Attach a custom tool")
tools = Tools(G=list)
remove = Button()
add = Button()

# ----
# Robot
# Load robot from local package
# Model
load = Button()

py3 = Python3Script(ros_client=clients.ros_client, abb_client=clients.abb_client, load=load)  # -> out, robot; inputs load: Boolean
# ---------- py3: Python ----------
from compas.scene import SceneObject
from ghpythonlib.componentbase import executingcomponent as component
from scriptcontext import sticky as st


key = "_robot_"

if ros_client and ros_client.is_connected and load:
    # Load URDF from ROS
    st[key] = ros_client.load_robot(load_geometry=True, precision=12)
    st[key].scene_object = SceneObject(item=st[key].model)

robot = st.get(key, None)
if robot:  # client sometimes need to be restarted, without needing to reload geometry
    robot.ros_client = ros_client
# ---------- end py3 ----------

robot = Data(py3.robot)

attach_remove = Python3Script(robot=robot, tool=tools, attach=add, remove=remove)  # -> out, update
# ---------- attach_remove: Python ----------
if attach:
    robot.attach_tool(tool)
if remove:
    robot.detach_tool()
# ---------- end attach_remove ----------

# ----
# Info
info = Python3Script(robot=robot)  # -> out, main_group_name
# ---------- info: Python ----------
if robot:
    print(robot.info())

main_group_name = robot.main_group_name
# ---------- end info ----------
panel_2 = Panel(info.out)

# ----
# forward kinematics
number_slider = Slider(-53.8, range=-180..180)
forward_kinematics = Python3Script(
    reset=reset_button,
    robot=robot,
    a_cart=Slider(3.037, range=0..4.2),
    a_a1=number_slider,
    a_a2=Slider(-24, range=-90..150),
    a_a3=Slider(37.2, range=-180..180),
    a_a4=Slider(38.8, range=-400..400),
    a_a5=Slider(-12, range=-125..120),
    a_a6=Slider(0, range=-400..400))  # -> configuration
# ---------- forward_kinematics: Python ----------
import math
import Grasshopper

import Rhino
import scriptcontext as sc

from compas_robots.model import Joint
from compas_robots import Configuration

#reset = True
if reset:
    j = 0
    for i in range(ghenv.Component.Params.Input.Count):
        nslider = ghenv.Component.Params.Input[i].Sources[0]
        #print(nslider.GetType())
        if nslider.GetType() == Grasshopper.Kernel.Special.GH_NumberSlider:
            print(nslider)
            nslider.TrySetSliderValue(0)
            j += 1


def reset_sliders():
    # Get all number sliders in the document
    sliders = [comp for comp in sc.doc.Objects if isinstance(comp, Rhino.DocObjects.ObjRef) and isinstance(comp.Geometry(), Rhino.Geometry.NurbsCurve) and comp.Attributes.Name == "Number Slider"]
    
    print(sliders)
    # Loop through sliders and set their values to zero
    for slider in sliders:
        slider.Geometry().SetUserString("Value", "0")

# Check if the toggle button is toggled on
if reset:
    reset_sliders()


if robot:
    joint_positions = [a_cart, a_a1, a_a2, a_a3, a_a4, a_a5, a_a6]
    print ("joint positions: ", joint_positions)
    joint_types = robot.model.get_joint_types()
    print("joint types: ", joint_types)
    joint_names = robot.model.get_configurable_joint_names()
    print("joint names: ", joint_names)

    for i, joint_type in enumerate(joint_types):
        if joint_type == Joint.REVOLUTE:
            joint_positions[i] = math.radians(joint_positions[i])
        if joint_type == Joint.PRISMATIC:
            joint_positions[i] = joint_positions[i]
    
    configuration = Configuration(joint_positions, joint_types, joint_names)
    print ("configuration: ", configuration)
# ---------- end forward_kinematics ----------

# ----
# inverse kinematics
ik = Python3Script(robot=robot)  # -> configuration; unedited script template
list_2 = ValueList({"fk_configuration": 0, "robot_configuration": 1}, selected="fk_configuration")
fk_configuration = Data(forward_kinematics)
go_to_start_configuration = BooleanToggle(False)
avoid_collisions = BooleanToggle(False)
filter = StreamFilter(Gate=list_2, Stream0=fk_configuration, Stream1=ik)
inverse_kinematics = Python3Script(
    compute=Toggle(True),
    robot=robot,
    plane=pln,
    start_configuration=filter,
    go_to_start_configuration=go_to_start_configuration,
    avoid_collisions=avoid_collisions,
    group=info.main_group_name)  # -> out, ik_configuration, t0cp; inputs plane: Plane
# ---------- inverse_kinematics: Python ----------
from __future__ import print_function
import logging
from compas.geometry import Frame
from scriptcontext import sticky as st
from compas_ghpython.drawing import draw_frame
from compas_rhino.conversions import plane_to_compas_frame

LOGGER = logging.getLogger('roslibpy')

#vizualize t0cf
if robot.attached_tool:
    t0cf = plane_to_compas_frame(plane)
    t0cp = draw_frame(t0cf)
    print (t0cf)


if compute:
    robot.client = robot.ros_client
    if go_to_start_configuration:
        ik_configuration = start_configuration
    else:
        tool_frame = plane_to_compas_frame(plane)
        ik_configuration = robot.inverse_kinematics(tool_frame,
                                                    start_configuration,
                                                    group=group,
                                                    options={
                                                      'avoid_collisions':avoid_collisions,
                                                      'return_full_configuration':True,
                                                    })        
#group_configuration = robot.get_group_configuration(group, ik_configuration)
#print (group_configuration)
st["ik_configuration"] = ik_configuration

ik_configuration = st["ik_configuration"] 
print(ik_configuration)
# ---------- end inverse_kinematics ----------
panel_3 = Panel(inverse_kinematics.out)
draw = Python3Script(planes=inverse_kinematics.t0cp, scale=Slider(0.2, range=0..1))  # -> P, V, C, W; inputs planes: list of Plane
# ---------- draw: Python ----------
from System.Drawing import Color
# from compas_ghpython.drawing import FrameArtist

red = Color.FromArgb(255, 0, 0)
green = Color.FromArgb(0, 255, 0)
blue = Color.FromArgb(0, 0, 255)

P = []
V = []
C = []

scale = float(scale)

for plane in planes:
    if not plane:
        continue
    P += [plane.Origin] * 3
    V.append(plane.XAxis * scale)
    V.append(plane.YAxis * scale)
    V.append(plane.ZAxis * scale)
    C += [red, green, blue]

W = 3
# ---------- end draw ----------
vdisex = VectorDisplayEx(Point=draw.P, Vector=draw.V, Colour=draw.C, Width=draw.W)

# ----
# Control with Compas_RRC
robot_2 = Data(robot)
tcp_speed = Slider(250, range=0..1000)
target_plane = Plane(pln)

# ----
# Digital Output
button_3 = Button()
digital_signal = Python3Script(robot=robot_2, close_gripper=button_3, release_gripper=Button())  # -> out
# ---------- digital_signal: Python ----------
import abb_fabrication_control as ffc

if close_gripper:
    ffc.commands.close(robot)

if release_gripper:
    ffc.commands.release(robot)
# ---------- end digital_signal ----------
out = Panel(digital_signal)

# ----
# Get Robot Configurations
get_joints_2 = Python3Script(robot=robot_2, get_frame=get_frame, get_robtarget=get_robtarget, get_joints=get_joints)  # -> out, joint, current_plane
# ---------- get_joints_2: Python ----------
from compas_ghpython.drawing import draw_frame
from scriptcontext import sticky as st
import abb_fabrication_control as ffc
import os

# store robot in component
guid = str(ghenv.Component.InstanceGuid)
current_frame_key = "current_frame_" + guid
current_robtarget_key = "current_robtarget_" + guid
current_configuration_key = "current_configuration_" + guid

if current_frame_key not in st:
    st[current_frame_key] = None

if current_robtarget_key not in st:
    st[current_robtarget_key] = None

if current_configuration_key not in st:
    st[current_configuration_key] = None


#get commands
if get_frame:
    current_frame = ffc.feedback.get_frame(robot, scalefactor=0.001)
    st[current_frame_key] = current_frame

if get_robtarget:
    current_robtarget = ffc.feedback.get_robtarget(robot, scalefactor=0.001)
    print(current_robtarget)
    st[current_robtarget_key] = current_robtarget


if get_joints:
    current_configuration = ffc.feedback.get_joints(robot)
    st[current_configuration_key] = current_configuration
    print(current_configuration)

# sticky
if st[current_frame_key]:
    current_frame = st[current_frame_key]
    current_plane = draw_frame(current_frame)

if st[current_robtarget_key]:
    current_robtarget = st[current_robtarget_key]

if st[current_configuration_key]:
    current_configuration = st[current_configuration_key]
    print(current_configuration)
# ---------- end get_joints_2 ----------
data_recorder = DataRecorder(get_joints_2.out, DataLimit=-10, RecordData=True)
draw_2 = Python3Script(plane=get_joints_2.current_plane, scale=Slider(0.2, range=0..1))  # -> out, P, V, C, W
# ---------- draw_2: Python ----------
from System.Drawing import Color
from compas_ghpython.drawing import draw_frame

red = Color.FromArgb(255, 0, 0)
green = Color.FromArgb(0, 255, 0)
blue = Color.FromArgb(0, 0, 255)

P = []
V = []
C = []

scale = float(scale)


if plane:
    P += [plane.Origin] * 3
    V.append(plane.XAxis * scale)
    V.append(plane.YAxis * scale)
    V.append(plane.ZAxis * scale)
    C += [red, green, blue]
    
    W = 3
# ---------- end draw_2 ----------
joint_values = Panel(data_recorder)
vdisex_2 = VectorDisplayEx(Point=draw_2.P, Vector=draw_2.V, Colour=draw_2.C, Width=draw_2.W)

# ----
# Plan motion in Joint-space
robot_3 = Data(robot)
group = Data(info.main_group_name)
compute = Button()

# ----
# Configuration
pln_2 = Plane(Plane(origin=(0.5165247764, -1.815864517, 0.9386438171), x=(1, 0, 0), y=(0, -1, 0)))

constraints_from_plane = Python3Script(robot=robot_3, plane=pln_2, group=group)  # -> constraints
# ---------- constraints_from_plane: Python ----------
"""
Create a position and an orientation constraint from a plane calculated for the group's end-effector link.

COMPAS FAB v1.0.2
"""

import math

from compas_rhino.conversions import plane_to_compas_frame
from ghpythonlib.componentbase import executingcomponent as component


class ConstraintsFromPlane(component):
    def RunScript(self,
            robot,
            plane,
            group,
            tolerance_position,
            tolerance_xaxis,
            tolerance_yaxis,
            tolerance_zaxis):
        goal_constraints = None
        if robot and plane:
            tolerance_position = tolerance_position or 0.001
            tolerance_xaxis = tolerance_xaxis or 1.0
            tolerance_yaxis = tolerance_yaxis or 1.0
            tolerance_zaxis = tolerance_zaxis or 1.0

            frame = plane_to_compas_frame(plane)
            tolerances_axes = [
                math.radians(tolerance_xaxis),
                math.radians(tolerance_yaxis),
                math.radians(tolerance_zaxis),
            ]
            goal_constraints = robot.constraints_from_frame(frame, tolerance_position, tolerances_axes, group)

        return goal_constraints
# ---------- end constraints_from_plane ----------
plan_motion = Python3Script(
    robot=robot_3,
    goal_constraints=constraints_from_plane,
    start_configuration=forward_kinematics,
    group=group,
    compute=compute)  # -> out, trajectory; inputs goal_constraints: list
# ---------- plan_motion: Python ----------
"""
Calculate a motion path.

COMPAS FAB v1.0.2
"""

from ghpythonlib.componentbase import executingcomponent as component
from scriptcontext import sticky as st
import System

# from compas_fab.ghpython.components import create_id


class PlanMotion(component):
    def RunScript(self,
            robot,
            goal_constraints: System.Collections.Generic.IList[object],
            start_configuration,
            group,
            attached_collision_meshes,
            path_constraints,
            planner_id,
            compute):
        key = "trajectory"

        path_constraints = list(path_constraints) if path_constraints else None
        attached_collision_meshes = list(attached_collision_meshes) if attached_collision_meshes else None
        planner_id = str(planner_id) if planner_id else "RRTConnect"

        if (
            robot
            and robot.client
            and robot.client.is_connected
            and start_configuration
            and goal_constraints
            and compute
        ):
            st[key] = robot.plan_motion(
                goal_constraints,
                start_configuration=start_configuration,
                group=group,
                options=dict(
                    attached_collision_meshes=attached_collision_meshes,
                    path_constraints=path_constraints,
                    planner_id=planner_id,
                ),
            )

        trajectory = st.get(key, None)
        return trajectory
# ---------- end plan_motion ----------
trajectory_visualize = Python3Script(robot=robot_3, group=group, trajectory=plan_motion.trajectory)  # -> out, start_configuration, configurations, fraction, time, planes, P, V, A
# ---------- trajectory_visualize: Python ----------
"""
Visualizes a trajectory.

COMPAS FAB v1.0.2
"""

from compas_ghpython.drawing import draw_frame
from compas_ghpython.sets import list_to_ghtree
from ghpythonlib.componentbase import executingcomponent as component


class TrajectoryVisualize(component):
    def RunScript(self, robot, group, trajectory):
        start_configuration = None
        configurations = []
        fraction = 0.0
        time = 0.0

        planes = []
        positions = []
        velocities = []
        accelerations = []

        if robot and trajectory:
            group = group or robot.main_group_name

            for c in trajectory.points:
                configurations.append(
                    robot.merge_group_with_full_configuration(c, trajectory.start_configuration, group)
                )
                frame = robot.forward_kinematics(c, group, options=dict(solver="model"))
                planes.append(draw_frame(frame))
                positions.append(c.positions)
                velocities.append(c.velocities)
                accelerations.append(c.accelerations)

            start_configuration = trajectory.start_configuration
            fraction = trajectory.fraction
            time = trajectory.time_from_start

        P = list_to_ghtree(list(zip(*positions)))
        V = list_to_ghtree(list(zip(*velocities)))
        A = list_to_ghtree(list(zip(*accelerations)))

        # return outputs if you have them; here I try it for you:
        return (start_configuration, configurations, fraction, time, planes, P, V, A)
# ---------- end trajectory_visualize ----------
pln_3 = Python3Script(P=trajectory_visualize.planes)  # -> P
# ---------- pln_3: Python ----------
print("hi")
# ---------- end pln_3 ----------
pline = PolyLine(Vertices=pln_3, Closed=False)
select = Python3Script(L=trajectory_visualize.configurations, i=Slider(46, range=0..100))  # -> a; inputs i: Int32
# ---------- select: Python ----------
print(len(L))

if i < len(L):
    a = L[i]
else:
    a = L[-1]
# ---------- end select ----------
preview = CustomPreview(Geometry=pline, Material=ColourSwatch(SwatchColor=RGB(59, 137, 161)))

item = ListItem(List=trajectory_visualize.configurations, Index=Slider(16, range=0..20), Wrap=True)

# ----
# Visualisation
list_3 = ValueList({"0 forward_kinematics": 0, "1 inverse_kinematics": 1, "2 plan motion": 2}, selected="1 inverse_kinematics")
fk_configuration_2 = Data(forward_kinematics)
ik_configuration = Data(inverse_kinematics.ik_configuration)
show_end_effector_frame = BooleanToggle(True)
show_base_frame = BooleanToggle(True)
show_collision = BooleanToggle(False)
show_frames = BooleanToggle(True)
show_visual = BooleanToggle(True)
show_acm = BooleanToggle(False)
filter_2 = StreamFilter(Gate=list_3, Stream0=fk_configuration_2, Stream1=ik_configuration, Stream2=item)
visualise = Python3Script(
    robot=robot,
    group=info.main_group_name,
    configuration=filter_2,
    redraw=attach_remove.update,
    show_frames=show_frames,
    show_base_frame=show_base_frame,
    show_end_effector_frame=show_end_effector_frame,
    show_visual_meshes=show_visual,
    show_collision_meshes=show_collision,
    show_attached_collision_meshes=show_acm)  # -> out, joint_planes, visual_meshes, collision_meshes, base_plane, end_effector_plane, attched_collision_meshes
# ---------- visualise: Python ----------
from compas.geometry import Frame
from compas.geometry import Transformation
from compas_rhino.conversions import frame_to_rhino, mesh_to_rhino

if robot:
    configuration = configuration or robot.zero_configuration()
    robot.update(configuration, visual=show_visual_meshes, collision=show_collision_meshes)

if show_frames == True: 
    joint_frames = robot.transformed_frames(configuration)
    joint_planes = [frame_to_rhino(a) for a in joint_frames]
else:
    joint_planes = []

if show_base_frame == True:
    show_base_frame = robot.forward_kinematics(configuration, group, options={"link":robot.get_base_link_name()})
    base_plane = frame_to_rhino(show_base_frame)
else:
    base_plane = []

if show_end_effector_frame == True:
    end_effector_frame = robot.forward_kinematics(configuration, group, options={"link":robot.get_end_effector_link_name()})
    end_effector_plane = frame_to_rhino(end_effector_frame)
else:
    end_effector_plane = []

if show_visual_meshes == True:
    visual_meshes = robot.draw_visual()

if show_collision_meshes == True:
    collision_meshes = robot.draw_collision()

if show_attached_collision_meshes == True:
    acm = robot.get_attached_tool_collision_meshes()[0]
    print(acm)
    attached_collision_meshes = [mesh_to_rhino(m.collision_mesh.mesh) for m in acm]
# ---------- end visualise ----------
pln_4 = Plane(visualise.joint_planes)
pln_5 = Plane(visualise.base_plane)
pln_6 = Plane(visualise.end_effector_plane)
draw_3 = Python3Script(planes=[pln_4, pln_5, pln_6], scale=Slider(0.2, range=0..1))  # -> out, P, V, C, W; inputs planes: list of Plane
# ---------- draw_3: Python ----------
from System.Drawing import Color


print(planes)

red = Color.FromArgb(255, 0, 0)
green = Color.FromArgb(0, 255, 0)
blue = Color.FromArgb(0, 0, 255)

P = []
V = []
C = []

scale = float(scale)

for plane in planes:
    if not plane:
        continue
    P += [plane.Origin] * 3
    V.append(plane.XAxis * scale)
    V.append(plane.YAxis * scale)
    V.append(plane.ZAxis * scale)
    C += [red, green, blue]

W = 3
# ---------- end draw_3 ----------
geo = Geometry([visualise.collision_meshes, visualise.attched_collision_meshes, visualise.visual_meshes])
preview_2 = CustomPreview(Geometry=geo, Shader=ColourSwatch(SwatchColor=RGB(207, 157, 160)))
vdisex_3 = VectorDisplayEx(Point=draw_3.P, Vector=draw_3.V, Colour=draw_3.C, Width=draw_3.W)

# ----
# Move Joints
tcp_speed_2 = Slider(250, range=0..1000)
to_joints = Button()
movej = Python3Script(robot=robot_2, abb_client=clients.abb_client, configuration=filter_2, speed=tcp_speed_2, move_to_joints=to_joints)  # -> out, a
# ---------- movej: Python ----------
import abb_fabrication_control as ffc
import compas_rrc as rrc


if move_to_joints:
    #send move to joints command
    ffc.commands.move_to_joints(abb_client, configuration, speed=speed, zone=rrc.Zone.FINE)
# ---------- end movej ----------
data_recorder_2 = DataRecorder(movej.out, DataLimit=-10, RecordData=True)
out_2 = Panel(data_recorder_2)

# ----
# Move Cartesian
movel = Python3Script(
    robot=robot_2,
    abb_client=clients.abb_client,
    start_configuration=filter_2,
    speed=tcp_speed,
    target_plane=target_plane,
    move_to_frame=to_frame,
    move_to_robtarget=to_robtarget,
    set_tool=set_tool)  # -> out
# ---------- movel: Python ----------
import compas_rrc as rrc
import abb_fabrication_control as ffc
from compas.geometry import Frame
from compas_rhino.conversions import plane_to_compas_frame


#set tool in RobotStudio
if set_tool:
    if robot.attached_tool:
        tool_name = robot.attached_tool.name
        done = abb_client.send(rrc.SetTool(tool_name))
        print(done)
    else:
        abb_client.send(rrc.SetTool("tool0"))

if move_to_frame:
    #transform target plane into target frame
    target_frame = plane_to_compas_frame(target_plane)
    #send move to frame command
    ffc.commands.move_to_frame(abb_client, target_frame, speed=speed, zone=rrc.Zone.FINE, scalefactor=1000)

if move_to_robtarget:
    #transform target plane into target frame
    target_frame = plane_to_compas_frame(target_plane)
    #store cart value from configuration
    cart = (start_configuration.joint_values[0])
    #send move to robtarget command
    ffc.commands.move_to_robtarget(abb_client, target_frame, cart, speed=speed, zone=rrc.Zone.FINE, scalefactor=1000)
# ---------- end movel ----------
data_recorder_3 = DataRecorder(movel, DataLimit=-10, RecordData=True)
out_3 = Panel(data_recorder_3)

# ==== cluster Tools

# ---- group: measurement tool
geo = Geometry(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)
mesh = Mesh(geo)
mjoin = MeshJoin(Meshes=mesh)
yaxis_line = Curve(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)
xaxis_line = Curve(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)
tool = Python3Script(rhmesh=mjoin, xline=xaxis_line, yline=yaxis_line)  # -> out, tool; inputs rhmesh: Mesh
# ---------- tool: Python ----------
import Rhino.Geometry as rg
import os, math
from compas.geometry import Frame, Rotation, Plane
from compas.datastructures import Mesh
from compas_fab.robots import Tool
from compas_rhino.conversions import mesh_to_compas, point_to_compas, vector_to_compas
 
xaxis = rg.Line(xline.PointAtStart, xline.PointAtEnd)
yaxis = rg.Line(yline.PointAtStart, yline.PointAtEnd)

if xaxis.From.DistanceTo(yaxis.From) < 0.01:
    origin = xaxis.From
    xaxis = xaxis.Direction
    yaxis = yaxis.Direction
elif xaxis.To.DistanceTo(yaxis.To) < 0.01:
    origin = xaxis.To
    xaxis = -xaxis.Direction
    yaxis = -yaxis.Direction
elif xaxis.From.DistanceTo(yaxis.To) < 0.01:
    origin = xaxis.From
    xaxis = xaxis.Direction
    yaxis = -yaxis.Direction
elif xaxis.To.DistanceTo(yaxis.From) < 0.01:
    origin = xaxis.To
    xaxis = -xaxis.Direction
    yaxis = yaxis.Direction

xaxis.Unitize()
yaxis.Unitize()

ee_frame = Frame(point_to_compas(origin), vector_to_compas(xaxis), vector_to_compas(yaxis))
ee_mesh = mesh_to_compas(rhmesh)

tool = Tool(ee_mesh, ee_frame)
# ---------- end tool ----------

# ---- group: concrete extruder tool
geo_2 = Geometry(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)
mesh_2 = Mesh(geo_2)
mjoin_2 = MeshJoin(Meshes=mesh_2)
yaxis_line_2 = Curve(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)
xaxis_line_2 = Curve(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)
tool_2 = Python3Script(rhmesh=mjoin_2, xline=xaxis_line_2, yline=yaxis_line_2)  # -> out, tool; inputs rhmesh: Mesh
# ---------- tool_2: Python ----------
import Rhino.Geometry as rg
import os, math
from compas.geometry import Frame, Rotation
from compas.datastructures import Mesh
from compas_fab.robots import Tool
from compas_rhino.conversions import mesh_to_compas, point_to_compas, vector_to_compas

xaxis = rg.Line(xline.PointAtStart, xline.PointAtEnd)
yaxis = rg.Line(yline.PointAtStart, yline.PointAtEnd)

if xaxis.From.DistanceTo(yaxis.From) < 0.01:
    origin = xaxis.From
    xaxis = xaxis.Direction
    yaxis = yaxis.Direction
elif xaxis.To.DistanceTo(yaxis.To) < 0.01:
    origin = xaxis.To
    xaxis = -xaxis.Direction
    yaxis = -yaxis.Direction
elif xaxis.From.DistanceTo(yaxis.To) < 0.01:
    origin = xaxis.From
    xaxis = xaxis.Direction
    yaxis = -yaxis.Direction
elif xaxis.To.DistanceTo(yaxis.From) < 0.01:
    origin = xaxis.To
    xaxis = -xaxis.Direction
    yaxis = yaxis.Direction

xaxis.Unitize()
yaxis.Unitize()

ee_frame = Frame(point_to_compas(origin), vector_to_compas(xaxis), vector_to_compas(yaxis))
ee_mesh = mesh_to_compas(rhmesh)

tool = Tool(ee_mesh, ee_frame)
# ---------- end tool_2 ----------

# ----
G = ClusterInput()
filter = StreamFilter(Gate=G, Stream0=tool.tool, Stream1=tool_2.tool)
s_0 = ClusterOutput(filter)
