# Grasshopper definition 220126 fabtory_simulation -2.ghx (Grasshopper 1.0.7)

reload = Button()
path = PythonScript()  # -> HERE, DATA, ROBOT_DESCRIPTION
# ---------- path: Python ----------
import os

HERE = os.path.dirname(ghdoc.Path)
DATA = os.path.abspath(os.path.join(HERE, "..", "data"))
ROBOT_DESCRIPTION = os.path.abspath(os.path.join(DATA, "robot_description"))

print(HERE)
print(DATA)
print(ROBOT_DESCRIPTION)
# ---------- end path ----------
py = PythonScript(reload=reload)
# ---------- py: Python ----------
if reload:
    from compas_ghpython import unload_modules
    unload_modules('compas')
    unload_modules("compas_fab")
    unload_modules("fabtory_fabrication_control")
# ---------- end py ----------

# ----
# Robot Model
# Load robot from local package
panel = Panel("abb_fabtory.urdf")
list = ValueList({"abb_fabtory"}, selected="abb_fabtory")
py_2 = PythonScript()  # -> packages
# ---------- py_2: Python ----------
packages = ["abb_irb6700_support", "abb_end_effectors", "abb_fabtory"]
# ---------- end py_2 ----------
py_3 = PythonScript(path=path.ROBOT_DESCRIPTION, package=list, urdf_name=panel, srdf_name="abb_fabtory.srdf")  # -> package_path, urdf_filename, srdf_filename
# ---------- py_3: Python ----------
import os

package_path = os.path.join(path, package)
print(package_path)

urdf_filename = os.path.join(package_path, "urdf", urdf_name)
srdf_filename = os.path.join(package_path, srdf_name)

assert os.path.isfile(urdf_filename)
assert os.path.isfile(srdf_filename)
# ---------- end py_3 ----------
py_4 = PythonScript(path=path.ROBOT_DESCRIPTION, packages=py_2)  # -> loaders; inputs packages: list
# ---------- py_4: Python ----------
from compas.robots import LocalPackageMeshLoader

loaders = []
print packages


for package in packages:
    loaders.append(LocalPackageMeshLoader(path, package))
# ---------- end py_4 ----------
units = ValueList({"m": 1, "cm": 100, "mm": 1000}, selected="m")
load = Button()
create = PythonScript(loaders=py_4, urdf_filename=py_3.urdf_filename, srdf_filename=py_3.srdf_filename, scale_factor=units, load=load)  # -> out, robot; inputs loaders: list
# ---------- create: Python ----------
import os
from scriptcontext import sticky as st

import compas

from compas.robots import RobotModel
from compas.robots import LocalPackageMeshLoader

from compas_fab.robots import Robot
from compas_fab.robots import RobotSemantics

from compas_fab.ghpython import RobotArtist

compas.PRECISION = '12f'

# store robot in component
guid = str(ghenv.Component.InstanceGuid)
robot_key = "robot_" + guid

if robot_key not in st:
    st[robot_key] = None

print loaders

if load:
    model = RobotModel.from_urdf_file(urdf_filename)
    
    model.load_geometry(*loaders)
    artist = RobotArtist(model)
    semantics = RobotSemantics.from_srdf_file(srdf_filename, model)
    robot = Robot(model, artist, semantics, client=None)
    
    st[robot_key] = robot

robot = st[robot_key]


if robot:
    robot.scale(scale_factor)
# ---------- end create ----------
robot = Data(create.robot)

# ----
# Tool
panel_2 = Panel("Attach a custom tool")
list_2 = ValueList({"measurement_tool": 0, "area_grip": 1, "concrete_extruder": 2}, selected="area_grip")
tools = Tools(G=list_2)
remove = Button()
add = Button()
attach_remove = PythonScript(robot=robot, tool=tools, attach=add, remove=remove)  # -> out, bang
# ---------- attach_remove: Python ----------
if attach:
    robot.attach_tool(tool)
if remove:
    robot.detach_tool()
# ---------- end attach_remove ----------

# ----
# ROS & ABB client
toggle = BooleanToggle(True)
ip = ValueList({"192.168.125.1", "127.0.0.1"}, selected="127.0.0.1")
robot_port = ValueList({"9090", "30101"}, selected="9090")
ros = ROSConnect(ip=ip, port=robot_port, connect=toggle)  # -> ros_client, is_connected; inputs port: Int32, connect: Boolean
#   port ip: The ip address ROS. Defaults to 127.0.0.1.
#   port port: The port of ROS. Defaults to 9090.
#   port connect: If True, connects to ROS. If False, disconnects from ROS. Defaults to False.
#   port ros_client: The ROS client.
#   port is_connected: True if connection established.
# ---------- ros: Python ----------
"""
Connect or disconnect to ROS.

COMPAS FAB v0.19.1
"""
from ghpythonlib.componentbase import executingcomponent as component
from scriptcontext import sticky as st

from compas_fab.backends import RosClient
from compas_fab.ghpython.components import create_id


class ROSConnect(component):
    def RunScript(self, ip, port, connect):
        ros_client = None

        ip = ip or '127.0.0.1'
        port = port or 9090

        key = create_id(self, 'ros_client')
        ros_client = st.get(key, None)

        if ros_client:
            st[key].close()
        if connect:
            st[key] = RosClient(ip, port)
            st[key].run(5)

        ros_client = st.get(key, None)
        is_connected = ros_client.is_connected if ros_client else False
        return (ros_client, is_connected)
# ---------- end ros ----------
abb = GhPythonScript(ros_client=ros.ros_client, connect=Toggle(True))  # -> out, abb_client; inputs connect: Boolean
# ---------- abb: Python ----------
import compas_rrc as rrc

if ros_client:
    if ros_client.is_connected and connect: 
        # Create ABB Client
        abb_client = rrc.AbbClient(ros_client, '/rob1')
# ---------- end abb ----------
is_connected = Panel(ros.is_connected)
set = PythonScript(robot=robot, ros_client=ros.ros_client, abb_client=abb.abb_client)  # -> robot
# ---------- set: Python ----------
if robot and ros_client and abb_client:
    robot.ros_client = ros_client
    robot.abb_client = abb_client
# ---------- end set ----------
robot_2 = Data(set)
info = PythonScript(robot=robot_2)  # -> out, main_group_name
# ---------- info: Python ----------
if robot:
    robot.info()
    main_group_name = robot.main_group_name
# ---------- end info ----------

# ----
# Configuration
number_slider = Slider(0, range=-125..120)
jp = GhPythonScript()  # -> configuration_values
# ---------- jp: Python ----------
import math
joint_values = [-3.136, -0.328, -1.218, 3.129, 0.852, 0.008]
#joint_values = [math.degrees(j) for j in joint_values]
#joint_positions = [0] * 6

cart = 0
joint_values = [0,0,0,0,0,0]

configuration_values = [cart] + joint_values
# ---------- end jp ----------
forward_kinematics = PythonScript(
    robot=robot_2,
    reset_configuration=Button(),
    configuration_values=jp,
    a_cart=Slider(0, range=0..4.2),
    a_a1=Slider(0, range=-180..180),
    a_a2=Slider(0, range=-90..150),
    a_a3=Slider(0, range=-180..180),
    a_a4=Slider(0, range=-400..400),
    a_a5=number_slider,
    a_a6=Slider(0, range=-400..400))  # -> full_configuration; inputs reset_configuration: Boolean, configuration_values: list
# ---------- forward_kinematics: Python ----------
import math
import Grasshopper
import copy
from compas.robots import Joint
from compas_fab.robots import Configuration

if reset_configuration:
    j = 0
    for i in range(ghenv.Component.Params.Input.Count):
        nslider = ghenv.Component.Params.Input[i].Sources[0]
        if nslider.GetType() == Grasshopper.Kernel.Special.GH_NumberSlider:
            nslider.TrySetSliderValue(configuration_values[j])
            j += 1

    
if robot:
    #a_cyl = a_a2 * -0.25
    #a_piston = math.radians(a_a2) * 0.15
    #joint_positions = [a_cart, a_a1, a_a2, a_cyl, a_a3, a_a4, a_a5, a_a6, a_piston]
    joint_positions = [a_cart, a_a1, a_a2, a_a3, a_a4, a_a5, a_a6]
    joint_positions_degrees = copy.deepcopy(joint_positions)
    joint_types = robot.get_configurable_joint_types()
    print(joint_types)
    for i, joint_type in enumerate(joint_types):
        if joint_type == Joint.REVOLUTE:
            joint_positions[i] = math.radians(joint_positions[i])
        if joint_type == Joint.PRISMATIC:
            joint_positions[i] = joint_positions[i]
    full_configuration = Configuration(joint_positions, joint_types)
# ---------- end forward_kinematics ----------

robot_info = Panel(info.out)
list_3 = ValueList({"0 forward_kinematics": 0, "1 inverse_kinematics": 1}, selected="0 forward_kinematics")
fk_configuration = Data(forward_kinematics)

# ----
# Inverse Kinematics
py_5 = PythonScript(robot=robot_2)  # -> configuration
# ---------- py_5: Python ----------
from compas_fab.robots import Configuration

if robot:
    types = robot.get_configurable_joint_types()
    values = [0] * len(types)
    configuration = Configuration(values, types)
    print configuration
    print robot.get_configurable_joint_names()
# ---------- end py_5 ----------
x_axis = Curve(<curve referenced from the Rhino model>)
y_axis = Curve(<curve referenced from the Rhino model>)
fk_configuration_2 = Data(forward_kinematics)
list_4 = ValueList({"0", "1"}, selected="0")
plane = PythonScript(plane_axes=[x_axis, y_axis])  # -> plane; inputs plane_axes: list of Curve
# ---------- plane: Python ----------
import Rhino.Geometry as rg

x_axis, y_axis = plane_axes

x_axis = rg.Line(x_axis.PointAtStart, x_axis.PointAtEnd)
y_axis = rg.Line(y_axis.PointAtStart, y_axis.PointAtEnd)

if x_axis.From.DistanceTo(y_axis.From) < 0.01:
    origin = x_axis.From
    xvec = x_axis.Direction
    yvec = y_axis.Direction
elif x_axis.To.DistanceTo(y_axis.To) < 0.01:
    origin = x_axis.To
    xvec = -x_axis.Direction
    yvec = -y_axis.Direction
elif x_axis.From.DistanceTo(y_axis.To) < 0.01:
    origin = x_axis.From
    xvec = x_axis.Direction
    yvec = -y_axis.Direction
elif x_axis.To.DistanceTo(y_axis.From) < 0.01:
    origin = x_axis.To
    xvec = -x_axis.Direction
    yvec = y_axis.Direction

plane = rg.Plane(origin, xvec, yvec)
# ---------- end plane ----------
compute = BooleanToggle(True)
filter = StreamFilter(Gate=list_4, Stream0=fk_configuration_2, Stream1=py_5)
inverse_kinematics = GhPythonScript(compute=compute, robot=robot_2, group=info.main_group_name, planes=plane, start_configuration=filter)  # -> out, ik_configuration; inputs planes: list of Plane
# ---------- inverse_kinematics: Python ----------
from __future__ import print_function
import logging
from compas.geometry import Frame
import compas_rrc as rrc
from compas.robots import Joint
from compas_fab.robots import Configuration
import math

LOGGER = logging.getLogger('roslibpy')

robot_joint_positions = []

for i, joint_type in enumerate(start_configuration.joint_types):
    if joint_type == Joint.REVOLUTE:
        robot_joint_positions.append(math.degrees(start_configuration.joint_values[i]))
    if joint_type == Joint.PRISMATIC:
        robot_track_position = start_configuration.joint_values[i]*1000

print (robot_joint_positions, robot_track_position)

track_pos_joint_goal = [robot_track_position]



if robot and robot.ros_client and compute == True:

    group_configurations = []
    ik_configuration = []

    #if robot.attached_tool:
        #tool_attached = True
    #else:
        #tool_attached = False

    for plane in planes:
         frame = Frame(plane.Origin, plane.XAxis, plane.YAxis)
         #if tool_attached:
             #frame = robot.from_tcf_to_t0cf([frame])[0]
         ik_config = robot.inverse_kinematics(frame,
                                              start_configuration,
                                              group=group,
                                              options={
                                              'return_full_configuration':True,
                                              })        
         group_configuration = robot.get_group_configuration(group, ik_config)
         ik_configuration.append(ik_config)
         group_configurations.append(group_configuration)
    print('done')
else:
    print("Robot client is not connected")


print(ik_configuration)
# ---------- end inverse_kinematics ----------
out = Panel(inverse_kinematics.out)

ik_configuration = Data(inverse_kinematics.ik_configuration)
filter_2 = StreamFilter(Gate=list_3, Stream0=fk_configuration, Stream1=ik_configuration)

# ----
# Visualisation
show_end_effector_frame = BooleanToggle(True)
show_base_frame = BooleanToggle(False)
show_collision = BooleanToggle(False)
show_frames = BooleanToggle(False)
show_visual = BooleanToggle(True)
show_acm = BooleanToggle(False)
robot_visualize = RobotVisualize(
    robot=robot_2,
    group=info.main_group_name,
    configuration=filter_2,
    redraw=attach_remove.bang,
    show_visual=show_visual,
    show_collision=show_collision,
    show_frames=show_frames,
    show_base_frame=show_base_frame,
    show_end_effector_frame=show_end_effector_frame,
    show_acm=show_acm)  # -> visual, collision, attached_meshes, frames, base_frame, ee_frame; inputs redraw: list, show_visual: Boolean, show_collision: Boolean, show_frames: Boolean, show_base_frame: Boolean, show_end_effector_frame: Boolean, show_acm: Boolean
#   port group: The planning group used for end-effector and base visualization.
#   port configuration: The robot's full configuration.
#   port redraw: A list of attached collision meshes.
#   port show_visual: Whether or not to show the robot's visual meshes.
#   port show_collision: Whether or not to show the robot's collision meshes.
#   port show_frames: Whether or not to show the robot's joint frames.
#   port show_base_frame: Whether or not to show the robot's base frame.
#   port show_end_effector_frame: Whether or not to show the robot's end-effector frame.
#   port show_acm: Whether or not to show the attached collision meshes (if any).
#   port visual: The robot's visual Rhino meshes (if any).
#   port collision: The robot's collision Rhino meshes (if any).
#   port attached_meshes: The attached collision Rhino meshes (if any).
#   port frames: The robot's joint frames as Rhino planes (if any).
#   port base_frame: The robot's base frame as a Rhino plane (if any).
#   port ee_frame: The robot's end-effector frame as a Rhino plane (if any).
# ---------- robot_visualize: Python ----------
"""
Visualizes the robot.

COMPAS FAB v0.19.1
"""
from compas.geometry import Frame
from compas.geometry import Transformation
from compas_ghpython.artists import FrameArtist
from compas_ghpython.artists import MeshArtist
from ghpythonlib.componentbase import executingcomponent as component


class RobotVisualize(component):
    def RunScript(self, robot, group, configuration, attached_collision_meshes, show_visual, show_collision,
                  show_frames, show_base_frame, show_end_effector_frame, show_acm):

        visual = None
        collision = None
        attached_meshes = None
        frames = None
        base_frame = None
        ee_frame = None

        if robot:
            show_visual = True if show_visual is None else show_visual
            configuration = configuration or robot.zero_configuration()

            robot.update(configuration, visual=show_visual, collision=show_collision)
            compas_frames = robot.transformed_frames(configuration, group)

            if show_visual:               
                visual = robot.artist.draw_visual()
                

            if show_collision:
                collision = robot.artist.draw_collision()

            if show_base_frame:
                base_compas_frame = compas_frames[0]
                artist = FrameArtist(base_compas_frame)
                base_frame = artist.draw()

            if show_end_effector_frame:
                ee_compas_frame = robot.forward_kinematics(configuration, group, options=dict(solver='model'))
                if robot.attached_tool:
                    ee_compas_frame = robot.from_t0cf_to_tcf([ee_compas_frame])[0]
                artist = FrameArtist(ee_compas_frame)
                ee_frame = artist.draw()

            if show_frames:
                frames = []
                for compas_frame in compas_frames[1:]:
                    artist = FrameArtist(compas_frame)
                    frame = artist.draw()
                    frames.append(frame)

            if show_acm:
                attached_meshes = []
                for acm in attached_collision_meshes:
                    frame = robot.forward_kinematics(configuration, options=dict(solver='model', link_name=acm.link_name))
                    T = Transformation.from_frame_to_frame(Frame.worldXY(), frame)
                    mesh = acm.collision_mesh.mesh.transformed(T)
                    attached_meshes.append(MeshArtist(mesh).draw())

        return (visual, collision, attached_meshes, frames, base_frame, ee_frame)
# ---------- end robot_visualize ----------
geo = Geometry([robot_visualize.visual, robot_visualize.collision, robot_visualize.attached_meshes])
preview = CustomPreview(Geometry=geo, Shader=ColourSwatch(SwatchColor=RGB(207, 157, 160)))
draw = GhPythonScript(planes=[robot_visualize.frames, robot_visualize.base_frame, robot_visualize.ee_frame], scale=Slider(0.2, range=0..1))  # -> P, V, C, W; inputs planes: list
# ---------- draw: Python ----------
from System.Drawing import Color
from compas_ghpython.artists import FrameArtist

red = Color.FromArgb(255, 0, 0)
green = Color.FromArgb(0, 255, 0)
blue = Color.FromArgb(0, 0, 255)

P = []
V = []
C = []

scale = float(scale)

for plane in planes:
    if not plane:
        continue
    P += [plane.Origin] * 3
    V.append(plane.XAxis * scale)
    V.append(plane.YAxis * scale)
    V.append(plane.ZAxis * scale)
    C += [red, green, blue]

W = 3
# ---------- end draw ----------
vdisex = VectorDisplayEx(Point=draw.P, Vector=draw.V, Colour=draw.C, Width=draw.W)

receive = Button()
scale_m_mm = Slider(0.001, range=0..0.001)
received_frame = GhPythonScript(robot=robot_2, scale=scale_m_mm, receive=receive)  # -> frame, plane
# ---------- received_frame: Python ----------
import compas_rrc as rrc
from compas.geometry import Frame, Scale
from compas_ghpython import draw_frame
from compas_ghpython.artists import FrameArtist

if receive == True:
    receive_frame, external_axes = robot.abb_client.send_and_wait(rrc.GetRobtarget())
    #print receive_frame

#track_position = tuple(x/1000 for x in external_axes)
robot_track_position = external_axes[0]*scale
print robot_track_position



p = draw_frame(receive_frame)
#print p
n_plane = Frame(p.Origin*scale, p.XAxis, p.YAxis)
print n_plane

plane = draw_frame(n_plane)
# ---------- end received_frame ----------
draw_2 = GhPythonScript(planes=received_frame.plane, scale=Slider(0.2, range=0..1))  # -> P, V, C, W; inputs planes: list; same code as draw
data_recorder = DataRecorder(received_frame.frame, DataLimit=-10, RecordData=True)
vdisex_2 = VectorDisplayEx(Point=draw_2.P, Vector=draw_2.V, Colour=draw_2.C, Width=draw_2.W)
frame_values = Panel(data_recorder)

x_axis_2 = Curve(<curve referenced from the Rhino model>)
y_axis_2 = Curve(<curve referenced from the Rhino model>)

# ----
# IK Control
tcp_speed = Slider(250, range=0..250)
scale_m_mm_2 = Slider(0.001, range=0..0.001)
send = Button()
send_joint_command = GhPythonScript(robot=robot_2, full_configurations=filter_2, speed=tcp_speed, scale=scale_m_mm_2, send=send)  # -> out; inputs full_configurations: list, send: Boolean
# ---------- send_joint_command: Python ----------
import compas_rrc as rrc
from compas.robots import Joint
from compas_fab.robots import Configuration
import math


if send==True:
    # Define the configuration
    robot_configurations =  []
    for configuration in full_configurations:
        robot_joint_positions = []
        for i, joint_type in enumerate(configuration.joint_types):
            if joint_type == Joint.REVOLUTE:
                robot_joint_positions.append(math.degrees(configuration.joint_values[i]))
            if joint_type == Joint.PRISMATIC:
                robot_track_position = configuration.joint_values[i]/scale
        robot_configurations.append({"joint_positions": robot_joint_positions, "track_position": robot_track_position})



    # Move to position
    for configuration in robot_configurations:
        print(configuration["joint_positions"])
        print(configuration["track_position"])
        done = robot.abb_client.send(rrc.MoveToJoints(configuration["joint_positions"], [configuration["track_position"]], speed, rrc.Zone.FINE))
# ---------- end send_joint_command ----------
data_recorder_2 = DataRecorder(send_joint_command, DataLimit=-10, RecordData=True)
panel_3 = Panel(data_recorder_2)

frame_to_plane = GhPythonScript()  # -> plane; disabled
# ---------- frame_to_plane: Python ----------
from compas.geometry import Point, Frame, Vector
from compas_ghpython.artists import FrameArtist
import Rhino.Geometry as rg


frame = Frame(Point(2.434, -0.000, 1.746), Vector(-0.259, 0.000, -0.966), Vector(0.000, 1.000, 0.000))
#ExternalAxes = ([1000.0]))






frameartist = FrameArtist(frame)
plane = frameartist.draw()
# ---------- end frame_to_plane ----------
send_2 = Button()

# ----
# MoveJ Control
tcp_speed_2 = Slider(250, range=0..250)
send_joint_command_2 = GhPythonScript(robot=robot_2, fk_configuration=filter_2, speed=tcp_speed_2, send=send_2)  # -> out; inputs send: Boolean
# ---------- send_joint_command_2: Python ----------
import compas_rrc as rrc
from compas.robots import Joint
from compas_fab.robots import Configuration
import math


robot_joint_positions = []

for i, joint_type in enumerate(fk_configuration.joint_types):
    if joint_type == Joint.REVOLUTE:
        robot_joint_positions.append(math.degrees(fk_configuration.joint_values[i]))
    if joint_type == Joint.PRISMATIC:
        robot_track_position = fk_configuration.joint_values[i]*1000

print (robot_joint_positions, robot_track_position)

track_pos_joint_goal = [robot_track_position]
#print track_pos_joint_goal


if send == True:
    robot.abb_client.send(rrc.MoveToJoints(robot_joint_positions, track_pos_joint_goal, speed, rrc.Zone.FINE))
# ---------- end send_joint_command_2 ----------
data_recorder_3 = DataRecorder(send_joint_command_2, DataLimit=-10, RecordData=True)
joint_values = Panel(data_recorder_3)

plane_2 = PythonScript(plane_axes=[x_axis_2, y_axis_2])  # -> plane; inputs plane_axes: list of Curve; same code as plane
plane_3 = Plane(frame_to_plane)  # disabled
plane_01 = Plane(Plane(origin=(2.342267334, 0, 1.926251099), x=(-0.1736481324, 0, -0.984807761), y=(0, 1, 0)))

# ----
# MoveL Control
scale_m_mm_3 = Slider(0.001, range=0..0.001)
tcp_speed_3 = Slider(250, range=0..250)
send_3 = Button()
send_frame_command = GhPythonScript(robot=robot_2, end_plane=plane_01, speed=tcp_speed_3, scale=scale_m_mm_3, send=send_3)  # -> out; inputs end_plane: Plane, send: Boolean
# ---------- send_frame_command: Python ----------
import compas_rrc as rrc
from compas.geometry import Frame, Scale
import math
import fabtory_fabrication_control as ffc





second_frame = Frame(end_plane.Origin/scale, end_plane.XAxis, end_plane.YAxis)
print second_frame

if send == True:
    #robot.abb_client.send(rrc.MoveToRobtarget(second_frame, external_axes, speed, rrc.Zone.FINE))
    #robot.abb_client.send(rrc.MoveToFrame(second_frame, speed, rrc.Zone.FINE))
    #robot.abb_client.send(rrc.MoveToFrame(second_frame, speed, rrc.Zone.FINE, rrc.Motion.JOINT))


    # Set tool
    robot.abb_client.send(rrc.SetTool('tool0'))
    print('Set tool0')

    # Set work object
    robot.abb_client.send(rrc.SetWorkObject('wobj0'))
    print('Set work object')
 
    # Send MoveToFrame Command
    frame = ffc.utilities.plane_to_frame(end_plane)
    robot.abb_client.send(rrc.MoveToFrame(second_frame, speed, rrc.Zone.FINE))
    
    # send move to frame command
    # ffc.commands.move_to_frame(robot, end_plane, speed)

    # End of Code
    print('Finished')
# ---------- end send_frame_command ----------
data_recorder_4 = DataRecorder(send_frame_command, DataLimit=-10, RecordData=True)
out_2 = Panel(data_recorder_4)

plane_02 = Plane(Plane(origin=(1.721566162, -0.9640608521, 0.8409630737), x=(-0.2910093804, 0.9498357531, -0.1145669352), y=(0.9087045917, 0.3118754582, 0.2774701129)))
receive_2 = Button()
receive_3 = BooleanToggle(True)

# ----
# MoveL Control
scale_m_mm_4 = Slider(0.001, range=0..0.001)
tcp_speed_4 = Slider(250, range=0..250)
send_4 = Button()
send_frame_offset_command = GhPythonScript(robot=robot_2, speed=tcp_speed_4, scale=scale_m_mm_4, receive=receive_3, send=send_4)  # -> out, plane; inputs send: Boolean
# ---------- send_frame_offset_command: Python ----------
import compas_rrc as rrc
from compas.geometry import Frame, Scale
from compas_ghpython import draw_frame


if receive == True:
    receive_frame, external_axes = robot.abb_client.send_and_wait(rrc.GetRobtarget())

receive_frame.point[0] += 500
robot_track_position = [(external_axes[0] + 0)]
print robot_track_position


#To vizualize the plane in GH
p = draw_frame(receive_frame)
n_plane = Frame(p.Origin*scale, p.XAxis, p.YAxis)
plane = draw_frame(n_plane)


if receive and send == True:
    # Set tool
    robot.abb_client.send(rrc.SetTool('tool0'))
    print('Set tool0')

    # Set work object
    robot.abb_client.send(rrc.SetWorkObject('wobj0'))
    print('Set work object')

    # send frame
    robot.abb_client.send(rrc.MoveToRobtarget(receive_frame, robot_track_position, speed, rrc.Zone.FINE))
    print('Finish')
# ---------- end send_frame_offset_command ----------
data_recorder_5 = DataRecorder(send_frame_offset_command.out, DataLimit=-10, RecordData=True)
draw_3 = GhPythonScript(planes=send_frame_offset_command.plane, scale=Slider(0.2, range=0..1))  # -> P, V, C, W; inputs planes: list; same code as draw
out_3 = Panel(data_recorder_5)
vdisex_3 = VectorDisplayEx(Point=draw_3.P, Vector=draw_3.V, Colour=draw_3.C, Width=draw_3.W)

# ----
# RobotStudio Feedback
scale_m_mm_5 = Slider(0.001, range=0..0.001)
receive_4 = Button()
receive_5 = Button()
received_joints = GhPythonScript(robot=robot_2, receive=receive_4)  # -> joint
# ---------- received_joints: Python ----------
import compas_rrc as rrc
from compas.robots import Joint
from compas_fab.robots import Configuration
import math
from compas_ghpython import draw_frame


#Get joints
if receive == True:
    robot_joints, external_axes = robot.abb_client.send_and_wait(rrc.GetJoints())
    print (robot_joints, external_axes)
# ---------- end received_joints ----------
data_recorder_6 = DataRecorder(received_joints, DataLimit=-10, RecordData=True)
received_frame_2 = GhPythonScript(robot=robot_2, scale=scale_m_mm_5, receive=receive_5)  # -> frame, plane; same code as received_frame
data_recorder_7 = DataRecorder(received_frame_2.frame, DataLimit=-10, RecordData=True)
joint_values_2 = Panel(data_recorder_6)
draw_4 = GhPythonScript(planes=received_frame_2.plane, scale=Slider(0.2, range=0..1))  # -> P, V, C, W; inputs planes: list; same code as draw
frame_values_2 = Panel(data_recorder_7)
vdisex_4 = VectorDisplayEx(Point=draw_4.P, Vector=draw_4.V, Colour=draw_4.C, Width=draw_4.W)

# ==== cluster Tools

# ---- group: area grip tool
geo = Geometry(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)
mesh = Mesh(geo)
mjoin = MeshJoin(Meshes=mesh)
zaxis_line = Curve(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)
xaxis_line = Curve(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)
tool = PythonScript(rhmesh=mjoin, xline=xaxis_line, zline=zaxis_line)  # -> tool; inputs rhmesh: Mesh
# ---------- tool: Python ----------
import Rhino.Geometry as rg
import os, math
from compas.geometry import Frame, Rotation
from compas.datastructures import Mesh
from compas_ghpython.artists import MeshArtist
from compas_fab.robots import Tool
from compas_rhino.geometry import RhinoMesh

xaxis = rg.Line(xline.PointAtStart, xline.PointAtEnd)
zaxis = rg.Line(zline.PointAtStart, zline.PointAtEnd)

if xaxis.From.DistanceTo(zaxis.From) < 0.01:
    origin = xaxis.From
    xaxis = xaxis.Direction
    zaxis = zaxis.Direction
elif xaxis.To.DistanceTo(zaxis.To) < 0.01:
    origin = xaxis.To
    xaxis = -xaxis.Direction
    zaxis = -zaxis.Direction
elif xaxis.From.DistanceTo(zaxis.To) < 0.01:
    origin = xaxis.From
    xaxis = xaxis.Direction
    zaxis = -zaxis.Direction
elif xaxis.To.DistanceTo(zaxis.From) < 0.01:
    origin = xaxis.To
    xaxis = -xaxis.Direction
    zaxis = zaxis.Direction

xaxis.Unitize()
zaxis.Unitize()


ee_frame = Frame(origin, xaxis, zaxis)
rmesh = RhinoMesh()
rmesh.from_geometry(rhmesh)
ee_mesh = rmesh.to_compas()

#ee_frame = Frame(origin, xaxis, yaxis)
#ee_mesh = RhinoMesh.from_geometry(rhmesh).to_compas()

tool = Tool(ee_mesh, ee_frame)
# ---------- end tool ----------

# ---- group: measurement tool
geo_2 = Geometry(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)
mesh_2 = Mesh(geo_2)
mjoin_2 = MeshJoin(Meshes=mesh_2)
xaxis_line_2 = Curve(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)
yaxis_line = Curve(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)
tool_2 = PythonScript(rhmesh=mjoin_2, xline=xaxis_line_2, yline=yaxis_line)  # -> tool; inputs rhmesh: Mesh
# ---------- tool_2: Python ----------
import Rhino.Geometry as rg
import os, math
from compas.geometry import Frame, Rotation
from compas.datastructures import Mesh
from compas_ghpython.artists import MeshArtist
from compas_fab.robots import Tool
from compas_rhino.geometry import RhinoMesh

xaxis = rg.Line(xline.PointAtStart, xline.PointAtEnd)
yaxis = rg.Line(yline.PointAtStart, yline.PointAtEnd)

if xaxis.From.DistanceTo(yaxis.From) < 0.01:
    origin = xaxis.From
    xaxis = xaxis.Direction
    yaxis = yaxis.Direction
elif xaxis.To.DistanceTo(yaxis.To) < 0.01:
    origin = xaxis.To
    xaxis = -xaxis.Direction
    yaxis = -yaxis.Direction
elif xaxis.From.DistanceTo(yaxis.To) < 0.01:
    origin = xaxis.From
    xaxis = xaxis.Direction
    yaxis = -yaxis.Direction
elif xaxis.To.DistanceTo(yaxis.From) < 0.01:
    origin = xaxis.To
    xaxis = -xaxis.Direction
    yaxis = yaxis.Direction

xaxis.Unitize()
yaxis.Unitize()

ee_frame = Frame(origin, xaxis, yaxis)
rmesh = RhinoMesh()
rmesh.from_geometry(rhmesh)
ee_mesh = rmesh.to_compas()
"""
ee_frame = Frame(origin, xaxis, yaxis)
ee_mesh = RhinoMesh.from_geometry(rhmesh).to_compas()
"""
tool = Tool(ee_mesh, ee_frame)
# ---------- end tool_2 ----------

# ---- group: area grip tool
geo_3 = Geometry(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)
mesh_3 = Mesh(geo_3)
mjoin_3 = MeshJoin(Meshes=mesh_3)
yaxis_line_2 = Curve(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)
xaxis_line_3 = Curve(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)
tool_3 = PythonScript(rhmesh=mjoin_3, xline=xaxis_line_3, yline=yaxis_line_2)  # -> tool; inputs rhmesh: Mesh
# ---------- tool_3: Python ----------
import Rhino.Geometry as rg
import os, math
from compas.geometry import Frame, Rotation
from compas.datastructures import Mesh
from compas_ghpython.artists import MeshArtist
from compas_fab.robots import Tool
from compas_rhino.geometry import RhinoMesh

xaxis = rg.Line(xline.PointAtStart, xline.PointAtEnd)
yaxis = rg.Line(yline.PointAtStart, yline.PointAtEnd)

if xaxis.From.DistanceTo(yaxis.From) < 0.01:
    origin = xaxis.From
    xaxis = xaxis.Direction
    yaxis = yaxis.Direction
elif xaxis.To.DistanceTo(yaxis.To) < 0.01:
    origin = xaxis.To
    xaxis = -xaxis.Direction
    yaxis = -yaxis.Direction
elif xaxis.From.DistanceTo(yaxis.To) < 0.01:
    origin = xaxis.From
    xaxis = xaxis.Direction
    yaxis = -yaxis.Direction
elif xaxis.To.DistanceTo(yaxis.From) < 0.01:
    origin = xaxis.To
    xaxis = -xaxis.Direction
    yaxis = yaxis.Direction

xaxis.Unitize()
yaxis.Unitize()

ee_frame = Frame(origin, xaxis, yaxis)
rmesh = RhinoMesh()
rmesh.from_geometry(rhmesh)
ee_mesh = rmesh.to_compas()

#ee_frame = Frame(origin, xaxis, yaxis)
#ee_mesh = RhinoMesh.from_geometry(rhmesh).to_compas()

tool = Tool(ee_mesh, ee_frame)
# ---------- end tool_3 ----------

# ----
G = ClusterInput()
filter = StreamFilter(Gate=G, Stream0=tool_2, Stream1=tool_3, Stream2=tool)
s_1 = ClusterOutput(filter)
