# Grasshopper definition fabtory_control_3CDP - testfile.ghx (Grasshopper 1.0.7)

reload = Button()
path = PythonScript()  # -> HERE, DATA, ROBOT_DESCRIPTION
# ---------- path: Python ----------
import os

HERE = os.path.dirname(ghdoc.Path)
DATA = os.path.abspath(os.path.join(HERE, "..", "data"))
ROBOT_DESCRIPTION = os.path.abspath(os.path.join(DATA, "robot_description"))

print(HERE)
print(DATA)
print(ROBOT_DESCRIPTION)
# ---------- end path ----------
py = PythonScript(reload=reload)
# ---------- py: Python ----------
if reload:
    from compas_ghpython import unload_modules
    unload_modules("compas")
    unload_modules("compas_fab")
    unload_modules("fabtory_fabrication_control")
    unload_modules("compas_rrc")
    unload_modules("extruder_control")

    unload_modules("fabrication_control")
    unload_modules("assembly_information_model")
# ---------- end py ----------

# ----
# Kappendecke - Var. 3
var_3_one_layered = Curve(reparameterize([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]))
var_3_double_layered = Curve(reparameterize([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]))

# ----
# Kappendecke - Var. 1
var_1_double_layered = Curve(reparameterize([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]))
var_1_one_layered = Curve(reparameterize([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]))

# ----
# Kappendecke - Var. 2
var_2_one_layered = Curve(reparameterize(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))
var_2_double_layered = Curve(reparameterize(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))

# ----
# Kappendecke - Var. 4
var_4_one_layered = Curve(reparameterize([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]))
var_4_double_layered = Curve(reparameterize([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]))

# ----
# Var. 3 - planes
show = BooleanToggle(True)
fab_planes = GhPythonScript(toolpath=flatten(var_3_one_layered), show_preview=show)  # -> fab_planes_a, planes_layer_a, fab_planes_b, planes_layer_b, fab_planes_c, planes_layer_c, port, preview; inputs toolpath: list of Curve, show_preview: Boolean
# ---------- fab_planes: Python ----------
import ghpythonlib.components as gh 
import math



###########################################################
## Define fabrication planes: 
###########################################################
def fab_planes(toolpath, subdivision = 35):
    
    ## remove the connection lines:
    curves_filtered = []
    
    single_curves = gh.Explode(toolpath, True)[0]
    for crv in single_curves:
      if str(type(crv)) != "<type 'LineCurve'>": curves_filtered.append(crv)
    
    curves_filtered = gh.JoinCurves(curves_filtered, False)
    
    pts_mid = gh.CurveMiddle(curves_filtered)
    pts_ind = gh.SortAlongCurve(pts_mid, toolpath)[1]
    
    curves_filtered_new = []
    for i in range(len(pts_ind)): curves_filtered_new.append(curves_filtered[pts_ind[i]])
    
    
    ## resort the curves:
    curves_sorted = []
    
    curves_flipped = gh.FlipCurve(curves_filtered_new, curves_filtered_new[0])[0]
    for i in range(len(curves_flipped)):
        if i %2 == 0: curves_sorted.append(gh.FlipCurve(curves_flipped[i])[0])
        else: curves_sorted.append(curves_flipped[i])
    
    
    ## Create the fabrication planes: 
    fab_planes = []
    planes_layer = []
    
    for crv in curves_sorted:
        
        divisions = int(subdivision*gh.Length(crv)/0.85)
        if divisions < 3: divisions = 3
        
        base_plane = gh.Planar(crv)[1]
        div = gh.DivideCurve(crv, divisions, False)[0]
        planes_layer.append(len(div))
        
        for pt in div:
            plane_loc = gh.PlaneOrigin(base_plane, pt)
            plane_loc_dec = gh.DeconstructPlane(plane_loc)
            
            plane_new = gh.PlaneNormal(plane_loc_dec[0], plane_loc_dec[3])
            plane_new_dec = gh.DeconstructPlane(plane_new)
            
            flip_x = False
            flip_y = False
            if plane_new_dec[1][1] < 0: flip_x = True
            if plane_new_dec[1][0] < 0: flip_x = True
            if plane_new_dec[2][0] < 0: flip_y = True
            plane_new = gh.FlipPlane(plane_new, flip_x, flip_y, False)
            
            fab_planes.append(plane_new)
    
    
    return(fab_planes, planes_layer)



###########################################################
## Optimize curves: 
###########################################################

part_a = fab_planes(toolpath[0])
part_b = fab_planes(toolpath[1])
part_c = fab_planes(toolpath[2])

fab_planes_a = part_a[0]
fab_planes_b = part_b[0]
fab_planes_c = part_c[0]

planes_layer_a = part_a[1]
planes_layer_b = part_b[1]
planes_layer_c = part_c[1]



###########################################################
## Preview curves: 
###########################################################

if show_preview == True:
    preview = []
    
    preview.append(gh.PolyLine(gh.DeconstructPlane(fab_planes_a)[0], False))
    preview.append(gh.PolyLine(gh.DeconstructPlane(fab_planes_b)[0], False))
    preview.append(gh.PolyLine(gh.DeconstructPlane(fab_planes_c)[0], False))
# ---------- end fab_planes ----------
colour_swatch = ColourSwatch(SwatchColor=RGB(184, 0, 0))  # disabled
custom_preview = CustomPreview(Geometry=fab_planes.preview, Material=colour_swatch)

# ----
# Var. 2 - planes
show_2 = BooleanToggle(True)
fab_planes_2 = GhPythonScript(toolpath=flatten(var_1_one_layered), show_preview=show_2)  # -> fab_planes_a, planes_layer_a, fab_planes_b, planes_layer_b, port, preview; inputs toolpath: list of Curve, show_preview: Boolean
# ---------- fab_planes_2: Python ----------
import ghpythonlib.components as gh 
import math



###########################################################
## Define fabrication planes: 
###########################################################
def fab_planes(toolpath, subdivision = 35):
    
    ## remove the connection lines:
    curves_filtered = []
    
    single_curves = gh.Explode(toolpath, True)[0]
    for crv in single_curves:
      if str(type(crv)) != "<type 'LineCurve'>": curves_filtered.append(crv)
    
    curves_filtered = gh.JoinCurves(curves_filtered, False)
    
    pts_mid = gh.CurveMiddle(curves_filtered)
    pts_ind = gh.SortAlongCurve(pts_mid, toolpath)[1]
    
    curves_filtered_new = []
    for i in range(len(pts_ind)): curves_filtered_new.append(curves_filtered[pts_ind[i]])
    
    
    ## resort the curves:
    curves_sorted = []
    
    curves_flipped = gh.FlipCurve(curves_filtered_new, curves_filtered_new[0])[0]
    for i in range(len(curves_flipped)):
        if i %2 == 0: curves_sorted.append(gh.FlipCurve(curves_flipped[i])[0])
        else: curves_sorted.append(curves_flipped[i])
    
    
    ## Create the fabrication planes: 
    fab_planes = []
    planes_layer = []
    
    for crv in curves_sorted:
        
        divisions = int(subdivision*gh.Length(crv)/0.85)
        if divisions < 3: divisions = 3
        
        base_plane = gh.Planar(crv)[1]
        div = gh.DivideCurve(crv, divisions, False)[0]
        planes_layer.append(len(div))
        
        for pt in div:
            plane_loc = gh.PlaneOrigin(base_plane, pt)
            plane_loc_dec = gh.DeconstructPlane(plane_loc)
            
            plane_new = gh.PlaneNormal(plane_loc_dec[0], plane_loc_dec[3])
            plane_new_dec = gh.DeconstructPlane(plane_new)
            
            flip_x = False
            flip_y = False
            if plane_new_dec[1][1] < 0: flip_x = True
            if plane_new_dec[1][0] < 0: flip_x = True
            if plane_new_dec[2][0] < 0: flip_y = True
            plane_new = gh.FlipPlane(plane_new, flip_x, flip_y, False)
            
            fab_planes.append(plane_new)
    
    
    return(fab_planes, planes_layer)



###########################################################
## Optimize curves: 
###########################################################

points_part_a = gh.ControlPoints(toolpath[0])[0]
fab_planes_a = gh.FlipPlane(gh.XYPlane(points_part_a), False, False, True)
planes_layer_a = [4]

for i in range (int(((len(points_part_a)-4)/10))):
    planes_layer_a.append(10)
planes_layer_a.append(4)

part_b = fab_planes(toolpath[1])

fab_planes_b = part_b[0]
planes_layer_b = part_b[1]

fab_planes_b.reverse()
planes_layer_b.reverse()



###########################################################
## Add additional planes for the last step: 
###########################################################

plane_a = gh.DeconstructPlane(fab_planes_a[-1])
plane_a_end = gh.ConstructPlane(gh.ConstructPoint(plane_a[0][0], plane_a[0][1]-0.15, plane_a[0][2]+0.15), plane_a[1], plane_a[2])
fab_planes_a.append(plane_a_end)
planes_layer_a[-1] += 1


plane_b = gh.DeconstructPlane(fab_planes_b[-1])
plane_b_end = gh.ConstructPlane(gh.ConstructPoint(plane_b[0][0], plane_b[0][1]-0.15, plane_b[0][2]+0.15), plane_b[1], plane_b[2])
fab_planes_b.append(plane_b_end)
planes_layer_b[-1] += 1



###########################################################
## Preview curves: 
###########################################################

if show_preview == True:
    preview = []
    
    preview.append(gh.PolyLine(gh.DeconstructPlane(fab_planes_a)[0], False))
    preview.append(gh.PolyLine(gh.DeconstructPlane(fab_planes_b)[0], False))
# ---------- end fab_planes_2 ----------
custom_preview_2 = CustomPreview(Geometry=fab_planes_2.preview, Material=ColourSwatch(SwatchColor=RGB(184, 0, 0)))

# ----
# Var. 2 - planes
show_3 = BooleanToggle(True)
fab_planes_3 = GhPythonScript(toolpath=flatten(var_2_double_layered), show_preview=show_3)  # -> fab_planes_a, planes_layer_a, port, preview; inputs toolpath: list of Curve, show_preview: Boolean
# ---------- fab_planes_3: Python ----------
import ghpythonlib.components as gh 
import math



###########################################################
## Define fabrication planes: 
###########################################################

def fab_planes(toolpath, subdivision = 35):
    
    ## remove the connection lines:
    curves_filtered = []
    
    single_curves = gh.Explode(toolpath, True)[0]
    for crv in single_curves:
      if str(type(crv)) != "<type 'LineCurve'>": curves_filtered.append(crv)
    
    curves_filtered = gh.JoinCurves(curves_filtered, False)
    
    pts_mid = gh.CurveMiddle(curves_filtered)
    pts_ind = gh.SortAlongCurve(pts_mid, toolpath)[1]
    
    curves_filtered_new = []
    for i in range(len(pts_ind)): curves_filtered_new.append(curves_filtered[pts_ind[i]])
    
    
    ## resort the curves:
    curves_sorted = []
    
    curves_flipped = gh.FlipCurve(curves_filtered_new, curves_filtered_new[0])[0]
    for i in range(len(curves_flipped)):
        if i %2 == 0: curves_sorted.append(gh.FlipCurve(curves_flipped[i])[0])
        else: curves_sorted.append(curves_flipped[i])
    
    
    ## Create the fabrication planes: 
    fab_planes = []
    planes_layer = []
    
    for crv in curves_sorted:
        
        divisions = int(subdivision*gh.Length(crv)/0.85)
        if divisions < 3: divisions = 3
        
        base_plane = gh.Planar(crv)[1]
        div = gh.DivideCurve(crv, divisions, False)[0]
        planes_layer.append(len(div))
        
        for pt in div:
            plane_loc = gh.PlaneOrigin(base_plane, pt)
            plane_loc_dec = gh.DeconstructPlane(plane_loc)
            
            plane_new = gh.PlaneNormal(plane_loc_dec[0], plane_loc_dec[3])
            plane_new_dec = gh.DeconstructPlane(plane_new)
            
            flip_x = False
            flip_y = False
            if plane_new_dec[1][1] < 0: flip_x = True
            if plane_new_dec[1][0] < 0: flip_x = True
            if plane_new_dec[2][0] < 0: flip_y = True
            plane_new = gh.FlipPlane(plane_new, flip_x, flip_y, False)
            
            fab_planes.append(plane_new)
    
    
    return(fab_planes, planes_layer)



###########################################################
## Optimize curves: 
###########################################################

planes = fab_planes(toolpath[0])
fab_planes_a = planes[0]
planes_layer_a = planes[1]



###########################################################
## Add additional planes for the last step: 
###########################################################

plane_a = gh.DeconstructPlane(fab_planes_a[-1])
plane_a_end = gh.ConstructPlane(gh.ConstructPoint(plane_a[0][0], plane_a[0][1]-0.15, plane_a[0][2]+0.15), plane_a[1], plane_a[2])
fab_planes_a.append(plane_a_end)
planes_layer_a[-1] += 1



###########################################################
## Preview curves: 
###########################################################

if show_preview == True:
    preview = []
    
    preview.append(gh.PolyLine(gh.DeconstructPlane(fab_planes_a)[0], False))
# ---------- end fab_planes_3 ----------
colour_swatch_2 = ColourSwatch(SwatchColor=RGB(184, 0, 0))  # disabled
custom_preview_3 = CustomPreview(Geometry=fab_planes_3.preview, Material=colour_swatch_2)

# ----
# Var. 4 - planes
show_4 = BooleanToggle(True)
fab_planes_4 = GhPythonScript(toolpath=flatten(var_4_double_layered), show_preview=show_4)  # -> fab_planes_a, planes_layer_a, fab_planes_b, planes_layer_b, fab_planes_c, planes_layer_c, port, preview; inputs toolpath: list of Curve, show_preview: Boolean; same code as fab_planes
colour_swatch_3 = ColourSwatch(SwatchColor=RGB(184, 0, 0))  # disabled
custom_preview_4 = CustomPreview(Geometry=fab_planes_4.preview, Material=colour_swatch_3)  # disabled

# ----
# planes from curve
div_len = Slider(0.1, range=0..1)
crv = Curve(<curve referenced from the Rhino model>)
curve_def = GhPythonScript(crv=crv, div_len=div_len)  # -> planes; inputs crv: Curve
# ---------- curve_def: Python ----------
import rhinoscriptsyntax as rs
from compas.geometry import Frame, Line, Vector
from compas_ghpython import draw_frame

# dividing curve
pts = rs.DivideCurveLength(crv, div_len)
frames = [Frame([pt.X, pt.Y, pt.Z], [90, -1, 0], [-1, 0, 0]) for pt in pts]
print frames

# for vizualization
planes = []
for frame in frames:
    planes.append(draw_frame(frame))
# ---------- end curve_def ----------

layers_count = Slider(5, range=1..100)  # disabled
length_m = Slider(1, range=0..3)  # disabled
layer_height_m = Slider(0.01, range=0..0.4)  # disabled
amplitude_factor = Slider(0.085, range=0..1)  # disabled
waves_count = Slider(1, range=0..5)  # disabled
wave = BooleanToggle(True)  # disabled

# ----
# planes from am_model
base_point = Point(Point(1.376474623, -1.951755765, 0.6648682508))  # disabled
straight_line_cos_wave = GhPythonScript(
    length=length_m,
    layers=layers_count,
    layer_height=layer_height_m,
    base_point=base_point,
    wavy=wave,
    amplitude=amplitude_factor,
    waves=waves_count)  # -> out, points; inputs layers: Int32, base_point: Point3d, wavy: Boolean, waves: Int32; disabled
# ---------- straight_line_cos_wave: Python ----------
from compas.geometry import Point
import math
import ghpythonlib.components as gh


def straight_line(length, height, base_point):
    
    start = Point(base_point.x,base_point.y,base_point.z)
    end = Point(base_point.x+length,base_point.y,base_point.z+height)
    
    return(start, end)



def cos_wave(length, height, amplitude, waves, base_point):
    
    points= []
    waves = waves*10
    div = 50
    
    for i in range(div):
        
        x_point = length/div*i
        y_point = amplitude*math.cos(x_point*waves)
        
        points.append(Point(base_point.x+x_point,base_point.y+y_point,base_point.z+height))
        
    return(points)



points = []
base_point = Point(gh.Deconstruct(base_point)[0], gh.Deconstruct(base_point)[1], gh.Deconstruct(base_point)[2])

for i in range(layers):
    
    if wavy == True:
        
        curve = cos_wave(length, i*layer_height, amplitude, waves, base_point)
        
        if i%2 == 0:
            curve.reverse()
            
        for pt in curve:
            points.append(pt)
        
    else:
        
        curve = straight_line(length, i*layer_height, base_point)
        
        if i%2 == 0:
            curve = reversed(curve)
            
        for pt in curve:
            points.append(pt)
# ---------- end straight_line_cos_wave ----------
show_5 = BooleanToggle(True)  # disabled
layer_def = GhPythonScript(points=straight_line_cos_wave.points, layers=layers_count)  # -> out, layer, am_model, planes; inputs points: list, layers: Int32; disabled
# ---------- layer_def: Python ----------
import ghpythonlib.components as gh
import os
import sys
import json

from compas.geometry import Frame
from compas.geometry import Line
from compas.geometry import Vector

from compas_ghpython import draw_frame

from am_information_model.model import Node
from am_information_model.model import Layer
from am_information_model.model import AMModel



def _radius_between_frames(from_frame, via_frame, to_frame, max_radius):
        in_line = Line(from_frame.point, via_frame.point)
        out_line = Line(via_frame.point, to_frame.point)
        r = min(max_radius, in_line.length/2, out_line.length/2)
        return r

# nodes
max_r = 10
frames = [Frame([pt.x, pt.y, pt.z], [90, -1, 0], [-1, 0, 0]) for pt in points]

print max_r

nodes = []
for i,frame in enumerate(frames):
    r = _radius_between_frames(frames[max(0,i-1)], frame, frames[min(i+1, len(frames)-1)], max_r)
    nodes.append(Node(frame, radius=r))



# Create the print_layer: 

def partition(lst, size):
    for i in range(0, len(lst), size):
        yield lst[i : i+size]

count = int(len(nodes)/layers)
nodes_layer = list(partition(nodes, count))


layer = []


for i in range(layers):
    
    layer_loc = Layer.from_nodes(nodes_layer[i])
    layer.append(layer_loc)



# Create AM Model: 

am_model = AMModel()

for i in range(len(layer)):
    layer_new = layer[i]
    am_model.add_layer(layer_new)
    
planes = []
for l, layer in am_model.layers():
    for k, node in layer.nodes():
        planes.append(draw_frame(node.frame))
# ---------- end layer_def ----------
draw_curve = PythonScript(layer=layer_def.layer, points=straight_line_cos_wave.points, show=show_5)  # -> C; inputs points: list; disabled
# ---------- draw_curve: Python ----------
from compas.geometry import Transformation, Point
from compas.geometry import Frame
from compas.datastructures import mesh_transformed
from compas_ghpython.artists import MeshArtist
from compas_ghpython import draw_frame
import ghpythonlib.components as gh



if show:
    points_gh = []
    
    for pt in points:
        
        points_gh.append(gh.ConstructPoint(pt.x, pt.y, pt.z))
    
    C = gh.PolyLine(points_gh, False)



if show:
    F = [draw_frame(node.frame) for key, node in layer.nodes()]
# ---------- end draw_curve ----------
curve = Curve(draw_curve)  # disabled
planes = Plane(layer_def.planes)  # disabled

# ----
# single plane
x_axis = Curve(<curve referenced from the Rhino model>)
y_axis = Curve(<curve referenced from the Rhino model>)
plane = PythonScript(plane_axes=[x_axis, y_axis])  # -> plane; inputs plane_axes: list of Curve
# ---------- plane: Python ----------
import Rhino.Geometry as rg

x_axis, y_axis = plane_axes

x_axis = rg.Line(x_axis.PointAtStart, x_axis.PointAtEnd)
y_axis = rg.Line(y_axis.PointAtStart, y_axis.PointAtEnd)

if x_axis.From.DistanceTo(y_axis.From) < 0.01:
    origin = x_axis.From
    xvec = x_axis.Direction
    yvec = y_axis.Direction
elif x_axis.To.DistanceTo(y_axis.To) < 0.01:
    origin = x_axis.To
    xvec = -x_axis.Direction
    yvec = -y_axis.Direction
elif x_axis.From.DistanceTo(y_axis.To) < 0.01:
    origin = x_axis.From
    xvec = x_axis.Direction
    yvec = -y_axis.Direction
elif x_axis.To.DistanceTo(y_axis.From) < 0.01:
    origin = x_axis.To
    xvec = -x_axis.Direction
    yvec = y_axis.Direction

plane = rg.Plane(origin, xvec, yvec)
# ---------- end plane ----------

number_slider = Slider(0.035, range=0..1)

number_slider_2 = Slider(0.05, range=0..1)
transform = BooleanToggle(True)
transform_2 = BooleanToggle(True)
transform_3 = BooleanToggle(True)

transform_4 = BooleanToggle(True)

transform_5 = BooleanToggle(True)

# ----
# Var. 1 - AM Model - Part A
number_slider_3 = Slider(0.04, range=0..1)
transform_6 = BooleanToggle(True)
show_6 = BooleanToggle(True)
layer_def_2 = GhPythonScript(
    fab_planes=fab_planes_2.fab_planes_a,
    planes_layer=fab_planes_2.planes_layer_a,
    t_value=number_slider_3,
    transform=transform_6)  # -> layer, am_model, planes; inputs fab_planes: list of Plane, planes_layer: list of Int32, transform: Boolean
# ---------- layer_def_2: Python ----------
import ghpythonlib.components as gh
import os
import sys
import json

import Rhino.Geometry as rg

from compas.geometry import Frame
from compas.geometry import Line
from compas.geometry import Vector, Transformation

from am_information_model.model import Node
from am_information_model.model import Layer
from am_information_model.model import AMModel
from compas_ghpython import draw_frame
from compas.artists import Artist


def _radius_between_frames(from_frame, via_frame, to_frame, max_radius):
        in_line = Line(from_frame.point, via_frame.point)
        out_line = Line(via_frame.point, to_frame.point)
        r = min(max_radius, in_line.length/2, out_line.length/2)
        return r



# nodes
max_r = 0.1
frames = []

for plane in fab_planes:
    
    plane_dec = gh.DeconstructPlane(plane)
    
    p_orig = plane_dec[0]
    p_x = plane_dec[2]
    p_y = -plane_dec[1]
    p_z = plane_dec[3]
    
    
    frame = Frame([p_orig[0], p_orig[1], p_orig[2]], [p_x[0], p_x[1], p_x[2]], [p_y[0], p_y[1], p_y[2]])
    frames.append(frame)

nodes = []
for i,frame in enumerate(frames):
    r = _radius_between_frames(frames[max(0,i-1)], frame, frames[min(i+1, len(frames)-1)], max_r)
    nodes.append(Node(frame, radius=r))



# Create the print_layer: 
def partition(lst, size):
    for i in range(0, len(lst), size):
        yield lst[i : i+size]

nodes_layer = []
numb_old = 0

for i in range(len(planes_layer)):
    
    if i == 0: nodes_layer.append(nodes[0:planes_layer[i]])
    else: nodes_layer.append(nodes[numb_old:numb_old+planes_layer[i]])
    
    numb_old += planes_layer[i]


layer = []
for i in range(len(planes_layer)):
    layer_loc = Layer.from_nodes(nodes_layer[i])
    layer.append(layer_loc)



# Create AM Model: 
am_model = AMModel()

for i in range(len(layer)):
    layer_new = layer[i]
    am_model.add_layer(layer_new)
    
    
planes = []
frame = []

frames_transformed = []
for l, layer in am_model.layers():
    for k, node in layer.nodes():
        planes.append(draw_frame(node.frame))


if transform:
    for plane in planes:
        plane.Translate(rg.Vector3d.ZAxis*t_value)
# ---------- end layer_def_2 ----------
draw = PythonScript(layer=layer_def_2.layer, show=show_6)  # -> M, F, S
# ---------- draw: Python ----------
from compas.geometry import Transformation
from compas.geometry import Frame
from compas.datastructures import mesh_transformed
from compas_ghpython.artists import MeshArtist
from compas_ghpython import draw_frame

if show:
    F = [draw_frame(node.frame) for key, node in layer.nodes()]
# ---------- end draw ----------

transform_7 = BooleanToggle(True)
transform_8 = BooleanToggle(True)
transform_9 = BooleanToggle(True)

# ----
# Var. 1 - AM Model - Part B
show_7 = BooleanToggle(True)
layer_def_3 = GhPythonScript(
    fab_planes=fab_planes_2.fab_planes_b,
    planes_layer=fab_planes_2.planes_layer_b,
    t_value=Slider(0.04, range=0..1),
    transform=transform_5)  # -> layer, am_model, planes; inputs fab_planes: list of Plane, planes_layer: list of Int32, transform: Boolean
# ---------- layer_def_3: Python ----------
import ghpythonlib.components as gh
import os
import sys
import json

import Rhino.Geometry as rg

from compas.geometry import Frame
from compas.geometry import Line
from compas.geometry import Vector, Transformation

from am_information_model.model import Node
from am_information_model.model import Layer
from am_information_model.model import AMModel
from compas_ghpython import draw_frame


def _radius_between_frames(from_frame, via_frame, to_frame, max_radius):
        in_line = Line(from_frame.point, via_frame.point)
        out_line = Line(via_frame.point, to_frame.point)
        r = min(max_radius, in_line.length/2, out_line.length/2)
        return r



# nodes
max_r = 0.1
frames = []

for plane in fab_planes:
    
    plane_dec = gh.DeconstructPlane(plane)
    
    p_orig = plane_dec[0]
    p_x = plane_dec[2]
    p_y = -plane_dec[1]
    p_z = plane_dec[3]
    
    
    frame = Frame([p_orig[0], p_orig[1], p_orig[2]], [p_x[0], p_x[1], p_x[2]], [p_y[0], p_y[1], p_y[2]])
    frames.append(frame)

nodes = []
for i,frame in enumerate(frames):
    r = _radius_between_frames(frames[max(0,i-1)], frame, frames[min(i+1, len(frames)-1)], max_r)
    nodes.append(Node(frame, radius=r))



# Create the print_layer: 
def partition(lst, size):
    for i in range(0, len(lst), size):
        yield lst[i : i+size]

nodes_layer = []
numb_old = 0

for i in range(len(planes_layer)):
    
    if i == 0: nodes_layer.append(nodes[0:planes_layer[i]])
    else: nodes_layer.append(nodes[numb_old:numb_old+planes_layer[i]])
    
    numb_old += planes_layer[i]


layer = []
for i in range(len(planes_layer)):
    layer_loc = Layer.from_nodes(nodes_layer[i])
    layer.append(layer_loc)



# Create AM Model: 
am_model = AMModel()

for i in range(len(layer)):
    layer_new = layer[i]
    am_model.add_layer(layer_new)

    
planes = []
frame = []

frames_transformed = []
for l, layer in am_model.layers():
    for k, node in layer.nodes():
        planes.append(draw_frame(node.frame))


if transform:
    for plane in planes:
        plane.Translate(rg.Vector3d.ZAxis*t_value)
# ---------- end layer_def_3 ----------
draw_2 = PythonScript(layer=layer_def_3.layer, show=show_7)  # -> M, F, S; same code as draw

# ----
# Var. 3 - AM Model - Part A
layer_def_4 = GhPythonScript(fab_planes=fab_planes.fab_planes_a, planes_layer=fab_planes.planes_layer_a, t_value=number_slider_2, transform=transform)  # -> out, layer, am_model, planes; inputs fab_planes: list of Plane, planes_layer: list of Int32
# ---------- layer_def_4: Python ----------
import ghpythonlib.components as gh
import os
import sys
import json
import Rhino.Geometry as rg

from compas.geometry import Frame
from compas.geometry import Line
from compas.geometry import Vector, Transformation
from compas_ghpython import draw_frame

from am_information_model.model import Node
from am_information_model.model import Layer
from am_information_model.model import AMModel


def _radius_between_frames(from_frame, via_frame, to_frame, max_radius):
        in_line = Line(from_frame.point, via_frame.point)
        out_line = Line(via_frame.point, to_frame.point)
        r = min(max_radius, in_line.length/2, out_line.length/2)
        return r



# Change Plane direction: 
planes_new = []

for plane in fab_planes:
    
    plane_dec = gh.DeconstructPlane(plane)
    if abs(plane_dec[2][0]) > abs(plane_dec[1][0]): swap = True
    else: swap = False
    
    plane_loc = gh.FlipPlane(plane, False, False, swap)
    
    plane_loc_dec = gh.DeconstructPlane(plane_loc)
    if plane_loc_dec[2][1] > 0: flip_y = True
    else: flip_y = False
    plane_loc = gh.FlipPlane(plane_loc, False, flip_y, False)
    
    plane_loc_dec = gh.DeconstructPlane(plane_loc)
    if plane_loc_dec[1][0] < 0: flip_x = True
    else: flip_x = False
    plane_loc = gh.FlipPlane(plane_loc, flip_x,False , False)
    
    planes_new.append(plane_loc)

fab_planes = planes_new



# nodes
max_r = 0.1
frames = []

for plane in fab_planes:
    
    plane_dec = gh.DeconstructPlane(plane)
    
    p_orig = plane_dec[0]
    p_x = plane_dec[1]
    p_y = plane_dec[2]
    p_z = plane_dec[3]
    
    
    frame = Frame([p_orig[0], p_orig[1], p_orig[2]], [p_x[0], p_x[1], p_x[2]], [p_y[0], p_y[1], p_y[2]])
    frames.append(frame)

nodes = []
for i,frame in enumerate(frames):
    r = _radius_between_frames(frames[max(0,i-1)], frame, frames[min(i+1, len(frames)-1)], max_r)
    nodes.append(Node(frame, radius=r))



# Create the print_layer: 
def partition(lst, size):
    for i in range(0, len(lst), size):
        yield lst[i : i+size]

nodes_layer = []
numb_old = 0

for i in range(len(planes_layer)):
    
    if i == 0: nodes_layer.append(nodes[0:planes_layer[i]])
    else: nodes_layer.append(nodes[numb_old:numb_old+planes_layer[i]])
    
    numb_old += planes_layer[i]


layer = []
for i in range(len(planes_layer)):
    layer_loc = Layer.from_nodes(nodes_layer[i])
    layer.append(layer_loc)



# Create AM Model: 
am_model = AMModel()

for i in range(len(layer)):
    layer_new = layer[i]
    am_model.add_layer(layer_new)




# Create and transform planes:

planes = []
frame = []

frames_transformed = []
for l, layer in am_model.layers():
    for k, node in layer.nodes():
        planes.append(draw_frame(node.frame))


if transform:
    for plane in planes:
        plane.Translate(rg.Vector3d.ZAxis*t_value)
# ---------- end layer_def_4 ----------

# ----
# Var. 3 - AM Model - Part B
layer_def_5 = GhPythonScript(
    fab_planes=fab_planes.fab_planes_b,
    planes_layer=fab_planes.planes_layer_b,
    t_value=number_slider_2,
    transform=transform_2)  # -> out, layer, am_model, planes; inputs fab_planes: list of Plane, planes_layer: list of Int32, transform: Boolean
# ---------- layer_def_5: Python ----------
import ghpythonlib.components as gh
import os
import sys
import json

from compas.geometry import Frame
from compas.geometry import Line
from compas.geometry import Vector
from compas_ghpython import draw_frame
import Rhino.Geometry as rg

from am_information_model.model import Node
from am_information_model.model import Layer
from am_information_model.model import AMModel


def _radius_between_frames(from_frame, via_frame, to_frame, max_radius):
        in_line = Line(from_frame.point, via_frame.point)
        out_line = Line(via_frame.point, to_frame.point)
        r = min(max_radius, in_line.length/2, out_line.length/2)
        return r



# Change Plane direction: 
planes_new = []

for plane in fab_planes:
    
    plane_dec = gh.DeconstructPlane(plane)
    if abs(plane_dec[2][0]) > abs(plane_dec[1][0]): swap = True
    else: swap = False
    
    plane_loc = gh.FlipPlane(plane, False, False, swap)
    
    plane_loc_dec = gh.DeconstructPlane(plane_loc)
    if plane_loc_dec[2][1] > 0: flip_y = True
    else: flip_y = False
    plane_loc = gh.FlipPlane(plane_loc, False, flip_y, False)
    
    plane_loc_dec = gh.DeconstructPlane(plane_loc)
    if plane_loc_dec[1][0] < 0: flip_x = True
    else: flip_x = False
    plane_loc = gh.FlipPlane(plane_loc, flip_x,False , False)
    
    planes_new.append(plane_loc)

fab_planes = planes_new



# nodes
max_r = 0.1
frames = []

for plane in fab_planes:
    
    plane_dec = gh.DeconstructPlane(plane)
    
    p_orig = plane_dec[0]
    p_x = plane_dec[1]
    p_y = plane_dec[2]
    p_z = plane_dec[3]
    
    
    frame = Frame([p_orig[0], p_orig[1], p_orig[2]], [p_x[0], p_x[1], p_x[2]], [p_y[0], p_y[1], p_y[2]])
    frames.append(frame)

nodes = []
for i,frame in enumerate(frames):
    r = _radius_between_frames(frames[max(0,i-1)], frame, frames[min(i+1, len(frames)-1)], max_r)
    nodes.append(Node(frame, radius=r))



# Create the print_layer: 
def partition(lst, size):
    for i in range(0, len(lst), size):
        yield lst[i : i+size]

nodes_layer = []
numb_old = 0

for i in range(len(planes_layer)):
    
    if i == 0: nodes_layer.append(nodes[0:planes_layer[i]])
    else: nodes_layer.append(nodes[numb_old:numb_old+planes_layer[i]])
    
    numb_old += planes_layer[i]


layer = []
for i in range(len(planes_layer)):
    layer_loc = Layer.from_nodes(nodes_layer[i])
    layer.append(layer_loc)



# Create AM Model: 
am_model = AMModel()

for i in range(len(layer)):
    layer_new = layer[i]
    am_model.add_layer(layer_new)



# Create and transform planes:

planes = []
frame = []

frames_transformed = []
for l, layer in am_model.layers():
    for k, node in layer.nodes():
        planes.append(draw_frame(node.frame))


if transform:
    for plane in planes:
        plane.Translate(rg.Vector3d.ZAxis*t_value)
# ---------- end layer_def_5 ----------

# ----
# Var. 3 - AM Model - Part C
layer_def_6 = GhPythonScript(
    fab_planes=fab_planes.fab_planes_c,
    planes_layer=fab_planes.planes_layer_c,
    t_value=Slider(0.03, range=0..1),
    transform=transform_3)  # -> out, layer, am_model, planes; inputs fab_planes: list of Plane, planes_layer: list of Int32, transform: Boolean
# ---------- layer_def_6: Python ----------
import ghpythonlib.components as gh
import os
import sys
import json

from compas.geometry import Frame
from compas.geometry import Line
from compas.geometry import Vector
from compas_ghpython import draw_frame
import Rhino.Geometry as rg

from am_information_model.model import Node
from am_information_model.model import Layer
from am_information_model.model import AMModel


def _radius_between_frames(from_frame, via_frame, to_frame, max_radius):
        in_line = Line(from_frame.point, via_frame.point)
        out_line = Line(via_frame.point, to_frame.point)
        r = min(max_radius, in_line.length/2, out_line.length/2)
        return r



# nodes
max_r = 0.1
frames = []

for plane in fab_planes:
    
    plane_dec = gh.DeconstructPlane(plane)
    
    p_orig = plane_dec[0]
    p_x = plane_dec[2]
    p_y = -plane_dec[1]
    p_z = plane_dec[3]
    
    
    frame = Frame([p_orig[0], p_orig[1], p_orig[2]], [p_x[0], p_x[1], p_x[2]], [p_y[0], p_y[1], p_y[2]])
    frames.append(frame)

nodes = []
for i,frame in enumerate(frames):
    r = _radius_between_frames(frames[max(0,i-1)], frame, frames[min(i+1, len(frames)-1)], max_r)
    nodes.append(Node(frame, radius=r))



# Create the print_layer: 
def partition(lst, size):
    for i in range(0, len(lst), size):
        yield lst[i : i+size]

nodes_layer = []
numb_old = 0

for i in range(len(planes_layer)):
    
    if i == 0: nodes_layer.append(nodes[0:planes_layer[i]])
    else: nodes_layer.append(nodes[numb_old:numb_old+planes_layer[i]])
    
    numb_old += planes_layer[i]


layer = []
for i in range(len(planes_layer)):
    layer_loc = Layer.from_nodes(nodes_layer[i])
    layer.append(layer_loc)



# Create AM Model: 
am_model = AMModel()

for i in range(len(layer)):
    layer_new = layer[i]
    am_model.add_layer(layer_new)



# Create and transform planes:

planes = []
frame = []

frames_transformed = []
for l, layer in am_model.layers():
    for k, node in layer.nodes():
        planes.append(draw_frame(node.frame))


if transform:
    for plane in planes:
        plane.Translate(rg.Vector3d.ZAxis*t_value)
# ---------- end layer_def_6 ----------

# ----
# Var. 2 - AM Model
layer_def_7 = GhPythonScript(
    fab_planes=fab_planes_3.fab_planes_a,
    planes_layer=fab_planes_3.planes_layer_a,
    t_value=Slider(0.03, range=0..1),
    transform=transform_4)  # -> out, layer, am_model, planes; inputs fab_planes: list of Plane, planes_layer: list of Int32, transform: Boolean
# ---------- layer_def_7: Python ----------
import ghpythonlib.components as gh
import os
import sys
import json
import Rhino.Geometry as rg

from compas.geometry import Frame
from compas.geometry import Line
from compas.geometry import Vector, Transformation
from compas_ghpython import draw_frame

from am_information_model.model import Node
from am_information_model.model import Layer
from am_information_model.model import AMModel


def _radius_between_frames(from_frame, via_frame, to_frame, max_radius):
        in_line = Line(from_frame.point, via_frame.point)
        out_line = Line(via_frame.point, to_frame.point)
        r = min(max_radius, in_line.length/2, out_line.length/2)
        return r



# nodes
max_r = 0.1
frames = []

for plane in fab_planes:
    
    plane_dec = gh.DeconstructPlane(plane)
    
    p_orig = plane_dec[0]
    p_x = plane_dec[2]
    p_y = -plane_dec[1]
    p_z = plane_dec[3]
    
    
    frame = Frame([p_orig[0], p_orig[1], p_orig[2]], [p_x[0], p_x[1], p_x[2]], [p_y[0], p_y[1], p_y[2]])
    frames.append(frame)

nodes = []
for i,frame in enumerate(frames):
    r = _radius_between_frames(frames[max(0,i-1)], frame, frames[min(i+1, len(frames)-1)], max_r)
    nodes.append(Node(frame, radius=r))



# Create the print_layer: 
def partition(lst, size):
    for i in range(0, len(lst), size):
        yield lst[i : i+size]

nodes_layer = []
numb_old = 0

for i in range(len(planes_layer)):
    
    if i == 0: nodes_layer.append(nodes[0:planes_layer[i]])
    else: nodes_layer.append(nodes[numb_old:numb_old+planes_layer[i]])
    
    numb_old += planes_layer[i]


layer = []
for i in range(len(planes_layer)):
    layer_loc = Layer.from_nodes(nodes_layer[i])
    layer.append(layer_loc)



# Create AM Model: 
am_model = AMModel()

for i in range(len(layer)):
    layer_new = layer[i]
    am_model.add_layer(layer_new)



# Create and transform planes:

planes = []
frame = []

frames_transformed = []
for l, layer in am_model.layers():
    for k, node in layer.nodes():
        planes.append(draw_frame(node.frame))


if transform:
    for plane in planes:
        plane.Translate(rg.Vector3d.ZAxis*t_value)
# ---------- end layer_def_7 ----------

# ----
# Var. 4 - AM Model - Part A
layer_def_8 = GhPythonScript(
    fab_planes=fab_planes_4.fab_planes_a,
    planes_layer=fab_planes_4.planes_layer_a,
    t_value=number_slider,
    transform=transform_8)  # -> out, layer, am_model, planes; inputs fab_planes: list of Plane, planes_layer: list of Int32
# ---------- layer_def_8: Python ----------
import ghpythonlib.components as gh
import os
import sys
import json
import Rhino.Geometry as rg


from compas.geometry import Frame
from compas.geometry import Line
from compas.geometry import Vector
from compas_ghpython import draw_frame

from am_information_model.model import Node
from am_information_model.model import Layer
from am_information_model.model import AMModel


def _radius_between_frames(from_frame, via_frame, to_frame, max_radius):
        in_line = Line(from_frame.point, via_frame.point)
        out_line = Line(via_frame.point, to_frame.point)
        r = min(max_radius, in_line.length/2, out_line.length/2)
        return r



# Change Plane direction: 
planes_new = []

for plane in fab_planes:
    
    plane_dec = gh.DeconstructPlane(plane)
    if abs(plane_dec[2][0]) > abs(plane_dec[1][0]): swap = True
    else: swap = False
    
    plane_loc = gh.FlipPlane(plane, False, False, swap)
    plane_loc_dec = gh.DeconstructPlane(plane_loc)
    
    if plane_loc_dec[2][1] > 0: flip_y = True
    else: flip_y = False
    
    plane_loc = gh.FlipPlane(plane_loc, False, flip_y, False)
    planes_new.append(plane_loc)

fab_planes = planes_new



# nodes
max_r = 0.1
frames = []

for plane in fab_planes:
    
    plane_dec = gh.DeconstructPlane(plane)
    
    p_orig = plane_dec[0]
    p_x = plane_dec[1]
    p_y = plane_dec[2]
    p_z = plane_dec[3]
    
    
    frame = Frame([p_orig[0], p_orig[1], p_orig[2]], [p_x[0], p_x[1], p_x[2]], [p_y[0], p_y[1], p_y[2]])
    frames.append(frame)

nodes = []
for i,frame in enumerate(frames):
    r = _radius_between_frames(frames[max(0,i-1)], frame, frames[min(i+1, len(frames)-1)], max_r)
    nodes.append(Node(frame, radius=r))



# Create the print_layer: 
def partition(lst, size):
    for i in range(0, len(lst), size):
        yield lst[i : i+size]

nodes_layer = []
numb_old = 0

for i in range(len(planes_layer)):
    
    if i == 0: nodes_layer.append(nodes[0:planes_layer[i]])
    else: nodes_layer.append(nodes[numb_old:numb_old+planes_layer[i]])
    
    numb_old += planes_layer[i]


layer = []
for i in range(len(planes_layer)):
    layer_loc = Layer.from_nodes(nodes_layer[i])
    layer.append(layer_loc)



# Create AM Model: 
am_model = AMModel()

for i in range(len(layer)):
    layer_new = layer[i]
    am_model.add_layer(layer_new)



# Create and transform planes:

planes = []
frame = []

frames_transformed = []
for l, layer in am_model.layers():
    for k, node in layer.nodes():
        planes.append(draw_frame(node.frame))


if transform:
    for plane in planes:
        plane.Translate(rg.Vector3d.ZAxis*t_value)
# ---------- end layer_def_8 ----------

# ----
# Var. 4 - AM Model - Part B
layer_def_9 = GhPythonScript(
    fab_planes=fab_planes_4.fab_planes_b,
    planes_layer=fab_planes_4.planes_layer_b,
    t_value=number_slider,
    transform=transform_9)  # -> out, layer, am_model, planes; inputs fab_planes: list of Plane, planes_layer: list of Int32
# ---------- layer_def_9: Python ----------
import ghpythonlib.components as gh
import os
import sys
import json
import Rhino.Geometry as rg

from compas.geometry import Frame
from compas.geometry import Line
from compas.geometry import Vector
from compas_ghpython import draw_frame

from am_information_model.model import Node
from am_information_model.model import Layer
from am_information_model.model import AMModel


def _radius_between_frames(from_frame, via_frame, to_frame, max_radius):
        in_line = Line(from_frame.point, via_frame.point)
        out_line = Line(via_frame.point, to_frame.point)
        r = min(max_radius, in_line.length/2, out_line.length/2)
        return r



# Change Plane direction: 
planes_new = []

for plane in fab_planes:
    
    plane_dec = gh.DeconstructPlane(plane)
    if abs(plane_dec[2][0]) > abs(plane_dec[1][0]): swap = True
    else: swap = False
    
    plane_loc = gh.FlipPlane(plane, False, False, swap)
    plane_loc_dec = gh.DeconstructPlane(plane_loc)
    
    if plane_loc_dec[2][1] > 0: flip_y = True
    else: flip_y = False
    
    plane_loc = gh.FlipPlane(plane_loc, False, flip_y, False)
    planes_new.append(plane_loc)

fab_planes = planes_new



# nodes
max_r = 0.1
frames = []

for plane in fab_planes:
    
    plane_dec = gh.DeconstructPlane(plane)
    
    p_orig = plane_dec[0]
    p_x = plane_dec[1]
    p_y = plane_dec[2]
    p_z = plane_dec[3]
    
    
    frame = Frame([p_orig[0], p_orig[1], p_orig[2]], [p_x[0], p_x[1], p_x[2]], [p_y[0], p_y[1], p_y[2]])
    frames.append(frame)

nodes = []
for i,frame in enumerate(frames):
    r = _radius_between_frames(frames[max(0,i-1)], frame, frames[min(i+1, len(frames)-1)], max_r)
    nodes.append(Node(frame, radius=r))



# Create the print_layer: 
def partition(lst, size):
    for i in range(0, len(lst), size):
        yield lst[i : i+size]

nodes_layer = []
numb_old = 0

for i in range(len(planes_layer)):
    
    if i == 0: nodes_layer.append(nodes[0:planes_layer[i]])
    else: nodes_layer.append(nodes[numb_old:numb_old+planes_layer[i]])
    
    numb_old += planes_layer[i]


layer = []
for i in range(len(planes_layer)):
    layer_loc = Layer.from_nodes(nodes_layer[i])
    layer.append(layer_loc)



# Create AM Model: 
am_model = AMModel()

for i in range(len(layer)):
    layer_new = layer[i]
    am_model.add_layer(layer_new)



# Create and transform planes:

planes = []
frame = []

frames_transformed = []
for l, layer in am_model.layers():
    for k, node in layer.nodes():
        planes.append(draw_frame(node.frame))


if transform:
    for plane in planes:
        plane.Translate(rg.Vector3d.ZAxis*t_value)
# ---------- end layer_def_9 ----------

# ----
# Var. 4 - AM Model - Part C
layer_def_10 = GhPythonScript(
    fab_planes=fab_planes_4.fab_planes_c,
    planes_layer=fab_planes_4.planes_layer_c,
    t_value=number_slider,
    transform=transform_7)  # -> out, layer, am_model, planes; inputs fab_planes: list of Plane, planes_layer: list of Int32
# ---------- layer_def_10: Python ----------
import ghpythonlib.components as gh
import os
import sys
import json
import Rhino.Geometry as rg

from compas.geometry import Frame
from compas.geometry import Line
from compas.geometry import Vector
from compas_ghpython import draw_frame

from am_information_model.model import Node
from am_information_model.model import Layer
from am_information_model.model import AMModel


def _radius_between_frames(from_frame, via_frame, to_frame, max_radius):
        in_line = Line(from_frame.point, via_frame.point)
        out_line = Line(via_frame.point, to_frame.point)
        r = min(max_radius, in_line.length/2, out_line.length/2)
        return r



# nodes
max_r = 0.1
frames = []

for plane in fab_planes:
    
    plane_dec = gh.DeconstructPlane(plane)
    
    p_orig = plane_dec[0]
    p_x = plane_dec[2]
    p_y = -plane_dec[1]
    p_z = plane_dec[3]
    
    
    frame = Frame([p_orig[0], p_orig[1], p_orig[2]], [p_x[0], p_x[1], p_x[2]], [p_y[0], p_y[1], p_y[2]])
    frames.append(frame)

nodes = []
for i,frame in enumerate(frames):
    r = _radius_between_frames(frames[max(0,i-1)], frame, frames[min(i+1, len(frames)-1)], max_r)
    nodes.append(Node(frame, radius=r))



# Create the print_layer: 
def partition(lst, size):
    for i in range(0, len(lst), size):
        yield lst[i : i+size]

nodes_layer = []
numb_old = 0

for i in range(len(planes_layer)):
    
    if i == 0: nodes_layer.append(nodes[0:planes_layer[i]])
    else: nodes_layer.append(nodes[numb_old:numb_old+planes_layer[i]])
    
    numb_old += planes_layer[i]


layer = []
for i in range(len(planes_layer)):
    layer_loc = Layer.from_nodes(nodes_layer[i])
    layer.append(layer_loc)



# Create AM Model: 
am_model = AMModel()

for i in range(len(layer)):
    layer_new = layer[i]
    am_model.add_layer(layer_new)



# Create and transform planes:

planes = []
frame = []

frames_transformed = []
for l, layer in am_model.layers():
    for k, node in layer.nodes():
        planes.append(draw_frame(node.frame))


if transform:
    for plane in planes:
        plane.Translate(rg.Vector3d.ZAxis*t_value)
# ---------- end layer_def_10 ----------

list = ValueList({"20", "50", "100", "500", "1000", "5000"}, selected="50")
back = Button()
reset = Button()
start = Button()
stop = Button()
step = Button()
full = Button()

plane_2 = Plane(layer_def_7.planes)  # disabled
var_1_a = Plane(layer_def_2.planes)  # disabled
var_1_b = Plane(layer_def_3.planes)  # disabled
plane_3 = Plane(layer_def_8.planes)
plane_4 = Plane(layer_def_9.planes)
plane_5 = Plane(layer_def_10.planes)
plane_6 = Plane(layer_def_4.planes)  # disabled
plane_7 = Plane(layer_def_5.planes)  # disabled
plane_8 = Plane(layer_def_6.planes)  # disabled
am_model = Data(layer_def_10.am_model)

# ----
# Draw
show_8 = BooleanToggle(True)
show_9 = BooleanToggle(True)
counter = CountThroughList(am_model=am_model, start=start, stop=stop, step=step, step_back=back, reset=reset, full=full, interval=list)  # -> item, counter; inputs start: Boolean, stop: Boolean, step_back: Boolean
# ---------- counter: Python ----------
from scriptcontext import sticky as st
from compas_ghpython import update_component


L = list(am_model.layers())
# store data in component
guid = str(ghenv.Component.InstanceGuid)
counter_key = "counter_" + guid
running_key = "running_" + guid

if counter_key not in st:
    st[counter_key] = 0

if running_key not in st:
    st[running_key] = False
    

if st[running_key]:
    if st[counter_key] < len(L) - 1:
        st[counter_key] += 1
        update_component(ghenv, interval)
    else:
        st[counter_key] = 0
        st[running_key] = False
    
    
if start:
    st[running_key] = True

if stop:
    st[running_key] = False

if step:
    if st[counter_key] < len(L) - 1:
        st[counter_key] += 1

if step_back:
    if st[counter_key] < len(L) - 1:
        st[counter_key] -= 1

if reset:
    st[counter_key] = 0

if full:
    st[counter_key] = len(L)-1

if len(L):
    item = L[st[counter_key]]



#st["visualisation_counter"] = st[counter_key]
counter = st[counter_key]
# ---------- end counter ----------
idx = Panel(counter.counter)
draw_3 = PythonScript(am_model=am_model, show_all=show_8, show_counter=show_9, counter=idx)  # -> G, tool_planes_WCS, current_tool_plane, current_tool_planes; inputs counter: Int32
# ---------- draw_3: Python ----------
import os
import sys

import math

from compas_ghpython.artists import MeshArtist
from compas_ghpython import draw_frame


G = []

key_index = am_model.network.key_index()
keys = [key_index[key] for key in am_model.network.nodes()]
layers = [am_model.layer(key) for key in keys]
#print elements
#print([(e.gripping_frame) for e in elements])

start_planes_WCS = [draw_frame(l.node(0).frame) for l in layers]

current_tool_plane = start_planes_WCS[counter]
current_tool_planes = [draw_frame(node.frame) for key, node in am_model.layer(counter).nodes()]

if show_all and not show_counter:
    for layer in layers:
        for key, node in layer.nodes():
            plane = draw_frame(node.frame) 
            G.append(plane)

if show_counter:
    for layer in layers[0:counter+1]:
        for key, node in layer.nodes():
            plane = draw_frame(node.frame) 
            G.append(plane)

    tool_planes_WCS = [draw_frame(l.node(0).tool_frame) for l in layers[0:counter+1]]
# ---------- end draw_3 ----------
pln = Plane(draw_3.current_tool_planes)
geo = Geometry(draw_3.G)
pln_2 = Plane(draw_3.tool_planes_WCS)
preview = CustomPreview(Geometry=geo, Shader=ColourSwatch(SwatchColor=RGBA(255, 227, 227, 233)))
preview_2 = CustomPreview(Geometry=[pln_2, pln], Shader=ColourSwatch(SwatchColor=RGBA(209, 27, 27, 178)))

# ----
# Input
list_2 = ValueList({"single plane": 0, "planes from curve": 1, "planes from am_model": 2}, selected="planes from am_model")
filter = StreamFilter(Gate=list_2, Stream0=plane, Stream1=curve_def, Stream2=draw_3.current_tool_plane)

pln_3 = Plane(draw_3.current_tool_plane)
tcp_speed = Slider(250, range=0..1000)
# Concrete Extruder
ext_ip = ValueList({"192.168.125.220", "192.168.125.60"}, selected="192.168.125.220")
# Concrete Pump
ext_ip_2 = ValueList({"192.168.125.10"}, selected="192.168.125.10")  # disabled
ext_port = ValueList({"50003", "50004"}, selected="50004")  # disabled
ext_port_2 = ValueList({"50003", "50004", "50001"}, selected="50004")

# ----
# --> Set controller IP address
button = Button()  # disabled
globals = PythonScript(ext_ip=ext_ip_2, ext_port=ext_port, clear=button)  # disabled
# ---------- globals: Python ----------
from scriptcontext import sticky as st

#st["server_address"] = server_address
#st["server_port"] = server_port

st["ext_ip"] = ext_ip
st["ext_port"] = ext_port


if clear:
    st.clear()
# ---------- end globals ----------

# ----
# --> Set controller IP address
button_2 = Button()
globals_2 = PythonScript(ext_ip=ext_ip, ext_port=ext_port_2, clear=button_2)  # same code as globals

ping = Button()
py_2 = PythonScript(ip=ext_ip, ping=ping)  # -> out, trigger
# ---------- py_2: Python ----------
import os
from scriptcontext import sticky as st

guid = str(ghenv.Component.InstanceGuid)
txt_key = "txt_" + guid
if txt_key not in st:
    st[txt_key] = ""

def is_available(ip):
    syscall = "ping -r 1 -n 1 %s"
    response = os.system(syscall % ip)
    if response == 0:
        return True
    else:
        return False

if ping:
    available = is_available(ip)
    
    if available:
        st[txt_key] = "%s is up!" % ip
        trigger = True
    else:
        st[txt_key] = "%s is down!" % ip
        trigger = False

print(st[txt_key])
# ---------- end py_2 ----------
panel = Panel(py_2.out)

set_tool = Button()

ping_2 = Button()  # disabled
py_3 = PythonScript(ip=ext_ip_2, ping=ping_2)  # -> out, trigger; disabled; same code as py_2
panel_2 = Panel(py_3.out)  # disabled

# ----
# Set Motor Data
speed = Slider(24505.6, range=0..51200)
max_speed = Slider(45277.56, range=0..51200)
send = Button()
value = BooleanToggle(True)
extruder_data = PythonScript(motor_state=value, max_speed=max_speed, speed=speed, send=send)  # -> out; inputs motor_state: Boolean
# ---------- extruder_data: Python ----------
import time
from scriptcontext import sticky as st
from extruder_control.concrete_extruderclient import ExtruderClient

ext_ip = st["ext_ip"]
ext_port = st["ext_port"]

ec = ExtruderClient(ext_ip, ext_port)
wait_for_response = False

if send:
    ec.connect()
    time.sleep(0.2)
    ec.send_motordata(motor_state, max_speed, speed, wait_for_response)
    #ec.get_msg_arduino_info(wait_for_response)
    time.sleep(0.2)
    ec.close()
# ---------- end extruder_data ----------
data_recorder = DataRecorder(extruder_data, DataLimit=-10, RecordData=True)
out = Panel(data_recorder)

# ----
# extruder control
# Toggle Digital Output
value_2 = BooleanToggle(True)
send_2 = Button()
list_3 = ValueList({"1", "2", "3", "4", "5", "6", "7", "8", "9", "10", "11", "12", "13"}, selected="10")
digital_out = PythonScript(pin=list_3, state=value_2, send=send_2)  # -> out; inputs pin: Int32, state: Boolean
# ---------- digital_out: Python ----------
import time
from scriptcontext import sticky as st
from extruder_control.concrete_extruderclient import ExtruderClient

ext_ip = st["ext_ip"]
ext_port = st["ext_port"]

ec = ExtruderClient(ext_ip, ext_port)
wait_for_response = False


if send:
    ec.connect()
    time.sleep(0.2)
    ec.send_set_do(pin, int(state), wait_for_response)
    time.sleep(0.2)
    ec.close()
# ---------- end digital_out ----------
data_recorder_2 = DataRecorder(digital_out, DataLimit=-10, RecordData=True)
out_2 = Panel(data_recorder_2)

tcp_speed_2 = Slider(250, range=0..1000)
tcp_speed_3 = Slider(250, range=0..1000)

to_robtarget = Button()
to_frame = Button()

to_single_joints = Button()
to_joints = Button()

set_tool_2 = Button()
target_plane = Plane(filter)
parallelize = BooleanToggle(False)

# ----
# Toggle Motor State
value_3 = BooleanToggle(True)
send_3 = Button()
extruder_state = PythonScript(state=value_3, send=send_3)  # -> out; inputs state: Boolean
# ---------- extruder_state: Python ----------
import time
from scriptcontext import sticky as st
from extruder_control.concrete_extruderclient import ExtruderClient

ext_ip = st["ext_ip"]
ext_port = st["ext_port"]

ec = ExtruderClient(ext_ip, ext_port)
wait_for_response = False

if send:
    ec.connect()
    time.sleep(0.2)
    ec.send_motorstate(int(state), wait_for_response)
    time.sleep(0.2)
    ec.close()
# ---------- end extruder_state ----------

# ----
# Stop ALL
stop_2 = Button()
stop_3 = PythonScript(stop=stop_2)  # -> out
# ---------- stop_3: Python ----------
import time
from scriptcontext import sticky as st
from extruder_control.concrete_extruderclient import ExtruderClient

ext_ip = st["ext_ip"]
ext_port = st["ext_port"]

ec = ExtruderClient(ext_ip, ext_port)
wait_for_response = False

if stop:
    ec.connect()
    time.sleep(0.2)
    ec.send_stop(wait_for_response)
    time.sleep(0.2)
    ec.close()
# ---------- end stop_3 ----------

# ----
# Reset
# Reset turns on the extruder
send_4 = Button()
digital_out_2 = PythonScript(send=send_4)  # -> out
# ---------- digital_out_2: Python ----------
import time
from scriptcontext import sticky as st
from extruder_control.concrete_extruderclient import ExtruderClient

ext_ip = st["ext_ip"]
ext_port = st["ext_port"]

ec = ExtruderClient(ext_ip, ext_port)

    
if send:
    ec.connect()
    time.sleep(0.2)
    ec.send_reset()
    time.sleep(0.2)
    ec.close()
# ---------- end digital_out_2 ----------

data_recorder_3 = DataRecorder(stop_3, DataLimit=-10, RecordData=True)
data_recorder_4 = DataRecorder(extruder_state, DataLimit=-10, RecordData=True)

get_frame = Button()
get_robtarget = Button()
get_joints = Button()

out_3 = Panel(data_recorder_3)
out_4 = Panel(data_recorder_4)

# ----
# STATE  VIEWER
trigger = Trigger(Interval=100, TimerInterval=100, Target=fabrication_state)
fabrication_state = PythonScript()  # -> out, state, num_tasks, num_current_task, num_tasks_left, log_messages
# ---------- fabrication_state: Python ----------
from scriptcontext import sticky as st

fabrication = st["fabrication"]

if hasattr(fabrication, "fab_thread"):
    if fabrication.fab_thread.is_alive():
        state = "THREAD RUNNING"
    else:
        state = "THREAD STOPPED"

num_tasks = len(fabrication.tasks)
if fabrication.current_task_key is not None:
    num_current_task = fabrication.current_task_key+1
else:
    num_current_task = 0
num_tasks_left = num_tasks-num_current_task
log_messages = fabrication.log_messages
# ---------- end fabrication_state ----------
num_tasks_left = Panel(fabrication_state.num_tasks_left)
state = Panel(fabrication_state.state)
num_tasks = Panel(fabrication_state.num_tasks)
num_current_task = Panel(fabrication_state.num_current_task)
log_messages = Panel(fabrication_state.log_messages)

# ----
# Tool
panel_3 = Panel("Attach a custom tool")
list_4 = ValueList({"measurement_tool": 0, "concrete_extruder": 1}, selected="concrete_extruder")
tools = Tools(G=list_4)
remove = Button()
add = Button()

# ----
# ROS & ABB client
ros_ip = ValueList({"127.0.0.1"}, selected="127.0.0.1")
ros_port = ValueList({"9090"}, selected="9090")
ros = ROSConnect(ip=ros_ip, port=ros_port, connect=Toggle(True))  # -> ros_client, is_connected; inputs port: Int32, connect: Boolean
#   port ip: The ip address ROS. Defaults to 127.0.0.1.
#   port port: The port of ROS. Defaults to 9090.
#   port connect: If True, connects to ROS. If False, disconnects from ROS. Defaults to False.
#   port ros_client: The ROS client.
#   port is_connected: True if connection established.
# ---------- ros: Python ----------
"""
Connect or disconnect to ROS.

COMPAS FAB v0.19.1
"""
from ghpythonlib.componentbase import executingcomponent as component
from scriptcontext import sticky as st

from compas_fab.backends import RosClient
from compas_fab.ghpython.components import create_id


class ROSConnect(component):
    def RunScript(self, ip, port, connect):
        ros_client = None

        ip = ip or '127.0.0.1'
        port = port or 9090

        key = create_id(self, 'ros_client')
        ros_client = st.get(key, None)

        if ros_client:
            st[key].close()
        if connect:
            st[key] = RosClient(ip, port)
            st[key].run(5)

        ros_client = st.get(key, None)
        is_connected = ros_client.is_connected if ros_client else False
        return (ros_client, is_connected)
# ---------- end ros ----------
is_connected = Panel(ros.is_connected)
abb = GhPythonScript(ros_client=ros.ros_client, connect=Toggle(True))  # -> out, abb_client; inputs connect: Boolean
# ---------- abb: Python ----------
import compas_rrc as rrc

if ros_client:
    if ros_client.is_connected and connect: 
        # Create ABB Client
        abb_client = rrc.AbbClient(ros_client, '/rob1')
# ---------- end abb ----------

# ----
# Load Model
# Load robot from local package
load = Button()
list_5 = ValueList({"abb_fabtory"}, selected="abb_fabtory")
units = ValueList({"m": 1, "cm": 100, "mm": 1000}, selected="m")

# ----
# Robot Model
panel_4 = Panel("abb_fabtory.srdf")

load_model = PythonScript(
    path=path.ROBOT_DESCRIPTION,
    package=list_5,
    urdf_name="abb_fabtory.urdf",
    srdf_name=panel_4,
    scale_factor=units,
    load=load)  # -> robot
# ---------- load_model: Python ----------
import os
from scriptcontext import sticky as st
import compas
from compas.robots import RobotModel
from compas.robots import LocalPackageMeshLoader
from compas_fab.robots import Robot
from compas_fab.robots import RobotSemantics
from compas_fab.ghpython import RobotArtist

packages = ["abb_irb6700_support", "abb_end_effectors", "abb_fabtory"]
loaders = []

for package in packages:
    loaders.append(LocalPackageMeshLoader(path, package))

#path directory
package_path = os.path.join(path, package)
print(package_path)

urdf_filename = os.path.join(package_path, "urdf", urdf_name)
srdf_filename = os.path.join(package_path, srdf_name)

assert os.path.isfile(urdf_filename)
assert os.path.isfile(srdf_filename)

compas.PRECISION = '12f'

# store robot in component
guid = str(ghenv.Component.InstanceGuid)
robot_key = "robot_" + guid

if robot_key not in st:
    st[robot_key] = None

#load robot model from urdf
if load:
    model = RobotModel.from_urdf_file(urdf_filename)
    model.load_geometry(*loaders)
    artist = RobotArtist(model)
    semantics = RobotSemantics.from_srdf_file(srdf_filename, model)
    robot = Robot(model, artist, semantics, client=None)

    st[robot_key] = robot
robot = st[robot_key]

#vizualize robot in the right scale of your environment
robot.scale(scale_factor)
# ---------- end load_model ----------

attach_remove = PythonScript(robot=load_model, tool=tools, attach=add, remove=remove)  # -> bang
# ---------- attach_remove: Python ----------
if attach:
    robot.attach_tool(tool)

    
if remove:
    robot.detach_tool()
# ---------- end attach_remove ----------

set = PythonScript(robot=load_model, ros_client=ros.ros_client, abb_client=abb.abb_client)  # -> out, robot, main_group_name
# ---------- set: Python ----------
if robot and ros_client and abb_client:
    robot.ros_client = ros_client
    robot.abb_client = abb_client

    robot.info()
    main_group_name = robot.main_group_name
    print robot.info
# ---------- end set ----------

robot_info = Panel(set.out)

# ----
# forward kinematics
number_slider_4 = Slider(0, range=-400..400)
# Configuration
number_slider_5 = Slider(0, range=0..4.2)
jp = GhPythonScript()  # -> configuration_values
# ---------- jp: Python ----------
import math
joint_values = [-3.136, -0.328, -1.218, 3.129, 0.852, 0.008]
#joint_values = [math.degrees(j) for j in joint_values]
#joint_positions = [0] * 6

cart = 0
joint_values = [0,0,0,0,0,0]

configuration_values = [cart] + joint_values
# ---------- end jp ----------
forward_kinematics = PythonScript(
    robot=set.robot,
    reset_configuration=Button(),
    configuration_values=jp,
    a_cart=number_slider_5,
    a_a1=Slider(-86.5, range=-180..180),
    a_a2=Slider(0, range=-90..150),
    a_a3=Slider(0, range=-180..180),
    a_a4=Slider(0, range=-400..400),
    a_a5=Slider(0, range=-125..120),
    a_a6=number_slider_4)  # -> full_configuration; inputs reset_configuration: Boolean, configuration_values: list
# ---------- forward_kinematics: Python ----------
import math
import Grasshopper
import copy
from compas.robots import Joint
from compas_fab.robots import Configuration





if reset_configuration:
    j = 0
    for i in range(ghenv.Component.Params.Input.Count):
        nslider = ghenv.Component.Params.Input[i].Sources[0]
        if nslider.GetType() == Grasshopper.Kernel.Special.GH_NumberSlider:
            nslider.TrySetSliderValue(configuration_values[j])
            j += 1


if robot:
    joint_positions = [a_cart, a_a1, a_a2, a_a3, a_a4, a_a5, a_a6]
    #print joint_positions
    joint_positions_degrees = copy.deepcopy(joint_positions)
    joint_types = robot.get_configurable_joint_types()
    #print(joint_types)
    for i, joint_type in enumerate(joint_types):
        if joint_type == Joint.REVOLUTE:
            joint_positions[i] = math.radians(joint_positions[i])
        if joint_type == Joint.PRISMATIC:
            joint_positions[i] = joint_positions[i]
    full_configuration = Configuration(joint_positions, joint_types)
    #print full_configuration
# ---------- end forward_kinematics ----------

# ----
# inverse kinematics
py_4 = PythonScript(robot=set.robot)  # -> configuration
# ---------- py_4: Python ----------
from compas_fab.robots import Configuration

if robot:
    types = robot.get_configurable_joint_types()
    values = [0] * len(types)
    configuration = Configuration(values, types)
    print configuration
    print robot.get_configurable_joint_names()
# ---------- end py_4 ----------
list_6 = ValueList({"fk_configuration": 0, "robot_configuration": 1}, selected="fk_configuration")
fk_configuration = Data(forward_kinematics)
go_to_start_configuration = BooleanToggle(False)
list_7 = ValueList({"manipulator", "manipulator_axis"}, selected="manipulator")
avoid_collisions = BooleanToggle(False)
filter_2 = StreamFilter(Gate=list_6, Stream0=fk_configuration, Stream1=py_4)
inverse_kinematics = GhPythonScript(
    compute=Toggle(True),
    robot=set.robot,
    plane=filter,
    start_configuration=filter_2,
    go_to_start_configuration=go_to_start_configuration,
    avoid_collisions=avoid_collisions,
    group=set.main_group_name)  # -> out, ik_configuration, t0cp; inputs plane: Plane
# ---------- inverse_kinematics: Python ----------
from __future__ import print_function
import logging
from compas.geometry import Frame
from scriptcontext import sticky as st
from compas_ghpython.artists import FrameArtist

LOGGER = logging.getLogger('roslibpy')

#vizualize t0cf
if robot.attached_tool:
    t0cf = Frame(plane.Origin, plane.XAxis, plane.YAxis)
    t0cf = robot.from_tcf_to_t0cf([t0cf])[0]
    #artist = FrameArtist(t0cf)
    #t0cp = artist.draw()
    #print (t0cf)


if compute:
    if robot.attached_tool:
        tool_attached = True
    else:
        tool_attached = False

    robot.client = robot.ros_client
    if go_to_start_configuration:
        ik_configuration = start_configuration
    else:
        frame = Frame(plane.Origin, plane.XAxis, plane.YAxis)
        if tool_attached:
            tool_frame = robot.from_tcf_to_t0cf([frame])[0]
        else:
            tool_frame = frame

    ik_configuration = robot.inverse_kinematics(tool_frame,
                                                  start_configuration,
                                                  group=group,
                                                  options={
                                                    'avoid_collisions':avoid_collisions,
                                                    'return_full_configuration':True,
                                                  })        
#group_configuration = robot.get_group_configuration(group, ik_configuration)
#print (group_configuration)
st["ik_configuration"] = ik_configuration

ik_configuration = st["ik_configuration"] 
print(ik_configuration)
# ---------- end inverse_kinematics ----------
draw_4 = GhPythonScript(planes=inverse_kinematics.t0cp, scale=Slider(0.2, range=0..1))  # -> P, V, C, W; inputs planes: list
# ---------- draw_4: Python ----------
from System.Drawing import Color
from compas_ghpython.artists import FrameArtist

red = Color.FromArgb(255, 0, 0)
green = Color.FromArgb(0, 255, 0)
blue = Color.FromArgb(0, 0, 255)

P = []
V = []
C = []

scale = float(scale)

for plane in planes:
    if not plane:
        continue
    P += [plane.Origin] * 3
    V.append(plane.XAxis * scale)
    V.append(plane.YAxis * scale)
    V.append(plane.ZAxis * scale)
    C += [red, green, blue]

W = 3
# ---------- end draw_4 ----------
out_5 = Panel(inverse_kinematics.out)
vdisex = VectorDisplayEx(Point=draw_4.P, Vector=draw_4.V, Colour=draw_4.C, Width=draw_4.W)

list_8 = ValueList({"0 forward_kinematics": 0, "1 inverse_kinematics": 1}, selected="1 inverse_kinematics")
ik_configuration = Data(inverse_kinematics.ik_configuration)
fk_configuration_2 = Data(forward_kinematics)
filter_3 = StreamFilter(Gate=list_8, Stream0=fk_configuration_2, Stream1=ik_configuration)

# ----
# Visualisation
show_end_effector_frame = BooleanToggle(False)
show_base_frame = BooleanToggle(False)
show_collision = BooleanToggle(False)
show_frames = BooleanToggle(False)
show_visual = BooleanToggle(True)
show_acm = BooleanToggle(False)
robot_visualize = RobotVisualize(
    robot=set.robot,
    group=set.main_group_name,
    configuration=filter_3,
    redraw=attach_remove,
    show_visual=show_visual,
    show_collision=show_collision,
    show_frames=show_frames,
    show_base_frame=show_base_frame,
    show_end_effector_frame=show_end_effector_frame,
    show_acm=show_acm)  # -> visual, collision, attached_meshes, frames, base_frame, ee_frame; inputs redraw: list, show_visual: Boolean, show_collision: Boolean, show_frames: Boolean, show_base_frame: Boolean, show_end_effector_frame: Boolean, show_acm: Boolean
#   port group: The planning group used for end-effector and base visualization.
#   port configuration: The robot's full configuration.
#   port redraw: A list of attached collision meshes.
#   port show_visual: Whether or not to show the robot's visual meshes.
#   port show_collision: Whether or not to show the robot's collision meshes.
#   port show_frames: Whether or not to show the robot's joint frames.
#   port show_base_frame: Whether or not to show the robot's base frame.
#   port show_end_effector_frame: Whether or not to show the robot's end-effector frame.
#   port show_acm: Whether or not to show the attached collision meshes (if any).
#   port visual: The robot's visual Rhino meshes (if any).
#   port collision: The robot's collision Rhino meshes (if any).
#   port attached_meshes: The attached collision Rhino meshes (if any).
#   port frames: The robot's joint frames as Rhino planes (if any).
#   port base_frame: The robot's base frame as a Rhino plane (if any).
#   port ee_frame: The robot's end-effector frame as a Rhino plane (if any).
# ---------- robot_visualize: Python ----------
"""
Visualizes the robot.

COMPAS FAB v0.19.1
"""
from compas.geometry import Frame
from compas.geometry import Transformation
from compas_ghpython.artists import FrameArtist
from compas_ghpython.artists import MeshArtist
from ghpythonlib.componentbase import executingcomponent as component


class RobotVisualize(component):
    def RunScript(self, robot, group, configuration, attached_collision_meshes, show_visual, show_collision,
                  show_frames, show_base_frame, show_end_effector_frame, show_acm):

        visual = None
        collision = None
        attached_meshes = None
        frames = None
        base_frame = None
        ee_frame = None

        if robot:
            show_visual = True if show_visual is None else show_visual
            configuration = configuration or robot.zero_configuration()

            robot.update(configuration, visual=show_visual, collision=show_collision)
            compas_frames = robot.transformed_frames(configuration, group)

            if show_visual:               
                visual = robot.artist.draw_visual()
                

            if show_collision:
                collision = robot.artist.draw_collision()

            if show_base_frame:
                base_compas_frame = compas_frames[0]
                artist = FrameArtist(base_compas_frame)
                base_frame = artist.draw()

            if show_end_effector_frame:
                ee_compas_frame = robot.forward_kinematics(configuration, group, options=dict(solver='model'))
                if robot.attached_tool:
                    ee_compas_frame = robot.from_t0cf_to_tcf([ee_compas_frame])[0]
                artist = FrameArtist(ee_compas_frame)
                ee_frame = artist.draw()

            if show_frames:
                frames = []
                for compas_frame in compas_frames[1:]:
                    artist = FrameArtist(compas_frame)
                    frame = artist.draw()
                    frames.append(frame)

            if show_acm:
                attached_meshes = []
                for acm in attached_collision_meshes:
                    frame = robot.forward_kinematics(configuration, options=dict(solver='model', link_name=acm.link_name))
                    T = Transformation.from_frame_to_frame(Frame.worldXY(), frame)
                    mesh = acm.collision_mesh.mesh.transformed(T)
                    attached_meshes.append(MeshArtist(mesh).draw())

        return (visual, collision, attached_meshes, frames, base_frame, ee_frame)
# ---------- end robot_visualize ----------
draw_5 = GhPythonScript(frames=[robot_visualize.frames, robot_visualize.base_frame, robot_visualize.ee_frame], scale=Slider(0.2, range=0..1))  # -> P, V, C, W; inputs frames: list
# ---------- draw_5: Python ----------
from System.Drawing import Color
from compas_ghpython.artists import FrameArtist

red = Color.FromArgb(255, 0, 0)
green = Color.FromArgb(0, 255, 0)
blue = Color.FromArgb(0, 0, 255)

P = []
V = []
C = []

scale = float(scale)

for plane in frames:
    if not plane:
        continue
    P += [plane.Origin] * 3
    V.append(plane.XAxis * scale)
    V.append(plane.YAxis * scale)
    V.append(plane.ZAxis * scale)
    C += [red, green, blue]

W = 3
# ---------- end draw_5 ----------
geo_2 = Geometry([robot_visualize.visual, robot_visualize.collision, robot_visualize.attached_meshes])
# Move Control
preview_3 = CustomPreview(Geometry=geo_2, Shader=ColourSwatch(SwatchColor=RGB(207, 157, 160)))
vdisex_2 = VectorDisplayEx(Point=draw_5.P, Vector=draw_5.V, Colour=draw_5.C, Width=draw_5.W)

# ----
# Move Cartesian from List
to_robtargets = Button()
to_frames = Button()
movel_command = GhPythonScript(
    robot=set.robot,
    configuration=filter_3,
    speed=tcp_speed,
    target_planes=plane_5,
    move_to_frames=to_frames,
    move_to_robtargets=to_robtargets,
    set_tool=set_tool)  # -> out; inputs target_planes: list of Plane, move_to_frames: Boolean, move_to_robtargets: Boolean
# ---------- movel_command: Python ----------
import compas_rrc as rrc
import fabtory_fabrication_control as ffc
from compas.geometry import Frame

#set tool in RobotStudio
if set_tool:
    if robot.attached_tool:
        tool_name = robot.attached_tool.name
        done = robot.abb_client.send(rrc.SetTool(tool_name))
        print done
    else:
        robot.abb_client.send(rrc.SetTool("tool0"))

if move_to_frames:
    #transform target plane into target frame
    
    for i, target_plane in enumerate(target_planes):
        if i < len(target_planes)-1:
            zone = rrc.Zone.Z50
        else:
            zone = rrc.Zone.FINE
        print zone
        target_frame = Frame(target_plane.Origin, target_plane.XAxis, target_plane.YAxis)
        #send move to frame command
        ffc.commands.move_to_frame(robot, target_frame, speed=speed, zone=zone, scalefactor=1000)

if move_to_robtargets:
    for i, target_plane in enumerate(target_planes):
        if i < len(target_planes)-1:
            zone = rrc.Zone.Z50
        else:
            zone = rrc.Zone.FINE
        print zone
        #transform target plane into target frame
        target_frame = Frame(target_plane.Origin, target_plane.XAxis, target_plane.YAxis)
        #store cart value from configuration
        cart = (configuration.joint_values[0])
        #send move to robtarget command
        ffc.commands.move_to_robtarget(robot, target_frame, cart, speed=speed, zone=zone, scalefactor=1000)
# ---------- end movel_command ----------
data_recorder_5 = DataRecorder(movel_command, DataLimit=-10, RecordData=True)
out_6 = Panel(data_recorder_5)

# ----
# Move Joints
tcp_speed_4 = Slider(250, range=0..1000)
movej_command = GhPythonScript(
    robot=set.robot,
    configuration=filter_3,
    speed=tcp_speed_4,
    move_to_joints=to_joints,
    move_single_joints=to_single_joints)  # -> out; inputs move_to_joints: Boolean
# ---------- movej_command: Python ----------
import fabtory_fabrication_control as ffc
import compas_rrc as rrc


from compas.geometry import Scale
from compas.robots import Joint
import math



# Print text on FlexPenant
# robot.abb_client.send(rrc.PrintText('Welcome TUM to COMPAS_RRC! ;)'))

#print configuration

if move_to_joints:
    #ffc.commands.move_to_joints(robot, configuration, speed=speed, zone=rrc.Zone.FINE)
    ffc.commands.move_to_joints_2(robot, configuration, speed=speed, zone=rrc.Zone.FINE)


#ext_axes = rrc.ExternalAxes.from_configuration(configuration) #store all robot values from configuration
#cart = rrc.ExternalAxes(ext_axes.values[0]) #store cart values from robot values
#joints = rrc.RobotJoints(ext_axes.values[1:]) #store joint values from robot values
#robot.abb_client.send(rrc.MoveToJoints(joints, cart, speed, zone)) #send move to joints command



#joint_goal = movejoints.get_current_joint_values()
#print joint_goal


if move_single_joints:
    pass
    # TODO
# ---------- end movej_command ----------
data_recorder_6 = DataRecorder(movej_command, DataLimit=-10, RecordData=True)
out_7 = Panel(data_recorder_6)

jp_2 = GhPythonScript(robot=set.robot)  # -> full_configurations
# ---------- jp_2: Python ----------
import math
import Grasshopper
import copy
from compas.robots import Joint
from compas_fab.robots import Configuration




"""
joint_values = [-3.136, -0.328, -1.218, 3.129, 0.852, 0.008]
#joint_values = [math.degrees(j) for j in joint_values]
#joint_positions = [0] * 6

configurations_values = []

cart = 0
joint_values = [0,0,0,0,0,0]
configuration_values = [cart] + joint_values

configurations_values.append(configuration_values)

full_configurations = []

for configuration_values in configurations_values:

    joint_positions_degrees = copy.deepcopy(configuration_values)
    joint_types = robot.get_configurable_joint_types()
    #print(joint_types)
    for i, joint_type in enumerate(joint_types):
        if joint_type == Joint.REVOLUTE:
            joint_positions[i] = math.radians(joint_positions[i])
        if joint_type == Joint.PRISMATIC:
            joint_positions[i] = joint_positions[i]
    full_configurations.append(Configuration(joint_positions, joint_types))


if move_to_joints:
    #ffc.commands.move_to_joints(robot, configuration, speed=speed, zone=rrc.Zone.FINE)
    ffc.commands.move_to_joints_2(robot, configuration, speed=speed, zone=rrc.Zone.FINE)
"""





full_configurations = []

c = Configuration((0.937, -1.328, 0.277, 0.786, 0.276, -1.079, -0.134), (2, 0, 0, 0, 0, 0, 0), ('axis_joint', 'joint_1', 'joint_2', 'joint_3', 'joint_4', 'joint_5', 'joint_6'))
full_configurations.append(c)

c = Configuration((1.691, -2.350, -0.365, 0.800, -0.258, -0.483, 0.197), (2, 0, 0, 0, 0, 0, 0), ('axis_joint', 'joint_1', 'joint_2', 'joint_3', 'joint_4', 'joint_5', 'joint_6'))
full_configurations.append(c)

c = Configuration((1.679, -1.497, 0.538, -0.330, -0.150, -1.191, 0.272), (2, 0, 0, 0, 0, 0, 0), ('axis_joint', 'joint_1', 'joint_2', 'joint_3', 'joint_4', 'joint_5', 'joint_6'))
full_configurations.append(c)
# ---------- end jp_2 ----------

# ----
# Move Joints from List
tcp_speed_5 = Slider(250, range=0..1000)
to_joints_2 = Button()
movej_command_2 = GhPythonScript(robot=set.robot, configurations=jp_2, speed=tcp_speed_5, move_to_joints=to_joints_2)  # -> out; inputs configurations: list, move_to_joints: Boolean
# ---------- movej_command_2: Python ----------
import fabtory_fabrication_control as ffc
import compas_rrc as rrc


if move_to_joints:
    for configuration in configurations:
        ffc.commands.move_to_joints_2(robot, configuration, speed=speed, zone=rrc.Zone.Z200)
# ---------- end movej_command_2 ----------
data_recorder_7 = DataRecorder(movej_command_2, DataLimit=-10, RecordData=True)
out_8 = Panel(data_recorder_7)

# ----
# Move Cartesian
movel_command_2 = GhPythonScript(
    robot=set.robot,
    configuration=filter_3,
    speed=tcp_speed_3,
    target_plane=target_plane,
    move_to_frame=to_frame,
    move_to_robtarget=to_robtarget,
    set_tool=set_tool_2)  # -> out; inputs target_plane: Plane, move_to_frame: Boolean, move_to_robtarget: Boolean
# ---------- movel_command_2: Python ----------
import compas_rrc as rrc
import fabtory_fabrication_control as ffc
from compas.geometry import Frame

#set tool in RobotStudio
if set_tool:
    if robot.attached_tool:
        tool_name = robot.attached_tool.name
        done = robot.abb_client.send(rrc.SetTool(tool_name))
        print done
    else:
        robot.abb_client.send(rrc.SetTool("tool0"))

if move_to_frame:
    #transform target plane into target frame
    target_frame = Frame(target_plane.Origin, target_plane.XAxis, target_plane.YAxis)
    #send move to frame command
    ffc.commands.move_to_frame(robot, target_frame, speed=speed, zone=rrc.Zone.FINE, scalefactor=1000)

if move_to_robtarget:
    #transform target plane into target frame
    target_frame = Frame(target_plane.Origin, target_plane.XAxis, target_plane.YAxis)
    #store cart value from configuration
    cart = (configuration.joint_values[0])
    #send move to robtarget command
    ffc.commands.move_to_robtarget(robot, target_frame, cart, speed=speed, zone=rrc.Zone.FINE, scalefactor=1000)
# ---------- end movel_command_2 ----------
data_recorder_8 = DataRecorder(movel_command_2, DataLimit=-10, RecordData=True)
out_9 = Panel(data_recorder_8)

# ----
# Get Robot Configurations
get_joints_2 = GhPythonScript(robot=set.robot, get_frame=get_frame, get_robtarget=get_robtarget, get_joints=get_joints)  # -> joint, current_plane
# ---------- get_joints_2: Python ----------
from compas_ghpython.artists import FrameArtist
from scriptcontext import sticky as st
import fabtory_fabrication_control as ffc
import os

# store robot in component
guid = str(ghenv.Component.InstanceGuid)
current_frame_key = "current_frame_" + guid
current_robtarget_key = "current_robtarget_" + guid
current_configuration_key = "current_configuration_" + guid

if current_frame_key not in st:
    st[current_frame_key] = None

if current_robtarget_key not in st:
    st[current_robtarget_key] = None

if current_configuration_key not in st:
    st[current_configuration_key] = None


#get commands
if get_frame:
    current_frame = ffc.feedback.get_frame(robot, scalefactor=0.001)
    st[current_frame_key] = current_frame

if get_robtarget:
    current_robtarget = ffc.feedback.get_robtarget(robot, scalefactor=0.001)
    print current_robtarget
    st[current_robtarget_key] = current_robtarget


if get_joints:
    current_configuration = ffc.feedback.get_joints(robot)
    st[current_configuration_key] = current_configuration
    print current_configuration

# sticky
if st[current_frame_key]:
    current_frame = st[current_frame_key]
    artist = FrameArtist(current_frame)
    current_plane = artist.draw()

if st[current_robtarget_key]:
    current_robtarget = st[current_robtarget_key]

if st[current_configuration_key]:
    current_configuration = st[current_configuration_key]
    print current_configuration
# ---------- end get_joints_2 ----------
data_recorder_9 = DataRecorder(get_joints_2.joint, DataLimit=-10, RecordData=True)
draw_6 = GhPythonScript(plane=get_joints_2.current_plane, scale=Slider(0.2, range=0..1))  # -> P, V, C, W; inputs plane: Plane
# ---------- draw_6: Python ----------
from System.Drawing import Color
from compas_ghpython.artists import FrameArtist

red = Color.FromArgb(255, 0, 0)
green = Color.FromArgb(0, 255, 0)
blue = Color.FromArgb(0, 0, 255)

P = []
V = []
C = []

scale = float(scale)


if plane:
    P += [plane.Origin] * 3
    V.append(plane.XAxis * scale)
    V.append(plane.YAxis * scale)
    V.append(plane.ZAxis * scale)
    C += [red, green, blue]
    
    W = 3
# ---------- end draw_6 ----------
joint_values = Panel(data_recorder_9)
vdisex_3 = VectorDisplayEx(Point=draw_6.P, Vector=draw_6.V, Colour=draw_6.C, Width=draw_6.W)

# ----
# Fabrication Control
button_3 = Button()
init = Button()
start_fabrication = Button()
stop_fabrication = Button()
reset_fabrication = Button()  # disabled
fabrication = PythonScript(init=init, parallelize=parallelize)  # -> out, fabrication
# ---------- fabrication: Python ----------
from scriptcontext import sticky as st
from fabrication_control.fabrication import Fabrication

if init:
    fabrication = Fabrication()
    fabrication.parallelize = parallelize
    st["fabrication"] = fabrication

fabrication = st["fabrication"]
# ---------- end fabrication ----------
set_tasks = Button()

tasks = GhPythonScript(create=button_3, robot=set.robot, speed=tcp_speed_2, am_model=am_model, configuration=filter_3)  # -> out, tasks, configurations
# ---------- tasks: Python ----------
import fabtory_fabrication_control as ffc
import compas_rrc as rrc
import time
from fabrication_control.task import Task
from compas.geometry import Frame
from scriptcontext import sticky as st
from compas.geometry import Frame


class MoveRobTargets(Task):
    def __init__(self, name):
        self.name = name
        self.robot = None
        self.is_completed = False
        self.is_running = False
        self._stop_flag = True
        self.frames = []
        self.configurations = []
        self.speeds = []
        self.log_messages = []
        self.key = None
        self.parallelizable = False
    
    def set_robot(self, robot):
        self.robot = robot

    def run(self, _stop_flag):
        self.log("{}: started".format(self.name))
        #if self.robot.attached_tool:
            #tool_name = self.robot.attached_tool.name
            #self.robot.abb_client.send(rrc.SetTool(tool_name))
        #else:
            #self.robot.abb_client.send(rrc.SetTool("tool0"))
        
        for i, f in enumerate(self.frames):
            #if _stop_flag():
                #self.is_running = False
                #break
            if i < len(self.frames)-1:
                zone = rrc.Zone.Z50
            else:
                zone = rrc.Zone.FINE
            #store cart value from configuration
            cart = (self.configurations[i].joint_values[0])

            #send move to robtarget command
            if i<len(self.frames)-1:
                ffc.commands.move_to_robtarget(self.robot, f, cart, speed=self.speeds[i], zone=zone, scalefactor=1000, send_and_wait = False)
            else:
                ffc.commands.move_to_robtarget(self.robot, f, cart, speed=self.speeds[i], zone=zone, scalefactor=1000, send_and_wait = True)
        
        self.is_completed = True
        return True

    def add_frame(self, frame, config, spd):
        #self.robot.client = self.robot.ros_client
        #if self.robot.attached_tool:
            #tool_frame = self.robot.from_tcf_to_t0cf([frame])[0]
        #else:
            #tool_frame = frame
        self.frames.append(frame)
        self.speeds.append(spd)
        self.configurations.append(config)


if create:
    tasks = []
    for j, layer in am_model.layers():
        new_task = MoveRobTargets(name="LAYER_{}".format(j))
        new_task.robot = robot
        for i, node in layer.nodes():
            new_task.add_frame(node.frame, configuration, speed)
        tasks.append(new_task)
    st["tasks"]= tasks
    
tasks = st["tasks"]
# ---------- end tasks ----------
list_item = ListItem(List=tasks.configurations, Index=Slider(0, range=0..10), Wrap=True)
ghpython_script = GhPythonScript(tasks=tasks.tasks, id=Slider(0, range=0..10), run=Button())  # -> out; inputs tasks: list, id: Int32
# ---------- ghpython_script: Python ----------
import rhinoscriptsyntax as rs

if run:
    tasks[id].run(lambda:False)
# ---------- end ghpython_script ----------

set_fab_params = PythonScript(fabrication=fabrication.fabrication, tasks=tasks.tasks, set_tasks=set_tasks)  # -> out, fabrication; inputs tasks: list, set_tasks: Boolean
# ---------- set_fab_params: Python ----------
from scriptcontext import sticky as st

guid = str(ghenv.Component.InstanceGuid)
tasks_set_key = "tasks_set" + guid

if not tasks_set_key in st:
    st[tasks_set_key] = False

if set_tasks == True:
    print "setting tasks"    
    fabrication.clear_tasks()
    fabrication.set_tasks(tasks) #needs to be revised with aim
    st[tasks_set_key] = True
# ---------- end set_fab_params ----------
fabrication_2 = PythonScript(fabrication=set_fab_params.fabrication, start=start_fabrication, stop=stop_fabrication, reset=reset_fabrication)  # -> out
# ---------- fabrication_2: Python ----------
if start:
    #if robot.is_connected(): #and arduino.is_connected():
    print "starting process"
    fabrication.start()

if stop:
    print "stopping process"
    fabrication.stop()
    
if reset:
    print "resetting process"
    fabrication.reset()
"""
if pause:
    print "pausing process"
    fabrication.pause()

if resume:
    print "resuming process"
    fabrication.resume()
"""
# ---------- end fabrication_2 ----------

panel_5 = Panel(ghpython_script)

# ==== cluster Tools

# ---- group: measurement tool
geo = Geometry(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)
mesh = Mesh(geo)
mjoin = MeshJoin(Meshes=mesh)
xaxis_line = Curve(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)
yaxis_line = Curve(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)
tool = PythonScript(rhmesh=mjoin, xline=xaxis_line, yline=yaxis_line)  # -> values_for_robotstudio, tool; inputs rhmesh: Mesh
# ---------- tool: Python ----------
import Rhino.Geometry as rg
import os, math
from compas.geometry import Frame, Rotation
from compas.datastructures import Mesh
from compas_ghpython.artists import MeshArtist
from compas_fab.robots import Tool
from compas_rhino.geometry import RhinoMesh

xaxis = rg.Line(xline.PointAtStart, xline.PointAtEnd)
yaxis = rg.Line(yline.PointAtStart, yline.PointAtEnd)

if xaxis.From.DistanceTo(yaxis.From) < 0.01:
    origin = xaxis.From
    xaxis = xaxis.Direction
    yaxis = yaxis.Direction
elif xaxis.To.DistanceTo(yaxis.To) < 0.01:
    origin = xaxis.To
    xaxis = -xaxis.Direction
    yaxis = -yaxis.Direction
elif xaxis.From.DistanceTo(yaxis.To) < 0.01:
    origin = xaxis.From
    xaxis = xaxis.Direction
    yaxis = -yaxis.Direction
elif xaxis.To.DistanceTo(yaxis.From) < 0.01:
    origin = xaxis.To
    xaxis = -xaxis.Direction
    yaxis = yaxis.Direction

xaxis.Unitize()
yaxis.Unitize()

ee_frame = Frame(origin, xaxis, yaxis)
ee_mesh = RhinoMesh.from_geometry(rhmesh).to_compas()

tool = Tool(ee_mesh, ee_frame, collision=None, name="t_measurement")

values_for_robotstudio = [[round(entry*1000, 5) for entry in list(ee_frame.point)], list(ee_frame.quaternion)]
print values_for_robotstudio
# ---------- end tool ----------
values_for_robotstudio = Panel(tool.values_for_robotstudio)

# ---- group: concrete extruder tool
geo_2 = Geometry(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)
mesh_2 = Mesh(geo_2)
mjoin_2 = MeshJoin(Meshes=mesh_2)
yaxis_line_2 = Curve(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)
xaxis_line_2 = Curve(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)
tool_2 = PythonScript(rhmesh=mjoin_2, xline=xaxis_line_2, yline=yaxis_line_2)  # -> values_for_robotstudio, tool; inputs rhmesh: Mesh
# ---------- tool_2: Python ----------
import Rhino.Geometry as rg
import os, math
from compas.geometry import Frame, Rotation
from compas.datastructures import Mesh
from compas_ghpython.artists import MeshArtist
from compas_fab.robots import Tool
from compas_rhino.geometry import RhinoMesh


xaxis = rg.Line(xline.PointAtStart, xline.PointAtEnd)
yaxis = rg.Line(yline.PointAtStart, yline.PointAtEnd)

if xaxis.From.DistanceTo(yaxis.From) < 0.01:
    origin = xaxis.From
    xaxis = xaxis.Direction
    yaxis = yaxis.Direction
elif xaxis.To.DistanceTo(yaxis.To) < 0.01:
    origin = xaxis.To
    xaxis = -xaxis.Direction
    yaxis = -yaxis.Direction
elif xaxis.From.DistanceTo(yaxis.To) < 0.01:
    origin = xaxis.From
    xaxis = xaxis.Direction
    yaxis = -yaxis.Direction
elif xaxis.To.DistanceTo(yaxis.From) < 0.01:
    origin = xaxis.To
    xaxis = -xaxis.Direction
    yaxis = yaxis.Direction

xaxis.Unitize()
yaxis.Unitize()

ee_frame = Frame(origin, xaxis, yaxis)
ee_mesh = RhinoMesh.from_geometry(rhmesh).to_compas()

tool = Tool(ee_mesh, ee_frame, collision=None, name="t_concreteextruder")

values_for_robotstudio = [[round(entry*1000, 5) for entry in list(ee_frame.point)], list(ee_frame.quaternion)]
print values_for_robotstudio
# ---------- end tool_2 ----------
values_for_robotstudio_2 = Panel(tool_2.values_for_robotstudio)

# ----
G = ClusterInput()
filter = StreamFilter(Gate=G, Stream0=tool.tool, Stream1=tool_2.tool)
s_1 = ClusterOutput(filter)
