# Grasshopper definition fabtory_control_curve.ghx (Grasshopper 1.0.7)

path = PythonScript()  # -> HERE, DATA, ROBOT_DESCRIPTION
# ---------- path: Python ----------
import os

HERE = os.path.dirname(ghdoc.Path)
DATA = os.path.abspath(os.path.join(HERE, "..", "data"))
ROBOT_DESCRIPTION = os.path.abspath(os.path.join(DATA, "robot_description"))

print(HERE)
print(DATA)
print(ROBOT_DESCRIPTION)
# ---------- end path ----------
reload = Button()
py = PythonScript(reload=reload)
# ---------- py: Python ----------
if reload:
    from compas_ghpython import unload_modules
    unload_modules('compas')
    unload_modules("compas_fab")
    unload_modules("fabtory_fabrication_control")
    unload_modules("compas_rrc")
# ---------- end py ----------

div_len = Slider(0.2, range=0..1)
show = BooleanToggle(True)
crv = Curve(<curve referenced from the Rhino model>)
layer_def = GhPythonScript(crv=crv, div_len=div_len)  # -> out, layer; inputs crv: Curve
# ---------- layer_def: Python ----------
import compas_rrc as rrc
import fabtory_fabrication_control as ffc

import rhinoscriptsyntax as rs
from compas.geometry import Frame, Line, Vector
from am_information_model.model import Node
from am_information_model.model import Layer


def _radius_between_frames(from_frame, via_frame, to_frame, max_radius):
        in_line = Line(from_frame.point, via_frame.point)
        out_line = Line(via_frame.point, to_frame.point)
        r = min(max_radius, in_line.length/2, out_line.length/2)
        return r

# nodes: dividing curve
pts = rs.DivideCurveLength(crv, div_len)
max_radius = div_len/2
frames = [Frame([pt.X, pt.Y, pt.Z], [0, -1, 0], [-1, 0, 0])for pt in pts]


nodes = []
for i,frame in enumerate(frames):
    #from_frame = frames[max(0,i-1)]
    #via_frame = frame
    #to_frame = frames[min(i+1, len(frames)-1)]

    #r = ffc.model.rad_between_crvs(from_frame, via_frame, to_frame, max_radius)


    r = _radius_between_frames(frames[max(0,i-1)], frame, frames[min(i+1, len(frames)-1)], max_radius)

    nodes.append(Node(frame, radius=r))
layer = Layer.from_nodes(nodes)
# ---------- end layer_def ----------
draw = PythonScript(layer=layer_def.layer, show=show)  # -> M, F, S
# ---------- draw: Python ----------
from compas.geometry import Transformation
from compas.geometry import Frame
from compas.datastructures import mesh_transformed
from compas_ghpython.artists import MeshArtist
from compas_ghpython import draw_frame

if show:
    F = [draw_frame(node.frame) for key, node in layer.nodes()]
# ---------- end draw ----------
cp = Plane(PlaneXY(0, 0, 0))
generate_assembly = GhPythonScript(centerplane=cp, layer=layer_def.layer, layer_height=Slider(0.006, range=0..0.01))  # -> am_model, planes
# ---------- generate_assembly: Python ----------
import Rhino.Geometry as rg
import math
from scriptcontext import sticky as st


from compas.geometry import Frame
from compas.geometry import Transformation
from compas.geometry import Rotation
from compas.geometry import Translation
from compas.geometry import Point

from compas_ghpython import draw_frame

from am_information_model.model import AMModel
from am_information_model.model import Layer

import Rhino.Geometry as rg


# initialize an empty assembly class
am_model = AMModel()

cp = centerplane
cf = Frame(cp.Origin, cp.XAxis, cp.YAxis)

for i in range(25): # loop through the number of layers i
    T = Translation.from_vector([0,0,layer_height*i])
    cft = cf.transformed(T) #transforms the origin plane

    T1 = Transformation.from_frame_to_frame(cf, cft)
    # create new instances of the element
    new_layer = layer.transformed(T) #returns a deep copy of the initial element at the new location of the frame
    print(new_layer.node(0).frame)
    am_model.add_layer(new_layer)
# ---------- end generate_assembly ----------
pln = Plane(generate_assembly.planes)

list = ValueList({"20", "50", "100", "500", "1000", "5000"}, selected="50")
back = Button()
reset = Button()
start = Button()
stop = Button()
step = Button()
full = Button()

go_to_start_configuration = BooleanToggle(False)
# inverse kinematics
list_2 = ValueList({"0", "1"}, selected="0")
avoid_collisions = BooleanToggle(False)
compute = BooleanToggle(False)

# ----
# Draw
counter = CountThroughList(
    am_model=generate_assembly.am_model,
    start=start,
    stop=stop,
    step=step,
    step_back=back,
    reset=reset,
    full=full,
    interval=list)  # -> item, counter; inputs start: Boolean, stop: Boolean, step_back: Boolean
# ---------- counter: Python ----------
from scriptcontext import sticky as st
from compas_ghpython import update_component


L = list(am_model.layers())
# store data in component
guid = str(ghenv.Component.InstanceGuid)
counter_key = "counter_" + guid
running_key = "running_" + guid

if counter_key not in st:
    st[counter_key] = 0

if running_key not in st:
    st[running_key] = False
    

if st[running_key]:
    if st[counter_key] < len(L) - 1:
        st[counter_key] += 1
        update_component(ghenv, interval)
    else:
        st[counter_key] = 0
        st[running_key] = False
    
    
if start:
    st[running_key] = True

if stop:
    st[running_key] = False

if step:
    if st[counter_key] < len(L) - 1:
        st[counter_key] += 1

if step_back:
    if st[counter_key] < len(L) - 1:
        st[counter_key] -= 1

if reset:
    st[counter_key] = 0

if full:
    st[counter_key] = len(L)-1

if len(L):
    item = L[st[counter_key]]



#st["visualisation_counter"] = st[counter_key]
counter = st[counter_key]
# ---------- end counter ----------
show_2 = BooleanToggle(False)
show_3 = BooleanToggle(False)
idx = Panel(counter.counter)
draw_2 = PythonScript(am_model=generate_assembly.am_model, show_all=show_2, show_counter=show_3, counter=idx)  # -> G, tool_planes_WCS, current_tool_plane, current_tool_planes; inputs counter: Int32
# ---------- draw_2: Python ----------
import os
import sys

import math

from compas_ghpython.artists import MeshArtist
from compas_ghpython import draw_frame


G = []

key_index = am_model.network.key_index()
keys = [key_index[key] for key in am_model.network.nodes()]
layers = [am_model.layer(key) for key in keys]
#print elements
#print([(e.gripping_frame) for e in elements])

start_planes_WCS = [draw_frame(l.node(0).frame) for l in layers]

current_tool_plane = start_planes_WCS[counter]
current_tool_planes = [draw_frame(node.frame) for key, node in am_model.layer(counter).nodes()]

if show_all and not show_counter:
    for layer in layers:
        for key, node in layer.nodes():
            plane = draw_frame(node.frame) 
            G.append(plane)

if show_counter:
    for layer in layers[0:counter+1]:
        for key, node in layer.nodes():
            plane = draw_frame(node.frame) 
            G.append(plane)

    tool_planes_WCS = [draw_frame(l.node(0).tool_frame) for l in layers[0:counter+1]]
# ---------- end draw_2 ----------
geo = Geometry(draw_2.G)
pln_2 = Plane(draw_2.tool_planes_WCS)
pln_3 = Plane(draw_2.current_tool_plane)
preview = CustomPreview(Geometry=geo, Shader=ColourSwatch(SwatchColor=RGBA(255, 227, 227, 233)))
preview_2 = CustomPreview(Geometry=[pln_2, pln_3], Shader=ColourSwatch(SwatchColor=RGBA(209, 27, 27, 178)))

pln_4 = Plane(draw_2.current_tool_planes)
tcp_speed = Slider(250, range=0..1000)

to_single_joints = Button()
to_joints = Button()

to_robtarget = Button()
to_frame = Button()

get_frame = Button()
get_robtarget = Button()
get_joints = Button()

# ----
# Load Model
# Load robot from local package
panel = Panel("abb_fabtory.urdf")
list_3 = ValueList({"abb_fabtory"}, selected="abb_fabtory")
py_2 = PythonScript()  # -> packages
# ---------- py_2: Python ----------
packages = ["abb_irb6700_support", "abb_end_effectors", "abb_fabtory"]
# ---------- end py_2 ----------
py_3 = PythonScript(path=path.ROBOT_DESCRIPTION, packages=py_2)  # -> loaders; inputs packages: list
# ---------- py_3: Python ----------
from compas.robots import LocalPackageMeshLoader

loaders = []
print packages


for package in packages:
    loaders.append(LocalPackageMeshLoader(path, package))
# ---------- end py_3 ----------
load = Button()
units = ValueList({"m": 1, "cm": 100, "mm": 1000}, selected="m")

# ----
# Robot Model
panel_2 = Panel("abb_fabtory.srdf")

py_4 = PythonScript(path=path.ROBOT_DESCRIPTION, package=list_3, urdf_name=panel, srdf_name=panel_2)  # -> package_path, urdf_filename, srdf_filename
# ---------- py_4: Python ----------
import os

package_path = os.path.join(path, package)
print(package_path)

urdf_filename = os.path.join(package_path, "urdf", urdf_name)
srdf_filename = os.path.join(package_path, srdf_name)

assert os.path.isfile(urdf_filename)
assert os.path.isfile(srdf_filename)
# ---------- end py_4 ----------
create = PythonScript(loaders=py_3, urdf_filename=py_4.urdf_filename, srdf_filename=py_4.srdf_filename, scale_factor=units, load=load)  # -> out, robot; inputs loaders: list
# ---------- create: Python ----------
import os
from scriptcontext import sticky as st

import compas

from compas.robots import RobotModel
from compas.robots import LocalPackageMeshLoader

from compas_fab.robots import Robot
from compas_fab.robots import RobotSemantics

from compas_fab.ghpython import RobotArtist

compas.PRECISION = '12f'

# store robot in component
guid = str(ghenv.Component.InstanceGuid)
robot_key = "robot_" + guid

if robot_key not in st:
    st[robot_key] = None

print loaders

if load:
    model = RobotModel.from_urdf_file(urdf_filename)
    
    model.load_geometry(*loaders)
    artist = RobotArtist(model)
    semantics = RobotSemantics.from_srdf_file(srdf_filename, model)
    robot = Robot(model, artist, semantics, client=None)
    
    st[robot_key] = robot

robot = st[robot_key]


if robot:
    robot.scale(scale_factor)
# ---------- end create ----------
robot = Data(create.robot)

# ----
# Tool
panel_3 = Panel("Attach a custom tool")
list_4 = ValueList({"measurement_tool": 0, "area_grip": 1, "concrete_extruder": 2}, selected="concrete_extruder")
tools = Tools(G=list_4)
remove = Button()
add = Button()
attach_remove = PythonScript(robot=robot, tool=tools, attach=add, remove=remove)  # -> out, bang
# ---------- attach_remove: Python ----------
if attach:
    robot.attach_tool(tool)
if remove:
    robot.detach_tool()
# ---------- end attach_remove ----------

# ----
# ROS & ABB client
ip = ValueList({"192.168.125.1", "127.0.0.1"}, selected="127.0.0.1")
robot_port = ValueList({"9090", "30101"}, selected="9090")
ros = ROSConnect(ip=ip, port=robot_port, connect=Toggle(True))  # -> ros_client, is_connected; inputs port: Int32, connect: Boolean
#   port ip: The ip address ROS. Defaults to 127.0.0.1.
#   port port: The port of ROS. Defaults to 9090.
#   port connect: If True, connects to ROS. If False, disconnects from ROS. Defaults to False.
#   port ros_client: The ROS client.
#   port is_connected: True if connection established.
# ---------- ros: Python ----------
"""
Connect or disconnect to ROS.

COMPAS FAB v0.19.1
"""
from ghpythonlib.componentbase import executingcomponent as component
from scriptcontext import sticky as st

from compas_fab.backends import RosClient
from compas_fab.ghpython.components import create_id


class ROSConnect(component):
    def RunScript(self, ip, port, connect):
        ros_client = None

        ip = ip or '127.0.0.1'
        port = port or 9090

        key = create_id(self, 'ros_client')
        ros_client = st.get(key, None)

        if ros_client:
            st[key].close()
        if connect:
            st[key] = RosClient(ip, port)
            st[key].run(5)

        ros_client = st.get(key, None)
        is_connected = ros_client.is_connected if ros_client else False
        return (ros_client, is_connected)
# ---------- end ros ----------
abb = GhPythonScript(ros_client=ros.ros_client, connect=Toggle(True))  # -> out, abb_client; inputs connect: Boolean
# ---------- abb: Python ----------
import compas_rrc as rrc

if ros_client:
    if ros_client.is_connected and connect: 
        # Create ABB Client
        abb_client = rrc.AbbClient(ros_client, '/rob1')
# ---------- end abb ----------
is_connected = Panel(ros.is_connected)
set = PythonScript(robot=robot, ros_client=ros.ros_client, abb_client=abb.abb_client)  # -> robot
# ---------- set: Python ----------
if robot and ros_client and abb_client:
    robot.ros_client = ros_client
    robot.abb_client = abb_client
# ---------- end set ----------
robot_2 = Data(set)
info = PythonScript(robot=robot_2)  # -> out, main_group_name
# ---------- info: Python ----------
if robot:
    robot.info()
    main_group_name = robot.main_group_name
# ---------- end info ----------

robot_info = Panel(info.out)

# ----
# forward kinematics
number_slider = Slider(0, range=-180..180)
# Configuration
number_slider_2 = Slider(0, range=0..4.2)
jp = GhPythonScript()  # -> configuration_values
# ---------- jp: Python ----------
import math
joint_values = [-3.136, -0.328, -1.218, 3.129, 0.852, 0.008]
#joint_values = [math.degrees(j) for j in joint_values]
#joint_positions = [0] * 6

cart = 0
joint_values = [0,0,0,0,0,0]

configuration_values = [cart] + joint_values
# ---------- end jp ----------
forward_kinematics = PythonScript(
    robot=robot_2,
    reset_configuration=Button(),
    configuration_values=jp,
    a_cart=number_slider_2,
    a_a1=number_slider,
    a_a2=Slider(0, range=-90..150),
    a_a3=Slider(0, range=-180..180),
    a_a4=Slider(0, range=-400..400),
    a_a5=Slider(0, range=-125..120),
    a_a6=Slider(0, range=-400..400))  # -> full_configuration; inputs reset_configuration: Boolean, configuration_values: list
# ---------- forward_kinematics: Python ----------
import math
import Grasshopper
import copy
from compas.robots import Joint
from compas_fab.robots import Configuration





if reset_configuration:
    j = 0
    for i in range(ghenv.Component.Params.Input.Count):
        nslider = ghenv.Component.Params.Input[i].Sources[0]
        if nslider.GetType() == Grasshopper.Kernel.Special.GH_NumberSlider:
            nslider.TrySetSliderValue(configuration_values[j])
            j += 1


if robot:
    joint_positions = [a_cart, a_a1, a_a2, a_a3, a_a4, a_a5, a_a6]
    print joint_positions
    joint_positions_degrees = copy.deepcopy(joint_positions)
    joint_types = robot.get_configurable_joint_types()
    print(joint_types)
    for i, joint_type in enumerate(joint_types):
        if joint_type == Joint.REVOLUTE:
            joint_positions[i] = math.radians(joint_positions[i])
        if joint_type == Joint.PRISMATIC:
            joint_positions[i] = joint_positions[i]
    full_configuration = Configuration(joint_positions, joint_types)
    print full_configuration
# ---------- end forward_kinematics ----------

# ----
# inverse kinematics
py_5 = PythonScript(robot=robot_2)  # -> configuration
# ---------- py_5: Python ----------
from compas_fab.robots import Configuration

if robot:
    types = robot.get_configurable_joint_types()
    values = [0] * len(types)
    configuration = Configuration(values, types)
    print configuration
    print robot.get_configurable_joint_names()
# ---------- end py_5 ----------
x_axis = Curve(<curve referenced from the Rhino model>)
y_axis = Curve(<curve referenced from the Rhino model>)
fk_configuration = Data(forward_kinematics)
go_to_start_configuration_2 = BooleanToggle(False)
list_5 = ValueList({"0", "1"}, selected="0")
avoid_collisions_2 = BooleanToggle(False)
plane = PythonScript(plane_axes=[x_axis, y_axis])  # -> plane; inputs plane_axes: list of Curve
# ---------- plane: Python ----------
import Rhino.Geometry as rg

x_axis, y_axis = plane_axes

x_axis = rg.Line(x_axis.PointAtStart, x_axis.PointAtEnd)
y_axis = rg.Line(y_axis.PointAtStart, y_axis.PointAtEnd)

if x_axis.From.DistanceTo(y_axis.From) < 0.01:
    origin = x_axis.From
    xvec = x_axis.Direction
    yvec = y_axis.Direction
elif x_axis.To.DistanceTo(y_axis.To) < 0.01:
    origin = x_axis.To
    xvec = -x_axis.Direction
    yvec = -y_axis.Direction
elif x_axis.From.DistanceTo(y_axis.To) < 0.01:
    origin = x_axis.From
    xvec = x_axis.Direction
    yvec = -y_axis.Direction
elif x_axis.To.DistanceTo(y_axis.From) < 0.01:
    origin = x_axis.To
    xvec = -x_axis.Direction
    yvec = y_axis.Direction

plane = rg.Plane(origin, xvec, yvec)
# ---------- end plane ----------
compute_2 = Button()
filter = StreamFilter(Gate=list_5, Stream0=fk_configuration, Stream1=py_5)
inverse_kinematics = GhPythonScript(
    compute=compute_2,
    robot=robot_2,
    group=info.main_group_name,
    plane=plane,
    start_configuration=filter,
    go_to_start_configuration=go_to_start_configuration_2,
    avoid_collisions=avoid_collisions_2)  # -> out, ik_configuration, t0cp; inputs plane: Plane
# ---------- inverse_kinematics: Python ----------
from __future__ import print_function
import logging
from compas.geometry import Frame
from scriptcontext import sticky as st
from compas_ghpython.artists import FrameArtist

LOGGER = logging.getLogger('roslibpy')

#vizualize t0cf
if robot.attached_tool:
    t0cf = Frame(plane.Origin, plane.XAxis, plane.YAxis)
    t0cf = robot.from_tcf_to_t0cf([t0cf])[0]
    artist = FrameArtist(t0cf)
    t0cp = artist.draw()
    print (t0cf)


if compute:
    if robot.attached_tool:
        tool_attached = True
    else:
        tool_attached = False

    robot.client = robot.ros_client
    if go_to_start_configuration:
        ik_configuration = start_configuration
    else:
        frame = Frame(plane.Origin, plane.XAxis, plane.YAxis)
        if tool_attached:
            tool_frame = robot.from_tcf_to_t0cf([frame])[0]
        else:
            tool_frame = frame

        ik_configuration = robot.inverse_kinematics(tool_frame,
                                                      start_configuration,
                                                      group=group,
                                                      options={
                                                        'avoid_collisions':avoid_collisions,
                                                        'return_full_configuration':True,
                                                      })        
    #group_configuration = robot.get_group_configuration(group, ik_configuration)
    #print (group_configuration)
    st["ik_configuration"] = ik_configuration

ik_configuration = st["ik_configuration"] 
print(ik_configuration)
# ---------- end inverse_kinematics ----------
out = Panel(inverse_kinematics.out)
draw_3 = GhPythonScript(planes=inverse_kinematics.t0cp, scale=Slider(0.2, range=0..1))  # -> P, V, C, W; inputs planes: list
# ---------- draw_3: Python ----------
from System.Drawing import Color
from compas_ghpython.artists import FrameArtist

red = Color.FromArgb(255, 0, 0)
green = Color.FromArgb(0, 255, 0)
blue = Color.FromArgb(0, 0, 255)

P = []
V = []
C = []

scale = float(scale)

for plane in planes:
    if not plane:
        continue
    P += [plane.Origin] * 3
    V.append(plane.XAxis * scale)
    V.append(plane.YAxis * scale)
    V.append(plane.ZAxis * scale)
    C += [red, green, blue]

W = 3
# ---------- end draw_3 ----------
vdisex = VectorDisplayEx(Point=draw_3.P, Vector=draw_3.V, Colour=draw_3.C, Width=draw_3.W)

py_6 = PythonScript(robot=robot_2)  # -> configuration; same code as py_5
fk_configuration_2 = Data(forward_kinematics)
filter_2 = StreamFilter(Gate=list_2, Stream0=fk_configuration_2, Stream1=py_6)
inverse_kinematics_2 = GhPythonScript(
    compute=compute,
    robot=robot_2,
    group=info.main_group_name,
    plane=pln_4,
    start_configuration=filter_2,
    go_to_start_configuration=go_to_start_configuration,
    avoid_collisions=avoid_collisions)  # -> out, ik_configuration, t0cp; inputs plane: Plane; same code as inverse_kinematics
ik_path_configuration = Data(inverse_kinematics_2.ik_configuration)

list_6 = ValueList({"0 forward_kinematics": 0, "1 inverse_kinematics": 1, "2 ik_path_configuration": 2}, selected="2 ik_path_configuration")
ik_configuration = Data(inverse_kinematics.ik_configuration)
fk_configuration_3 = Data(forward_kinematics)
filter_3 = StreamFilter(Gate=list_6, Stream0=fk_configuration_3, Stream1=ik_configuration, Stream2=ik_path_configuration)

# ----
# Visualisation
show_end_effector_frame = BooleanToggle(False)
show_base_frame = BooleanToggle(False)
show_collision = BooleanToggle(False)
show_frames = BooleanToggle(False)
show_visual = BooleanToggle(True)
show_acm = BooleanToggle(False)
robot_visualize = RobotVisualize(
    robot=robot_2,
    group=info.main_group_name,
    configuration=filter_3,
    redraw=attach_remove.bang,
    show_visual=show_visual,
    show_collision=show_collision,
    show_frames=show_frames,
    show_base_frame=show_base_frame,
    show_end_effector_frame=show_end_effector_frame,
    show_acm=show_acm)  # -> visual, collision, attached_meshes, frames, base_frame, ee_frame; inputs redraw: list, show_visual: Boolean, show_collision: Boolean, show_frames: Boolean, show_base_frame: Boolean, show_end_effector_frame: Boolean, show_acm: Boolean
#   port group: The planning group used for end-effector and base visualization.
#   port configuration: The robot's full configuration.
#   port redraw: A list of attached collision meshes.
#   port show_visual: Whether or not to show the robot's visual meshes.
#   port show_collision: Whether or not to show the robot's collision meshes.
#   port show_frames: Whether or not to show the robot's joint frames.
#   port show_base_frame: Whether or not to show the robot's base frame.
#   port show_end_effector_frame: Whether or not to show the robot's end-effector frame.
#   port show_acm: Whether or not to show the attached collision meshes (if any).
#   port visual: The robot's visual Rhino meshes (if any).
#   port collision: The robot's collision Rhino meshes (if any).
#   port attached_meshes: The attached collision Rhino meshes (if any).
#   port frames: The robot's joint frames as Rhino planes (if any).
#   port base_frame: The robot's base frame as a Rhino plane (if any).
#   port ee_frame: The robot's end-effector frame as a Rhino plane (if any).
# ---------- robot_visualize: Python ----------
"""
Visualizes the robot.

COMPAS FAB v0.19.1
"""
from compas.geometry import Frame
from compas.geometry import Transformation
from compas_ghpython.artists import FrameArtist
from compas_ghpython.artists import MeshArtist
from ghpythonlib.componentbase import executingcomponent as component


class RobotVisualize(component):
    def RunScript(self, robot, group, configuration, attached_collision_meshes, show_visual, show_collision,
                  show_frames, show_base_frame, show_end_effector_frame, show_acm):

        visual = None
        collision = None
        attached_meshes = None
        frames = None
        base_frame = None
        ee_frame = None

        if robot:
            show_visual = True if show_visual is None else show_visual
            configuration = configuration or robot.zero_configuration()

            robot.update(configuration, visual=show_visual, collision=show_collision)
            compas_frames = robot.transformed_frames(configuration, group)

            if show_visual:               
                visual = robot.artist.draw_visual()
                

            if show_collision:
                collision = robot.artist.draw_collision()

            if show_base_frame:
                base_compas_frame = compas_frames[0]
                artist = FrameArtist(base_compas_frame)
                base_frame = artist.draw()

            if show_end_effector_frame:
                ee_compas_frame = robot.forward_kinematics(configuration, group, options=dict(solver='model'))
                if robot.attached_tool:
                    ee_compas_frame = robot.from_t0cf_to_tcf([ee_compas_frame])[0]
                artist = FrameArtist(ee_compas_frame)
                ee_frame = artist.draw()

            if show_frames:
                frames = []
                for compas_frame in compas_frames[1:]:
                    artist = FrameArtist(compas_frame)
                    frame = artist.draw()
                    frames.append(frame)

            if show_acm:
                attached_meshes = []
                for acm in attached_collision_meshes:
                    frame = robot.forward_kinematics(configuration, options=dict(solver='model', link_name=acm.link_name))
                    T = Transformation.from_frame_to_frame(Frame.worldXY(), frame)
                    mesh = acm.collision_mesh.mesh.transformed(T)
                    attached_meshes.append(MeshArtist(mesh).draw())

        return (visual, collision, attached_meshes, frames, base_frame, ee_frame)
# ---------- end robot_visualize ----------
draw_4 = GhPythonScript(frames=[robot_visualize.frames, robot_visualize.base_frame, robot_visualize.ee_frame], scale=Slider(0.2, range=0..1))  # -> P, V, C, W; inputs frames: list
# ---------- draw_4: Python ----------
from System.Drawing import Color
from compas_ghpython.artists import FrameArtist

red = Color.FromArgb(255, 0, 0)
green = Color.FromArgb(0, 255, 0)
blue = Color.FromArgb(0, 0, 255)

P = []
V = []
C = []

scale = float(scale)

for plane in frames:
    if not plane:
        continue
    P += [plane.Origin] * 3
    V.append(plane.XAxis * scale)
    V.append(plane.YAxis * scale)
    V.append(plane.ZAxis * scale)
    C += [red, green, blue]

W = 3
# ---------- end draw_4 ----------
geo_2 = Geometry([robot_visualize.visual, robot_visualize.collision, robot_visualize.attached_meshes])
# Move Control
preview_3 = CustomPreview(Geometry=geo_2, Shader=ColourSwatch(SwatchColor=RGB(207, 157, 160)))
vdisex_2 = VectorDisplayEx(Point=draw_4.P, Vector=draw_4.V, Colour=draw_4.C, Width=draw_4.W)

out_2 = Panel(inverse_kinematics_2.out)
draw_5 = GhPythonScript(planes=inverse_kinematics_2.t0cp, scale=Slider(0.2, range=0..1))  # -> P, V, C, W; inputs planes: list; same code as draw_3
vdisex_3 = VectorDisplayEx(Point=draw_5.P, Vector=draw_5.V, Colour=draw_5.C, Width=draw_5.W)

# ----
# Move Joints
tcp_speed_2 = Slider(250, range=0..1000)
movej_command = GhPythonScript(robot=robot_2, configuration=filter_3, speed=tcp_speed_2, move_to_joints=to_joints, move_single_joints=to_single_joints)  # -> out; inputs move_to_joints: Boolean
# ---------- movej_command: Python ----------
import fabtory_fabrication_control as ffc
import compas_rrc as rrc

if move_to_joints or move_single_joints:
    #ffc.commands.move_to_joints(robot, configuration, speed=speed, zone=rrc.Zone.FINE)
    ffc.commands.move_to_joints_2(robot, configuration, speed=speed, zone=rrc.Zone.FINE)
# ---------- end movej_command ----------
data_recorder = DataRecorder(movej_command, DataLimit=-10, RecordData=True)
out_3 = Panel(data_recorder)

target_plane = Plane(plane)

# ----
# Move Cartesian
movel_command = GhPythonScript(
    robot=robot_2,
    configuration=filter_3,
    speed=tcp_speed,
    target_plane=target_plane,
    move_to_frame=to_frame,
    move_to_robtarget=to_robtarget)  # -> out; inputs target_plane: Plane, move_to_frame: Boolean, move_to_robtarget: Boolean
# ---------- movel_command: Python ----------
import compas_rrc as rrc
import fabtory_fabrication_control as ffc
from compas.geometry import Frame

if move_to_frame:
    #transform target plane into target frame
    target_frame = Frame(target_plane.Origin, target_plane.XAxis, target_plane.YAxis)
    #send move to frame command
    ffc.commands.move_to_frame(robot, target_frame, speed=speed, zone=rrc.Zone.FINE, scalefactor=1000)

if move_to_robtarget:
    #transform target plane into target frame
    target_frame = Frame(target_plane.Origin, target_plane.XAxis, target_plane.YAxis)
    #store cart value from configuration
    cart = (configuration.joint_values[0])
    #send move to robtarget command
    ffc.commands.move_to_robtarget(robot, target_frame, cart, speed=speed, zone=rrc.Zone.FINE, scalefactor=1000)
# ---------- end movel_command ----------
data_recorder_2 = DataRecorder(movel_command, DataLimit=-10, RecordData=True)
out_4 = Panel(data_recorder_2)

# ----
# Get Robot Configurations
get_joints_2 = GhPythonScript(robot=robot_2, get_frame=get_frame, get_robtarget=get_robtarget, get_joints=get_joints)  # -> joint, current_plane; disabled
# ---------- get_joints_2: Python ----------
from compas_ghpython.artists import FrameArtist
from scriptcontext import sticky as st
import fabtory_fabrication_control as ffc
import os

# store robot in component
guid = str(ghenv.Component.InstanceGuid)
current_frame_key = "current_frame_" + guid
current_robtarget_key = "current_robtarget_" + guid
current_configuration_key = "current_configuration_" + guid

if current_frame_key not in st:
    st[current_frame_key] = None

if current_robtarget_key not in st:
    st[current_robtarget_key] = None

if current_configuration_key not in st:
    st[current_configuration_key] = None


#get commands
if get_frame:
    current_frame = ffc.feedback.get_frame(robot, scalefactor=0.001)
    st[current_frame_key] = current_frame

if get_robtarget:
    current_robtarget = ffc.feedback.get_robtarget(robot, scalefactor=0.001)
    print current_robtarget
    st[current_robtarget_key] = current_robtarget


if get_joints:
    current_configuration = ffc.feedback.get_joints(robot)
    st[current_configuration_key] = current_configuration
    print current_configuration

# sticky
if st[current_frame_key]:
    current_frame = st[current_frame_key]
    artist = FrameArtist(current_frame)
    current_plane = artist.draw()

if st[current_robtarget_key]:
    current_robtarget = st[current_robtarget_key]

if st[current_configuration_key]:
    current_configuration = st[current_configuration_key]
# ---------- end get_joints_2 ----------
data_recorder_3 = DataRecorder(get_joints_2.joint, DataLimit=-10, RecordData=True)
joint_values = Panel(data_recorder_3)
draw_6 = GhPythonScript(plane=get_joints_2.current_plane, scale=Slider(0.2, range=0..1))  # -> P, V, C, W; inputs plane: Plane
# ---------- draw_6: Python ----------
from System.Drawing import Color
from compas_ghpython.artists import FrameArtist

red = Color.FromArgb(255, 0, 0)
green = Color.FromArgb(0, 255, 0)
blue = Color.FromArgb(0, 0, 255)

P = []
V = []
C = []

scale = float(scale)


if plane:
    P += [plane.Origin] * 3
    V.append(plane.XAxis * scale)
    V.append(plane.YAxis * scale)
    V.append(plane.ZAxis * scale)
    C += [red, green, blue]
    
    W = 3
# ---------- end draw_6 ----------
vdisex_4 = VectorDisplayEx(Point=draw_6.P, Vector=draw_6.V, Colour=draw_6.C, Width=draw_6.W)

# ==== cluster Tools

# ---- group: concrete extruder tool
geo = Geometry(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)
mesh = Mesh(geo)
mjoin = MeshJoin(Meshes=mesh)
yaxis_line = Curve(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)
xaxis_line = Curve(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)

# ---- group: measurement tool
geo_2 = Geometry(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)
mesh_2 = Mesh(geo_2)
mjoin_2 = MeshJoin(Meshes=mesh_2)
xaxis_line_2 = Curve(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)
yaxis_line_2 = Curve(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)
tool = PythonScript(rhmesh=mjoin_2, xline=xaxis_line_2, yline=yaxis_line_2)  # -> tool; inputs rhmesh: Mesh
# ---------- tool: Python ----------
import Rhino.Geometry as rg
import os, math
from compas.geometry import Frame, Rotation
from compas.datastructures import Mesh
from compas_ghpython.artists import MeshArtist
from compas_fab.robots import Tool
from compas_rhino.geometry import RhinoMesh

xaxis = rg.Line(xline.PointAtStart, xline.PointAtEnd)
yaxis = rg.Line(yline.PointAtStart, yline.PointAtEnd)

if xaxis.From.DistanceTo(yaxis.From) < 0.01:
    origin = xaxis.From
    xaxis = xaxis.Direction
    yaxis = yaxis.Direction
elif xaxis.To.DistanceTo(yaxis.To) < 0.01:
    origin = xaxis.To
    xaxis = -xaxis.Direction
    yaxis = -yaxis.Direction
elif xaxis.From.DistanceTo(yaxis.To) < 0.01:
    origin = xaxis.From
    xaxis = xaxis.Direction
    yaxis = -yaxis.Direction
elif xaxis.To.DistanceTo(yaxis.From) < 0.01:
    origin = xaxis.To
    xaxis = -xaxis.Direction
    yaxis = yaxis.Direction

xaxis.Unitize()
yaxis.Unitize()

ee_frame = Frame(origin, xaxis, yaxis)
ee_mesh = RhinoMesh.from_geometry(rhmesh).to_compas()

tool = Tool(ee_mesh, ee_frame)
# ---------- end tool ----------

# ---- group: area grip tool
geo_3 = Geometry(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)
mesh_3 = Mesh(geo_3)
mjoin_3 = MeshJoin(Meshes=mesh_3)
yaxis_line_3 = Curve(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)
xaxis_line_3 = Curve(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)
tool_2 = PythonScript(rhmesh=mjoin_3, xline=xaxis_line_3, yline=yaxis_line_3)  # -> tool; inputs rhmesh: Mesh; same code as tool

# ----
tool_3 = PythonScript(rhmesh=mjoin, xline=xaxis_line, yline=yaxis_line)  # -> tool; inputs rhmesh: Mesh; same code as tool
G = ClusterInput()
filter = StreamFilter(Gate=G, Stream0=tool, Stream1=tool_2, Stream2=tool_3)
s_2 = ClusterOutput(filter)
