# Grasshopper definition fabtory_control_print-03.ghx (Grasshopper 1.0.7)
# plug-ins: Kangaroo2 Components

div_v_count = Slider(15, range=1..50)  # disabled
length_m = Slider(0.6, range=0..1)  # disabled
base_point = Point(<point referenced from the Rhino model>)  # disabled
depth_m = Slider(0.6, range=0..1)  # disabled
div_u_count = Slider(15, range=1..50)  # disabled

unit_y = UnitY(Factor=expr("-x/2", length_m))  # disabled
move = Move(Geometry=base_point, Motion=unit_y)  # -> Geometry, Transform; disabled
xz_plane = XZPlane(Origin=move.Geometry)  # disabled
unit_x = UnitX(Factor=1)  # disabled
number_slider = Slider(-25, range=-180..180)  # disabled
layer_height_m = Slider(0.01, range=0..0.1)  # disabled
rotate_3d = Rotate3D(Geometry=xz_plane, Angle=degrees(number_slider), Center=move.Geometry, Axis=unit_x)  # -> Geometry, Transform; disabled
deconstruct_plane = DeconstructPlane(Plane=rotate_3d.Geometry)  # -> Origin, XAxis, YAxis, ZAxis; disabled
series = Series(Start=0, Step=layer_height_m, Count=150)  # disabled
amplitude = Amplitude(Vector=deconstruct_plane.ZAxis, Amplitude=expr("-x", series))  # disabled
move_2 = Move(Geometry=rotate_3d.Geometry, Motion=amplitude)  # -> graft(Geometry), Transform; disabled

restart = Button()  # disabled
run = BooleanToggle(False)  # disabled

panel = Panel(deconstruct_plane.YAxis)  # disabled

crv = Curve(<curve referenced from the Rhino model>)  # disabled
# Input
x_axis = Curve(<curve referenced from the Rhino model>)  # disabled
y_axis = Curve(<curve referenced from the Rhino model>)  # disabled

# ----
# Curve
# Predefine an element and its dimensions
# Visualise the defined element
number_slider_2 = Slider(0.07, range=0..1)  # disabled
show = BooleanToggle(False)  # disabled
layer_def = GhPythonScript(crv=crv, div_length=number_slider_2)  # -> out, layer; inputs crv: Curve; disabled
# ---------- layer_def: Python ----------
import rhinoscriptsyntax as rs
import os
import sys
import json

from compas.geometry import Frame
from compas.geometry import Line
from compas.geometry import Vector

from am_information_model.model import Node
from am_information_model.model import Layer

def _radius_between_frames(from_frame, via_frame, to_frame, max_radius):
        in_line = Line(from_frame.point, via_frame.point)
        out_line = Line(via_frame.point, to_frame.point)
        r = min(max_radius, in_line.length/2, out_line.length/2)
        return r

# nodes
print crv
pts = rs.DivideCurveLength(crv, div_length)
max_r = div_length/2
nodes = []
frames = [Frame([pt.X, pt.Y, pt.Z], [90, -1, 0], [-1, 0, 0]) for pt in pts]
print frames

for i,frame in enumerate(frames):
    r = _radius_between_frames(frames[max(0,i-1)], frame, frames[min(i+1, len(frames)-1)], max_r)
    nodes.append(Node(frame, radius=r))
layer = Layer.from_nodes(nodes)
# ---------- end layer_def ----------
draw = PythonScript(layer=layer_def.layer, show=show)  # -> M, F, S; disabled
# ---------- draw: Python ----------
from compas.geometry import Transformation
from compas.geometry import Frame
from compas.datastructures import mesh_transformed
from compas_ghpython.artists import MeshArtist
from compas_ghpython import draw_frame

if show:
    F = [draw_frame(node.frame) for key, node in layer.nodes()]
# ---------- end draw ----------

div_len = Slider(0.1, range=0..1)  # disabled
plane = PythonScript(plane_axes=[x_axis, y_axis])  # -> plane; inputs plane_axes: list of Curve; disabled
# ---------- plane: Python ----------
import Rhino.Geometry as rg

x_axis, y_axis = plane_axes

x_axis = rg.Line(x_axis.PointAtStart, x_axis.PointAtEnd)
y_axis = rg.Line(y_axis.PointAtStart, y_axis.PointAtEnd)

if x_axis.From.DistanceTo(y_axis.From) < 0.01:
    origin = x_axis.From
    xvec = x_axis.Direction
    yvec = y_axis.Direction
elif x_axis.To.DistanceTo(y_axis.To) < 0.01:
    origin = x_axis.To
    xvec = -x_axis.Direction
    yvec = -y_axis.Direction
elif x_axis.From.DistanceTo(y_axis.To) < 0.01:
    origin = x_axis.From
    xvec = x_axis.Direction
    yvec = -y_axis.Direction
elif x_axis.To.DistanceTo(y_axis.From) < 0.01:
    origin = x_axis.To
    xvec = -x_axis.Direction
    yvec = y_axis.Direction

plane = rg.Plane(origin, xvec, yvec)
# ---------- end plane ----------
curve_def = GhPythonScript(cplane=plane, crv=crv, div_len=div_len)  # -> planes; inputs crv: Curve; disabled
# ---------- curve_def: Python ----------
import rhinoscriptsyntax as rs
from compas.geometry import Frame, Line, Vector
from compas_ghpython import draw_frame

# dividing curve
pts = rs.DivideCurveLength(crv, div_len)
frames = [Frame([pt.X, pt.Y, pt.Z], cplane.XAxis, cplane.YAxis) for pt in pts]
print frames

# for vizualization
planes = []
for frame in frames:
    planes.append(draw_frame(frame))
# ---------- end curve_def ----------
# AM Model
number_slider_3 = Slider(0.01, range=0..0.1)  # disabled
cp = Plane(PlaneXY(0, 0, 0))  # disabled

reload = Button()
path = PythonScript()  # -> HERE, DATA, ROBOT_DESCRIPTION
# ---------- path: Python ----------
import os

HERE = os.path.dirname(ghdoc.Path)
DATA = os.path.abspath(os.path.join(HERE, "..", "data"))
ROBOT_DESCRIPTION = os.path.abspath(os.path.join(DATA, "robot_description"))

print(HERE)
print(DATA)
print(ROBOT_DESCRIPTION)
# ---------- end path ----------
py = PythonScript(reload=reload)
# ---------- py: Python ----------
if reload:
    from compas_ghpython import unload_modules
    unload_modules("compas")
    unload_modules("compas_fab")
    unload_modules("fabtory_fabrication_control")
    unload_modules("compas_rrc")
    unload_modules("extruder_control")

    unload_modules("fabrication_control")
    unload_modules("assembly_information_model")
# ---------- end py ----------

generate_assembly = GhPythonScript(centerplane=cp, layer=layer_def.layer, layer_height=number_slider_3)  # -> am_model, planes; disabled
# ---------- generate_assembly: Python ----------
import Rhino.Geometry as rg
import math
from scriptcontext import sticky as st


from compas.geometry import Frame
from compas.geometry import Transformation
from compas.geometry import Rotation
from compas.geometry import Translation
from compas.geometry import Point

from compas_ghpython import draw_frame

from am_information_model.model import AMModel
from am_information_model.model import Layer

import Rhino.Geometry as rg


# initialize an empty assembly class
am_model = AMModel()

cp = centerplane
cf = Frame(cp.Origin, cp.XAxis, cp.YAxis)

for i in range(25): # loop through the number of layers i
    T = Translation.from_vector([0,0,layer_height*i])
    cft = cf.transformed(T) #transforms the origin plane

    T1 = Transformation.from_frame_to_frame(cf, cft)
    # create new instances of the element
    new_layer = layer.transformed(T) #returns a deep copy of the initial element at the new location of the frame
    print(new_layer.node(0).frame)
    am_model.add_layer(new_layer)
    
planes = []
for l, layer in am_model.layers():
    for k, node in layer.nodes():
        planes.append(draw_frame(node.frame))
# ---------- end generate_assembly ----------

wavy = BooleanToggle(True)
length_m_2 = Slider(2, range=0..3)
layers_count = Slider(70, range=1..100)
layer_height_m_2 = Slider(0.01, range=0..0.4)
amplitude_factor = Slider(0.085, range=0..1)
waves_count = Slider(2, range=0..5)

base_point_2 = Point(Point(-0.2427399658, -2.746493225, -0.355000006))
straight_line_cos_wave = GhPythonScript(
    length=length_m_2,
    layers=layers_count,
    layer_height=layer_height_m_2,
    base_point=base_point_2,
    wavy=wavy,
    amplitude=amplitude_factor,
    waves=waves_count)  # -> out, points; inputs layers: Int32, base_point: Point3d, wavy: Boolean, waves: Int32
# ---------- straight_line_cos_wave: Python ----------
from compas.geometry import Point
import math
import ghpythonlib.components as gh


def straight_line(length, height, base_point):
    
    start = Point(base_point.x,base_point.y,base_point.z)
    end = Point(base_point.x+length,base_point.y,base_point.z+height)
    
    return(start, end)



def cos_wave(length, height, amplitude, waves, base_point):
    
    points= []
    waves = waves*10
    div = 50
    
    for i in range(div):
        
        x_point = length/div*i
        y_point = amplitude*math.cos(x_point*waves)
        
        points.append(Point(base_point.x+x_point,base_point.y+y_point,base_point.z+height))
        
    return(points)



points = []
base_point = Point(gh.Deconstruct(base_point)[0], gh.Deconstruct(base_point)[1], gh.Deconstruct(base_point)[2])

for i in range(layers):
    
    if wavy == True:
        
        curve = cos_wave(length, i*layer_height, amplitude, waves, base_point)
        
        if i%2 == 0:
            curve.reverse()
            
        for pt in curve:
            points.append(pt)
        
    else:
        
        curve = straight_line(length, i*layer_height, base_point)
        
        if i%2 == 0:
            curve = reversed(curve)
            
        for pt in curve:
            points.append(pt)
# ---------- end straight_line_cos_wave ----------
layer_def_2 = GhPythonScript(points_compas=straight_line_cos_wave.points, layers=layers_count)  # -> out, layer, am_model, planes; inputs points_compas: list, layers: Int32
# ---------- layer_def_2: Python ----------
import ghpythonlib.components as gh
import os
import sys
import json

from compas.geometry import Frame
from compas.geometry import Line
from compas.geometry import Vector

from compas_ghpython import draw_frame

from am_information_model.model import Node
from am_information_model.model import Layer
from am_information_model.model import AMModel



def _radius_between_frames(from_frame, via_frame, to_frame, max_radius):
        in_line = Line(from_frame.point, via_frame.point)
        out_line = Line(via_frame.point, to_frame.point)
        r = min(max_radius, in_line.length/2, out_line.length/2)
        return r

# nodes
max_r = 10
frames = [Frame([pt.x, pt.y, pt.z], [90, -1, 0], [-1, 0, 0]) for pt in points_compas]

print max_r

nodes = []
for i,frame in enumerate(frames):
    r = _radius_between_frames(frames[max(0,i-1)], frame, frames[min(i+1, len(frames)-1)], max_r)
    nodes.append(Node(frame, radius=r))



# Create the print_layer: 

def partition(lst, size):
    for i in range(0, len(lst), size):
        yield lst[i : i+size]

count = int(len(nodes)/layers)
nodes_layer = list(partition(nodes, count))


layer = []


for i in range(layers):
    
    layer_loc = Layer.from_nodes(nodes_layer[i])
    layer.append(layer_loc)



# Create AM Model: 

am_model = AMModel()

for i in range(len(layer)):
    layer_new = layer[i]
    am_model.add_layer(layer_new)
    
planes = []
for l, layer in am_model.layers():
    for k, node in layer.nodes():
        planes.append(draw_frame(node.frame))
# ---------- end layer_def_2 ----------
show_2 = BooleanToggle(True)
draw_2 = PythonScript(layer=layer_def_2.layer, points=straight_line_cos_wave.points, show=show_2)  # -> C; inputs points: list
# ---------- draw_2: Python ----------
from compas.geometry import Transformation, Point
from compas.geometry import Frame
from compas.datastructures import mesh_transformed
from compas_ghpython.artists import MeshArtist
from compas_ghpython import draw_frame
import ghpythonlib.components as gh



if show:
    points_gh = []
    
    for pt in points:
        
        points_gh.append(gh.ConstructPoint(pt.x, pt.y, pt.z))
    
    C = gh.PolyLine(points_gh, False)



if show:
    F = [draw_frame(node.frame) for key, node in layer.nodes()]
# ---------- end draw_2 ----------
curve = Curve(draw_2)  # disabled

pln = Plane(layer_def_2.planes)
list = ValueList({"plane": 0, "plane from curve": 1, "plane from am_model": 2, "test_curve": 3}, selected="plane from am_model")

list_2 = ValueList({"20", "50", "100", "500", "1000", "5000"}, selected="50")
back = Button()
reset = Button()
start = Button()
stop = Button()
step = Button()
full = Button()

list_3 = ValueList({"fk_configuration": 0, "robot_configuration": 1}, selected="fk_configuration")
tcp_speed = Slider(200, range=0..1000)
tcp_speed_2 = Slider(54, range=0..1000)
tcp_speed_3 = Slider(250, range=0..1000)

to_robtarget = Button()
to_frame = Button()

to_single_joints = Button()
to_joints = Button()

set_tool = Button()
set_tool_2 = Button()
parallelize = BooleanToggle(False)
# Concrete Extruder
ext_ip = ValueList({"192.168.125.220", "192.168.125.60"}, selected="192.168.125.220")
ext_ip_2 = ValueList({"192.168.125.10"}, selected="192.168.125.10")  # disabled
ext_port = ValueList({"50003", "50004"}, selected="50004")  # disabled
ext_port_2 = ValueList({"50003", "50004", "50001"}, selected="50004")

# ----
# --> Set controller IP address
button = Button()
globals = PythonScript(ext_ip=ext_ip, ext_port=ext_port_2, clear=button)
# ---------- globals: Python ----------
from scriptcontext import sticky as st

#st["server_address"] = server_address
#st["server_port"] = server_port

st["ext_ip"] = ext_ip
st["ext_port"] = ext_port


if clear:
    st.clear()
# ---------- end globals ----------

# ----
# --> Set controller IP address
button_2 = Button()  # disabled
globals_2 = PythonScript(ext_ip=ext_ip_2, ext_port=ext_port, clear=button_2)  # disabled; same code as globals

# ----
# Concrete Pump
ping = Button()
py_2 = PythonScript(ip=ext_ip, ping=ping)  # -> out, trigger
# ---------- py_2: Python ----------
import os
from scriptcontext import sticky as st

guid = str(ghenv.Component.InstanceGuid)
txt_key = "txt_" + guid
if txt_key not in st:
    st[txt_key] = ""

def is_available(ip):
    syscall = "ping -r 1 -n 1 %s"
    response = os.system(syscall % ip)
    if response == 0:
        return True
    else:
        return False

if ping:
    available = is_available(ip)
    
    if available:
        st[txt_key] = "%s is up!" % ip
        trigger = True
    else:
        st[txt_key] = "%s is down!" % ip
        trigger = False

print(st[txt_key])
# ---------- end py_2 ----------
panel_2 = Panel(py_2.out)

ping_2 = Button()  # disabled
py_3 = PythonScript(ip=ext_ip_2, ping=ping_2)  # -> out, trigger; disabled; same code as py_2
panel_3 = Panel(py_3.out)  # disabled

# ----
# Set Motor Data
speed = Slider(24505.6, range=0..51200)
max_speed = Slider(45277.56, range=0..51200)
send = Button()
value = BooleanToggle(True)
extruder_data = PythonScript(motor_state=value, max_speed=max_speed, speed=speed, send=send)  # -> out; inputs motor_state: Boolean
# ---------- extruder_data: Python ----------
import time
from scriptcontext import sticky as st
from extruder_control.concrete_extruderclient import ExtruderClient

ext_ip = st["ext_ip"]
ext_port = st["ext_port"]

ec = ExtruderClient(ext_ip, ext_port)
wait_for_response = False

if send:
    ec.connect()
    time.sleep(0.2)
    ec.send_motordata(motor_state, max_speed, speed, wait_for_response)
    #ec.get_msg_arduino_info(wait_for_response)
    time.sleep(0.2)
    ec.close()
# ---------- end extruder_data ----------
data_recorder = DataRecorder(extruder_data, DataLimit=-10, RecordData=True)
out = Panel(data_recorder)

get_frame = Button()
get_robtarget = Button()
get_joints = Button()

# ----
# Toggle Digital Output
value_2 = BooleanToggle(True)
send_2 = Button()
list_4 = ValueList({"1", "2", "3", "4", "5", "6", "7", "8", "9", "10", "11", "12", "13"}, selected="10")
digital_out = PythonScript(pin=list_4, state=value_2, send=send_2)  # -> out; inputs pin: Int32, state: Boolean
# ---------- digital_out: Python ----------
import time
from scriptcontext import sticky as st
from extruder_control.concrete_extruderclient import ExtruderClient

ext_ip = st["ext_ip"]
ext_port = st["ext_port"]

ec = ExtruderClient(ext_ip, ext_port)
wait_for_response = False


if send:
    ec.connect()
    time.sleep(0.2)
    ec.send_set_do(pin, int(state), wait_for_response)
    time.sleep(0.2)
    ec.close()
# ---------- end digital_out ----------
data_recorder_2 = DataRecorder(digital_out, DataLimit=-10, RecordData=True)
out_2 = Panel(data_recorder_2)

# ----
# STATE  VIEWER
trigger = Trigger(Interval=100, TimerInterval=100, Target=fabrication_state)
fabrication_state = PythonScript()  # -> out, state, num_tasks, num_current_task, num_tasks_left, log_messages
# ---------- fabrication_state: Python ----------
from scriptcontext import sticky as st

fabrication = st["fabrication"]

if hasattr(fabrication, "task_thread"):
    if fabrication.task_thread.is_alive():
        state = "THREAD RUNNING"
    else:
        state = "THREAD STOPPED"

num_tasks = len(fabrication.tasks)
if fabrication.current_task_key is not None:
    num_current_task = fabrication.current_task_key+1
else:
    num_current_task = 0
num_tasks_left = num_tasks-num_current_task
log_messages = fabrication.log_messages
# ---------- end fabrication_state ----------
num_tasks_left = Panel(fabrication_state.num_tasks_left)
state = Panel(fabrication_state.state)
num_tasks = Panel(fabrication_state.num_tasks)
num_current_task = Panel(fabrication_state.num_current_task)
log_messages = Panel(fabrication_state.log_messages)

# ----
# Toggle Motor State
value_3 = BooleanToggle(True)
send_3 = Button()
extruder_state = PythonScript(state=value_3, send=send_3)  # -> out; inputs state: Boolean
# ---------- extruder_state: Python ----------
import time
from scriptcontext import sticky as st
from extruder_control.concrete_extruderclient import ExtruderClient

ext_ip = st["ext_ip"]
ext_port = st["ext_port"]

ec = ExtruderClient(ext_ip, ext_port)
wait_for_response = False

if send:
    ec.connect()
    time.sleep(0.2)
    ec.send_motorstate(int(state), wait_for_response)
    time.sleep(0.2)
    ec.close()
# ---------- end extruder_state ----------

# ----
# Stop ALL
stop_2 = Button()
stop_3 = PythonScript(stop=stop_2)  # -> out
# ---------- stop_3: Python ----------
import time
from scriptcontext import sticky as st
from extruder_control.concrete_extruderclient import ExtruderClient

ext_ip = st["ext_ip"]
ext_port = st["ext_port"]

ec = ExtruderClient(ext_ip, ext_port)
wait_for_response = False

if stop:
    ec.connect()
    time.sleep(0.2)
    ec.send_stop(wait_for_response)
    time.sleep(0.2)
    ec.close()
# ---------- end stop_3 ----------

# ----
# Reset
# Reset turns on the extruder
send_4 = Button()
digital_out_2 = PythonScript(send=send_4)  # -> out
# ---------- digital_out_2: Python ----------
import time
from scriptcontext import sticky as st
from extruder_control.concrete_extruderclient import ExtruderClient

ext_ip = st["ext_ip"]
ext_port = st["ext_port"]

ec = ExtruderClient(ext_ip, ext_port)

    
if send:
    ec.connect()
    time.sleep(0.2)
    ec.send_reset()
    time.sleep(0.2)
    ec.close()
# ---------- end digital_out_2 ----------

data_recorder_3 = DataRecorder(stop_3, DataLimit=-10, RecordData=True)
data_recorder_4 = DataRecorder(extruder_state, DataLimit=-10, RecordData=True)
out_3 = Panel(data_recorder_3)
out_4 = Panel(data_recorder_4)

print_test_3 = GhPythonScript(length=length_m, base_point=base_point, depth=depth_m)  # -> surface; inputs base_point: Point3d; disabled
# ---------- print_test_3: Python ----------
import ghpythonlib.components as gh



# Create base_surface: 

rec = gh.Rectangle(gh.XYPlane(base_point), gh.ConstructDomain(-length/2, length/2), gh.ConstructDomain(-depth/2, depth/2), 0)[0]
surface = gh.BoundarySurfaces(rec)
# ---------- end print_test_3 ----------
divide_surface = DivideSurface(Surface=print_test_3, UCount=div_u_count, VCount=div_v_count)  # -> Points, Normals, Parameters; disabled
flip_matrix = FlipMatrix(Data=divide_surface.Points)  # disabled
polyline = PolyLine(Vertices=flip_matrix, Closed=False)  # disabled
polyline_2 = PolyLine(Vertices=divide_surface.Points, Closed=False)  # disabled
end_points = EndPoints(Curve=polyline_2)  # -> Start, End; disabled
end_points_2 = EndPoints(Curve=polyline)  # -> Start, End; disabled
explode = Explode(Curve=polyline_2, Recursive=True)  # -> Segments, flatten(Vertices); disabled
explode_2 = Explode(Curve=polyline, Recursive=True)  # -> Segments, Vertices; disabled
merge = Merge(Data1=end_points.End, Data2=end_points_2.Start, Data3=end_points_2.End)  # -> flatten(Result); disabled
merge_2 = Merge(Data1=explode_2.Segments, Data2=explode.Segments)  # -> flatten(Result); disabled
strength = Slider(3, range=0..100)  # disabled
number_slider_4 = Slider(0.005, range=0..1)  # disabled
unit_z = UnitZ(Factor=number_slider_4)  # disabled
list_length = ListLength(List=flatten(polyline_2))  # disabled

load = Load(Point=explode.Vertices, ForceVector=unit_z)  # disabled
length_line = LengthLine(Line=merge_2, Strength=strength)  # disabled
anchor = Anchor(Point=merge, Strength=10000)  # disabled
show_3 = Show(G=flatten(polyline))  # disabled

solver = Solver(GoalObjects=[show_3, length_line, load, anchor], Reset=restart, Threshold=1e-15, Tolerance=0.01, On=run)  # -> I, V, O; disabled
split_list = SplitList(List=solver.O, Index=list_length)  # -> ListA, ListB; disabled
rebuild_curve = RebuildCurve(Curve=split_list.ListA, Degree=3, Count=10, Tangents=False)  # disabled
loft = Loft(Curves=rebuild_curve, Options={Adjust=False, Closed=False, LoftEnds=0, LoftSimp=0, LoftType=0, Rebuild=10, Refit=0.01})  # disabled

brep_plane = BrepPlane(Brep=loft, Plane=move_2.Geometry)  # -> flatten(Curves), Points; disabled
rotate_3d_2 = Rotate3D(Geometry=brep_plane.Curves, Angle=degrees(0), Center=base_point, Axis=Vector(0, 0, 1))  # -> Geometry, Transform; disabled
reverse_list = ReverseList(List=rotate_3d_2.Geometry)  # disabled
partition_list = PartitionList(List=reverse_list, Size=2)  # disabled
list_item = ListItem(List=partition_list, Index=0, Wrap=True)  # -> Item, Item1; disabled
flip_curve = FlipCurve(Curve=list_item.Item)  # -> Curve, Flag; disabled
merge_3 = Merge(Data1=flip_curve.Curve, Data2=list_item.Item1)  # -> flatten(Result); disabled
list_length_2 = ListLength(List=brep_plane.Curves)  # disabled
divide_curve = DivideCurve(Curve=merge_3, Count=20, Kinks=False)  # -> flatten(Points), Tangents, Parameters; disabled
close_curves = GhPythonScript(curves=rotate_3d_2.Geometry)  # -> curves_add; inputs curves: list of Curve; disabled
# ---------- close_curves: Python ----------
import ghpythonlib.components as gh



# close the curves for a print path:

curves_add = []

for i in range(len(curves)):
    
    if i%2 == 0 and i > 0:
        
        end = gh.EndPoints(curves[i])[0]
        start = gh.EndPoints(last_curve)[0]
        
        close_line = gh.Line(end, start)
        curves_add.append(close_line)
        
    
    elif i%2 != 0 and i > 0:
        
        end = gh.EndPoints(curves[i])[1]
        start = gh.EndPoints(last_curve)[1]
        
        close_line = gh.Line(end, start)
        curves_add.append(close_line)
    
    last_curve = curves[i]
# ---------- end close_curves ----------
show_4 = BooleanToggle(True)  # disabled
layer_def_3 = GhPythonScript(points_gh=divide_curve.Points, y_axis=deconstruct_plane.YAxis, layers=list_length_2)  # -> out, layer, am_model, planes; inputs points_gh: list of Point3d, y_axis: Vector3d, layers: Int32; disabled
# ---------- layer_def_3: Python ----------
import ghpythonlib.components as gh
import os
import sys
import json

from compas.geometry import Frame
from compas.geometry import Line
from compas.geometry import Vector

from am_information_model.model import Node
from am_information_model.model import Layer
from am_information_model.model import AMModel
from compas_ghpython import draw_frame


def _radius_between_frames(from_frame, via_frame, to_frame, max_radius):
        in_line = Line(from_frame.point, via_frame.point)
        out_line = Line(via_frame.point, to_frame.point)
        r = min(max_radius, in_line.length/2, out_line.length/2)
        return r



# nodes
max_r = gh.Distance(points_gh[0], points_gh[1])
frames = [Frame([gh.Deconstruct(pt)[0], gh.Deconstruct(pt)[1], gh.Deconstruct(pt)[2]], [1,0,0], [0,-0.5,-gh.DeconstructVector(y_axis)[2]]) for pt in points_gh]

print max_r

nodes = []
for i,frame in enumerate(frames):
    r = _radius_between_frames(frames[max(0,i-1)], frame, frames[min(i+1, len(frames)-1)], max_r)
    nodes.append(Node(frame, radius=r))



# Create the print_layer: 

def partition(lst, size):
    for i in range(0, len(lst), size):
        yield lst[i : i+size]

count = int(len(nodes)/layers)
nodes_layer = list(partition(nodes, count))


layer = []


for i in range(layers):
    
    layer_loc = Layer.from_nodes(nodes_layer[i])
    layer.append(layer_loc)



# Create AM Model: 

am_model = AMModel()

for i in range(len(layer)):
    layer_new = layer[i]
    am_model.add_layer(layer_new)

planes = []
for l, layer in am_model.layers():
    for k, node in layer.nodes():
        planes.append(draw_frame(node.frame))
# ---------- end layer_def_3 ----------
join_curves = JoinCurves(Curves=flatten([close_curves, rotate_3d_2.Geometry]), Preserve=False)  # disabled
draw_3 = PythonScript(layer=layer_def_3.layer, show=show_4)  # -> M, F, S; disabled; same code as draw

plane_2 = Plane(layer_def_3.planes)  # disabled

# ----
# Draw
show_5 = BooleanToggle(True)
show_6 = BooleanToggle(True)
counter = CountThroughList(
    am_model=layer_def_3.am_model,
    start=start,
    stop=stop,
    step=step,
    step_back=back,
    reset=reset,
    full=full,
    interval=list_2)  # -> item, counter; inputs start: Boolean, stop: Boolean, step_back: Boolean
# ---------- counter: Python ----------
from scriptcontext import sticky as st
from compas_ghpython import update_component


L = list(am_model.layers())
# store data in component
guid = str(ghenv.Component.InstanceGuid)
counter_key = "counter_" + guid
running_key = "running_" + guid

if counter_key not in st:
    st[counter_key] = 0

if running_key not in st:
    st[running_key] = False
    

if st[running_key]:
    if st[counter_key] < len(L) - 1:
        st[counter_key] += 1
        update_component(ghenv, interval)
    else:
        st[counter_key] = 0
        st[running_key] = False
    
    
if start:
    st[running_key] = True

if stop:
    st[running_key] = False

if step:
    if st[counter_key] < len(L) - 1:
        st[counter_key] += 1

if step_back:
    if st[counter_key] < len(L) - 1:
        st[counter_key] -= 1

if reset:
    st[counter_key] = 0

if full:
    st[counter_key] = len(L)-1

if len(L):
    item = L[st[counter_key]]



#st["visualisation_counter"] = st[counter_key]
counter = st[counter_key]
# ---------- end counter ----------
idx = Panel(counter.counter)
draw_4 = PythonScript(am_model=layer_def_3.am_model, show_all=show_5, show_counter=show_6, counter=idx)  # -> G, tool_planes_WCS, current_tool_plane, current_tool_planes; inputs counter: Int32
# ---------- draw_4: Python ----------
import os
import sys

import math

from compas_ghpython.artists import MeshArtist
from compas_ghpython import draw_frame


G = []

key_index = am_model.network.key_index()
keys = [key_index[key] for key in am_model.network.nodes()]
layers = [am_model.layer(key) for key in keys]
#print elements
#print([(e.gripping_frame) for e in elements])

start_planes_WCS = [draw_frame(l.node(0).frame) for l in layers]

current_tool_plane = start_planes_WCS[counter]
current_tool_planes = [draw_frame(node.frame) for key, node in am_model.layer(counter).nodes()]

if show_all and not show_counter:
    for layer in layers:
        for key, node in layer.nodes():
            plane = draw_frame(node.frame) 
            G.append(plane)

if show_counter:
    for layer in layers[0:counter+1]:
        for key, node in layer.nodes():
            plane = draw_frame(node.frame) 
            G.append(plane)

    tool_planes_WCS = [draw_frame(l.node(0).tool_frame) for l in layers[0:counter+1]]
# ---------- end draw_4 ----------
pln_2 = Plane(draw_4.tool_planes_WCS)
pln_3 = Plane(draw_4.current_tool_planes)
geo = Geometry(draw_4.G)
preview = CustomPreview(Geometry=geo, Shader=ColourSwatch(SwatchColor=RGBA(255, 227, 227, 233)))
preview_2 = CustomPreview(Geometry=[pln_2, pln_3], Shader=ColourSwatch(SwatchColor=RGBA(209, 27, 27, 178)))

filter = StreamFilter(Gate=list, Stream0=plane, Stream2=draw_4.current_tool_plane, Stream3=draw_4.current_tool_plane)
target_plane = Plane(filter)

# ----
# Tool
panel_4 = Panel("Attach a custom tool")
list_5 = ValueList({"measurement_tool": 0, "concrete_extruder": 1}, selected="concrete_extruder")
tools = Tools(G=list_5)
remove = Button()
add = Button()

# ----
# ROS & ABB client
ros_ip = ValueList({"127.0.0.1"}, selected="127.0.0.1")
ros_port = ValueList({"9090"}, selected="9090")
ros = ROSConnect(ip=ros_ip, port=ros_port, connect=Toggle(True))  # -> ros_client, is_connected; inputs port: Int32, connect: Boolean
#   port ip: The ip address ROS. Defaults to 127.0.0.1.
#   port port: The port of ROS. Defaults to 9090.
#   port connect: If True, connects to ROS. If False, disconnects from ROS. Defaults to False.
#   port ros_client: The ROS client.
#   port is_connected: True if connection established.
# ---------- ros: Python ----------
"""
Connect or disconnect to ROS.

COMPAS FAB v0.19.1
"""
from ghpythonlib.componentbase import executingcomponent as component
from scriptcontext import sticky as st

from compas_fab.backends import RosClient
from compas_fab.ghpython.components import create_id


class ROSConnect(component):
    def RunScript(self, ip, port, connect):
        ros_client = None

        ip = ip or '127.0.0.1'
        port = port or 9090

        key = create_id(self, 'ros_client')
        ros_client = st.get(key, None)

        if ros_client:
            st[key].close()
        if connect:
            st[key] = RosClient(ip, port)
            st[key].run(5)

        ros_client = st.get(key, None)
        is_connected = ros_client.is_connected if ros_client else False
        return (ros_client, is_connected)
# ---------- end ros ----------
is_connected = Panel(ros.is_connected)
abb = GhPythonScript(ros_client=ros.ros_client, connect=Toggle(True))  # -> out, abb_client; inputs connect: Boolean
# ---------- abb: Python ----------
import compas_rrc as rrc

if ros_client:
    if ros_client.is_connected and connect: 
        # Create ABB Client
        abb_client = rrc.AbbClient(ros_client, '/rob1')
# ---------- end abb ----------

# ----
# Load Model
# Load robot from local package
load_2 = Button()
list_6 = ValueList({"abb_fabtory"}, selected="abb_fabtory")
units = ValueList({"m": 1, "cm": 100, "mm": 1000}, selected="m")

# ----
# Robot Model
panel_5 = Panel("abb_fabtory.srdf")

load_model = PythonScript(
    path=path.ROBOT_DESCRIPTION,
    package=list_6,
    urdf_name="abb_fabtory.urdf",
    srdf_name=panel_5,
    scale_factor=units,
    load=load_2)  # -> robot
# ---------- load_model: Python ----------
import os
from scriptcontext import sticky as st
import compas
from compas.robots import RobotModel
from compas.robots import LocalPackageMeshLoader
from compas_fab.robots import Robot
from compas_fab.robots import RobotSemantics
from compas_fab.ghpython import RobotArtist

packages = ["abb_irb6700_support", "abb_end_effectors", "abb_fabtory"]
loaders = []

for package in packages:
    loaders.append(LocalPackageMeshLoader(path, package))

#path directory
package_path = os.path.join(path, package)
print(package_path)

urdf_filename = os.path.join(package_path, "urdf", urdf_name)
srdf_filename = os.path.join(package_path, srdf_name)

assert os.path.isfile(urdf_filename)
assert os.path.isfile(srdf_filename)

compas.PRECISION = '12f'

# store robot in component
guid = str(ghenv.Component.InstanceGuid)
robot_key = "robot_" + guid

if robot_key not in st:
    st[robot_key] = None

#load robot model from urdf
if load:
    model = RobotModel.from_urdf_file(urdf_filename)
    model.load_geometry(*loaders)
    artist = RobotArtist(model)
    semantics = RobotSemantics.from_srdf_file(srdf_filename, model)
    robot = Robot(model, artist, semantics, client=None)

    st[robot_key] = robot
robot = st[robot_key]

#vizualize robot in the right scale of your environment
robot.scale(scale_factor)
# ---------- end load_model ----------

attach_remove = PythonScript(robot=load_model, tool=tools, attach=add, remove=remove)  # -> bang
# ---------- attach_remove: Python ----------
if attach:
    robot.attach_tool(tool)

    
if remove:
    robot.detach_tool()
# ---------- end attach_remove ----------

set = PythonScript(robot=load_model, ros_client=ros.ros_client, abb_client=abb.abb_client)  # -> out, robot, main_group_name
# ---------- set: Python ----------
if robot and ros_client and abb_client:
    robot.ros_client = ros_client
    robot.abb_client = abb_client

    robot.info()
    main_group_name = robot.main_group_name
    print robot.info
# ---------- end set ----------

robot_info = Panel(set.out)

# ----
# forward kinematics
number_slider_5 = Slider(0, range=-400..400)
# Configuration
number_slider_6 = Slider(0, range=0..4.2)
jp = GhPythonScript()  # -> configuration_values
# ---------- jp: Python ----------
import math
joint_values = [-3.136, -0.328, -1.218, 3.129, 0.852, 0.008]
#joint_values = [math.degrees(j) for j in joint_values]
#joint_positions = [0] * 6

cart = 0
joint_values = [0,0,0,0,0,0]

configuration_values = [cart] + joint_values
# ---------- end jp ----------
forward_kinematics = PythonScript(
    robot=set.robot,
    reset_configuration=Button(),
    configuration_values=jp,
    a_cart=number_slider_6,
    a_a1=Slider(0, range=-180..180),
    a_a2=Slider(0, range=-90..150),
    a_a3=Slider(0, range=-180..180),
    a_a4=Slider(0, range=-400..400),
    a_a5=Slider(0, range=-125..120),
    a_a6=number_slider_5)  # -> full_configuration; inputs reset_configuration: Boolean, configuration_values: list
# ---------- forward_kinematics: Python ----------
import math
import Grasshopper
import copy
from compas.robots import Joint
from compas_fab.robots import Configuration





if reset_configuration:
    j = 0
    for i in range(ghenv.Component.Params.Input.Count):
        nslider = ghenv.Component.Params.Input[i].Sources[0]
        if nslider.GetType() == Grasshopper.Kernel.Special.GH_NumberSlider:
            nslider.TrySetSliderValue(configuration_values[j])
            j += 1


if robot:
    joint_positions = [a_cart, a_a1, a_a2, a_a3, a_a4, a_a5, a_a6]
    #print joint_positions
    joint_positions_degrees = copy.deepcopy(joint_positions)
    joint_types = robot.get_configurable_joint_types()
    #print(joint_types)
    for i, joint_type in enumerate(joint_types):
        if joint_type == Joint.REVOLUTE:
            joint_positions[i] = math.radians(joint_positions[i])
        if joint_type == Joint.PRISMATIC:
            joint_positions[i] = joint_positions[i]
    full_configuration = Configuration(joint_positions, joint_types)
    #print full_configuration
# ---------- end forward_kinematics ----------

# ----
# inverse kinematics
py_4 = PythonScript(robot=set.robot)  # -> configuration
# ---------- py_4: Python ----------
from compas_fab.robots import Configuration

if robot:
    types = robot.get_configurable_joint_types()
    values = [0] * len(types)
    configuration = Configuration(values, types)
    print configuration
    print robot.get_configurable_joint_names()
# ---------- end py_4 ----------
list_7 = ValueList({"fk_configuration": 0, "robot_configuration": 1}, selected="fk_configuration")
fk_configuration = Data(forward_kinematics)
go_to_start_configuration = BooleanToggle(False)
list_8 = ValueList({"manipulator", "manipulator_axis"}, selected="manipulator")
avoid_collisions = BooleanToggle(False)
filter_2 = StreamFilter(Gate=list_7, Stream0=fk_configuration, Stream1=py_4)
inverse_kinematics = GhPythonScript(
    compute=Toggle(True),
    robot=set.robot,
    plane=filter,
    start_configuration=filter_2,
    go_to_start_configuration=go_to_start_configuration,
    avoid_collisions=avoid_collisions,
    group=set.main_group_name)  # -> out, ik_configuration, t0cp; inputs plane: Plane
# ---------- inverse_kinematics: Python ----------
from __future__ import print_function
import logging
from compas.geometry import Frame
from scriptcontext import sticky as st
from compas_ghpython.artists import FrameArtist

LOGGER = logging.getLogger('roslibpy')

#vizualize t0cf
if robot.attached_tool:
    t0cf = Frame(plane.Origin, plane.XAxis, plane.YAxis)
    t0cf = robot.from_tcf_to_t0cf([t0cf])[0]
    #artist = FrameArtist(t0cf)
    #t0cp = artist.draw()
    #print (t0cf)


if compute:
    if robot.attached_tool:
        tool_attached = True
    else:
        tool_attached = False

    robot.client = robot.ros_client
    if go_to_start_configuration:
        ik_configuration = start_configuration
    else:
        frame = Frame(plane.Origin, plane.XAxis, plane.YAxis)
        if tool_attached:
            tool_frame = robot.from_tcf_to_t0cf([frame])[0]
        else:
            tool_frame = frame

    ik_configuration = robot.inverse_kinematics(tool_frame,
                                                  start_configuration,
                                                  group=group,
                                                  options={
                                                    'avoid_collisions':avoid_collisions,
                                                    'return_full_configuration':True,
                                                  })        
#group_configuration = robot.get_group_configuration(group, ik_configuration)
#print (group_configuration)
st["ik_configuration"] = ik_configuration

ik_configuration = st["ik_configuration"] 
print(ik_configuration)
# ---------- end inverse_kinematics ----------
draw_5 = GhPythonScript(planes=inverse_kinematics.t0cp, scale=Slider(0.2, range=0..1))  # -> P, V, C, W; inputs planes: list
# ---------- draw_5: Python ----------
from System.Drawing import Color
from compas_ghpython.artists import FrameArtist

red = Color.FromArgb(255, 0, 0)
green = Color.FromArgb(0, 255, 0)
blue = Color.FromArgb(0, 0, 255)

P = []
V = []
C = []

scale = float(scale)

for plane in planes:
    if not plane:
        continue
    P += [plane.Origin] * 3
    V.append(plane.XAxis * scale)
    V.append(plane.YAxis * scale)
    V.append(plane.ZAxis * scale)
    C += [red, green, blue]

W = 3
# ---------- end draw_5 ----------
out_5 = Panel(inverse_kinematics.out)
vdisex = VectorDisplayEx(Point=draw_5.P, Vector=draw_5.V, Colour=draw_5.C, Width=draw_5.W)

list_9 = ValueList({"0 forward_kinematics": 0, "1 inverse_kinematics": 1}, selected="1 inverse_kinematics")
ik_configuration = Data(inverse_kinematics.ik_configuration)
fk_configuration_2 = Data(forward_kinematics)
filter_3 = StreamFilter(Gate=list_9, Stream0=fk_configuration_2, Stream1=ik_configuration)

# ----
# Visualisation
show_end_effector_frame = BooleanToggle(False)
show_base_frame = BooleanToggle(False)
show_collision = BooleanToggle(False)
show_frames = BooleanToggle(False)
show_visual = BooleanToggle(True)
show_acm = BooleanToggle(False)
robot_visualize = RobotVisualize(
    robot=set.robot,
    group=set.main_group_name,
    configuration=filter_3,
    redraw=attach_remove,
    show_visual=show_visual,
    show_collision=show_collision,
    show_frames=show_frames,
    show_base_frame=show_base_frame,
    show_end_effector_frame=show_end_effector_frame,
    show_acm=show_acm)  # -> visual, collision, attached_meshes, frames, base_frame, ee_frame; inputs redraw: list, show_visual: Boolean, show_collision: Boolean, show_frames: Boolean, show_base_frame: Boolean, show_end_effector_frame: Boolean, show_acm: Boolean
#   port group: The planning group used for end-effector and base visualization.
#   port configuration: The robot's full configuration.
#   port redraw: A list of attached collision meshes.
#   port show_visual: Whether or not to show the robot's visual meshes.
#   port show_collision: Whether or not to show the robot's collision meshes.
#   port show_frames: Whether or not to show the robot's joint frames.
#   port show_base_frame: Whether or not to show the robot's base frame.
#   port show_end_effector_frame: Whether or not to show the robot's end-effector frame.
#   port show_acm: Whether or not to show the attached collision meshes (if any).
#   port visual: The robot's visual Rhino meshes (if any).
#   port collision: The robot's collision Rhino meshes (if any).
#   port attached_meshes: The attached collision Rhino meshes (if any).
#   port frames: The robot's joint frames as Rhino planes (if any).
#   port base_frame: The robot's base frame as a Rhino plane (if any).
#   port ee_frame: The robot's end-effector frame as a Rhino plane (if any).
# ---------- robot_visualize: Python ----------
"""
Visualizes the robot.

COMPAS FAB v0.19.1
"""
from compas.geometry import Frame
from compas.geometry import Transformation
from compas_ghpython.artists import FrameArtist
from compas_ghpython.artists import MeshArtist
from ghpythonlib.componentbase import executingcomponent as component


class RobotVisualize(component):
    def RunScript(self, robot, group, configuration, attached_collision_meshes, show_visual, show_collision,
                  show_frames, show_base_frame, show_end_effector_frame, show_acm):

        visual = None
        collision = None
        attached_meshes = None
        frames = None
        base_frame = None
        ee_frame = None

        if robot:
            show_visual = True if show_visual is None else show_visual
            configuration = configuration or robot.zero_configuration()

            robot.update(configuration, visual=show_visual, collision=show_collision)
            compas_frames = robot.transformed_frames(configuration, group)

            if show_visual:               
                visual = robot.artist.draw_visual()
                

            if show_collision:
                collision = robot.artist.draw_collision()

            if show_base_frame:
                base_compas_frame = compas_frames[0]
                artist = FrameArtist(base_compas_frame)
                base_frame = artist.draw()

            if show_end_effector_frame:
                ee_compas_frame = robot.forward_kinematics(configuration, group, options=dict(solver='model'))
                if robot.attached_tool:
                    ee_compas_frame = robot.from_t0cf_to_tcf([ee_compas_frame])[0]
                artist = FrameArtist(ee_compas_frame)
                ee_frame = artist.draw()

            if show_frames:
                frames = []
                for compas_frame in compas_frames[1:]:
                    artist = FrameArtist(compas_frame)
                    frame = artist.draw()
                    frames.append(frame)

            if show_acm:
                attached_meshes = []
                for acm in attached_collision_meshes:
                    frame = robot.forward_kinematics(configuration, options=dict(solver='model', link_name=acm.link_name))
                    T = Transformation.from_frame_to_frame(Frame.worldXY(), frame)
                    mesh = acm.collision_mesh.mesh.transformed(T)
                    attached_meshes.append(MeshArtist(mesh).draw())

        return (visual, collision, attached_meshes, frames, base_frame, ee_frame)
# ---------- end robot_visualize ----------
draw_6 = GhPythonScript(frames=[robot_visualize.frames, robot_visualize.base_frame, robot_visualize.ee_frame], scale=Slider(0.2, range=0..1))  # -> P, V, C, W; inputs frames: list
# ---------- draw_6: Python ----------
from System.Drawing import Color
from compas_ghpython.artists import FrameArtist

red = Color.FromArgb(255, 0, 0)
green = Color.FromArgb(0, 255, 0)
blue = Color.FromArgb(0, 0, 255)

P = []
V = []
C = []

scale = float(scale)

for plane in frames:
    if not plane:
        continue
    P += [plane.Origin] * 3
    V.append(plane.XAxis * scale)
    V.append(plane.YAxis * scale)
    V.append(plane.ZAxis * scale)
    C += [red, green, blue]

W = 3
# ---------- end draw_6 ----------
geo_2 = Geometry([robot_visualize.visual, robot_visualize.collision, robot_visualize.attached_meshes])
# Move Control
preview_3 = CustomPreview(Geometry=geo_2, Shader=ColourSwatch(SwatchColor=RGB(207, 157, 160)))
vdisex_2 = VectorDisplayEx(Point=draw_6.P, Vector=draw_6.V, Colour=draw_6.C, Width=draw_6.W)

py_5 = PythonScript(robot=set.robot)  # -> configuration; same code as py_4
fk_configuration_3 = Data(forward_kinematics)
filter_4 = StreamFilter(Gate=list_3, Stream0=fk_configuration_3, Stream1=py_5)

# ----
# Fabrication Control
button_3 = Button()
tasks = GhPythonScript(
    create=button_3,
    robot=set.robot,
    group=set.main_group_name,
    start_configuration=filter_4,
    avoid_collisions=Toggle(False),
    speed=tcp_speed,
    am_model=layer_def_2.am_model)  # -> out, tasks, configurations
# ---------- tasks: Python ----------
import fabtory_fabrication_control as ffc
import compas_rrc as rrc
import time
from fabrication_control.task import Task
from compas.geometry import Frame
from scriptcontext import sticky as st


class MoveJoints(Task):
    def __init__(self, name):
        self.name = name
        self.robot = None
        self.is_completed = False
        self.is_running = False
        self._stop_flag = True
        self.configurations = []
        self.speeds = []
        self.log_messages = []
        self.key = None
        self.parallelizable = False
    
    def set_robot(self, robot):
        self.robot = robot

    def run(self, _stop_flag):
        self.log("{}: started".format(self.name))
        for i, c in enumerate(self.configurations):
            if self.configurations[-1]==c:
                ffc.commands.move_to_joints_2(self.robot, c, speed=self.speeds[i], zone=rrc.Zone.Z200, send_and_wait=True)
            else:
                ffc.commands.move_to_joints_2(self.robot, c, speed=self.speeds[i], zone=rrc.Zone.Z200)
        self.is_completed = True
        return True
    
    def frame_to_joint_config(self, frame, speed):
        robot.client = robot.ros_client
        if robot.attached_tool:
            tool_frame = robot.from_tcf_to_t0cf([frame])[0]
        else:
            tool_frame = frame
        ik_configuration = robot.inverse_kinematics(tool_frame,
                                                    start_configuration,
                                                    group=group,
                                                    options={
                                                      'avoid_collisions':avoid_collisions,
                                                      'return_full_configuration':True,
                                                    })
        self.configurations.append(ik_configuration)
        self.speeds.append(speed)


if create:
    tasks = []
    st["task_configurations"] = []
    for j, layer in am_model.layers():
        new_task = MoveJoints(name="LAYER_{}".format(j))
        new_task.robot = robot
        for i, node in layer.nodes():
            new_task.frame_to_joint_config(node.frame, speed)
        tasks.append(new_task)
        st["task_configurations"].extend(new_task.configurations)
    st["tasks"]= tasks
    
tasks = st["tasks"]
configurations = st["task_configurations"]
# ---------- end tasks ----------
init = Button()
start_fabrication = Button()
stop_fabrication = Button()
reset_fabrication = Button()
fabrication = PythonScript(init=init, parallelize=parallelize)  # -> out, fabrication
# ---------- fabrication: Python ----------
from scriptcontext import sticky as st
from fabrication_control.fabrication import Fabrication

if init:
    fabrication = Fabrication()
    fabrication.parallelize = parallelize
    st["fabrication"] = fabrication

fabrication = st["fabrication"]
# ---------- end fabrication ----------
set_tasks = Button()
set_fab_params = PythonScript(fabrication=fabrication.fabrication, tasks=tasks.tasks, set_tasks=set_tasks)  # -> out, fabrication; inputs tasks: list, set_tasks: Boolean
# ---------- set_fab_params: Python ----------
from scriptcontext import sticky as st

guid = str(ghenv.Component.InstanceGuid)
tasks_set_key = "tasks_set" + guid

if not tasks_set_key in st:
    st[tasks_set_key] = False

if set_tasks == True:
    print "setting tasks"    
    fabrication.clear_tasks()
    fabrication.set_tasks(tasks) #needs to be revised with aim
    st[tasks_set_key] = True
# ---------- end set_fab_params ----------
# extruder control
fabrication_2 = PythonScript(fabrication=set_fab_params.fabrication, start=start_fabrication, stop=stop_fabrication, reset=reset_fabrication)  # -> out
# ---------- fabrication_2: Python ----------
if start:
    #if robot.is_connected(): #and arduino.is_connected():
    print "starting process"
    fabrication.start()

if stop:
    print "stopping process"
    fabrication.stop()
    
if reset:
    print "resetting process"
    fabrication.reset()
"""
if pause:
    print "pausing process"
    fabrication.pause()

if resume:
    print "resuming process"
    fabrication.resume()
"""
# ---------- end fabrication_2 ----------

ghpython_script = GhPythonScript(tasks=tasks.tasks, id=Slider(0, range=0..10), run=Button())  # -> out; inputs tasks: list, id: Int32
# ---------- ghpython_script: Python ----------
import rhinoscriptsyntax as rs

if run:
    tasks[id].run(False)
# ---------- end ghpython_script ----------

# ----
# Move Joints
tcp_speed_4 = Slider(250, range=0..1000)
movej_command = GhPythonScript(
    robot=set.robot,
    configuration=filter_3,
    speed=tcp_speed_4,
    move_to_joints=to_joints,
    move_single_joints=to_single_joints)  # -> out; inputs move_to_joints: Boolean
# ---------- movej_command: Python ----------
import fabtory_fabrication_control as ffc
import compas_rrc as rrc


from compas.geometry import Scale
from compas.robots import Joint
import math



# Print text on FlexPenant
# robot.abb_client.send(rrc.PrintText('Welcome TUM to COMPAS_RRC! ;)'))

#print configuration

if move_to_joints:
    #ffc.commands.move_to_joints(robot, configuration, speed=speed, zone=rrc.Zone.FINE)
    ffc.commands.move_to_joints_2(robot, configuration, speed=speed, zone=rrc.Zone.FINE)


#ext_axes = rrc.ExternalAxes.from_configuration(configuration) #store all robot values from configuration
#cart = rrc.ExternalAxes(ext_axes.values[0]) #store cart values from robot values
#joints = rrc.RobotJoints(ext_axes.values[1:]) #store joint values from robot values
#robot.abb_client.send(rrc.MoveToJoints(joints, cart, speed, zone)) #send move to joints command



#joint_goal = movejoints.get_current_joint_values()
#print joint_goal


if move_single_joints:
    pass
    # TODO
# ---------- end movej_command ----------
data_recorder_5 = DataRecorder(movej_command, DataLimit=-10, RecordData=True)
out_6 = Panel(data_recorder_5)

jp_2 = GhPythonScript(robot=set.robot)  # -> full_configurations
# ---------- jp_2: Python ----------
import math
import Grasshopper
import copy
from compas.robots import Joint
from compas_fab.robots import Configuration




"""
joint_values = [-3.136, -0.328, -1.218, 3.129, 0.852, 0.008]
#joint_values = [math.degrees(j) for j in joint_values]
#joint_positions = [0] * 6

configurations_values = []

cart = 0
joint_values = [0,0,0,0,0,0]
configuration_values = [cart] + joint_values

configurations_values.append(configuration_values)

full_configurations = []

for configuration_values in configurations_values:

    joint_positions_degrees = copy.deepcopy(configuration_values)
    joint_types = robot.get_configurable_joint_types()
    #print(joint_types)
    for i, joint_type in enumerate(joint_types):
        if joint_type == Joint.REVOLUTE:
            joint_positions[i] = math.radians(joint_positions[i])
        if joint_type == Joint.PRISMATIC:
            joint_positions[i] = joint_positions[i]
    full_configurations.append(Configuration(joint_positions, joint_types))


if move_to_joints:
    #ffc.commands.move_to_joints(robot, configuration, speed=speed, zone=rrc.Zone.FINE)
    ffc.commands.move_to_joints_2(robot, configuration, speed=speed, zone=rrc.Zone.FINE)
"""





full_configurations = []

c = Configuration((0.937, -1.328, 0.277, 0.786, 0.276, -1.079, -0.134), (2, 0, 0, 0, 0, 0, 0), ('axis_joint', 'joint_1', 'joint_2', 'joint_3', 'joint_4', 'joint_5', 'joint_6'))
full_configurations.append(c)

c = Configuration((1.691, -2.350, -0.365, 0.800, -0.258, -0.483, 0.197), (2, 0, 0, 0, 0, 0, 0), ('axis_joint', 'joint_1', 'joint_2', 'joint_3', 'joint_4', 'joint_5', 'joint_6'))
full_configurations.append(c)

c = Configuration((1.679, -1.497, 0.538, -0.330, -0.150, -1.191, 0.272), (2, 0, 0, 0, 0, 0, 0), ('axis_joint', 'joint_1', 'joint_2', 'joint_3', 'joint_4', 'joint_5', 'joint_6'))
full_configurations.append(c)
# ---------- end jp_2 ----------

# ----
# Move Joints from List
tcp_speed_5 = Slider(250, range=0..1000)
to_joints_2 = Button()
movej_command_2 = GhPythonScript(robot=set.robot, configurations=jp_2, speed=tcp_speed_5, move_to_joints=to_joints_2)  # -> out; inputs configurations: list, move_to_joints: Boolean
# ---------- movej_command_2: Python ----------
import fabtory_fabrication_control as ffc
import compas_rrc as rrc


if move_to_joints:
    for configuration in configurations:
        ffc.commands.move_to_joints_2(robot, configuration, speed=speed, zone=rrc.Zone.Z200)
# ---------- end movej_command_2 ----------
data_recorder_6 = DataRecorder(movej_command_2, DataLimit=-10, RecordData=True)
out_7 = Panel(data_recorder_6)

panel_6 = Panel(ghpython_script)

# ----
# Move Cartesian from List
to_robtargets = Button()
to_frames = Button()
movel_command = GhPythonScript(
    robot=set.robot,
    configuration=filter_3,
    speed=tcp_speed_3,
    target_planes=plane_2,
    move_to_frames=to_frames,
    move_to_robtargets=to_robtargets,
    set_tool=set_tool_2)  # -> out; inputs target_planes: list of Plane, move_to_frames: Boolean, move_to_robtargets: Boolean
# ---------- movel_command: Python ----------
import compas_rrc as rrc
import fabtory_fabrication_control as ffc
from compas.geometry import Frame

#set tool in RobotStudio
if set_tool:
    if robot.attached_tool:
        tool_name = robot.attached_tool.name
        done = robot.abb_client.send(rrc.SetTool(tool_name))
        print done
    else:
        robot.abb_client.send(rrc.SetTool("tool0"))

if move_to_frames:
    #transform target plane into target frame
    
    for i, target_plane in enumerate(target_planes):
        if i < len(target_planes)-1:
            zone = rrc.Zone.Z50
        else:
            zone = rrc.Zone.FINE
        print zone
        target_frame = Frame(target_plane.Origin, target_plane.XAxis, target_plane.YAxis)
        #send move to frame command
        ffc.commands.move_to_frame(robot, target_frame, speed=speed, zone=zone, scalefactor=1000)

if move_to_robtargets:
    for i, target_plane in enumerate(target_planes):
        if i < len(target_planes)-1:
            zone = rrc.Zone.Z50
        else:
            zone = rrc.Zone.FINE
        print zone
        #transform target plane into target frame
        target_frame = Frame(target_plane.Origin, target_plane.XAxis, target_plane.YAxis)
        #store cart value from configuration
        cart = (configuration.joint_values[0])
        #send move to robtarget command
        ffc.commands.move_to_robtarget(robot, target_frame, cart, speed=speed, zone=zone, scalefactor=1000)
# ---------- end movel_command ----------
data_recorder_7 = DataRecorder(movel_command, DataLimit=-10, RecordData=True)
out_8 = Panel(data_recorder_7)

# ----
# Move Cartesian
movel_command_2 = GhPythonScript(
    robot=set.robot,
    configuration=filter_3,
    speed=tcp_speed_2,
    target_plane=target_plane,
    move_to_frame=to_frame,
    move_to_robtarget=to_robtarget,
    set_tool=set_tool)  # -> out; inputs target_plane: Plane, move_to_frame: Boolean, move_to_robtarget: Boolean
# ---------- movel_command_2: Python ----------
import compas_rrc as rrc
import fabtory_fabrication_control as ffc
from compas.geometry import Frame

#set tool in RobotStudio
if set_tool:
    if robot.attached_tool:
        tool_name = robot.attached_tool.name
        done = robot.abb_client.send(rrc.SetTool(tool_name))
        print done
    else:
        robot.abb_client.send(rrc.SetTool("tool0"))

if move_to_frame:
    #transform target plane into target frame
    target_frame = Frame(target_plane.Origin, target_plane.XAxis, target_plane.YAxis)
    #send move to frame command
    ffc.commands.move_to_frame(robot, target_frame, speed=speed, zone=rrc.Zone.FINE, scalefactor=1000)

if move_to_robtarget:
    #transform target plane into target frame
    target_frame = Frame(target_plane.Origin, target_plane.XAxis, target_plane.YAxis)
    #store cart value from configuration
    cart = (configuration.joint_values[0])
    #send move to robtarget command
    ffc.commands.move_to_robtarget(robot, target_frame, cart, speed=speed, zone=rrc.Zone.FINE, scalefactor=1000)
# ---------- end movel_command_2 ----------
data_recorder_8 = DataRecorder(movel_command_2, DataLimit=-10, RecordData=True)
out_9 = Panel(data_recorder_8)

list_item_2 = ListItem(List=tasks.configurations, Index=Slider(0, range=0..10), Wrap=True)
panel_7 = Panel(tasks.out)

# ----
# Get Robot Configurations
get_joints_2 = GhPythonScript(robot=set.robot, get_frame=get_frame, get_robtarget=get_robtarget, get_joints=get_joints)  # -> joint, current_plane
# ---------- get_joints_2: Python ----------
from compas_ghpython.artists import FrameArtist
from scriptcontext import sticky as st
import fabtory_fabrication_control as ffc
import os

# store robot in component
guid = str(ghenv.Component.InstanceGuid)
current_frame_key = "current_frame_" + guid
current_robtarget_key = "current_robtarget_" + guid
current_configuration_key = "current_configuration_" + guid

if current_frame_key not in st:
    st[current_frame_key] = None

if current_robtarget_key not in st:
    st[current_robtarget_key] = None

if current_configuration_key not in st:
    st[current_configuration_key] = None


#get commands
if get_frame:
    current_frame = ffc.feedback.get_frame(robot, scalefactor=0.001)
    st[current_frame_key] = current_frame

if get_robtarget:
    current_robtarget = ffc.feedback.get_robtarget(robot, scalefactor=0.001)
    print current_robtarget
    st[current_robtarget_key] = current_robtarget


if get_joints:
    current_configuration = ffc.feedback.get_joints(robot)
    st[current_configuration_key] = current_configuration
    print current_configuration

# sticky
if st[current_frame_key]:
    current_frame = st[current_frame_key]
    artist = FrameArtist(current_frame)
    current_plane = artist.draw()

if st[current_robtarget_key]:
    current_robtarget = st[current_robtarget_key]

if st[current_configuration_key]:
    current_configuration = st[current_configuration_key]
    print current_configuration
# ---------- end get_joints_2 ----------
data_recorder_9 = DataRecorder(get_joints_2.joint, DataLimit=-10, RecordData=True)
draw_7 = GhPythonScript(plane=get_joints_2.current_plane, scale=Slider(0.2, range=0..1))  # -> P, V, C, W; inputs plane: Plane
# ---------- draw_7: Python ----------
from System.Drawing import Color
from compas_ghpython.artists import FrameArtist

red = Color.FromArgb(255, 0, 0)
green = Color.FromArgb(0, 255, 0)
blue = Color.FromArgb(0, 0, 255)

P = []
V = []
C = []

scale = float(scale)


if plane:
    P += [plane.Origin] * 3
    V.append(plane.XAxis * scale)
    V.append(plane.YAxis * scale)
    V.append(plane.ZAxis * scale)
    C += [red, green, blue]
    
    W = 3
# ---------- end draw_7 ----------
joint_values = Panel(data_recorder_9)
vdisex_3 = VectorDisplayEx(Point=draw_7.P, Vector=draw_7.V, Colour=draw_7.C, Width=draw_7.W)

# ==== cluster Tools

# ---- group: measurement tool
geo = Geometry(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)
mesh = Mesh(geo)
mjoin = MeshJoin(Meshes=mesh)
xaxis_line = Curve(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)
yaxis_line = Curve(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)
tool = PythonScript(rhmesh=mjoin, xline=xaxis_line, yline=yaxis_line)  # -> values_for_robotstudio, tool; inputs rhmesh: Mesh
# ---------- tool: Python ----------
import Rhino.Geometry as rg
import os, math
from compas.geometry import Frame, Rotation
from compas.datastructures import Mesh
from compas_ghpython.artists import MeshArtist
from compas_fab.robots import Tool
from compas_rhino.geometry import RhinoMesh

xaxis = rg.Line(xline.PointAtStart, xline.PointAtEnd)
yaxis = rg.Line(yline.PointAtStart, yline.PointAtEnd)

if xaxis.From.DistanceTo(yaxis.From) < 0.01:
    origin = xaxis.From
    xaxis = xaxis.Direction
    yaxis = yaxis.Direction
elif xaxis.To.DistanceTo(yaxis.To) < 0.01:
    origin = xaxis.To
    xaxis = -xaxis.Direction
    yaxis = -yaxis.Direction
elif xaxis.From.DistanceTo(yaxis.To) < 0.01:
    origin = xaxis.From
    xaxis = xaxis.Direction
    yaxis = -yaxis.Direction
elif xaxis.To.DistanceTo(yaxis.From) < 0.01:
    origin = xaxis.To
    xaxis = -xaxis.Direction
    yaxis = yaxis.Direction

xaxis.Unitize()
yaxis.Unitize()

ee_frame = Frame(origin, xaxis, yaxis)
ee_mesh = RhinoMesh.from_geometry(rhmesh).to_compas()

tool = Tool(ee_mesh, ee_frame, collision=None, name="t_measurement")

values_for_robotstudio = [[round(entry*1000, 5) for entry in list(ee_frame.point)], list(ee_frame.quaternion)]
print values_for_robotstudio
# ---------- end tool ----------
values_for_robotstudio = Panel(tool.values_for_robotstudio)

# ---- group: concrete extruder tool
geo_2 = Geometry(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)
mesh_2 = Mesh(geo_2)
mjoin_2 = MeshJoin(Meshes=mesh_2)
yaxis_line_2 = Curve(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)
xaxis_line_2 = Curve(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)
tool_2 = PythonScript(rhmesh=mjoin_2, xline=xaxis_line_2, yline=yaxis_line_2)  # -> values_for_robotstudio, tool; inputs rhmesh: Mesh
# ---------- tool_2: Python ----------
import Rhino.Geometry as rg
import os, math
from compas.geometry import Frame, Rotation
from compas.datastructures import Mesh
from compas_ghpython.artists import MeshArtist
from compas_fab.robots import Tool
from compas_rhino.geometry import RhinoMesh


xaxis = rg.Line(xline.PointAtStart, xline.PointAtEnd)
yaxis = rg.Line(yline.PointAtStart, yline.PointAtEnd)

if xaxis.From.DistanceTo(yaxis.From) < 0.01:
    origin = xaxis.From
    xaxis = xaxis.Direction
    yaxis = yaxis.Direction
elif xaxis.To.DistanceTo(yaxis.To) < 0.01:
    origin = xaxis.To
    xaxis = -xaxis.Direction
    yaxis = -yaxis.Direction
elif xaxis.From.DistanceTo(yaxis.To) < 0.01:
    origin = xaxis.From
    xaxis = xaxis.Direction
    yaxis = -yaxis.Direction
elif xaxis.To.DistanceTo(yaxis.From) < 0.01:
    origin = xaxis.To
    xaxis = -xaxis.Direction
    yaxis = yaxis.Direction

xaxis.Unitize()
yaxis.Unitize()

ee_frame = Frame(origin, xaxis, yaxis)
ee_mesh = RhinoMesh.from_geometry(rhmesh).to_compas()

tool = Tool(ee_mesh, ee_frame, collision=None, name="t_concreteextruder")

values_for_robotstudio = [[round(entry*1000, 5) for entry in list(ee_frame.point)], list(ee_frame.quaternion)]
print values_for_robotstudio
# ---------- end tool_2 ----------
values_for_robotstudio_2 = Panel(tool_2.values_for_robotstudio)

# ----
G = ClusterInput()
filter = StreamFilter(Gate=G, Stream0=tool.tool, Stream1=tool_2.tool)
s_1 = ClusterOutput(filter)
