# Grasshopper definition fabtory_simulation_playground.ghx (Grasshopper 1.0.7)

reload = Button()
path = PythonScript()  # -> HERE, DATA, ROBOT_DESCRIPTION
# ---------- path: Python ----------
import os

HERE = os.path.dirname(ghdoc.Path)
DATA = os.path.abspath(os.path.join(HERE, "..", "data"))
ROBOT_DESCRIPTION = os.path.abspath(os.path.join(DATA, "robot_description"))

print(HERE)
print(DATA)
print(ROBOT_DESCRIPTION)
# ---------- end path ----------
py = PythonScript(reload=reload)
# ---------- py: Python ----------
if reload:
    from compas_ghpython import unload_modules
    unload_modules('compas')
    unload_modules("compas_fab")
    unload_modules("fabtory_fabrication_control")
# ---------- end py ----------

# ---- group: plan motion
# Plan motion
# If you specify the tolerance vector with [360, 1, 1], it means that
#     the frame's y-axis and z-axis are allowed to rotate about the x-axis by an
#     angle of 360 degrees, whereas the x-axis can only change 1 degree.
compute = Button()
group = Data()
py_2 = PythonScript()  # -> configuration
# ---------- py_2: Python ----------
from compas_fab.robots import Configuration

if robot:
    types = robot.get_configurable_joint_types()
    values = [0] * len(types)

    configuration = Configuration(values, types)
    print configuration
# ---------- end py_2 ----------
list = ValueList({"don't use attached collision mesh": 0, "use attached collision mesh": 1}, selected="don't use attached collision mesh")
python = PythonScript(
    group=group,
    tolerance_position=Slider(0.001, range=0..0.001),
    tolerance_xaxis_deg=Slider(1, range=1..360),
    tolerance_yaxis_deg=Slider(1, range=1..360),
    tolerance_zaxis_deg=Slider(1, range=1..360))  # -> goal_constraints
# ---------- python: Python ----------
import math
from compas.geometry import Frame

frame = Frame(goal_plane.Origin, goal_plane.XAxis, goal_plane.YAxis)
if robot.attached_tool:
    frame = robot.from_attached_tool_to_tool0([frame])[0]

tolerances_axes = [math.radians(tolerance_xaxis_deg), math.radians(tolerance_yaxis_deg), math.radians(tolerance_zaxis_deg)]

if robot:
    goal_constraints = robot.constraints_from_frame(frame, tolerance_position, tolerances_axes, group)
# ---------- end python ----------
start_configuration = Data()
list_2 = ValueList({"0", "1"}, selected="0")
filter = StreamFilter(Gate=list_2, Stream0=start_configuration, Stream1=py_2)
list_3 = ValueList({"RRT", "RRT*": "RRTStar", "EST", "PRM": "RPM", "PRM*": "RPMStar", "SPARS"}, selected="RRT")
filter_2 = StreamFilter(Gate=list)
plan_motion = PythonScript(
    group=group,
    start_configuration=filter,
    goal_constraints=python,
    planner_id=list_3,
    attached_collision_meshes=filter_2,
    compute=compute)  # -> out, trajectory; inputs goal_constraints: list, attached_collision_meshes: list
# ---------- plan_motion: Python ----------
"""Calculates a motion path.
    Inputs:
        robot: The robot
        group: str, optional
            The planning group used for calculation. Defaults to the robot's
            main planning group.
        start_configuration: :class:`compas_fab.robots.Configuration`, optional
            The robot's full configuration, i.e. values for all configurable
            joints of the entire robot cell, at the starting position. Defaults
            to the all-zero configuration.
        goal_constraints: list of :class:`compas_fab.robots.Constraint`
            The goal to be achieved, defined in a set of constraints.
            Constraints can be very specific, for example defining value domains
            for each joint, such that the goal configuration is included,
            or defining a volume in space, to which a specific robot link (e.g.
            the end-effector) is required to move to.
        planner_id: str
            The name of the algorithm used for path planning. Defaults to 'RRT'.
        attached_collision_meshes: list of :class:`compas_fab.robots.AttachedCollisionMesh`
            Defaults to None.
        compute: bool
            Press to calculate solution.
    Output:
        :class:`compas_fab.robots.JointTrajectory`
            The calculated trajectory.
"""
from __future__ import print_function
import logging
import scriptcontext as sc

guid = str(ghenv.Component.InstanceGuid)
response_key = "response_" + guid
if response_key not in sc.sticky:
    sc.sticky[response_key] = None

LOGGER = logging.getLogger('roslibpy')

if robot and robot.client and start_configuration and compute:
    if robot.client.is_connected:
        """
        sc.sticky[response_key] = robot.plan_motion(goal_constraints,
                                                    start_configuration,
                                                    group,
                                                    options={
                                                        'planner_id': str(planner_id),
                                                        'attached_collision_meshes': list(attached_collision_meshes),
                                                    })"""
        sc.sticky[response_key] = robot.plan_motion(goal_constraints,
                                                    start_configuration,
                                                    group,
                                                    planner_id=str(planner_id),
                                                    attached_collision_meshes=list(attached_collision_meshes),
                                                    )
    else:
        print("Robot client is not connected.")

trajectory = sc.sticky[response_key]
# ---------- end plan_motion ----------
vis = PythonScript(response=plan_motion.trajectory)  # -> P, V, A, time
# ---------- vis: Python ----------
from compas_ghpython import list_to_ghtree

if response:

    positions = []
    velocities = []
    accelerations = []
    time_from_start = []

    for p in response.points:
        positions.append(p.positions)
        velocities.append(p.velocities)
        accelerations.append(p.accelerations)
        time_from_start.append(p.time_from_start.seconds)

    P = list_to_ghtree(list(zip(*positions)))
    V = list_to_ghtree(list(zip(*velocities)))
    A = list_to_ghtree(list(zip(*accelerations)))

    time = time_from_start[-1]
    print time
# ---------- end vis ----------
time_s = Panel(vis.time)
py_3 = PythonScript(group=group, trajectory=plan_motion.trajectory)  # -> configurations, full_configurations, fraction, time
# ---------- py_3: Python ----------
if trajectory:
    configurations = trajectory.points
    full_configurations = [robot.merge_group_with_full_configuration(c, trajectory.start_configuration, group) for c in configurations]
    start_configuration = trajectory.start_configuration
    fraction = trajectory.fraction
    time = trajectory.time_from_start
# ---------- end py_3 ----------
prismatic = QuickGraph(vis.P, SortOrder=0)
fraction = Panel(py_3.fraction)
time_s_2 = Panel(py_3.time)
panel = Panel(plan_motion.out)
panel_2 = Panel("positions")
graph = QuickGraph(vis.A, SortOrder=0)
graph_2 = QuickGraph(vis.V, SortOrder=0)
path_2 = GhPythonScript(full_configurations=py_3.full_configurations)  # -> frames, P; inputs full_configurations: list
# ---------- path_2: Python ----------
import Rhino.Geometry as rg

frames = []

if robot:
    for c in full_configurations:
        if c:
            #frame_WCF = robot.forward_kinematics(c, group, options={'backend':'model'})
            frame_WCF = robot.forward_kinematics(c, group, backend='model')
            frames.append(frame_WCF)

    P = [rg.Point3d(*list(frame.point)) for frame in frames]
# ---------- end path_2 ----------
idx = Slider(0, range=0..1)
animate = PythonScript(group=group, configurations=py_3.full_configurations, idx=idx)  # -> configuration; inputs configurations: list, idx: Int32
# ---------- animate: Python ----------
import Grasshopper
from compas_fab.utilities import map_range
from compas_fab.robots import Configuration

count = len(configurations)

for i in range(ghenv.Component.Params.Input.Count):
    nslider = ghenv.Component.Params.Input[i].Sources[0]
    if nslider.GetType() == Grasshopper.Kernel.Special.GH_NumberSlider and nslider.NickName == 'idx':
        nslider.Slider.Maximum = max(count - 1, 1)
        nslider.Slider.Minimum = 0

if count and robot and configurations[0] != None:
    configuration = configurations[idx]
# ---------- end animate ----------
panel_3 = Panel("velocities")
panel_4 = Panel("accelerations")
pline = PolyLine(Vertices=path_2.P, Closed=False)
preview = CustomPreview(Geometry=[path_2.P, pline], Material=ColourSwatch(SwatchColor=RGB(59, 161, 95)))

# ----
# Input
x_axis = Curve(<curve referenced from the Rhino model>)
y_axis = Curve(<curve referenced from the Rhino model>)
x_axis_2 = Curve(<curve referenced from the Rhino model>)
y_axis_2 = Curve(<curve referenced from the Rhino model>)
start_plane = PythonScript(plane_axes=[x_axis, y_axis])  # -> plane; inputs plane_axes: list of Curve
# ---------- start_plane: Python ----------
import Rhino.Geometry as rg

x_axis, y_axis = plane_axes

x_axis = rg.Line(x_axis.PointAtStart, x_axis.PointAtEnd)
y_axis = rg.Line(y_axis.PointAtStart, y_axis.PointAtEnd)

if x_axis.From.DistanceTo(y_axis.From) < 0.01:
    origin = x_axis.From
    xvec = x_axis.Direction
    yvec = y_axis.Direction
elif x_axis.To.DistanceTo(y_axis.To) < 0.01:
    origin = x_axis.To
    xvec = -x_axis.Direction
    yvec = -y_axis.Direction
elif x_axis.From.DistanceTo(y_axis.To) < 0.01:
    origin = x_axis.From
    xvec = x_axis.Direction
    yvec = -y_axis.Direction
elif x_axis.To.DistanceTo(y_axis.From) < 0.01:
    origin = x_axis.To
    xvec = -x_axis.Direction
    yvec = y_axis.Direction

plane = rg.Plane(origin, xvec, yvec)
# ---------- end start_plane ----------
end_plane = PythonScript(plane_axes=[x_axis_2, y_axis_2])  # -> plane; inputs plane_axes: list of Curve; same code as start_plane

list_4 = ValueList({"0", "1"}, selected="0")
py_4 = PythonScript(start_plane=start_plane, end_plane=end_plane)  # -> planes
# ---------- py_4: Python ----------
planes = [start_plane, end_plane]
print planes
# ---------- end py_4 ----------
inverse = GhPythonScript()  # -> out, group_configuration, full_configuration
# ---------- inverse: Python ----------
"""Calculate the robot's inverse kinematic for a given plane.
    Inputs:
        robot: The robot
        group: str, optional
            The planning group used for calculation. Defaults to the robot's
            main planning group.
        plane: The plane in world coordinate frame to calculate the inverse for.
        start_configuration: :class:`compas_fab.robots.Configuration`, optional
            If passed, the inverse will be calculated such that the calculated
            joint positions differ the least from the start_configuration.
            Defaults to the init configuration.
        avoid_collisions: bool, optional
            Whether or not to avoid collisions. Defaults to True.
    Output:
        group_configuration: The group configuration
        full_configuration: The full configuration
"""
from __future__ import print_function
import logging

from compas.geometry import Frame

LOGGER = logging.getLogger('roslibpy')

frame = Frame(plane.Origin, plane.XAxis, plane.YAxis)

if robot.attached_tool:
    frame = robot.from_attached_tool_to_tool0([frame])[0]

#print(frame)

if robot and robot.client:
    if robot.client.is_connected:
        """
        full_configuration = robot.inverse_kinematics(frame,
                                                      start_configuration,
                                                      group=group,
                                                      options={
                                                        'avoid_collisions':avoid_collisions,
                                                        'return_full_configuration':True,
                                                      })"""
        full_configuration = robot.inverse_kinematics(frame,
                                                      start_configuration,
                                                      group=group,
                                                      avoid_collisions=avoid_collisions,
                                                      return_full_configuration=True,
                                                      )
        group_configuration = robot.get_group_configuration(group, full_configuration)
        print(group_configuration)
    else:
        print("Robot client is not connected")
# ---------- end inverse ----------

# ----
# Tool
list_5 = ValueList({"measurement_tool": 0, "concrete_extruder": 1}, selected="concrete_extruder")
panel_5 = Panel("Attach a custom tool")
tools = Tools(G=list_5)
remove = Button()
add = Button()

# ----
# ROS & ABB client
ip = ValueList({"192.168.125.1", "127.0.0.1"}, selected="127.0.0.1")
robot_port = ValueList({"9090", "30101"}, selected="9090")
ros = ROSConnect(ip=ip, port=robot_port, connect=Toggle(True))  # -> ros_client, is_connected; inputs port: Int32, connect: Boolean
#   port ip: The ip address ROS. Defaults to 127.0.0.1.
# ---------- ros: Python ----------
from ghpythonlib.componentbase import executingcomponent as component
from scriptcontext import sticky as st

from compas_fab.backends import RosClient
from compas_fab.ghpython.components import create_id


class ROSConnect(component):
    def RunScript(self, ip, port, connect):
        ros_client = None

        ip = ip or '127.0.0.1'
        port = port or 9090

        key = create_id(self, 'ros_client')
        ros_client = st.get(key, None)

        if ros_client:
            st[key].close()
        if connect:
            st[key] = RosClient(ip, port)
            st[key].run(5)

        ros_client = st.get(key, None)
        is_connected = ros_client.is_connected if ros_client else False
        return (ros_client, is_connected)
# ---------- end ros ----------
is_connected = Panel(ros.is_connected)

# ----
# Load Model
# Load robot from local package
load = Button()
list_6 = ValueList({"abb_fabtory"}, selected="abb_fabtory")
units = ValueList({"m": 1, "cm": 100, "mm": 1000}, selected="m")

# ----
# Robot Model
panel_6 = Panel("abb_fabtory.srdf")

load_model = PythonScript(
    path=path.ROBOT_DESCRIPTION,
    package=list_6,
    urdf_name="abb_fabtory.urdf",
    srdf_name=panel_6,
    scale_factor=units,
    load=load)  # -> robot
# ---------- load_model: Python ----------
import os
from scriptcontext import sticky as st
import compas
from compas.robots import RobotModel
from compas.robots import LocalPackageMeshLoader
from compas_fab.robots import Robot
from compas_fab.robots import RobotSemantics
from compas_fab.ghpython import RobotArtist

packages = ["abb_irb6700_support", "abb_end_effectors", "abb_fabtory"]
loaders = []

for package in packages:
    loaders.append(LocalPackageMeshLoader(path, package))

#path directory
package_path = os.path.join(path, package)
print(package_path)

urdf_filename = os.path.join(package_path, "urdf", urdf_name)
srdf_filename = os.path.join(package_path, srdf_name)

assert os.path.isfile(urdf_filename)
assert os.path.isfile(srdf_filename)

compas.PRECISION = '12f'

# store robot in component
guid = str(ghenv.Component.InstanceGuid)
robot_key = "robot_" + guid

if robot_key not in st:
    st[robot_key] = None

#load robot model from urdf
if load:
    model = RobotModel.from_urdf_file(urdf_filename)
    model.load_geometry(*loaders)
    artist = RobotArtist(model)
    semantics = RobotSemantics.from_srdf_file(srdf_filename, model)
    robot = Robot(model, artist, semantics, client=None)

    st[robot_key] = robot
robot = st[robot_key]

#vizualize robot in the right scale of your environment
robot.scale(scale_factor)
# ---------- end load_model ----------

set = PythonScript(robot=load_model, ros_client=ros.ros_client)  # -> out, robot, main_group_name
# ---------- set: Python ----------
if robot and ros_client:
    robot.ros_client = ros_client


    robot.info()
    main_group_name = robot.main_group_name
# ---------- end set ----------

attach_remove = PythonScript(robot=load_model, tool=tools, attach=add, remove=remove)  # -> bang
# ---------- attach_remove: Python ----------
if attach:
    robot.attach_tool(tool)
if remove:
    robot.detach_tool()
# ---------- end attach_remove ----------

robot_info = Panel(set.out)

py_5 = PythonScript(robot=set.robot)  # -> configuration
# ---------- py_5: Python ----------
from compas_fab.robots import Configuration

if robot:
    types = robot.get_configurable_joint_types()
    values = [0] * len(types)
    configuration = Configuration(values, types)
    print configuration
    print robot.get_configurable_joint_names()
# ---------- end py_5 ----------

# ----
# forward kinematics
number_slider = Slider(0, range=-180..180)
# Configuration
number_slider_2 = Slider(0, range=0..4.2)
jp = GhPythonScript()  # -> configuration_values
# ---------- jp: Python ----------
import math
joint_values = [-3.136, -0.328, -1.218, 3.129, 0.852, 0.008]
#joint_values = [math.degrees(j) for j in joint_values]
#joint_positions = [0] * 6

cart = 0
joint_values = [0,0,0,0,0,0]

configuration_values = [cart] + joint_values
# ---------- end jp ----------
forward_kinematics = PythonScript(
    robot=set.robot,
    reset_configuration=Button(),
    configuration_values=jp,
    a_cart=number_slider_2,
    a_a1=number_slider,
    a_a2=Slider(0, range=-90..150),
    a_a3=Slider(0, range=-180..180),
    a_a4=Slider(0, range=-400..400),
    a_a5=Slider(0, range=-125..120),
    a_a6=Slider(0, range=-400..400))  # -> full_configuration; inputs reset_configuration: Boolean, configuration_values: list
# ---------- forward_kinematics: Python ----------
import math
import Grasshopper
import copy
from compas.robots import Joint
from compas_fab.robots import Configuration





if reset_configuration:
    j = 0
    for i in range(ghenv.Component.Params.Input.Count):
        nslider = ghenv.Component.Params.Input[i].Sources[0]
        if nslider.GetType() == Grasshopper.Kernel.Special.GH_NumberSlider:
            nslider.TrySetSliderValue(configuration_values[j])
            j += 1


if robot:
    joint_positions = [a_cart, a_a1, a_a2, a_a3, a_a4, a_a5, a_a6]
    print joint_positions
    joint_positions_degrees = copy.deepcopy(joint_positions)
    joint_types = robot.get_configurable_joint_types()
    print(joint_types)
    for i, joint_type in enumerate(joint_types):
        if joint_type == Joint.REVOLUTE:
            joint_positions[i] = math.radians(joint_positions[i])
        if joint_type == Joint.PRISMATIC:
            joint_positions[i] = joint_positions[i]
    full_configuration = Configuration(joint_positions, joint_types)
    print full_configuration
# ---------- end forward_kinematics ----------

fk_configuration = Data(forward_kinematics)
filter_3 = StreamFilter(Gate=list_4, Stream0=fk_configuration, Stream1=py_5)

# ----
# inverse kinematics
go_to_start_configuration = BooleanToggle(False)
avoid_collisions = BooleanToggle(False)
inverse_kinematics = GhPythonScript(
    compute=Button(),
    robot=set.robot,
    group=set.main_group_name,
    plane=start_plane,
    start_configuration=filter_3,
    go_to_start_configuration=go_to_start_configuration,
    avoid_collisions=avoid_collisions)  # -> out, ik_configuration, t0cp; inputs plane: Plane
# ---------- inverse_kinematics: Python ----------
from __future__ import print_function
import logging
from compas.geometry import Frame
from scriptcontext import sticky as st
from compas_ghpython.artists import FrameArtist

LOGGER = logging.getLogger('roslibpy')

#vizualize t0cf
if robot.attached_tool:
    t0cf = Frame(plane.Origin, plane.XAxis, plane.YAxis)
    t0cf = robot.from_tcf_to_t0cf([t0cf])[0]
    artist = FrameArtist(t0cf)
    t0cp = artist.draw()
    print (t0cf)

if compute:
    if robot.attached_tool:
        tool_attached = True
    else:
        tool_attached = False

    robot.client = robot.ros_client
    if go_to_start_configuration:
        ik_configuration = start_configuration
    else:
        frame = Frame(plane.Origin, plane.XAxis, plane.YAxis)
        if tool_attached:
            tool_frame = robot.from_tcf_to_t0cf([frame])[0]
        else:
            tool_frame = frame

        ik_configuration = robot.inverse_kinematics(tool_frame,
                                                      start_configuration,
                                                      group=group,
                                                      options={
                                                        'avoid_collisions':avoid_collisions,
                                                        'return_full_configuration':True,
                                                      })        
    group_configuration = robot.get_group_configuration(group, ik_configuration)
    print (group_configuration)
    st["ik_configuration"] = ik_configuration

ik_configuration = st["ik_configuration"] 
print(ik_configuration)
# ---------- end inverse_kinematics ----------
draw = GhPythonScript(planes=inverse_kinematics.t0cp, scale=Slider(0.2, range=0..1))  # -> P, V, C, W; inputs planes: list
# ---------- draw: Python ----------
from System.Drawing import Color
from compas_ghpython.artists import FrameArtist

red = Color.FromArgb(255, 0, 0)
green = Color.FromArgb(0, 255, 0)
blue = Color.FromArgb(0, 0, 255)

P = []
V = []
C = []

scale = float(scale)

for plane in planes:
    if not plane:
        continue
    P += [plane.Origin] * 3
    V.append(plane.XAxis * scale)
    V.append(plane.YAxis * scale)
    V.append(plane.ZAxis * scale)
    C += [red, green, blue]

W = 3
# ---------- end draw ----------
out = Panel(inverse_kinematics.out)
vdisex = VectorDisplayEx(Point=draw.P, Vector=draw.V, Colour=draw.C, Width=draw.W)

list_7 = ValueList({"0 forward_kinematics": 0, "1 inverse_kinematics": 1}, selected="1 inverse_kinematics")
ik_configuration = Data(inverse_kinematics.ik_configuration)
fk_configuration_2 = Data(forward_kinematics)
filter_4 = StreamFilter(Gate=list_7, Stream0=fk_configuration_2, Stream1=ik_configuration)

# ----
# Visualisation
show_end_effector_frame = BooleanToggle(True)
show_base_frame = BooleanToggle(False)
show_collision = BooleanToggle(False)
show_frames = BooleanToggle(False)
show_visual = BooleanToggle(True)
show_acm = BooleanToggle(False)
robot_visualize = RobotVisualize(
    robot=set.robot,
    group=set.main_group_name,
    configuration=filter_4,
    redraw=attach_remove,
    show_visual=show_visual,
    show_collision=show_collision,
    show_frames=show_frames,
    show_base_frame=show_base_frame,
    show_end_effector_frame=show_end_effector_frame,
    show_acm=show_acm)  # -> visual, collision, attached_meshes, frames, base_frame, ee_frame; inputs redraw: list, show_visual: Boolean, show_collision: Boolean, show_frames: Boolean, show_base_frame: Boolean, show_end_effector_frame: Boolean, show_acm: Boolean
#   port group: The planning group used for end-effector and base visualization.
#   port configuration: The robot's full configuration.
#   port redraw: A list of attached collision meshes.
#   port show_visual: Whether or not to show the robot's visual meshes.
#   port show_collision: Whether or not to show the robot's collision meshes.
#   port show_frames: Whether or not to show the robot's joint frames.
#   port show_base_frame: Whether or not to show the robot's base frame.
#   port show_end_effector_frame: Whether or not to show the robot's end-effector frame.
#   port show_acm: Whether or not to show the attached collision meshes (if any).
#   port visual: The robot's visual Rhino meshes (if any).
#   port collision: The robot's collision Rhino meshes (if any).
#   port attached_meshes: The attached collision Rhino meshes (if any).
#   port frames: The robot's joint frames as Rhino planes (if any).
#   port base_frame: The robot's base frame as a Rhino plane (if any).
#   port ee_frame: The robot's end-effector frame as a Rhino plane (if any).
# ---------- robot_visualize: Python ----------
"""
Visualizes the robot.

COMPAS FAB v0.19.1
"""
from compas.geometry import Frame
from compas.geometry import Transformation
from compas_ghpython.artists import FrameArtist
from compas_ghpython.artists import MeshArtist
from ghpythonlib.componentbase import executingcomponent as component


class RobotVisualize(component):
    def RunScript(self, robot, group, configuration, attached_collision_meshes, show_visual, show_collision,
                  show_frames, show_base_frame, show_end_effector_frame, show_acm):

        visual = None
        collision = None
        attached_meshes = None
        frames = None
        base_frame = None
        ee_frame = None

        if robot:
            show_visual = True if show_visual is None else show_visual
            configuration = configuration or robot.zero_configuration()

            robot.update(configuration, visual=show_visual, collision=show_collision)
            compas_frames = robot.transformed_frames(configuration, group)

            if show_visual:               
                visual = robot.artist.draw_visual()
                

            if show_collision:
                collision = robot.artist.draw_collision()

            if show_base_frame:
                base_compas_frame = compas_frames[0]
                artist = FrameArtist(base_compas_frame)
                base_frame = artist.draw()

            if show_end_effector_frame:
                ee_compas_frame = robot.forward_kinematics(configuration, group, options=dict(solver='model'))
                if robot.attached_tool:
                    ee_compas_frame = robot.from_t0cf_to_tcf([ee_compas_frame])[0]
                artist = FrameArtist(ee_compas_frame)
                ee_frame = artist.draw()

            if show_frames:
                frames = []
                for compas_frame in compas_frames[1:]:
                    artist = FrameArtist(compas_frame)
                    frame = artist.draw()
                    frames.append(frame)

            if show_acm:
                attached_meshes = []
                for acm in attached_collision_meshes:
                    frame = robot.forward_kinematics(configuration, options=dict(solver='model', link_name=acm.link_name))
                    T = Transformation.from_frame_to_frame(Frame.worldXY(), frame)
                    mesh = acm.collision_mesh.mesh.transformed(T)
                    attached_meshes.append(MeshArtist(mesh).draw())

        return (visual, collision, attached_meshes, frames, base_frame, ee_frame)
# ---------- end robot_visualize ----------
draw_2 = GhPythonScript(frames=[robot_visualize.frames, robot_visualize.base_frame, robot_visualize.ee_frame], scale=Slider(0.2, range=0..1))  # -> P, V, C, W; inputs frames: list
# ---------- draw_2: Python ----------
from System.Drawing import Color
from compas_ghpython.artists import FrameArtist

red = Color.FromArgb(255, 0, 0)
green = Color.FromArgb(0, 255, 0)
blue = Color.FromArgb(0, 0, 255)

P = []
V = []
C = []

scale = float(scale)

for plane in frames:
    if not plane:
        continue
    P += [plane.Origin] * 3
    V.append(plane.XAxis * scale)
    V.append(plane.YAxis * scale)
    V.append(plane.ZAxis * scale)
    C += [red, green, blue]

W = 3
# ---------- end draw_2 ----------
geo = Geometry([robot_visualize.visual, robot_visualize.collision, robot_visualize.attached_meshes])
preview_2 = CustomPreview(Geometry=geo, Shader=ColourSwatch(SwatchColor=RGB(207, 157, 160)))
vdisex_2 = VectorDisplayEx(Point=draw_2.P, Vector=draw_2.V, Colour=draw_2.C, Width=draw_2.W)

# ---- group: cartesian motion
# Plan cartesian motion
group_2 = Data(set.main_group_name)
list_8 = ValueList({"don't use attached collision mesh": 0, "use attached collision mesh": 1}, selected="don't use attached collision mesh")
py_6 = PythonScript(robot=set.robot)  # -> configuration; same code as py_2
number_slider_3 = Slider(0.01, range=0..0.01)
start_configuration_2 = Data(inverse_kinematics.ik_configuration)
list_9 = ValueList({"0", "1"}, selected="0")
avoid_collisions_2 = BooleanToggle(True)
filter_5 = StreamFilter(Gate=list_9, Stream0=start_configuration_2, Stream1=py_6)
filter_6 = StreamFilter(Gate=list_8)
plan_cartesian_motion = PythonScript(
    robot=set.robot,
    group=group_2,
    planes=py_4,
    start_configuration=filter_5,
    max_step=Slider(1, range=0..1),
    avoid_collisions=avoid_collisions_2,
    attached_collision_meshes=filter_6,
    compute=Toggle(True))  # -> out, trajectory; inputs planes: list, avoid_collisions: Boolean, attached_collision_meshes: list
# ---------- plan_cartesian_motion: Python ----------
"""Calculates a cartesian motion path (linear in tool space).
    Inputs:
        robot: The robot
        group: str, optional
            The planning group used for calculation. Defaults to the robot's
            main planning group.
        planes: The planes in world coordinate frame through which the path is defined.
        start_configuration: :class:`compas_fab.robots.Configuration`, optional
            The robot's full configuration, i.e. values for all configurable
            joints of the entire robot cell, at the starting position. Defaults
            to the all-zero configuration.
        max_step: float
            The approximate distance between the calculated points. (Defined in
            the robot's units)
        avoid_collisions: bool, optional
            Whether or not to avoid collisions. Defaults to True.
        attached_collision_meshes: list of :class:`compas_fab.robots.AttachedCollisionMesh`
            Defaults to None.
        compute: bool
            Press to calculate solution.
    Output:
        :class:`compas_fab.robots.JointTrajectory`
            The calculated trajectory.
"""
from __future__ import print_function
import logging
import scriptcontext as sc

from compas.geometry import Frame

LOGGER = logging.getLogger('roslibpy')

guid = str(ghenv.Component.InstanceGuid)
response_key = "response_" + guid
if response_key not in sc.sticky:
    sc.sticky[response_key] = None

frames = [Frame(plane.Origin, plane.XAxis, plane.YAxis) for plane in planes]

if robot.attached_tool:
    frames = [robot.from_attached_tool_to_tool0([frame])[0] for frame in frames]


if robot and robot.client and start_configuration and compute:
    if robot.client.is_connected:
        """
        sc.sticky[response_key] = robot.plan_cartesian_motion(frames,
                                                              start_configuration=start_configuration,
                                                              group=group,
                                                              options={
                                                                'max_step': float(max_step),
                                                                'avoid_collisions': bool(avoid_collisions),
                                                                'attached_collision_meshes': list(attached_collision_meshes),
                                                              })"""
        sc.sticky[response_key] = robot.plan_cartesian_motion(frames,
                                                              start_configuration=start_configuration,
                                                              group=group,
                                                              max_step=float(max_step),
                                                              avoid_collisions=bool(avoid_collisions),
                                                              attached_collision_meshes=list(attached_collision_meshes),
                                                              )
    else:
        print("Robot client is not connected")

trajectory = sc.sticky[response_key]
# ---------- end plan_cartesian_motion ----------
vis_2 = PythonScript(response=plan_cartesian_motion.trajectory)  # -> P, V, A
# ---------- vis_2: Python ----------
from compas_ghpython import list_to_ghtree

if response:
    #print response.points
    positions = []
    velocities = []
    accelerations = []

    for p in response.points:
        positions.append(p.positions)
        velocities.append(p.velocities)
        accelerations.append(p.accelerations)
    #print positions
    P = list_to_ghtree(list(zip(*positions)))
    V = list_to_ghtree(list(zip(*velocities)))
    A = list_to_ghtree(list(zip(*accelerations)))
# ---------- end vis_2 ----------
prismatic_2 = QuickGraph(vis_2.P, SortOrder=0)
py_7 = PythonScript(group=group_2, trajectory=plan_cartesian_motion.trajectory)  # -> configurations, full_configurations, fraction, time; same code as py_3
fraction_2 = Panel(py_7.fraction)
time_s_3 = Panel(py_7.time)
graph_3 = QuickGraph(vis_2.V, SortOrder=0)
graph_4 = QuickGraph(vis_2.A, SortOrder=0)
idx_2 = Slider(0, range=0..1)
path_3 = GhPythonScript(group=group_2, full_configurations=py_7.full_configurations)  # -> frames, P; inputs full_configurations: list
# ---------- path_3: Python ----------
import Rhino.Geometry as rg

frames = []

if robot:
    for c in full_configurations:
        
        if c:
            #frame_WCF = robot.forward_kinematics(c, group, options={'backend':'model'})
            frame_WCF = robot.forward_kinematics(c, group, backend='model')
            frames.append(frame_WCF)

    P = [rg.Point3d(*list(frame.point)) for frame in frames]
# ---------- end path_3 ----------
animate_2 = PythonScript(group=group_2, configurations=py_7.full_configurations, idx=idx_2)  # -> configuration; inputs configurations: list, idx: Int32; same code as animate
pline_2 = PolyLine(Vertices=path_3.P, Closed=False)
preview_3 = CustomPreview(Geometry=[path_3.P, pline_2], Material=ColourSwatch(SwatchColor=RGB(59, 137, 161)))

# ----
panel_10 = Panel(plan_cartesian_motion.out)

# ==== cluster Tools

# ---- group: measurement tool
geo = Geometry(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)
mesh = Mesh(geo)
mjoin = MeshJoin(Meshes=mesh)
xaxis_line = Curve(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)
yaxis_line = Curve(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)
tool = PythonScript(rhmesh=mjoin, xline=xaxis_line, yline=yaxis_line)  # -> tool; inputs rhmesh: Mesh
# ---------- tool: Python ----------
import Rhino.Geometry as rg
import os, math
from compas.geometry import Frame, Rotation
from compas.datastructures import Mesh
from compas_ghpython.artists import MeshArtist
from compas_fab.robots import Tool
from compas_rhino.geometry import RhinoMesh

xaxis = rg.Line(xline.PointAtStart, xline.PointAtEnd)
yaxis = rg.Line(yline.PointAtStart, yline.PointAtEnd)

if xaxis.From.DistanceTo(yaxis.From) < 0.01:
    origin = xaxis.From
    xaxis = xaxis.Direction
    yaxis = yaxis.Direction
elif xaxis.To.DistanceTo(yaxis.To) < 0.01:
    origin = xaxis.To
    xaxis = -xaxis.Direction
    yaxis = -yaxis.Direction
elif xaxis.From.DistanceTo(yaxis.To) < 0.01:
    origin = xaxis.From
    xaxis = xaxis.Direction
    yaxis = -yaxis.Direction
elif xaxis.To.DistanceTo(yaxis.From) < 0.01:
    origin = xaxis.To
    xaxis = -xaxis.Direction
    yaxis = yaxis.Direction

xaxis.Unitize()
yaxis.Unitize()

ee_frame = Frame(origin, xaxis, yaxis)
ee_mesh = RhinoMesh.from_geometry(rhmesh).to_compas()

tool = Tool(ee_mesh, ee_frame)
# ---------- end tool ----------

# ---- group: concrete extruder tool
geo_2 = Geometry(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)
mesh_2 = Mesh(geo_2)
mjoin_2 = MeshJoin(Meshes=mesh_2)
yaxis_line_2 = Curve(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)
xaxis_line_2 = Curve(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)

# ----
tool_2 = PythonScript(rhmesh=mjoin_2, xline=xaxis_line_2, yline=yaxis_line_2)  # -> tool; inputs rhmesh: Mesh; same code as tool
G = ClusterInput()
filter = StreamFilter(Gate=G, Stream0=tool, Stream1=tool_2)
s_1 = ClusterOutput(filter)
