# Grasshopper definition robotic_setup_fabtory_CompasToolsExperiment.ghx (Grasshopper 1.0.7)

# ---- group: ROS client
disconnect = Button()
connect = Button()
restart = Button()
ros = PythonScript(ip="127.0.0.1", restart=restart)  # -> out, ros_client
# ---------- ros: Python ----------
import sys
import time
import logging
import scriptcontext as sc

from compas_fab.backends import RosClient

from System import TimeSpan
from System.Threading import ManualResetEventSlim

LOGGER = logging.getLogger('roslibpy')

key = 'rosclient_%s' % str(ghenv.Component.InstanceGuid)
previous_client = sc.sticky.get(key, None)
if previous_client:
    previous_client.terminate()

ros_client = RosClient(ip, 9090)
sc.sticky[key] = ros_client

waitLock = ManualResetEventSlim(False)

ros_client.on_ready(lambda: waitLock.Set())

if not waitLock.Wait(TimeSpan.FromSeconds(5)):
    raise Exception('Unable to connect to ROS')

LOGGER.info('ROS connection opened')
# ---------- end ros ----------
connect_2 = PythonScript(ros_client=ros.ros_client, connect=connect, disconnect=disconnect)  # -> out, ros_client
# ---------- connect_2: Python ----------
import logging
from System import TimeSpan
from System.Threading import ManualResetEventSlim

LOGGER = logging.getLogger('roslibpy')

if connect:
    if not ros_client.is_connected:
        LOGGER.debug('Connecting...')
        waitLock = ManualResetEventSlim(False)
        ros_client.on_ready(lambda: waitLock.Set())
        ros_client.connect()

        if not waitLock.Wait(TimeSpan.FromSeconds(5)):
            raise Exception('Unable to connect to ROS')
        LOGGER.debug('Reconnected')

if disconnect:
    if ros_client.is_connected:
        ros_client.terminate()
        LOGGER.debug('Terminated')

print ros_client.is_connected
# ---------- end connect_2 ----------
is_connected = Panel(connect_2.out)

# ----
path = FilePath("C:\Users\julia\workspace\projects\fabtory_fabrication_control\rhino\robotic_setup_fabtory_CompasToolsExperiment.ghx")

# ----
# Robot Model
# Load robot from local package
panel = Panel("abb_linear_axis.srdf")
py = PythonScript()  # -> ghfile_path
# ---------- py: Python ----------
import os

filepath = ghenv.Component.OnPingDocument().FilePath
ghfile_path = os.path.dirname(filepath)
# ---------- end py ----------
list = ValueList({"abb_linear_axis"}, selected="abb_linear_axis")
py_2 = PythonScript(ghfile_path=py)  # -> robot_description
# ---------- py_2: Python ----------
import os

robot_description = os.path.join(ghfile_path, "..", "data", "robot_description")
robot_description = os.path.abspath(robot_description)

print robot_description
# ---------- end py_2 ----------
py_3 = PythonScript()  # -> packages
# ---------- py_3: Python ----------
packages = ["abb_irb6700_support", "abb_irb4600_40_255", "abb_end_effectors", "abb_linear_axis"]
# ---------- end py_3 ----------
py_4 = PythonScript(path=py_2, package=list, urdf_name="abb_irb6700_linear_axis.urdf", srdf_name=panel)  # -> package_path, urdf_filename, srdf_filename
# ---------- py_4: Python ----------
import os

package_path = os.path.join(path, package)
print(package_path)

urdf_filename = os.path.join(package_path, "urdf", urdf_name)
srdf_filename = os.path.join(package_path, srdf_name)

assert os.path.isfile(urdf_filename)
assert os.path.isfile(srdf_filename)
# ---------- end py_4 ----------
py_5 = PythonScript(path=py_2, packages=py_3)  # -> loaders; inputs packages: list
# ---------- py_5: Python ----------
from compas.robots import LocalPackageMeshLoader

loaders = []
print packages


for package in packages:
    loaders.append(LocalPackageMeshLoader(path, package))
# ---------- end py_5 ----------
load = Button()
units = ValueList({"m": 1, "cm": 100, "mm": 1000}, selected="m")
create = PythonScript(loaders=py_5, urdf_filename=py_4.urdf_filename, srdf_filename=py_4.srdf_filename, scale_factor=units, load=load)  # -> out, robot; inputs loaders: list
# ---------- create: Python ----------
import os
from scriptcontext import sticky as st

import compas

from compas.robots import RobotModel
from compas.robots import LocalPackageMeshLoader

from compas_fab.robots import Robot
from compas_fab.robots import RobotSemantics

from compas_fab.ghpython import RobotArtist

compas.PRECISION = '12f'

# store robot in component
guid = str(ghenv.Component.InstanceGuid)
robot_key = "robot_" + guid

if robot_key not in st:
    st[robot_key] = None

print loaders
if load:
    model = RobotModel.from_urdf_file(urdf_filename)
    
    model.load_geometry(*loaders)
    artist = RobotArtist(model)
    semantics = RobotSemantics.from_srdf_file(srdf_filename, model)
    robot = Robot(model, artist, semantics, client=None)
    
    st[robot_key] = robot

robot = st[robot_key]


if robot:
    robot.scale(scale_factor)
# ---------- end create ----------
set = PythonScript(robot=create.robot, client=connect_2.ros_client)  # -> robot
# ---------- set: Python ----------
if robot and client:
    robot.client = client
# ---------- end set ----------
robot = Data(set)
scene = PythonScript(robot=robot)  # -> scene
# ---------- scene: Python ----------
from scriptcontext import sticky as st

from compas_fab.robots import PlanningScene

# store scene in component
guid = str(ghenv.Component.InstanceGuid)
scene_key = "scene_" + guid

if scene_key not in st:
    st[scene_key] = None

if robot:
    st[scene_key] = PlanningScene(robot)

scene = st[scene_key]
# ---------- end scene ----------

py_6 = PythonScript(package_path=path)  # -> HERE, DATA
# ---------- py_6: Python ----------
import os

#package_path = os.path.dirname(empty_module.__file__)
DATA = os.path.abspath(os.path.join(package_path,"../data"))
# ---------- end py_6 ----------

reload = Button()
panel_2 = Panel(py_6.HERE)
py_7 = PythonScript(reload=reload)
# ---------- py_7: Python ----------
if reload:
    from compas_ghpython import unload_modules
    unload_modules('compas')
    unload_modules("compas_fab")
    unload_modules("ur_online_control")
# ---------- end py_7 ----------
data_path = Data(py_6.DATA)

geo = Geometry(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)
# Attach Tool
geo_2 = Geometry(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)
mesh = Mesh(geo)
mesh_2 = Mesh(geo_2)
mjoin = MeshJoin(Meshes=mesh)
mjoin_2 = MeshJoin(Meshes=mesh_2)
py_8 = PythonScript(robot=robot, idx=Slider(10, range=0..10))  # -> link_name; inputs idx: Int32
# ---------- py_8: Python ----------
if robot:
    link_names = robot.get_link_names()
    #print link_names
    link_name = link_names[idx]
# ---------- end py_8 ----------
list_2 = ValueList({"measurement_tool": 0, "area_grip": 1}, selected="area_grip")
tool = StreamFilter(Gate=list_2, Stream0=mjoin_2, Stream1=mjoin)
filter = StreamFilter(Gate=list_2, Stream0="measurement_tool", Stream1="area_grip")
acm = AttachedCollisionMesh(scene=scene, mesh=tool, identifier=filter, link_name=py_8, add=Button(), remove=Button())  # -> attached_collision_mesh; inputs mesh: Mesh, touch_links: list, add: Boolean, remove: Boolean
#   port scene: The planning scene.
#   port mesh: A collision mesh.
#   port identifier: The identifier of the collision mesh.
#   port link_name: The robot's link name to attach the mesh to.
#   port touch_links: Names of links that the robot is allowed to touch.
#   port add: If True, adds the collision mesh to the planning scene.
#   port remove: If True, removes the collision mesh from the planning scene.
#   port attached_collision_mesh: A collision mesh that is attached to a robot's link.
# ---------- acm: Python ----------
"""
Add an attached collision mesh to the robot.

COMPAS FAB v0.19.1
"""
from ghpythonlib.componentbase import executingcomponent as component

from compas_rhino.geometry import RhinoMesh
from compas_fab.robots import AttachedCollisionMesh
from compas_fab.robots import CollisionMesh


class AttachedCollisionMeshComponent(component):
    def RunScript(self, scene, mesh, identifier, link_name, touch_links, add, remove):
        attached_collision_mesh = None
        if scene and mesh and identifier and link_name:
            compas_mesh = RhinoMesh.from_geometry(mesh).to_compas()
            collision_mesh = CollisionMesh(compas_mesh, identifier)
            attached_collision_mesh = AttachedCollisionMesh(collision_mesh, link_name, touch_links)
            if add:
                scene.add_attached_collision_mesh(attached_collision_mesh)
            if remove:
                scene.remove_attached_collision_mesh(identifier)
                scene.remove_collision_mesh(identifier)
        return attached_collision_mesh
# ---------- end acm ----------

xaxis_line = Curve(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)
yaxis_line = Curve(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)
xaxis_line_2 = Curve(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)
yaxis_line_2 = Curve(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)
tool_2 = PythonScript(xline=xaxis_line_2, yline=yaxis_line_2)  # -> tool, ee_mesh; inputs rhmesh: Mesh
# ---------- tool_2: Python ----------
import Rhino.Geometry as rg
import os, math
from compas.geometry import Frame, Rotation
from compas.datastructures import Mesh
from compas_ghpython.artists import MeshArtist
from compas_fab.robots import Tool
from compas_rhino.geometry import RhinoMesh

xaxis = rg.Line(xline.PointAtStart, xline.PointAtEnd)
yaxis = rg.Line(yline.PointAtStart, yline.PointAtEnd)

if xaxis.From.DistanceTo(yaxis.From) < 0.01:
    origin = xaxis.From
    xaxis = xaxis.Direction
    yaxis = yaxis.Direction
elif xaxis.To.DistanceTo(yaxis.To) < 0.01:
    origin = xaxis.To
    xaxis = -xaxis.Direction
    yaxis = -yaxis.Direction
elif xaxis.From.DistanceTo(yaxis.To) < 0.01:
    origin = xaxis.From
    xaxis = xaxis.Direction
    yaxis = -yaxis.Direction
elif xaxis.To.DistanceTo(yaxis.From) < 0.01:
    origin = xaxis.To
    xaxis = -xaxis.Direction
    yaxis = yaxis.Direction

xaxis.Unitize()
yaxis.Unitize()

ee_frame = Frame(origin, xaxis, yaxis)
ee_mesh = RhinoMesh.from_geometry(rhmesh).to_compas()

tool = Tool(ee_mesh, ee_frame)
# ---------- end tool_2 ----------
# Tool
panel_3 = Panel("Attach a custom tool")
tool_3 = PythonScript(xline=xaxis_line, yline=yaxis_line)  # -> tool, ee_mesh; inputs rhmesh: Mesh; same code as tool_2
panel_4 = Panel("Attach a custom tool")
list_3 = ValueList({"suction_tool": 0, "suction_tool_straight": 1}, selected="suction_tool_straight")
show = BooleanToggle(False)
list_4 = ValueList({"measurement_tool": 0, "area_grip": 1}, selected="area_grip")
python = PythonScript(data_path=data_path, tool=list_3, show=show)  # -> tool, M, compas_mesh
# ---------- python: Python ----------
import os, math
from compas.geometry import Frame, Rotation
from compas.datastructures import Mesh
from compas_ghpython.artists import MeshArtist
from compas_fab.robots import Tool

tolerance = 0

if tool == 0:
    filename = 'suction_tool.stl'
    ee_frame = Frame([0, 0, 0.109], [1, 0, 0], [0, 1, 0])

elif tool == 1:
    filename = 'suction_tool_straight.stl'
    ee_frame = Frame([0, 0, 0.158 + tolerance], [1, 0, 0], [0, 1, 0])


data_path = os.path.join(data_path, "robot_description/abb_end_effectors/meshes/visual")
fullfilename = os.path.join(data_path, filename)
print fullfilename

ee_mesh = Mesh.from_stl(fullfilename)

#R = Rotation.from_axis_and_angle(ee_frame.zaxis, math.radians(180), point=ee_frame.point)
#ee_frame.transform(R)

if show:
    artist = MeshArtist(ee_mesh)
    M = artist.draw()

tool = Tool(ee_mesh, ee_frame)
compas_mesh = ee_mesh
# ---------- end python ----------
remove = Button()
tool_4 = StreamFilter(Gate=list_4, Stream0=python.tool, Stream1=tool_2.tool)
add = Button()

# ----
# Info
info = PythonScript(robot=robot)  # -> out, main_group_name
# ---------- info: Python ----------
if robot:
    robot.info()
    main_group_name = robot.main_group_name
# ---------- end info ----------
panel_5 = Panel(info.out)

py_9 = PythonScript(robot=robot, tool=tool_4, attach=add, remove=remove)  # -> out, bang
# ---------- py_9: Python ----------
if attach:
    robot.attach_tool(tool)
if remove:
    robot.detach_tool()
# ---------- end py_9 ----------
# Select link name to attach
mesh_3 = StreamFilter(Gate=list_4, Stream0=python.tool, Stream1=tool_2.ee_mesh)
# Select the links the object is allowed to touch
idxs = Data([3, 4, 5, 6, 7, 8, 9, 10])
panel_6 = Panel("ee_link")
py_10 = PythonScript(robot=robot, idxs=idxs)  # -> touch_links; inputs idxs: list of Int32
# ---------- py_10: Python ----------
if robot:
    link_names = robot.get_link_names()
    touch_links = [link_names[i] for i in idxs]
# ---------- end py_10 ----------
scale = BooleanToggle(False)
attached = PythonScript(scene=scene, compas_mesh=mesh_3, scale=scale, id="endeffector", touch_links=py_10, add=add, remove=remove)  # -> acm, out; inputs touch_links: list
# ---------- attached: Python ----------
from compas_fab.robots import CollisionMesh
from compas_fab.robots import AttachedCollisionMesh

cm = CollisionMesh(compas_mesh, id)
acm = AttachedCollisionMesh(cm, link_name, touch_links)

if scene:
    if add:
        scene.add_attached_collision_mesh(acm, scale)
    if remove:
        scene.remove_attached_collision_mesh(id)
        scene.remove_collision_mesh(id)
# ---------- end attached ----------
panel_7 = Panel(py_10)

# ----
# Input
x_axis = Curve(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)
y_axis = Curve(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)
y_axis_2 = Curve(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)
x_axis_2 = Curve(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)
plane = PythonScript(plane_axes=[x_axis, y_axis])  # -> plane; inputs plane_axes: list of Curve
# ---------- plane: Python ----------
import Rhino.Geometry as rg

x_axis, y_axis = plane_axes

x_axis = rg.Line(x_axis.PointAtStart, x_axis.PointAtEnd)
y_axis = rg.Line(y_axis.PointAtStart, y_axis.PointAtEnd)

if x_axis.From.DistanceTo(y_axis.From) < 0.01:
    origin = x_axis.From
    xvec = x_axis.Direction
    yvec = y_axis.Direction
elif x_axis.To.DistanceTo(y_axis.To) < 0.01:
    origin = x_axis.To
    xvec = -x_axis.Direction
    yvec = -y_axis.Direction
elif x_axis.From.DistanceTo(y_axis.To) < 0.01:
    origin = x_axis.From
    xvec = x_axis.Direction
    yvec = -y_axis.Direction
elif x_axis.To.DistanceTo(y_axis.From) < 0.01:
    origin = x_axis.To
    xvec = -x_axis.Direction
    yvec = y_axis.Direction

plane = rg.Plane(origin, xvec, yvec)
# ---------- end plane ----------
plane_2 = PythonScript(plane_axes=[x_axis_2, y_axis_2])  # -> plane; inputs plane_axes: list of Curve; same code as plane
end_plane = Plane(plane_2)
start_plane = Plane(plane)

compute = Button()
pln = Plane([start_plane, end_plane])
ik = InverseKinematics(robot=robot, plane=end_plane)  # -> configuration
#   port plane: The plane or frame to calculate the inverse kinematic for.
#   port start_configuration: If passed, calculates the inverse such that the joint positions differ the least from the start_configuration. Defaults to the zero configuration.
#   port group: The planning group used for calculation. Defaults to the robot's main planning group.
#   port configuration: The planning group's configuration.
# ---------- ik: Python ----------
"""
Calculate the robot's inverse kinematic for a given plane.

COMPAS FAB v0.19.1
"""
from ghpythonlib.componentbase import executingcomponent as component

from compas_fab.ghpython.components import coerce_frame


class InverseKinematics(component):
    def RunScript(self, robot, plane, start_configuration, group):
        configuration = None
        if robot and robot.client and robot.client.is_connected and plane:
            frame = coerce_frame(plane)
            configuration = robot.inverse_kinematics(frame, start_configuration, group)
        return configuration
# ---------- end ik ----------
plan_cartesian_motion = PlanCartesianMotion(
    robot=robot,
    planes=start_plane,
    start_configuration=ik,
    group=info.main_group_name,
    attached_collision_meshes=acm,
    compute=Toggle(False))  # -> trajectory; inputs planes: list, attached_collision_meshes: list, path_constraints: list, compute: Boolean
#   port planes: The planes or frames through which the path is defined.
#   port start_configuration: The robot's full configuration, i.e. values for all configurable joints of the entire robot, at the starting position. Defaults to the all-zero configuration.
#   port group: The planning group used for calculation. Defaults to the robot's main planning group.
#   port attached_collision_meshes: A list of attached collision meshes to be included for planning.
#   port path_constraints: Optional constraints that can be imposed along the solution path. Note that path calculation won't work if the start_configuration violates these constraints. Defaults to None.
#   port max_step: The approximate distance between the calculated points. (Defined in the robot's units.) Defaults to 0.01.
#   port compute: If True, calculates a trajectory.
#   port trajectory: The calculated trajectory.
# ---------- plan_cartesian_motion: Python ----------
"""
Calculate a cartesian motion path (linear in tool space).

COMPAS FAB v0.19.1
"""
from ghpythonlib.componentbase import executingcomponent as component
from scriptcontext import sticky as st

from compas_fab.ghpython.components import coerce_frame
from compas_fab.ghpython.components import create_id


class PlanCartesianMotion(component):
    def RunScript(self, robot, planes, start_configuration, group, attached_collision_meshes, path_constraints, max_step, compute):
        print("hi")
        key = create_id(self, 'trajectory')

        max_step = float(max_step) if max_step else 0.01
        path_constraints = list(path_constraints) if path_constraints else None
        attached_collision_meshes = list(attached_collision_meshes) if attached_collision_meshes else None

        if robot and robot.client and robot.client.is_connected and start_configuration and planes and compute:
            frames = [coerce_frame(plane) for plane in planes]
            st[key] = robot.plan_cartesian_motion(frames,
                                                  start_configuration=start_configuration,
                                                  group=group,
                                                  options=dict(
                                                      max_step=max_step,
                                                      path_constraints=path_constraints,
                                                      attached_collision_meshes=attached_collision_meshes
                                                  ))

        trajectory = st.get(key, None)
        print(trajectory)
        return trajectory
# ---------- end plan_cartesian_motion ----------
list_5 = ValueList({"measurement_tool": 0, "Inverse Kinematics": 1}, selected="Inverse Kinematics")
filter_2 = StreamFilter(Gate=list_5, Stream1=ik)
robot_visualize = RobotVisualize(
    robot=robot,
    group=info.main_group_name,
    configuration=filter_2,
    attached_collision_meshes=acm,
    show_visual=Toggle(True),
    show_collision=Toggle(False),
    show_frames=Toggle(False),
    show_base_frame=Toggle(False),
    show_end_effector_frame=Toggle(False),
    show_acm=Toggle(True))  # -> visual, collision, attached_meshes, frames, base_frame, ee_frame; inputs attached_collision_meshes: list, show_visual: Boolean, show_collision: Boolean, show_frames: Boolean, show_base_frame: Boolean, show_end_effector_frame: Boolean, show_acm: Boolean
#   port group: The planning group used for end-effector and base visualization.
#   port configuration: The robot's full configuration.
#   port attached_collision_meshes: A list of attached collision meshes.
#   port show_visual: Whether or not to show the robot's visual meshes.
#   port show_collision: Whether or not to show the robot's collision meshes.
#   port show_frames: Whether or not to show the robot's joint frames.
#   port show_base_frame: Whether or not to show the robot's base frame.
#   port show_end_effector_frame: Whether or not to show the robot's end-effector frame.
#   port show_acm: Whether or not to show the attached collision meshes (if any).
#   port visual: The robot's visual Rhino meshes (if any).
#   port collision: The robot's collision Rhino meshes (if any).
#   port attached_meshes: The attached collision Rhino meshes (if any).
#   port frames: The robot's joint frames as Rhino planes (if any).
#   port base_frame: The robot's base frame as a Rhino plane (if any).
#   port ee_frame: The robot's end-effector frame as a Rhino plane (if any).
# ---------- robot_visualize: Python ----------
"""
Visualizes the robot.

COMPAS FAB v0.19.1
"""
from compas.geometry import Frame
from compas.geometry import Transformation
from compas_ghpython.artists import FrameArtist
from compas_ghpython.artists import MeshArtist
from ghpythonlib.componentbase import executingcomponent as component


class RobotVisualize(component):
    def RunScript(self, robot, group, configuration, attached_collision_meshes, show_visual, show_collision,
                  show_frames, show_base_frame, show_end_effector_frame, show_acm):

        visual = None
        collision = None
        attached_meshes = None
        frames = None
        base_frame = None
        ee_frame = None

        if robot:
            show_visual = True if show_visual is None else show_visual
            configuration = configuration or robot.zero_configuration()

            robot.update(configuration, visual=show_visual, collision=show_collision)
            compas_frames = robot.transformed_frames(configuration, group)

            if show_visual:
                visual = robot.artist.draw_visual()

            if show_collision:
                collision = robot.artist.draw_collision()

            if show_base_frame:
                base_compas_frame = compas_frames[0]
                artist = FrameArtist(base_compas_frame)
                base_frame = artist.draw()

            if show_end_effector_frame:
                ee_compas_frame = robot.forward_kinematics(configuration, group, options=dict(solver='model'))
                artist = FrameArtist(ee_compas_frame)
                ee_frame = artist.draw()

            if show_frames:
                frames = []
                for compas_frame in compas_frames[1:]:
                    artist = FrameArtist(compas_frame)
                    frame = artist.draw()
                    frames.append(frame)

            if show_acm:
                attached_meshes = []
                for acm in attached_collision_meshes:
                    frame = robot.forward_kinematics(configuration, options=dict(solver='model', link_name=acm.link_name))
                    T = Transformation.from_frame_to_frame(Frame.worldXY(), frame)
                    mesh = acm.collision_mesh.mesh.transformed(T)
                    attached_meshes.append(MeshArtist(mesh).draw())

        return (visual, collision, attached_meshes, frames, base_frame, ee_frame)
# ---------- end robot_visualize ----------

jp = GhPythonScript()  # -> configuration_values
# ---------- jp: Python ----------
import math
joint_values = [-3.136, -0.328, -1.218, 3.129, 0.852, 0.008]
#joint_positions = [0] * 6

cart = 0
j_values = [0,0,0,0,0,0]

configuration_values = [cart] + j_values
# ---------- end jp ----------
forward_kinematics = PythonScript(
    robot=robot,
    reset_configuration=Button(),
    configuration_values=jp,
    a_cart=Slider(0, range=0..4.4),
    a_a1=Slider(0, range=-180..180),
    a_a2=Slider(0, range=-90..150),
    a_a3=Slider(0, range=-180..180),
    a_a4=Slider(0, range=-400..400),
    a_a5=Slider(0, range=-125..120),
    a_a6=Slider(0, range=-400..400),
    bang=py_9.bang)  # -> full_configuration; inputs reset_configuration: Boolean, configuration_values: list
# ---------- forward_kinematics: Python ----------
import math
import Grasshopper
from compas.robots import Joint
from compas_fab.robots import Configuration


import math
import Grasshopper
from compas_fab.robots import Configuration

if reset_configuration:
    j = 0
    for i in range(ghenv.Component.Params.Input.Count):
        nslider = ghenv.Component.Params.Input[i].Sources[0]
        if nslider.GetType() == Grasshopper.Kernel.Special.GH_NumberSlider:
            nslider.TrySetSliderValue(configuration_values[j])
            j += 1

    
if robot:
    a_cyl = a_a2 * -0.25
    a_piston = math.radians(a_a2) * 0.15
    joint_positions = [a_cart, a_a1, a_a2, a_cyl, a_a3, a_a4, a_a5, a_a6, a_piston]
    joint_types = robot.get_configurable_joint_types()
    print(joint_types)
    for i, joint_type in enumerate(joint_types):
        if joint_type == Joint.REVOLUTE:
            joint_positions[i] = math.radians(joint_positions[i])
    full_configuration = Configuration(joint_positions, joint_types)
# ---------- end forward_kinematics ----------

# ---- group: inverse kinematics
# IK
py_11 = PythonScript(robot=robot)  # -> configuration
# ---------- py_11: Python ----------
from compas_fab.robots import Configuration

if robot:
    types = robot.get_configurable_joint_types()
    values = [0] * len(types)
    configuration = Configuration(values, types)
    print configuration
    print robot.get_configurable_joint_names()
# ---------- end py_11 ----------
start_configuration = Data(forward_kinematics)
avoid_collisions = BooleanToggle(True)
list_6 = ValueList({"0", "1"}, selected="0")
filter_3 = StreamFilter(Gate=list_6, Stream0=start_configuration, Stream1=py_11)
inverse = GhPythonScript(
    robot=robot,
    group=info.main_group_name,
    plane=start_plane,
    start_configuration=filter_3,
    avoid_collisions_inactive=avoid_collisions)  # -> out, group_configuration, full_configuration
# ---------- inverse: Python ----------
"""Calculate the robot's inverse kinematic for a given plane.
    Inputs:
        robot: The robot
        group: str, optional
            The planning group used for calculation. Defaults to the robot's
            main planning group.
        plane: The plane in world coordinate frame to calculate the inverse for.
        start_configuration: :class:`compas_fab.robots.Configuration`, optional
            If passed, the inverse will be calculated such that the calculated
            joint positions differ the least from the start_configuration.
            Defaults to the init configuration.
        avoid_collisions: bool, optional
            Whether or not to avoid collisions. Defaults to True.
    Output:
        group_configuration: The group configuration
        full_configuration: The full configuration
"""
from __future__ import print_function
import logging

from compas.geometry import Frame

LOGGER = logging.getLogger('roslibpy')

frame = Frame(plane.Origin, plane.XAxis, plane.YAxis)

if robot.attached_tool:
    frame = robot.from_tcf_to_t0cf([frame])[0]
    #frame = robot.from_attached_tool_to_tool0([frame])[0]

#print(frame)

if robot and robot.client:
    if robot.client.is_connected:
        """
        full_configuration = robot.inverse_kinematics(frame,
                                                      start_configuration,
                                                      group=group,
                                                      options={
                                                        'avoid_collisions':avoid_collisions,
                                                        'return_full_configuration':True,
                                                      })"""
        full_configuration = robot.inverse_kinematics(frame,
                                                      start_configuration,
                                                      group=group,                                                      
                                                      return_full_configuration=True                                                      
                                                      )

        group_configuration = robot.get_group_configuration(group, full_configuration)
        print(group_configuration)
    else:
        print("Robot client is not connected")
# ---------- end inverse ----------
panel_8 = Panel(inverse.out)

# ---- group: plan motion
# Plan motion
# If you specify the tolerance vector with [360, 1, 1], it means that
#     the frame's y-axis and z-axis are allowed to rotate about the x-axis by an
#     angle of 360 degrees, whereas the x-axis can only change 1 degree.
group = Data(info.main_group_name)
compute_2 = Button()
list_7 = ValueList({"don't use attached collision mesh": 0, "use attached collision mesh": 1}, selected="don't use attached collision mesh")
py_12 = PythonScript(robot=robot)  # -> configuration
# ---------- py_12: Python ----------
from compas_fab.robots import Configuration

if robot:
    types = robot.get_configurable_joint_types()
    values = [0] * len(types)

    configuration = Configuration(values, types)
    print configuration
# ---------- end py_12 ----------
start_configuration_2 = Data(inverse.full_configuration)
python_2 = PythonScript(
    robot=robot,
    group=group,
    goal_plane=end_plane,
    tolerance_position=Slider(0.001, range=0..0.001),
    tolerance_xaxis_deg=Slider(1, range=1..360),
    tolerance_yaxis_deg=Slider(1, range=1..360),
    tolerance_zaxis_deg=Slider(1, range=1..360))  # -> goal_constraints
# ---------- python_2: Python ----------
import math
from compas.geometry import Frame

frame = Frame(goal_plane.Origin, goal_plane.XAxis, goal_plane.YAxis)
if robot.attached_tool:
    frame = robot.from_tcf_to_t0cf([frame])[0]

tolerances_axes = [math.radians(tolerance_xaxis_deg), math.radians(tolerance_yaxis_deg), math.radians(tolerance_zaxis_deg)]

if robot:
    goal_constraints = robot.constraints_from_frame(frame, tolerance_position, tolerances_axes, group)
# ---------- end python_2 ----------
list_8 = ValueList({"0", "1"}, selected="1")
list_9 = ValueList({"RRT", "RRT*": "RRTStar", "EST", "PRM": "RPM", "PRM*": "RPMStar", "SPARS"}, selected="RRT")
filter_4 = StreamFilter(Gate=list_8, Stream0=start_configuration_2, Stream1=py_12)
filter_5 = StreamFilter(Gate=list_7)
plan_motion = PythonScript(
    robot=robot,
    group=group,
    start_configuration=filter_4,
    goal_constraints=python_2,
    planner_id=list_9,
    attached_collision_meshes=filter_5,
    compute=compute_2)  # -> out, trajectory; inputs goal_constraints: list, attached_collision_meshes: list
# ---------- plan_motion: Python ----------
"""Calculates a motion path.
    Inputs:
        robot: The robot
        group: str, optional
            The planning group used for calculation. Defaults to the robot's
            main planning group.
        start_configuration: :class:`compas_fab.robots.Configuration`, optional
            The robot's full configuration, i.e. values for all configurable
            joints of the entire robot cell, at the starting position. Defaults
            to the all-zero configuration.
        goal_constraints: list of :class:`compas_fab.robots.Constraint`
            The goal to be achieved, defined in a set of constraints.
            Constraints can be very specific, for example defining value domains
            for each joint, such that the goal configuration is included,
            or defining a volume in space, to which a specific robot link (e.g.
            the end-effector) is required to move to.
        planner_id: str
            The name of the algorithm used for path planning. Defaults to 'RRT'.
        attached_collision_meshes: list of :class:`compas_fab.robots.AttachedCollisionMesh`
            Defaults to None.
        compute: bool
            Press to calculate solution.
    Output:
        :class:`compas_fab.robots.JointTrajectory`
            The calculated trajectory.
"""
from __future__ import print_function
import logging
import scriptcontext as sc

guid = str(ghenv.Component.InstanceGuid)
response_key = "response_" + guid
if response_key not in sc.sticky:
    sc.sticky[response_key] = None

LOGGER = logging.getLogger('roslibpy')

def configuration_correct(old_values):
    vals = []
    types = []
    for i in range(0,9):
        if i==0 or i==8:
            types.append(2)
        else:
            types.append(0)
        if i < 3:
            vals.append(old_values[i])
        elif i == 3 or i == 8:
            vals.append(0.0)
        else:
            vals.append(old_values[i-1])
    return Configuration(vals, types)


if robot and robot.client and start_configuration and compute:
    if robot.client.is_connected:
        
        sc.sticky[response_key] = robot.plan_motion(goal_constraints,
                                                    start_configuration,
                                                    group,
                                                    options={
                                                        'planner_id': str(planner_id),
                                                        'attached_collision_meshes': list(attached_collision_meshes),
                                                    })
    else:
        print("Robot client is not connected.")

trajectory = sc.sticky[response_key]
# ---------- end plan_motion ----------
vis = PythonScript(response=plan_motion.trajectory)  # -> P, V, A, time
# ---------- vis: Python ----------
from compas_ghpython import list_to_ghtree

if response:

    positions = []
    velocities = []
    accelerations = []
    time_from_start = []

    for p in response.points:
        positions.append(p.positions)
        velocities.append(p.velocities)
        accelerations.append(p.accelerations)
        time_from_start.append(p.time_from_start.seconds)

    P = list_to_ghtree(list(zip(*positions)))
    V = list_to_ghtree(list(zip(*velocities)))
    A = list_to_ghtree(list(zip(*accelerations)))

    time = time_from_start[-1]
    print time
# ---------- end vis ----------
time_s = Panel(vis.time)
prismatic = QuickGraph(vis.P, SortOrder=0)
panel_9 = Panel(plan_motion.out)
panel_10 = Panel("positions")
py_13 = PythonScript(robot=robot, group=group, trajectory=plan_motion.trajectory)  # -> configurations, full_configurations, fraction, time
# ---------- py_13: Python ----------
if trajectory:
    configurations = trajectory.points
    full_configurations = [robot.merge_group_with_full_configuration(c, trajectory.start_configuration, group) for c in configurations]
    start_configuration = trajectory.start_configuration
    fraction = trajectory.fraction
    time = trajectory.time_from_start
# ---------- end py_13 ----------
fraction = Panel(py_13.fraction)
time_s_2 = Panel(py_13.time)
graph = QuickGraph(vis.A, SortOrder=0)
graph_2 = QuickGraph(vis.V, SortOrder=0)
path_2 = GhPythonScript(robot=robot, full_configurations=py_13.full_configurations)  # -> frames, P; inputs full_configurations: list
# ---------- path_2: Python ----------
import Rhino.Geometry as rg

frames = []

if robot:
    for c in full_configurations:
        if c:
            frame_WCF = robot.forward_kinematics(c, group, options={'backend':'model'})

            frames.append(frame_WCF)

    P = [rg.Point3d(*list(frame.point)) for frame in frames]
# ---------- end path_2 ----------
idx = Slider(0, range=0..1)
animate = PythonScript(robot=robot, group=group, configurations=py_13.full_configurations, idx=idx)  # -> configuration; inputs configurations: list, idx: Int32
# ---------- animate: Python ----------
import Grasshopper
from compas_fab.utilities import map_range
from compas_fab.robots import Configuration

count = len(configurations)

for i in range(ghenv.Component.Params.Input.Count):
    nslider = ghenv.Component.Params.Input[i].Sources[0]
    if nslider.GetType() == Grasshopper.Kernel.Special.GH_NumberSlider and nslider.NickName == 'idx':
        nslider.Slider.Maximum = max(count - 1, 1)
        nslider.Slider.Minimum = 0

if count and robot and configurations[0] != None:
    configuration = configurations[idx]
# ---------- end animate ----------
panel_11 = Panel("velocities")
panel_12 = Panel("accelerations")
pline = PolyLine(Vertices=path_2.P, Closed=False)
preview = CustomPreview(Geometry=[path_2.P, pline], Material=ColourSwatch(SwatchColor=RGB(59, 161, 95)))

# ---- group: cartesian motion
# Plan cartesian motion
compute_3 = Button()
list_10 = ValueList({"don't use attached collision mesh": 0, "use attached collision mesh": 1}, selected="don't use attached collision mesh")
group_2 = Data(info.main_group_name)
py_14 = PythonScript(robot=robot)  # -> configuration; same code as py_12
start_configuration_3 = Data(inverse.full_configuration)
list_11 = ValueList({"0", "1"}, selected="1")
avoid_collisions_2 = BooleanToggle(True)
py_15 = PythonScript(start_plane=start_plane, end_plane=end_plane)  # -> planes
# ---------- py_15: Python ----------
planes = [start_plane, end_plane]
print planes
# ---------- end py_15 ----------
filter_6 = StreamFilter(Gate=list_10)
filter_7 = StreamFilter(Gate=list_11, Stream0=start_configuration_3, Stream1=py_14)
plan_cartesian_motion_2 = PythonScript(
    robot=robot,
    group=group_2,
    planes=py_15,
    start_configuration=filter_7,
    max_step=Slider(0.01, range=0..0.01),
    avoid_collisions=avoid_collisions_2,
    attached_collision_meshes=filter_6,
    compute=compute_3)  # -> out, trajectory; inputs planes: list, avoid_collisions: Boolean, attached_collision_meshes: list
# ---------- plan_cartesian_motion_2: Python ----------
"""Calculates a cartesian motion path (linear in tool space).
    Inputs:
        robot: The robot
        group: str, optional
            The planning group used for calculation. Defaults to the robot's
            main planning group.
        planes: The planes in world coordinate frame through which the path is defined.
        start_configuration: :class:`compas_fab.robots.Configuration`, optional
            The robot's full configuration, i.e. values for all configurable
            joints of the entire robot cell, at the starting position. Defaults
            to the all-zero configuration.
        max_step: float
            The approximate distance between the calculated points. (Defined in
            the robot's units)
        avoid_collisions: bool, optional
            Whether or not to avoid collisions. Defaults to True.
        attached_collision_meshes: list of :class:`compas_fab.robots.AttachedCollisionMesh`
            Defaults to None.
        compute: bool
            Press to calculate solution.
    Output:
        :class:`compas_fab.robots.JointTrajectory`
            The calculated trajectory.
"""
from __future__ import print_function
import logging
import scriptcontext as sc

from compas.geometry import Frame

LOGGER = logging.getLogger('roslibpy')

guid = str(ghenv.Component.InstanceGuid)
response_key = "response_" + guid
if response_key not in sc.sticky:
    sc.sticky[response_key] = None

frames = [Frame(plane.Origin, plane.XAxis, plane.YAxis) for plane in planes]

if robot.attached_tool:
    frames = [robot.from_tcf_to_t0cf([frame])[0] for frame in frames]


if robot and robot.client and start_configuration and compute:
    if robot.client.is_connected:
        
        sc.sticky[response_key] = robot.plan_cartesian_motion(frames,
                                                              start_configuration=start_configuration,
                                                              group=group,
                                                              options={
                                                                'max_step': float(max_step),
                                                                'avoid_collisions': bool(avoid_collisions),
                                                                'attached_collision_meshes': list(attached_collision_meshes),
                                                              })
    else:
        print("Robot client is not connected")

trajectory = sc.sticky[response_key]
# ---------- end plan_cartesian_motion_2 ----------
vis_2 = PythonScript(response=plan_cartesian_motion_2.trajectory)  # -> P, V, A
# ---------- vis_2: Python ----------
from compas_ghpython import list_to_ghtree

if response:
    #print response.points
    positions = []
    velocities = []
    accelerations = []

    for p in response.points:
        positions.append(p.positions)
        velocities.append(p.velocities)
        accelerations.append(p.accelerations)
    #print positions
    P = list_to_ghtree(list(zip(*positions)))
    V = list_to_ghtree(list(zip(*velocities)))
    A = list_to_ghtree(list(zip(*accelerations)))
# ---------- end vis_2 ----------
prismatic_2 = QuickGraph(vis_2.P, SortOrder=0)
py_16 = PythonScript(robot=robot, group=group_2, trajectory=plan_cartesian_motion_2.trajectory)  # -> configurations, full_configurations, fraction, time; same code as py_13
fraction_2 = Panel(py_16.fraction)
time_s_3 = Panel(py_16.time)
graph_3 = QuickGraph(vis_2.V, SortOrder=0)
graph_4 = QuickGraph(vis_2.A, SortOrder=0)
idx_2 = Slider(1, range=0..1)
path_3 = GhPythonScript(robot=robot, group=group_2, full_configurations=py_16.full_configurations)  # -> frames, P; inputs full_configurations: list
# ---------- path_3: Python ----------
import Rhino.Geometry as rg

frames = []

if robot:
    for c in full_configurations:
        
        if c:
            frame_WCF = robot.forward_kinematics(c, group, options={'backend':'model'})
            frames.append(frame_WCF)

    P = [rg.Point3d(*list(frame.point)) for frame in frames]
# ---------- end path_3 ----------
animate_2 = PythonScript(robot=robot, group=group_2, configurations=py_16.full_configurations, idx=idx_2)  # -> configuration; inputs configurations: list, idx: Int32; same code as animate
pline_2 = PolyLine(Vertices=path_3.P, Closed=False)
preview_2 = CustomPreview(Geometry=[path_3.P, pline_2], Material=ColourSwatch(SwatchColor=RGB(59, 137, 161)))

# ----
preview_3 = CustomPreview(Geometry=robot_visualize.visual, Material=ColourSwatch(SwatchColor=RGB(255, 255, 255)))

# ----
# Configuration
panel_16 = Panel(plan_cartesian_motion_2.out)

# ----
# Visualisation
# Select configuration input: from fk, ik, path, or from real robot
list_12 = ValueList({"0 forward_kinematics": 0, "1 inverse_kinematics": 1, "2 cartesian motion": 2, "3 free-space motion": 3}, selected="1 inverse_kinematics")
filter_8 = StreamFilter(Gate=list_12, Stream0=forward_kinematics, Stream1=inverse.full_configuration, Stream2=animate_2, Stream3=animate)
show_end_effector_frame = BooleanToggle(True)
show_base_frame = BooleanToggle(True)
show_collision = BooleanToggle(False)
show_frames = BooleanToggle(True)
show_visual = BooleanToggle(True)
visualize = PythonScript(
    robot=robot,
    full_configuration=filter_8,
    show_visual=show_visual,
    show_collision=show_collision,
    show_frames=show_frames,
    show_base_frame=show_base_frame,
    show_end_effector_frame=show_end_effector_frame)  # -> out, visual, collision, frames, base_frame_WCF, ee_frame_WCF
# ---------- visualize: Python ----------
"""Calculates a cartesian motion path (linear in tool space).
    Inputs:
        robot: The robot
        group: str
            The planning group used for visualisation
        full_configuration: :class:`compas_fab.robots.Configuration`
            The robot's full configuration to display.
        show_visual: bool
           Whether or not to show the robot's visual meshes.
        show_collision: bool
           Whether or not to show the robot's collision meshes.
        show_frames: bool
           Whether or not to show the robot's joint frames.
        show_base_frame: bool
           Whether or not to show the robot's base frame.
        show_end_effector_frame: bool
            Whether or not to show the robot's end-effector frame.
    Output:
        visual: The robot's visual meshes.
        collision: The robot's collision meshes.
        frames: The robot's joint frames.
        base_frame_WCF: The robot's base frame.
        ee_frame_WCF: The robot's end-effector frame.
"""
from __future__ import print_function
import ghpythonlib.components as ghcomp
from compas.geometry import Transformation, Frame
#from compas_ghpython.geometry import xform_from_transformation


def update(configuration, visual=True, collision=True):
    """Triggers the update of the robot geometry.
    Parameters
    ----------
    configuration : :class:`compas_fab.robots.Configuration`
        Instance of the configuration (joint state) to move to.
    visual : bool, optional
        ``True`` if the visual geometry should be also updated, otherwise ``False``.
        Defaults to ``True``.
    collision : bool, optional
        ``True`` if the collision geometry should be also updated, otherwise ``False``.
        Defaults to ``True``.
    """
    positions = configuration.values
    names = configuration.joint_names or robot.model.get_configurable_joint_names()
    if len(names) != len(configuration.values):
        raise ValueError("Please pass a configuration with %d joint_names." % len(positions))
    joint_state = dict(zip(names, positions))
    transformations = robot.model.compute_transformations(joint_state)
    for j in robot.model.iter_joints():
        link = j.child_link
        for item in link.visual:
            robot.artist._apply_transformation_on_transformed_link(item, transformations[j.name])
        if collision:
            for item in link.collision:
                # some links have only collision geometry, not visual. These meshes have not been loaded.
                if item.native_geometry:
                    robot.artist._apply_transformation_on_transformed_link(item, transformations[j.name])
    
    if robot.attached_tool:
        name = 'joint_6'
        frame = robot.forward_kinematics(configuration, options=dict(solver='model', link_name=robot.attached_tool.link_name))
        robot.artist.update_tool(visual=visual, collision=collision, transformation=Transformation.from_frame_to_frame(Frame.worldXY(), frame))
        #robot.artist._apply_transformation_on_transformed_link(robot.attached_tool, transformations[name])

if robot and full_configuration:
    #robot.update(full_configuration, visual=show_visual, collision=show_collision)
    update(full_configuration, visual=show_visual, collision=show_collision) #fast hack, because of a bug in compas_fab
    print(full_configuration)

    if show_visual:
        visual = robot.draw_visual()
        #print(len([v for v in visual]))
        #visual = ([v for v in visual])
        #T = robot.transformation_RCF_WCF()
        #visual = ghcomp.Transform(visual, xform_from_transformation(T))

    if show_collision:
        collision = robot.draw_collision()

    if show_frames:
        axes = robot.transformed_axes(full_configuration)
        frames = robot.transformed_frames(full_configuration)

    if show_base_frame:
        base_frame_WCF = robot.get_base_frame(group, full_configuration)

    if show_end_effector_frame:
        ee_frame_WCF = robot.get_end_effector_frame(group, full_configuration)
        if robot.attached_tool:
            ee_frame_WCF = robot.from_tcf_to_t0cf([ee_frame_WCF])[0]
        print("End-effector", ee_frame_WCF)
# ---------- end visualize ----------
py_17 = PythonScript(robot=robot)  # -> scale
# ---------- py_17: Python ----------
if robot:
    scale = robot.scale_factor * 0.1
else:
    scale = 1.
# ---------- end py_17 ----------
draw = GhPythonScript(frames=[visualize.frames, visualize.ee_frame_WCF, visualize.base_frame_WCF], scale=py_17)  # -> P, V, C, W; inputs frames: list
# ---------- draw: Python ----------
from System.Drawing import Color
from compas_ghpython import draw_frame

red = Color.FromArgb(255, 0, 0)
green = Color.FromArgb(0, 255, 0)
blue = Color.FromArgb(0, 0, 255)

P = []
V = []
C = []

scale = float(scale)

for frame in frames:
    if not frame:
        continue
    plane = draw_frame(frame)
    P += [plane.Origin] * 3
    V.append(plane.XAxis * scale)
    V.append(plane.YAxis * scale)
    V.append(plane.ZAxis * scale)
    C += [red, green, blue]

W = 3
# ---------- end draw ----------
draw_2 = GhPythonScript(frames=visualize.base_frame_WCF, scale=py_17)  # -> P, V, C, W; inputs frames: list; same code as draw
geo_3 = Geometry(visualize.visual)
geo_4 = Geometry(visualize.collision)
preview_4 = CustomPreview(Geometry=geo_3, Shader=ColourSwatch(SwatchColor=RGB(255, 163, 163)))
vdisex = VectorDisplayEx(Point=draw_2.P, Vector=draw_2.V, Colour=draw_2.C, Width=draw_2.W)
vdisex_2 = VectorDisplayEx(Point=draw.P, Vector=draw.V, Colour=draw.C, Width=draw.W)
