# Grasshopper definition robotic_setup_fabtory_simulation.ghx (Grasshopper 1.0.7)

reload = Button()
path = PythonScript()  # -> HERE, DATA, ROBOT_DESCRIPTION
# ---------- path: Python ----------
import os

HERE = os.path.dirname(ghdoc.Path)
DATA = os.path.abspath(os.path.join(HERE, "..", "data"))
ROBOT_DESCRIPTION = os.path.abspath(os.path.join(DATA, "robot_description"))

print(HERE)
print(DATA)
print(ROBOT_DESCRIPTION)
# ---------- end path ----------
py = PythonScript(reload=reload)
# ---------- py: Python ----------
if reload:
    from compas_ghpython import unload_modules
    unload_modules('compas')
    unload_modules("compas_fab")
    unload_modules("ur_online_control")
# ---------- end py ----------

# ----
# Create custom collision objects (walls, floor, workobjects, etc.)
number_slider = Slider(0, range=0..5)
pt = Point([<point referenced from the Rhino model> x2])
# Plan Motion
# #TODO
xz = XZPlane(Origin=pt)
item = ListItem(List=xz, Index=number_slider, Wrap=True)
list = ValueList({"0", "1"}, selected="0")

x_axis = Curve(<curve referenced from the Rhino model>)
y_axis = Curve(<curve referenced from the Rhino model>)
plane = PythonScript(plane_axes=[x_axis, y_axis])  # -> plane; inputs plane_axes: list of Curve
# ---------- plane: Python ----------
import Rhino.Geometry as rg

x_axis, y_axis = plane_axes

x_axis = rg.Line(x_axis.PointAtStart, x_axis.PointAtEnd)
y_axis = rg.Line(y_axis.PointAtStart, y_axis.PointAtEnd)

if x_axis.From.DistanceTo(y_axis.From) < 0.01:
    origin = x_axis.From
    xvec = x_axis.Direction
    yvec = y_axis.Direction
elif x_axis.To.DistanceTo(y_axis.To) < 0.01:
    origin = x_axis.To
    xvec = -x_axis.Direction
    yvec = -y_axis.Direction
elif x_axis.From.DistanceTo(y_axis.To) < 0.01:
    origin = x_axis.From
    xvec = x_axis.Direction
    yvec = -y_axis.Direction
elif x_axis.To.DistanceTo(y_axis.From) < 0.01:
    origin = x_axis.To
    xvec = -x_axis.Direction
    yvec = y_axis.Direction

plane = rg.Plane(origin, xvec, yvec)
# ---------- end plane ----------

avoid_collisions = BooleanToggle(False)
compute = Button()
compute_2 = BooleanToggle(False)
compute_3 = Button()
list_2 = ValueList({"RRT", "RRT*": "RRTStar", "EST", "PRM": "RPM", "PRM*": "RPMStar", "SPARS"}, selected="RRT")

# ----
# Robot Model
# Load robot from local package
panel = Panel("abb_fabtory.urdf")
list_3 = ValueList({"abb_fabtory"}, selected="abb_fabtory")
py_2 = PythonScript()  # -> packages
# ---------- py_2: Python ----------
packages = ["abb_irb6700_support", "abb_end_effectors", "abb_fabtory"]
# ---------- end py_2 ----------
py_3 = PythonScript(path=path.ROBOT_DESCRIPTION, package=list_3, urdf_name=panel, srdf_name="abb_fabtory.srdf")  # -> package_path, urdf_filename, srdf_filename
# ---------- py_3: Python ----------
import os

package_path = os.path.join(path, package)
print(package_path)

urdf_filename = os.path.join(package_path, "urdf", urdf_name)
srdf_filename = os.path.join(package_path, srdf_name)

assert os.path.isfile(urdf_filename)
assert os.path.isfile(srdf_filename)
# ---------- end py_3 ----------
py_4 = PythonScript(path=path.ROBOT_DESCRIPTION, packages=py_2)  # -> loaders; inputs packages: list
# ---------- py_4: Python ----------
from compas.robots import LocalPackageMeshLoader

loaders = []
print packages


for package in packages:
    loaders.append(LocalPackageMeshLoader(path, package))
# ---------- end py_4 ----------
load = Button()
units = ValueList({"m": 1, "cm": 100, "mm": 1000}, selected="m")
create = PythonScript(loaders=py_4, urdf_filename=py_3.urdf_filename, srdf_filename=py_3.srdf_filename, scale_factor=units, load=load)  # -> out, robot; inputs loaders: list
# ---------- create: Python ----------
import os
from scriptcontext import sticky as st

import compas

from compas.robots import RobotModel
from compas.robots import LocalPackageMeshLoader

from compas_fab.robots import Robot
from compas_fab.robots import RobotSemantics

from compas_fab.ghpython import RobotArtist

compas.PRECISION = '12f'

# store robot in component
guid = str(ghenv.Component.InstanceGuid)
robot_key = "robot_" + guid

if robot_key not in st:
    st[robot_key] = None

print loaders

if load:
    model = RobotModel.from_urdf_file(urdf_filename)
    
    model.load_geometry(*loaders)
    artist = RobotArtist(model)
    semantics = RobotSemantics.from_srdf_file(srdf_filename, model)
    robot = Robot(model, artist, semantics, client=None)
    
    st[robot_key] = robot

robot = st[robot_key]


if robot:
    robot.scale(scale_factor)
# ---------- end create ----------

# ----
# ROS client
panel_2 = Panel("9090")
ros = ROSConnect(ip="127.0.0.1", port=panel_2, connect=Toggle(True))  # -> ros_client, is_connected; inputs port: Int32, connect: Boolean
#   port ip: The ip address ROS. Defaults to 127.0.0.1.
#   port port: The port of ROS. Defaults to 9090.
#   port connect: If True, connects to ROS. If False, disconnects from ROS. Defaults to False.
#   port ros_client: The ROS client.
#   port is_connected: True if connection established.
# ---------- ros: Python ----------
"""
Connect or disconnect to ROS.

COMPAS FAB v0.19.1
"""
from ghpythonlib.componentbase import executingcomponent as component
from scriptcontext import sticky as st

from compas_fab.backends import RosClient
from compas_fab.ghpython.components import create_id


class ROSConnect(component):
    def RunScript(self, ip, port, connect):
        ros_client = None

        ip = ip or '127.0.0.1'
        port = port or 9090

        key = create_id(self, 'ros_client')
        ros_client = st.get(key, None)

        if ros_client:
            st[key].close()
        if connect:
            st[key] = RosClient(ip, port)
            st[key].run(5)

        ros_client = st.get(key, None)
        is_connected = ros_client.is_connected if ros_client else False
        return (ros_client, is_connected)
# ---------- end ros ----------
is_connected = Panel(ros.is_connected)
set = PythonScript(robot=create.robot, client=ros.ros_client)  # -> robot
# ---------- set: Python ----------
if robot and client:
    robot.client = client
# ---------- end set ----------
robot = Data(set)

# ----
# Tool
# #TODO
# Scene
list_4 = ValueList({"measurement_tool": 0, "area_grip": 1, "concrete_extruder": 2}, selected="concrete_extruder")
panel_3 = Panel("Attach a custom tool")
# #TODO
tools = Tools(G=list_4)
remove = Button()
add = Button()
attach_remove = PythonScript(robot=robot, tool=tools, attach=add, remove=remove)  # -> out, bang
# ---------- attach_remove: Python ----------
if attach:
    robot.attach_tool(tool)
if remove:
    robot.detach_tool()
# ---------- end attach_remove ----------

info = PythonScript(robot=robot, redraw=attach_remove.bang)  # -> out, main_group_name
# ---------- info: Python ----------
if robot:
    robot.info()
    main_group_name = robot.main_group_name
# ---------- end info ----------

panel_4 = Panel(info.out)
py_5 = PythonScript(robot=robot)  # -> zero_configuration
# ---------- py_5: Python ----------
from compas_fab.robots import Configuration

if robot:
    types = robot.get_configurable_joint_types()
    values = [0] * len(types)
    configuration = Configuration(values, types)
    print configuration
    print robot.get_configurable_joint_names()
# ---------- end py_5 ----------

# ----
# Forward Kinematics
number_slider_2 = Slider(2.267, range=0..4.2)
jp = GhPythonScript()  # -> configuration_values
# ---------- jp: Python ----------
import math
joint_values = [-3.136, -0.328, -1.218, 3.129, 0.852, 0.008]
#joint_positions = [0] * 6

cart = 0
j_values = [0,0,0,0,0,0]

configuration_values = [cart] + j_values
# ---------- end jp ----------
reset = Button()
forward_kinematics = PythonScript(
    robot=robot,
    reset_configuration=reset,
    configuration_values=jp,
    a_cart=number_slider_2,
    a_a1=Slider(-77.2, range=-180..180),
    a_a2=Slider(41.3, range=-90..150),
    a_a3=Slider(0, range=-180..180),
    a_a4=Slider(0, range=-400..400),
    a_a5=Slider(0, range=-125..120),
    a_a6=Slider(0, range=-400..400))  # -> full_configuration_fk; inputs reset_configuration: Boolean, configuration_values: list
# ---------- forward_kinematics: Python ----------
import math
import Grasshopper
from compas.robots import Joint
from compas_fab.robots import Configuration

if reset_configuration:
    j = 0
    for i in range(ghenv.Component.Params.Input.Count):
        nslider = ghenv.Component.Params.Input[i].Sources[0]
        if nslider.GetType() == Grasshopper.Kernel.Special.GH_NumberSlider:
            nslider.TrySetSliderValue(configuration_values[j])
            j += 1

    
if robot:
    #a_cyl = a_a2 * -0.25
    #a_piston = math.radians(a_a2) * 0.15
    #joint_positions = [a_cart, a_a1, a_a2, a_cyl, a_a3, a_a4, a_a5, a_a6, a_piston]
    joint_positions = [a_cart, a_a1, a_a2, a_a3, a_a4, a_a5, a_a6]
    joint_types = robot.get_configurable_joint_types()
    print(joint_types)
    for i, joint_type in enumerate(joint_types):
        if joint_type == Joint.REVOLUTE:
            joint_positions[i] = math.radians(joint_positions[i])
        if joint_type == Joint.PRISMATIC:
            joint_positions[i] = joint_positions[i]
    full_configuration_fk = Configuration(joint_positions, joint_types)
# ---------- end forward_kinematics ----------

# ----
# Plan Cartesian Motion
py_6 = PythonScript(robot=robot)  # -> zero_configuration; same code as py_5
fk_configuration = Data(forward_kinematics)
list_5 = ValueList({"0", "1"}, selected="0")
filter = StreamFilter(Gate=list_5, Stream0=fk_configuration, Stream1=py_6)

fk_configuration_2 = Data(forward_kinematics)
constraints_from_plane = ConstraintsFromPlane(
    robot=robot,
    plane=item,
    group=info.main_group_name,
    tolerance_position=Slider(0.001, range=0..0.001),
    tolerance_xaxis=Slider(1, range=1..360),
    tolerance_yaxis=Slider(1, range=1..360),
    tolerance_zaxis=Slider(1, range=1..360))  # -> constraints
#   port plane: The plane or frame from which we create position and orientation constraints.
#   port group: The planning group for which we specify the constraint. Defaults to the robot's main planning group.
#   port tolerance_position: The allowed tolerance to the frame's position (defined in the robot's units). Defaults to 0.001
#   port tolerance_xaxis: The allowed tolerance of the frame's X-axis in degrees.
#   port tolerance_yaxis: The allowed tolerance of the frame's Y-axis in degrees.
#   port tolerance_zaxis: The allowed tolerance of the frame's Z-axis in degrees.
#   port constraints: A list containing a position and an orientation constraint.
# ---------- constraints_from_plane: Python ----------
"""
Create a position and an orientation constraint from a plane calculated for the group's end-effector link.

COMPAS FAB v0.19.1
"""
import math

from ghpythonlib.componentbase import executingcomponent as component

from compas_fab.ghpython.components import coerce_frame


class ConstraintsFromPlane(component):
    def RunScript(self, robot, plane, group, tolerance_position, tolerance_xaxis, tolerance_yaxis, tolerance_zaxis):
        goal_constraints = None
        if robot and plane:
            tolerance_position = tolerance_position or 0.001
            tolerance_xaxis = tolerance_xaxis or 1.
            tolerance_yaxis = tolerance_yaxis or 1.
            tolerance_zaxis = tolerance_zaxis or 1.

            frame = coerce_frame(plane)
            tolerances_axes = [math.radians(tolerance_xaxis), math.radians(tolerance_yaxis), math.radians(tolerance_zaxis)]
            goal_constraints = robot.constraints_from_frame(frame, tolerance_position, tolerances_axes, group)

        return goal_constraints
# ---------- end constraints_from_plane ----------

# ----
# Inverse Kinematics
avoid_collisions_2 = BooleanToggle(True)
inverse = GhPythonScript(robot=robot, group=info.main_group_name, plane=item, start_configuration=filter, avoid_collisions=avoid_collisions_2)  # -> out, group_configuration, full_configuration_ik
# ---------- inverse: Python ----------
"""Calculate the robot's inverse kinematic for a given plane.
    Inputs:
        robot: The robot
        group: str, optional
            The planning group used for calculation. Defaults to the robot's
            main planning group.
        plane: The plane in world coordinate frame to calculate the inverse for.
        start_configuration: :class:`compas_fab.robots.Configuration`, optional
            If passed, the inverse will be calculated such that the calculated
            joint positions differ the least from the start_configuration.
            Defaults to the init configuration.
        avoid_collisions: bool, optional
            Whether or not to avoid collisions. Defaults to True.
    Output:
        group_configuration: The group configuration
        full_configuration: The full configuration
"""
from __future__ import print_function
import logging

from compas.geometry import Frame

LOGGER = logging.getLogger('roslibpy')

frame = Frame(plane.Origin, plane.XAxis, plane.YAxis)

if robot.attached_tool:
    frame = robot.from_tcf_to_t0cf([frame])[0]
    #frame = robot.from_attached_tool_to_tool0([frame])[0]

#print(frame)

if robot and robot.client:
    if robot.client.is_connected:
        full_configuration_ik = robot.inverse_kinematics(frame,
                                                      start_configuration,
                                                      group=group,
                                                      options={
                                                        'avoid_collisions':avoid_collisions,
                                                        'return_full_configuration':True,
                                                      })

        group_configuration = robot.get_group_configuration(group, full_configuration_ik)
        print(group_configuration)
    else:
        print("Robot client is not connected")
# ---------- end inverse ----------

filter_2 = StreamFilter(Gate=list, Stream0=fk_configuration_2, Stream1=py_5)
plan_cartesian_motion = PlanCartesianMotion(robot=robot, planes=xz, start_configuration=filter_2, group=info.main_group_name, compute=compute)  # -> trajectory; inputs planes: list, attached_collision_meshes: list, path_constraints: list, compute: Boolean
#   port planes: The planes or frames through which the path is defined.
#   port start_configuration: The robot's full configuration, i.e. values for all configurable joints of the entire robot, at the starting position. Defaults to the all-zero configuration.
#   port group: The planning group used for calculation. Defaults to the robot's main planning group.
#   port attached_collision_meshes: A list of attached collision meshes to be included for planning.
#   port path_constraints: Optional constraints that can be imposed along the solution path. Note that path calculation won't work if the start_configuration violates these constraints. Defaults to None.
#   port max_step: The approximate distance between the calculated points. (Defined in the robot's units.) Defaults to 0.01.
#   port compute: If True, calculates a trajectory.
#   port trajectory: The calculated trajectory.
# ---------- plan_cartesian_motion: Python ----------
"""
Calculate a cartesian motion path (linear in tool space).

COMPAS FAB v0.19.1
"""
from ghpythonlib.componentbase import executingcomponent as component
from scriptcontext import sticky as st

from compas_fab.ghpython.components import coerce_frame
from compas_fab.ghpython.components import create_id


class PlanCartesianMotion(component):
    def RunScript(self, robot, planes, start_configuration, group, attached_collision_meshes, path_constraints, max_step, compute):

        key = create_id(self, 'trajectory')

        max_step = float(max_step) if max_step else 0.01
        path_constraints = list(path_constraints) if path_constraints else None
        attached_collision_meshes = list(attached_collision_meshes) if attached_collision_meshes else None

        if robot and robot.client and robot.client.is_connected and start_configuration and planes and compute:
            print(start_configuration)
            frames = [coerce_frame(plane) for plane in planes]            
            st[key] = robot.plan_cartesian_motion(frames,
                                                  start_configuration=start_configuration,
                                                  group=group,
                                                  options=dict(
                                                      max_step=max_step,
                                                      path_constraints=path_constraints,
                                                      attached_collision_meshes=attached_collision_meshes
                                                  ))

        trajectory = st.get(key, None)
        return trajectory
# ---------- end plan_cartesian_motion ----------
plan_motion = PlanMotion(
    robot=robot,
    goal_constraints=constraints_from_plane,
    start_configuration=filter_2,
    group=info.main_group_name,
    planner_id=list_2,
    compute=compute_3)  # -> trajectory; inputs goal_constraints: list, attached_collision_meshes: list, path_constraints: list, compute: Boolean
#   port goal_constraints: The goal to be achieved, defined in a set of constraints. Constraints can be very specific, for example defining value domains for each joint, such that the goal configuration is included, or defining a volume in space, to which a specific robot link (e.g. the end-effector) is required to move to.
#   port start_configuration: The robot's full configuration, i.e. values for all configurable joints of the entire robot, at the starting position. Defaults to the all-zero configuration.
#   port group: The planning group used for calculation. Defaults to the robot's main planning group.
#   port attached_collision_meshes: A list of attached collision meshes to be included for planning.
#   port path_constraints: Optional constraints that can be imposed along the solution path. Note that path calculation won't work if the start_configuration violates these constraints. Defaults to None.
#   port planner_id: The name of the algorithm used for path planning. Defaults to 'RRTConnectkConfigDefault'
#   port compute: If True, calculates a trajectory.
#   port trajectory: The calculated trajectory.
# ---------- plan_motion: Python ----------
"""
Calculate a motion path.

COMPAS FAB v0.19.1
"""
from ghpythonlib.componentbase import executingcomponent as component
from scriptcontext import sticky as st

from compas_fab.ghpython.components import create_id


class PlanMotion(component):
    def RunScript(self, robot, goal_constraints, start_configuration, group, attached_collision_meshes, path_constraints, planner_id, compute):

        key = create_id(self, 'trajectory')

        path_constraints = list(path_constraints) if path_constraints else None
        attached_collision_meshes = list(attached_collision_meshes) if attached_collision_meshes else None
        planner_id = str(planner_id) if planner_id else 'RRTConnectkConfigDefault'

        if robot and robot.client and robot.client.is_connected and start_configuration and goal_constraints and compute:
            st[key] = robot.plan_motion(goal_constraints,
                                        start_configuration=start_configuration,
                                        group=group,
                                        options=dict(
                                            attached_collision_meshes=attached_collision_meshes,
                                            path_constraints=path_constraints,
                                            planner_id=planner_id,
                                        ))

        trajectory = st.get(key, None)
        return trajectory
# ---------- end plan_motion ----------

# ----
# Visualisation
list_6 = ValueList({"0 forward_kinematics": 0, "1 inverse_kinematics": 1, "2 cartesian motion": 2, "3 free-space motion": 3}, selected="1 inverse_kinematics")
filter_3 = StreamFilter(Gate=list_6, Stream0=forward_kinematics, Stream1=inverse.full_configuration_ik)
robot_visualize = RobotVisualize(
    robot=robot,
    group=info.main_group_name,
    configuration=filter_3,
    redraw=attach_remove.bang,
    show_visual=Toggle(True),
    show_collision=Toggle(False),
    show_frames=Toggle(False),
    show_base_frame=Toggle(False),
    show_end_effector_frame=Toggle(True),
    show_acm=Toggle(False))  # -> visual, collision, attached_meshes, frames, base_frame, ee_frame; inputs redraw: list, show_visual: Boolean, show_collision: Boolean, show_frames: Boolean, show_base_frame: Boolean, show_end_effector_frame: Boolean, show_acm: Boolean
#   port group: The planning group used for end-effector and base visualization.
#   port configuration: The robot's full configuration.
#   port redraw: A list of attached collision meshes.
#   port show_visual: Whether or not to show the robot's visual meshes.
#   port show_collision: Whether or not to show the robot's collision meshes.
#   port show_frames: Whether or not to show the robot's joint frames.
#   port show_base_frame: Whether or not to show the robot's base frame.
#   port show_end_effector_frame: Whether or not to show the robot's end-effector frame.
#   port show_acm: Whether or not to show the attached collision meshes (if any).
#   port visual: The robot's visual Rhino meshes (if any).
#   port collision: The robot's collision Rhino meshes (if any).
#   port attached_meshes: The attached collision Rhino meshes (if any).
#   port frames: The robot's joint frames as Rhino planes (if any).
#   port base_frame: The robot's base frame as a Rhino plane (if any).
#   port ee_frame: The robot's end-effector frame as a Rhino plane (if any).
# ---------- robot_visualize: Python ----------
"""
Visualizes the robot.

COMPAS FAB v0.19.1
"""
from compas.geometry import Frame
from compas.geometry import Transformation
from compas_ghpython.artists import FrameArtist
from compas_ghpython.artists import MeshArtist
from ghpythonlib.componentbase import executingcomponent as component




class RobotVisualize(component):
    def RunScript(self, robot, group, configuration, attached_collision_meshes, show_visual, show_collision,
                  show_frames, show_base_frame, show_end_effector_frame, show_acm):

        visual = None
        collision = None
        attached_meshes = None
        frames = None
        base_frame = None
        ee_frame = None

        if robot:
            show_visual = True if show_visual is None else show_visual
            configuration = configuration or robot.zero_configuration()

            robot.update(configuration, visual=show_visual, collision=show_collision)
            compas_frames = robot.transformed_frames(configuration, group)

            if show_visual:
                visual = robot.artist.draw_visual()

            if show_collision:
                collision = robot.artist.draw_collision()

            if show_base_frame:
                base_compas_frame = compas_frames[0]
                artist = FrameArtist(base_compas_frame)
                base_frame = artist.draw()

            if show_end_effector_frame:
                ee_compas_frame = robot.forward_kinematics(configuration, group, options=dict(solver='model'))
                if robot.attached_tool:
                    ee_compas_frame = robot.from_t0cf_to_tcf([ee_compas_frame])[0]
                artist = FrameArtist(ee_compas_frame)
                ee_frame = artist.draw()

            if show_frames:
                frames = []
                for compas_frame in compas_frames[1:]:
                    artist = FrameArtist(compas_frame)
                    frame = artist.draw()
                    frames.append(frame)

            if show_acm:
                attached_meshes = []
                for acm in attached_collision_meshes:
                    frame = robot.forward_kinematics(configuration, options=dict(solver='model', link_name=acm.link_name))
                    T = Transformation.from_frame_to_frame(Frame.worldXY(), frame)
                    mesh = acm.collision_mesh.mesh.transformed(T)
                    attached_meshes.append(MeshArtist(mesh).draw())

        return (visual, collision, attached_meshes, frames, base_frame, ee_frame)
# ---------- end robot_visualize ----------
preview = CustomPreview(
    Geometry=[robot_visualize.visual, robot_visualize.collision, robot_visualize.attached_meshes],
    Material=ColourSwatch(SwatchColor=RGB(92, 115, 130)))

# ----
# Send to Robot Studio
list_7 = ValueList({"0 forward_kinematics": 0, "1 inverse_kinematics": 1, "2 cartesian motion": 2, "3 free-space motion": 3}, selected="0 forward_kinematics")
send = Button()
robotstudioexample = GhPythonScript(mode=list_7, full_configuration_fk=forward_kinematics, send=send)  # -> out; inputs send: Boolean
# ---------- robotstudioexample: Python ----------
import compas_rrc as rrc
from compas.robots import Joint
from compas_fab.robots import Configuration
import math
"""
Instructions:
    1: Start Docker
    2: Open the Robot Studio File and press Start in the Simulation Tab
    3: Press the "Send" Button
    4: The Simulation will now run in Robot Studio and the component
    freezes until it has finished
"""

robot_joint_positions = []

if mode == 0:
    for i, joint_type in enumerate(full_configuration_fk.joint_types):
        if joint_type == Joint.REVOLUTE:
            robot_joint_positions.append(math.degrees(full_configuration_fk.joint_values[i]))
        if joint_type == Joint.PRISMATIC:
            robot_track_position = full_configuration_fk.joint_values[i]*1000


if __name__ == '__main__' and send==True:

    # Create Ros Client
    ros = rrc.RosClient()
    ros.run()

    # Create ABB Client
    print("Let's try to connect")
    abb = rrc.AbbClient(ros, '/rob1')
    print('Connected.')

    # Print text on FlexPenant
    abb.send(rrc.PrintText('Welcome TUM to COMPAS_RRC ;)'))

    # Define robot joint positions
    robot_pos_joints_park = [-90.0, -30.0, 70.0, 0.0, 50.0, 0.0]
    #robot_pos_joints_start = [-135.0, 30.0, 20.0, 0.0, 30.0, 0.0]    
    robot_pos_joints_start = robot_joint_positions
    
    # Define track joint positions 
    track_pos_joint_park = [0.0]
    track_pos_joint_start = [robot_track_position]
    
    # Set speed [mm/s]
    speed = 1000
    
    # Move to start position 
    done = abb.send_and_wait(rrc.MoveToJoints(robot_pos_joints_start, track_pos_joint_start, speed, rrc.Zone.FINE))

    # Move to park position
    done = abb.send_and_wait(rrc.MoveToJoints(robot_pos_joints_park, track_pos_joint_park, speed, rrc.Zone.FINE))

    # Print feedback 
    print('Feedback = ', done)

    # End of Code
    print('Finished')

    # Close client
    ros.close()
    ros.terminate()
# ---------- end robotstudioexample ----------
panel_5 = Panel(robotstudioexample)

# ==== cluster Tools

# ---- group: measurement tool
geo = Geometry(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)
mesh = Mesh(geo)
mjoin = MeshJoin(Meshes=mesh)
xaxis_line = Curve(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)
yaxis_line = Curve(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)
tool = PythonScript(rhmesh=mjoin, xline=xaxis_line, yline=yaxis_line)  # -> tool; inputs rhmesh: Mesh
# ---------- tool: Python ----------
import Rhino.Geometry as rg
import os, math
from compas.geometry import Frame, Rotation
from compas.datastructures import Mesh
from compas_ghpython.artists import MeshArtist
from compas_fab.robots import Tool
from compas_rhino.geometry import RhinoMesh

xaxis = rg.Line(xline.PointAtStart, xline.PointAtEnd)
yaxis = rg.Line(yline.PointAtStart, yline.PointAtEnd)

if xaxis.From.DistanceTo(yaxis.From) < 0.01:
    origin = xaxis.From
    xaxis = xaxis.Direction
    yaxis = yaxis.Direction
elif xaxis.To.DistanceTo(yaxis.To) < 0.01:
    origin = xaxis.To
    xaxis = -xaxis.Direction
    yaxis = -yaxis.Direction
elif xaxis.From.DistanceTo(yaxis.To) < 0.01:
    origin = xaxis.From
    xaxis = xaxis.Direction
    yaxis = -yaxis.Direction
elif xaxis.To.DistanceTo(yaxis.From) < 0.01:
    origin = xaxis.To
    xaxis = -xaxis.Direction
    yaxis = yaxis.Direction

xaxis.Unitize()
yaxis.Unitize()

ee_frame = Frame(origin, xaxis, yaxis)
ee_mesh = RhinoMesh.from_geometry(rhmesh).to_compas()

tool = Tool(ee_mesh, ee_frame)
# ---------- end tool ----------

# ---- group: area grip tool
geo_2 = Geometry(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)
mesh_2 = Mesh(geo_2)
mjoin_2 = MeshJoin(Meshes=mesh_2)
yaxis_line_2 = Curve(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)
xaxis_line_2 = Curve(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)
tool_2 = PythonScript(rhmesh=mjoin_2, xline=xaxis_line_2, yline=yaxis_line_2)  # -> tool; inputs rhmesh: Mesh; same code as tool

geo_3 = Geometry(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)
mesh_3 = Mesh(geo_3)
mjoin_3 = MeshJoin(Meshes=mesh_3)
zaxis_line = Curve(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)
xaxis_line_3 = Curve(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)
tool_3 = PythonScript(rhmesh=mjoin_3, xline=xaxis_line_3, zline=zaxis_line)  # -> tool; inputs rhmesh: Mesh
# ---------- tool_3: Python ----------
import Rhino.Geometry as rg
import os, math
from compas.geometry import Frame, Rotation
from compas.datastructures import Mesh
from compas_ghpython.artists import MeshArtist
from compas_fab.robots import Tool
from compas_rhino.geometry import RhinoMesh

xaxis = rg.Line(xline.PointAtStart, xline.PointAtEnd)
zaxis = rg.Line(zline.PointAtStart, zline.PointAtEnd)

if xaxis.From.DistanceTo(zaxis.From) < 0.01:
    origin = xaxis.From
    xaxis = xaxis.Direction
    zaxis = zaxis.Direction
elif xaxis.To.DistanceTo(zaxis.To) < 0.01:
    origin = xaxis.To
    xaxis = -xaxis.Direction
    zaxis = -zaxis.Direction
elif xaxis.From.DistanceTo(zaxis.To) < 0.01:
    origin = xaxis.From
    xaxis = xaxis.Direction
    zaxis = -zaxis.Direction
elif xaxis.To.DistanceTo(zaxis.From) < 0.01:
    origin = xaxis.To
    xaxis = -xaxis.Direction
    zaxis = zaxis.Direction

xaxis.Unitize()
zaxis.Unitize()

ee_frame = Frame(origin, xaxis, zaxis)
ee_mesh = RhinoMesh.from_geometry(rhmesh).to_compas()

tool = Tool(ee_mesh, ee_frame)
# ---------- end tool_3 ----------

# ----
G = ClusterInput()
filter = StreamFilter(Gate=G, Stream0=tool, Stream1=tool_2, Stream2=tool_3)
s_2 = ClusterOutput(filter)
