# Grasshopper definition fabtory_rrc_demo.ghx (Grasshopper 1.0.7)

reload = Button()
py = PythonScript(reload=reload)
# ---------- py: Python ----------
from compas_rhino.utilities.misc import get_tolerance
from compas_rhino.utilities.misc import unload_modules

from compas_ghpython import unload_modules

unload_modules("compas")
unload_modules("compas_fab")
unload_modules("ur_fabrication_control")
unload_modules("assembly_information_model")
unload_modules("am_information_model") 
unload_modules("window_in_wall")
# ---------- end py ----------
py_2 = PythonScript()  # -> HERE, DATA
# ---------- py_2: Python ----------
import os

HERE = os.path.dirname(ghdoc.Path)
DATA = os.path.abspath(os.path.join(HERE, "..", "data"))

#print(HERE)
#print(DATA)
# ---------- end py_2 ----------

crv_gate_right = Curve(<curve referenced from the Rhino model>)
crv_gate_left = Curve(<curve referenced from the Rhino model>)

list = ValueList({"20", "50", "100", "500", "1000", "5000"}, selected="100")
back = Button()
reset = Button()
start = Button()
stop = Button()
step = Button()
full = Button()

list_2 = ValueList({"20", "50", "100", "500", "1000", "5000"}, selected="20")
back_2 = Button()
reset_2 = Button()
start_2 = Button()
stop_2 = Button()
step_2 = Button()
full_2 = Button()

reload_2 = Button()
path = PythonScript()  # -> HERE, DATA, ROBOT_DESCRIPTION
# ---------- path: Python ----------
import os

HERE = os.path.dirname(ghdoc.Path)
DATA = os.path.abspath(os.path.join(HERE, "..", "data"))
ROBOT_DESCRIPTION = os.path.abspath(os.path.join(DATA, "robot_description"))

print(HERE)
print(DATA)
print(ROBOT_DESCRIPTION)
# ---------- end path ----------
py_3 = PythonScript(reload=reload_2)
# ---------- py_3: Python ----------
if reload:
    from compas_ghpython import unload_modules
    unload_modules('compas')
    unload_modules("compas_fab")
    unload_modules("ur_online_control")
# ---------- end py_3 ----------

# ---- group: Only needs to be created once
overwrite = Button()
# 5.
create = Button()
fabrication = GhPythonScript(create=create, overwrite=overwrite)  # -> out, fabrication
# ---------- fabrication: Python ----------
__author__ = "Gido"
__version__ = "2020.01.14"

from scriptcontext import sticky as st
#needs to be changed for ABB
from ur_fabrication_control.direct_control.fabrication_process import Fabrication

server_ip = st["server_address"]
server_port = st["server_port"]

fabrication_key = "fabrication"

if fabrication_key not in st:
    st[fabrication_key] = None

if overwrite and st[fabrication_key] != None:
    fabrication = st[fabrication_key]
    if hasattr(fabrication, 'task_thread') and hasattr(fabrication, 'listen_thread'):
        fabrication._join_threads()

if (create and st[fabrication_key] == None) or overwrite:
    fabrication = Fabrication()
    fabrication.set_feedback_server(server_ip, server_port)
    
    st[fabrication_key] = fabrication

fabrication = st[fabrication_key]
# ---------- end fabrication ----------

# ----
bang = Button()
panel = Panel("Unload libraries")
unload = PythonScript(bang=bang)
# ---------- unload: Python ----------
from compas_rhino.utilities.misc import get_tolerance
from compas_rhino.utilities.misc import unload_modules

unload_modules("compas")
unload_modules("compas_fab")
unload_modules("ur_fabrication_control")
unload_modules("mobile_additive_manufacturing")
unload_modules("am_information_model")
# ---------- end unload ----------

undo_task = Button()
skip_task = Button()
panel_2 = Panel(fabrication.out)

max_speed = Slider(4000, range=0..51200)  # disabled
speed = Slider(1600, range=0..51200)  # disabled
value = BooleanToggle(False)  # disabled
send = Button()  # disabled
extruder_data = PythonScript(motor_state=value, max_speed=max_speed, speed=speed, send=send)  # -> urscript; inputs motor_state: Int32; disabled
# ---------- extruder_data: Python ----------
import time
from scriptcontext import sticky as st
from mobile_additive_manufacturing.control.clay_extruder_control import ExtruderClient

ext_ip = st["ext_ip"]
ext_port = st["ext_port"]

ec = ExtruderClient(ext_ip, ext_port)
wait_for_response = False

if send:
    ec.connect()
    time.sleep(0.2)
    ec.send_motordata(motor_state, max_speed, speed, wait_for_response)
    time.sleep(0.2)
    ec.close()
# ---------- end extruder_data ----------

send_2 = Button()  # disabled
get_info = PythonScript(send=send_2)  # -> info; disabled
# ---------- get_info: Python ----------
import time
from scriptcontext import sticky as st
from mobile_additive_manufacturing.control.clay_extruder_control import ExtruderClient

ext_ip = st["ext_ip"]
ext_port = st["ext_port"]

ec = ExtruderClient(ext_ip, ext_port)
wait_for_response = True

if send:
    ec.connect()
    time.sleep(0.2)
    info = ec.send_get_arduino_info(wait_for_response)
    time.sleep(0.2)
    ec.close()
# ---------- end get_info ----------

# ----
# Extruder control
panel_3 = Panel(get_info)  # disabled

value_2 = BooleanToggle(True)  # disabled
send_3 = Button()  # disabled
extruder_state = PythonScript(state=value_2, send=send_3)  # -> urscript; inputs state: Boolean; disabled
# ---------- extruder_state: Python ----------
import time
from scriptcontext import sticky as st
from mobile_additive_manufacturing.control.clay_extruder_control import ExtruderClient

ext_ip = st["ext_ip"]
ext_port = st["ext_port"]

ec = ExtruderClient(ext_ip, ext_port)
wait_for_response = False

if send:
    ec.connect()
    time.sleep(0.2)
    ec.send_motorstate(0, int(state), wait_for_response)
    time.sleep(0.2)
    ec.close()
# ---------- end extruder_state ----------

stop_3 = Button()  # disabled
# Info
stop_4 = PythonScript(stop=stop_3)  # disabled
# ---------- stop_4: Python ----------
import time
from scriptcontext import sticky as st
from mobile_additive_manufacturing.control.clay_extruder_control import ExtruderClient

ext_ip = st["ext_ip"]
ext_port = st["ext_port"]

ec = ExtruderClient(ext_ip, ext_port)
wait_for_response = False

if stop:
    ec.connect()
    time.sleep(0.2)
    ec.send_stop(wait_for_response)
    time.sleep(0.2)
    ec.close()
# ---------- end stop_4 ----------

list_3 = ValueList({"30", "32", "34"}, selected="34")  # disabled

value_3 = BooleanToggle(True)  # disabled
send_4 = Button()  # disabled
digital_out = PythonScript(pin=list_3, state=value_3, send=send_4)  # -> urscript; inputs pin: Int32, state: Boolean; disabled
# ---------- digital_out: Python ----------
import time
from scriptcontext import sticky as st
from mobile_additive_manufacturing.control.clay_extruder_control import ExtruderClient

ext_ip = st["ext_ip"]
ext_port = st["ext_port"]

ec = ExtruderClient(ext_ip, ext_port)
wait_for_response = False

if send:
    ec.connect()
    time.sleep(0.2)
    ec.send_set_do(pin, int(state), wait_for_response)
    time.sleep(0.2)
    ec.close()
# ---------- end digital_out ----------

list_4 = ValueList({"30", "32", "34"}, selected="30")  # disabled

value_4 = BooleanToggle(False)  # disabled
send_5 = Button()  # disabled
digital_out_2 = PythonScript(pin=list_4, state=value_4, send=send_5)  # -> urscript; inputs pin: Int32, state: Boolean; disabled; same code as digital_out

list_5 = ValueList({"9", "30", "32", "34"}, selected="9")  # disabled

value_5 = BooleanToggle(False)  # disabled
send_6 = Button()  # disabled
digital_out_3 = PythonScript(pin=list_5, state=value_5, send=send_6)  # -> urscript; inputs pin: Int32, state: Boolean; disabled; same code as digital_out

# ---- group: Shape Initialization
list_6 = ValueList({"circular", "persian", "interactive", "triangular", "catenary"}, selected="persian")
width = Number(5.6)
height = Number(2.7)
elsize = Number(0.05)

# ----
toggle = BooleanToggle(True)
down_phase = Slider(0, range=0..3)
up_amp = Slider(0.03, range=0..0.3)
data = Data("Grasshopper.Kernel.Types.GH_ObjectWrapper")
cp = Plane(Plane(origin=(-1.026602616, -0.03965357101, -0.4442693296), x=(-0.01795929223, -0.9998379119, 0.001270365803), y=(0.9997696103, -0.0179729749, -0.01173449636)))
create_2 = Button()
xy = XYPlane(Origin=Point(0, 0, 0))
generate_assembly = GhPythonScript(create=Button(), centerplane=cp, init_am_model=data)  # -> am_model
# ---------- generate_assembly: Python ----------
import Rhino.Geometry as rg
import math
from scriptcontext import sticky as st


from compas.geometry import Frame
from compas.geometry import Transformation
from compas.geometry import Scale
from compas.geometry import Point

from compas_ghpython import draw_frame

from am_information_model.model import AMModel
from am_information_model.model import Layer

import Rhino.Geometry as rg

# initialize an empty assembly class

if "am_model" not in st:
    st["am_model"] = None

cp = centerplane
cf = Frame(cp.Origin, cp.XAxis, cp.YAxis)

T = Transformation.from_frame_to_frame(Frame.worldXY(), cf)


def transform_layers_from_am_model(amm, init_amm):
    for key, layer in init_amm.layers():
        new_layer = layer.transformed(T)
        amm.add_layer(new_layer)

if create:
    new_amm = AMModel()
    transform_layers_from_am_model(new_amm, init_am_model)
    st["am_model"] = new_amm

am_model = st["am_model"]
# ---------- end generate_assembly ----------

# ---- group: Shape Initialization (continued)
create_wall = GhPythonScript(init=Button(), width=width, height=height, elsize=elsize, double_layer=toggle)  # -> wall
# ---------- create_wall: Python ----------
from window_in_wall import Wall


# create wall
wall = Wall()

print len(list(wall.mesh_offset.vertices()))

# construct COMPAS quad mesh from width and height

if double_layer == True:
    wall.create_quad_meshes_from_dimensions_dl(width, height, elsize)

if double_layer == False:
    wall.create_quad_meshes_from_dimensions(width, height, elsize)

#print wall.mesh
# ---------- end create_wall ----------
define_gate = GhPythonScript(
    wall=create_wall,
    gate_type=list_6,
    gate_x=Slider(2.4, range=1..3),
    gate_size=Slider(1.845, range=0..2),
    gate_crv_left=crv_gate_left,
    gate_crv_right=crv_gate_right)  # -> out, wall, gate_crv_left, gate_crv_right, wall_crv_left, wall_crv_right, wall_crv_middle; inputs gate_crv_left: Curve, gate_crv_right: Curve
# ---------- define_gate: Python ----------
import math
import compas
import Rhino as rh
import ghpythonlib.components as ghcomp
from compas.datastructures import Mesh

import Rhino.Geometry as rg

# Create wall curves left and right
wall_crv_left = rg.Line(rg.Point3d(0,0,0), rg.Point3d(0,0,wall.height))
wall_crv_right = rg.Line(rg.Point3d(wall.width,0,0), rg.Point3d(wall.width,0,wall.height))

# --- catenary functions ---
def catenary_y(a,x):
    try:
        ans = a*math.cosh(x/a)
    except OverflowError:
        ans = float('inf')
    return ans

def define_catenary_a(cat_width, cat_height, tol=0.0001):
    length = cat_width/2
    an, an1, da = (1, 1, 0.1)
    hn = catenary_y(an, length)-an
    hn1 = hn
    for i in range(1000):
        dhn = hn-cat_height
        dhn1 = hn1-cat_height
        if (hn1 > cat_height and abs(dhn1)>abs(dhn)) or hn1==float('inf'):
            da = da/10
        if abs(dhn)<tol:
            break
        elif dhn<0:
            an = an-da
            an1 = an-da
        elif dhn>0:
            an = an+da
            an1 = an+da
        hn = catenary_y(an,length)-an
        hn1 = catenary_y(an1,length)-an1
    return an
# --- end of catenary functions ---

if gate_type == "interactive":
    # Create wall curve above gate
    gate_left_pts = ghcomp.EndPoints(curve=gate_crv_left)
    if gate_left_pts[0].Z > gate_left_pts[1].Z:
        gate_top_pt = gate_left_pts[0]
    else:
        gate_top_pt = gate_left_pts[1]
    gate_x = gate_top_pt.X
elif gate_type == "catenary":
    cat_a = define_catenary_a(gate_size, gate_size)

# Define gate
for vertex in wall.mesh.vertices():
    # get x and z coordinates from vertex
    x_val = wall.mesh.vertex_attribute(vertex, name='x')
    z_val = wall.mesh.vertex_attribute(vertex, name='z')

    # calculate distance
    gate_rel_x = gate_x-x_val
    gate_rel_z = z_val

    #in order to avoid division by zero. should be cleaned up ASAP
    if gate_rel_x==0:
        gate_rel_x=0.000000001

    #this boolean will be set to True if vertex lies inside the gate 
    in_gate_vertex = False

    #for each gate tpye, the a corresponding function is called to check
    # to check if vertex lies inside the gate
    if gate_type=="circular":
        if wall.in_gate_circular(gate_size, gate_rel_x,gate_rel_z):
            in_gate_vertex = True
    elif gate_type=="persian":
        if wall.in_gate_persian(gate_size, gate_rel_x,gate_rel_z):
            in_gate_vertex = True
    elif gate_type=="triangular":
        if wall.in_gate_triangular(gate_size, gate_rel_x,gate_rel_z):
            in_gate_vertex = True
    elif gate_type=="catenary":
        if wall.in_gate_catenary(gate_size, gate_rel_x, gate_rel_z, cat_a):
            in_gate_vertex = True
    elif gate_type=="interactive":
        point = rh.Geometry.Point3d(wall.mesh.vertex_attribute(vertex, name='x'), 0, wall.mesh.vertex_attribute(vertex, name='z') )
        point_in_gate = ghcomp.PointInCurve(point,gate_crv).relationship
        if point_in_gate == 2 or point_in_gate == 1: 
            in_gate_vertex = True

    if in_gate_vertex:
        # store new vertex attribute with the distance to the gate center
        wall.mesh.vertex_attribute(vertex,"x_disp", value=-gate_rel_x)
        wall.mesh.vertex_attribute(vertex,"z_disp", value=gate_rel_z)
        #in_gate flag indicates that this vertex lies in the gate
        wall.mesh.vertex_attribute(vertex,"in_gate", value=True)
        wall.gate_points.append(vertex)

if gate_type=="circular":
    center_pt = rg.Point3d(gate_x,0,0)
    start_pt = rg.Point3d(gate_x-gate_size,0,0)
    middle_left_pt = rg.Point3d(gate_x-(gate_size*(math.sqrt(2)/2)),0,gate_size*(math.sqrt(2)/2))
    middle_pt = rg.Point3d(gate_x,0,gate_size)
    middle_right_pt = rg.Point3d(gate_x+(gate_size*(math.sqrt(2)/2)),0,gate_size*(math.sqrt(2)/2))
    end_pt = rg.Point3d(gate_x+gate_size,0,0)
    gate_crv_left = ghcomp.Arc3Pt(start_pt, middle_left_pt, middle_pt)[0]
    gate_crv_right = ghcomp.Arc3Pt(middle_pt, middle_right_pt, end_pt)[0]
elif gate_type=="triangular":
    start_pt = rg.Point3d(gate_x-gate_size,0,0)
    middle_pt = rg.Point3d(gate_x,0,gate_size)
    end_pt = rg.Point3d(gate_x+gate_size,0,0)
    gate_crv_left = ghcomp.Line(start_pt, middle_pt)
    gate_crv_right = ghcomp.Line(end_pt, middle_pt)
elif gate_type=="persian":
    pers_radius = (1/3)*gate_size
    start_pt = rg.Point3d(gate_x-pers_radius,0,0)
    y1 = pers_radius*(math.sqrt(2.5-math.sqrt(2))+math.sqrt(2)/2)
    arc1_start_pt = rg.Point3d(gate_x-pers_radius,0,y1)
    arc2_start_pt = rg.Point3d(gate_x+pers_radius,0,y1)
    y2 = pers_radius*(math.sqrt(2.5-math.sqrt(2))+math.sqrt(2))
    int_relx = math.sqrt(pers_radius**2-(y2-y1)**2)
    arc1_int_pt = rg.Point3d(gate_x-(int_relx)*(math.sqrt(3)/math.sqrt(2)),0,y1+(y2-y1)/(math.sqrt(2)))
    arc2_int_pt = rg.Point3d(gate_x+(int_relx)*(math.sqrt(3)/math.sqrt(2)),0,y1+(y2-y1)/(math.sqrt(2)))
    
    arc1_end_pt = rg.Point3d(gate_x-int_relx,0,y2)
    arc2_end_pt = rg.Point3d(gate_x+int_relx,0,y2)
    y3 = math.sqrt(4*(pers_radius**2)-int_relx**2)+y2-2*(y2-y1)
    top_pt = rg.Point3d(gate_x,0,y3)
    arc3_int_pt = rg.Point3d(gate_x+int_relx-(2*int_relx)/math.sqrt(2),0,y1-(y2-y1)+2*(y2-y1)*(math.sqrt(3)/math.sqrt(2)))
    arc4_int_pt = rg.Point3d(gate_x-int_relx+(2*int_relx)/math.sqrt(2),0,y1-(y2-y1)+2*(y2-y1)*(math.sqrt(3)/math.sqrt(2)))
    
    end_pt = rg.Point3d(gate_x+pers_radius,0,0)
    gate_vert_left = ghcomp.Line(start_pt, arc1_start_pt)
    gate_vert_right = ghcomp.Line(end_pt, arc2_start_pt)
    arc1_crv = ghcomp.Arc3Pt(arc1_start_pt, arc1_int_pt, arc1_end_pt)
    arc2_crv = ghcomp.Arc3Pt(arc2_start_pt, arc2_int_pt, arc2_end_pt)
    arc3_crv = ghcomp.Arc3Pt(arc1_end_pt, arc3_int_pt, top_pt)
    arc4_crv = ghcomp.Arc3Pt(arc2_end_pt, arc4_int_pt, top_pt)
    
    gate_crv_left = ghcomp.JoinCurves([gate_vert_left, arc1_crv[0], arc3_crv[0]], False)
    gate_crv_right = ghcomp.JoinCurves([gate_vert_right, arc2_crv[0], arc4_crv[0]], False)
elif gate_type=="catenary":
    start_pt = rg.Point3d(gate_x-gate_size/2,0,0)
    end_pt = rg.Point3d(gate_x+gate_size/2,0,0)
    pts_left = [rg.Point3d(gate_x-((gate_size/2)/5)*i, 0, gate_size-catenary_y(cat_a, ((gate_size/2)/5)*i)+cat_a) for i in range(6)]
    pts_right = [rg.Point3d(gate_x+((gate_size/2)/5)*i, 0, gate_size-catenary_y(cat_a, ((gate_size/2)/5)*i)+cat_a) for i in range(6)]
    pts_left[-1] = start_pt
    pts_right[-1] = end_pt
    gate_crv_left = ghcomp.Interpolate(pts_left, 3, False, 0)[0]
    gate_crv_right = ghcomp.Interpolate(pts_right, 3, False, 0)[0]
    gate_crv_left.Reverse()
    gate_crv_right.Reverse()

# Create gate curve
gate_crv_top = ghcomp.JoinCurves(curves=[gate_crv_left, gate_crv_right], preserve=False)
gate_end_pts = ghcomp.EndPoints(curve=gate_crv_top)
gate_crv_bottom = rg.Line(gate_end_pts[0], gate_end_pts[1])
gate_crv = ghcomp.JoinCurves(curves=[gate_crv_top, gate_crv_bottom], preserve=False)

# Create wall curve above gate
gate_left_pts = ghcomp.EndPoints(curve=gate_crv_left)
if gate_left_pts[0].Z > gate_left_pts[1].Z:
    gate_top_pt = gate_left_pts[0]
else:
    gate_top_pt = gate_left_pts[1]
wall_crv_middle = rg.Line(gate_top_pt, rg.Point3d(gate_top_pt.X, gate_top_pt.Y, wall.height))
# ---------- end define_gate ----------
crv = Curve(define_gate.gate_crv_left)
crv_2 = Curve(define_gate.gate_crv_right)
crv_3 = Curve(define_gate.wall_crv_left)
crv_4 = Curve(define_gate.wall_crv_right)
crv_5 = Curve(define_gate.wall_crv_middle)
preview = CustomPreview(Geometry=[crv, crv_2, crv_3, crv_4, crv_5], Material=ColourSwatch(SwatchColor=RGB(0, 0, 0)))

# ---- group: Shape Manipulation
down_amp = Slider(0.08, range=0..0.3)
down_freq = Slider(1.857, range=1..3)
up_phase = Slider(0, range=0..3)
up_freq = Slider(1, range=1..3)
displacement = GhPythonScript(wall=define_gate.wall, compute_displ=Button(), visualize_displ=Toggle(False))  # -> out, wall
# ---------- displacement: Python ----------
from compas.rpc import Proxy


if compute_displ:
    #wall_methods_numpy = Proxy('window_in_wall.wall_methods_numpy')
    with Proxy('window_in_wall.wall_methods_pde') as wall_methods_pde:
        #wall_methods_numpy.stop_server() #if changes need to be reloaded
        #wall_methods_numpy.start_server()
        
        # compute displacement
        #solX, solZ = wall_methods_numpy.compute_displacement(wall.mesh,wall.gate_points, wall.x_size, wall.z_size)
        solX = wall_methods_pde.compute_displacement_x(wall.mesh, wall.gate_points, wall.x_size, wall.z_size)
        solZ = wall_methods_pde.compute_displacement_z(wall.mesh, wall.gate_points, wall.x_size, wall.z_size)
    
    # update vertex attributes with displacement values
    for v, data in wall.mesh.vertices(data=True):        
        wall.mesh.vertex_attribute(v, "x_disp", value=solX[v]) #value=solX[n_from_ij(i,j, wall.z_size)]
        wall.mesh.vertex_attribute(v, "z_disp", value=solZ[v]) #value=solZ[n_from_ij(i,j, wall.z_size)]

if visualize_displ:
    # displace the vertices (for preview only)
    wall.displace_vertices()
    #solmat = np.reshape(solX, (-1, n))
# ---------- end displacement ----------
wave = GhPythonScript(
    wall=displacement.wall,
    wave=Toggle(True),
    up_amp=up_amp,
    up_freq=up_freq,
    up_phase=up_phase,
    down_amp=down_amp,
    down_freq=down_freq,
    down_phase=down_phase)  # -> out, wall; inputs wave: Boolean
# ---------- wave: Python ----------
if wave:
    #wall.undulate(amp, freq, phase)
    #wall.undulate(up_amp, up_freq, up_phase, down_amp, down_freq, down_phase)
    wall.undulate_with_displ(up_amp, up_freq, up_phase, down_amp, down_freq, down_phase)
    #wall.undulate_with_displ(amp, freq, phase)
# ---------- end wave ----------

# ---- group: Visualization
visualize = GhPythonScript(wall=wave.wall, show_mesh=Toggle(True), show_vertices_gate=Toggle(True), show_vector_field=Toggle(False))  # -> out, rhmesh, rhmesh_offset, vertices_gate, vertices_all, disp_vectors
# ---------- visualize: Python ----------
from compas_ghpython.artists import MeshArtist
import Rhino.Geometry as rg

rh_mesh = []
vertices_gate = []
vertices_all = []
disp_vectors = []


if show_mesh:
    # Mesh Artist for visualization
    artist = MeshArtist(wall.mesh)
    
    #vertices = artist.draw_vertices()
    #edges = artist.draw_edges()
    #faces = artist.draw_faces()
    #labels = {key: key for key in mesh.vertices()}
    
    rhmesh = artist.draw_mesh()
    
    artist_offset = MeshArtist(wall.mesh_offset)
    rhmesh_offset = artist_offset.draw_mesh()

if show_vertices_gate:
    # draw gate points
    v = []
    for vertex in wall.mesh.vertices():
        gp = wall.mesh.vertex_attribute(vertex, name='in_gate')
        if gp: v.append(vertex)
    
    #print v
    if len(v): vertices_gate = artist.draw_vertices(vertices=v)


if show_vector_field:
    x_disp = []
    z_disp = []
    
    for vertex in wall.mesh.vertices():
        x_disp.append(wall.mesh.vertex_attribute(vertex, name='x_disp'))
        z_disp.append(wall.mesh.vertex_attribute(vertex, name='z_disp'))
    
    disp_vectors = [rg.Vector3d(x_disp[i], 0, z_disp[i])/5 for i in range(len(x_disp))]

    vertices_all = artist.draw_vertices()
# ---------- end visualize ----------
mesh = Mesh(visualize.rhmesh)
mesh_2 = Mesh(visualize.rhmesh_offset)
pt = Point(visualize.vertices_all)
pt_2 = Point(visualize.vertices_gate)
vec = Vector(visualize.disp_vectors)
preview_2 = CustomPreview(Geometry=[mesh, mesh_2], Material=ColourSwatch(SwatchColor=RGBA(255, 207, 207, 55)))
preview_3 = CustomPreview(Geometry=pt_2, Material=ColourSwatch(SwatchColor=RGB(0, 0, 0)))
vdisex = VectorDisplayEx(Point=pt, Vector=vec, Colour=ColourSwatch(SwatchColor=RGB(42, 0, 255)), Width=1)

# ---- group: Fabrication
list_7 = ValueList({"1:10": 0.1, "1:5": 0.2}, selected="1:10")
div_len = GhPythonScript(scalefactor=list_7)  # -> out, max_layer_height, avg_layer_height, min_layer_height
# ---------- div_len: Python ----------
max_layer_height = 0.0065 / scalefactor
avg_layer_height = 0.0045 / scalefactor
min_layer_height = 0.0030 / scalefactor
print (avg_layer_height)
# ---------- end div_len ----------
print_path_generation = GhPythonScript(
    max_layer_height=div_len.max_layer_height,
    avg_layer_height=div_len.avg_layer_height,
    min_layer_height=div_len.min_layer_height,
    angle_constraint="25",
    crv_gate_left=define_gate.gate_crv_left,
    crv_gate_right=define_gate.gate_crv_right,
    crv_wall_left=define_gate.wall_crv_left,
    crv_wall_right=define_gate.wall_crv_right,
    crv_gate_top=define_gate.wall_crv_middle,
    blend_layers="25")  # -> out, pts_gate_left, pts_wall_left, pts_gate_right, pts_wall_right, crvs_region_left, crvs_region_right, crvs_region_left_top, crvs_region_right_top, crvs_region_top; inputs crv_gate_left: Curve, crv_gate_right: Curve, crv_wall_left: Curve, crv_wall_right: Curve, crv_gate_top: Curve, blend_layers: Int32
# ---------- print_path_generation: Python ----------
import Rhino.Geometry as rg
import ghpythonlib.components as ghcomp
import math



# planes gate left
tsl = crv_gate_left.DivideByLength(avg_layer_height, True)
div_count = len(tsl)
tsc = crv_gate_left.DivideByCount(div_count, True)
planes_gate_left = [crv_gate_left.PerpendicularFrameAt(t)[1] for t in tsc]

# planes gate right
tsc = crv_gate_right.DivideByCount(len(tsl), True)
planes_gate_right = [crv_gate_right.PerpendicularFrameAt(t)[1] for t in tsc]

# planes wall left
tsl = crv_wall_left.DivideByLength(avg_layer_height, True)
planes_wall_left = [crv_wall_left.PerpendicularFrameAt(t)[1] for t in tsl]

# planes wall right
tsr = crv_wall_right.DivideByLength(avg_layer_height, True)
planes_wall_right = [crv_wall_right.PerpendicularFrameAt(t)[1] for t in tsr]

top_wall_left = rg.Curve.Split(crv_wall_left, t=tsl[len(planes_gate_left)-1])[1]
top_wall_right = rg.Curve.Split(crv_wall_right, t=tsr[len(planes_gate_right)-1])[1]

#planes_wall_left_top = planes_wall_left[len(planes_gate_left):]
#planes_wall_right_top = planes_wall_right[len(planes_gate_right):]

# planes gate top
#tsc = crv_gate_top.DivideByCount(len(planes_wall_right_top), False)
#planes_gate_top = [crv_gate_top.PerpendicularFrameAt(t)[1] for t in tsc]

tsc = crv_gate_top.DivideByLength(max_layer_height, True)
planes_gate_top = [crv_gate_top.PerpendicularFrameAt(t)[1] for t in tsc[1:]]

twl = top_wall_left.DivideByCount(len(planes_gate_top)+1, False)
twr = top_wall_right.DivideByCount(len(planes_gate_top)+1, False)
planes_wall_left_top = [top_wall_left.PerpendicularFrameAt(t)[1] for t in twl]
planes_wall_right_top = [top_wall_right.PerpendicularFrameAt(t)[1] for t in twr]


class BlendFunction():
    def __init__(self, func_type, count, blend_layers=0):
        self.count = count
        self.blend_layers = int(min(blend_layers, count/2))
        self.func_type = func_type
        self.blend_type = {
            "linear" : self.blend_linear,
            "cosine" : self.blend_cosine
        }
    
    def get_value(self, value):
        return self.blend_type[self.func_type](value)
    
    def blend_cosine(self, value):
        if self.blend_layers != 0:
            if value <= self.blend_layers:
                step = (math.pi/self.blend_layers)*value
            elif value >= self.count-self.blend_layers:
                step = math.pi + (math.pi/self.blend_layers)*(value-(self.count-self.blend_layers))
            else:
                step = math.pi
        else:
            step = (2*math.pi/self.blend_layers)*value
        blendfactor = (math.cos(math.pi+step)+1)/2
        return blendfactor

    def blend_linear(self, value):
        blendfactor = (1/self.count)*value
        return blendfactor

def generate_crvs(planes_gate, planes_wall, region="left"):
    base_tangent = rg.Vector3d(1,0,0)
    if "left" in region:
        mult=-1
    elif "right" in region:
        mult = 1

    tangent_start_min = mult*base_tangent
    tangent_start_max = tangent_start_min.Clone()
    
    if region=="left" or region=="right":
        b_func = BlendFunction("cosine", len(planes_gate), blend_layers)
        tangent_start_max.Rotate(math.radians(-mult*angle_constraint), rg.Vector3d.YAxis)
    elif region=="topleft" or region=="topright":
        b_func = BlendFunction("linear", len(planes_gate), blend_layers)
        tangent_start_min.Rotate(math.radians(-mult*angle_constraint), rg.Vector3d.YAxis)
    
    crvs = []
    
    for i in range(len(planes_gate)):
        plane_gate = planes_gate[i]
        plane_wall = planes_wall[i]
        
        vertices = [plane_gate.Origin, plane_wall.Origin]
        
        normal = mult*plane_gate.XAxis
        
        if region!="topleft" and region!="topright":
            if i<len(planes_gate)/2:
                tangent_start = b_func.get_value(i)*normal + (1-b_func.get_value(i))*tangent_start_min
            else:
                tangent_start = b_func.get_value(i)*normal + (1-b_func.get_value(i))*tangent_start_max
            
        else:
            tangent_start = b_func.get_value(i)*normal + (1-b_func.get_value(i))*tangent_start_min
        
        tangent_end = mult*plane_wall.XAxis
        c, c_len, c_domain = ghcomp.Interpolatet(vertices, tangent_start, tangent_end, knotstyle=0)
        crvs.append(c)

    return crvs

crvs_region_left = generate_crvs(planes_gate_left, planes_wall_left, region="left")
crvs_region_right = generate_crvs(planes_gate_right, planes_wall_right, region="right")

crvs_region_left_top = generate_crvs(planes_gate_top, planes_wall_left_top, region="topleft")
crvs_region_right_top = generate_crvs(planes_gate_top, planes_wall_right_top, region="topright")

crvs_region_top = []
for i in range(len(crvs_region_left_top)):
    crvs = [crvs_region_left_top[i], crvs_region_right_top[i]]
    
    crv_joined = ghcomp.JoinCurves(crvs, False)
    crvs_region_top.append(crv_joined)
# ---------- end print_path_generation ----------
Y = UnitY(Factor=1)
pt_3 = Point(print_path_generation.pts_gate_left)
pt_4 = Point(print_path_generation.pts_wall_right)
crv_6 = Curve(print_path_generation.crvs_region_left)
crv_7 = Curve(print_path_generation.crvs_region_right)
crv_8 = Curve(print_path_generation.crvs_region_left_top)
crv_9 = Curve(print_path_generation.crvs_region_right_top)
crv_10 = Curve(print_path_generation.crvs_region_top)
pt_5 = Point(print_path_generation.pts_wall_left)
pt_6 = Point(print_path_generation.pts_gate_right)
projecttomesh = CSharpScript(Curve=[crv_6, crv_7, crv_8, crv_9, crv_10], Mesh=mesh, Direction=Y)  # -> out, A; inputs Curve: Curve, Mesh: Mesh, Direction: Vector3d
# ---------- projecttomesh: C# usings ----------
using System.IO;
using System.Linq;
using System.Data;
using System.Drawing;
using System.Reflection;
using System.Windows.Forms;
using System.Xml;
using System.Xml.Linq;
using System.Runtime.InteropServices;

using Rhino.DocObjects;
using Rhino.Collections;
using GH_IO;
using GH_IO.Serialization;
# ---------- projecttomesh: C# ----------
    if (null != Curve && null != Mesh && Direction.IsValid)
    {
      var tol = RhinoDoc.ActiveDoc.ModelAbsoluteTolerance;
      A = Curve.ProjectToMesh(Curve, Mesh, Direction, tol);
    }
# ---------- end projecttomesh ----------

# ----
# AM Information Model
number_slider = Slider(0.05, range=0..1)
layer_def = GhPythonScript(
    front_mesh=mesh,
    back_mesh=visualize.rhmesh_offset,
    crvs_region_left=print_path_generation.crvs_region_left,
    crvs_region_right=print_path_generation.crvs_region_right,
    crvs_region_top=print_path_generation.crvs_region_top,
    div_length=number_slider,
    scale=list_7,
    double_layer=toggle)  # -> out, path_crvs_region_left, path_crvs_region_right, path_crvs_region_top, layers_left, layers_right, layers_top, path_length_left, path_length_right, path_length_top; inputs front_mesh: Mesh, back_mesh: Mesh, crvs_region_left: list of Curve, crvs_region_right: list of Curve, crvs_region_top: list of Curve, double_layer: Boolean
# ---------- layer_def: Python ----------
import os
import sys
import json

import Rhino.Geometry as rg
import ghpythonlib.components as ghcomp
import rhinoscriptsyntax as rs

from compas.geometry import Frame
from compas.geometry import Line
from compas.geometry import Vector

from am_information_model.model import Node
from am_information_model.model import Layer

max_r = (div_length*scale)/3
print max_r

def project_crvs(crvs, mesh, direction=rg.Vector3d.YAxis, offset=0, reversed=False):
    proj_crvs = []
    for crv in crvs:
        proj_crv = rg.Curve.ProjectToMesh(crv, mesh, direction, 0.001)[0]
        crv_end_pts = ghcomp.EndPoints(crv)
        proj_end_pts = ghcomp.EndPoints(proj_crv)
        if Vector.from_start_end(crv_end_pts[0], proj_end_pts[0]).length>0.2:
            proj_crv.Reverse()
        if reversed:
            proj_crv.Reverse()
        proj_crv.Translate(0,offset,0)
        proj_crvs.append(proj_crv)
    return proj_crvs

#def mirror_curves(curves, offset):
#    new_crvs = []
#    for crv in curves:
#        crv_endpoints = ghcomp.EndPoints(crv)
#        mir_crv = ghcomp.Mirror(crv, rg.Plane.WorldZX)[0]
#        mir_crv.Translate(0,offset,0)
#        mir_crv_endpoints = ghcomp.EndPoints(mir_crv)
#        if Vector.from_start_end(crv_endpoints[0], mir_crv_endpoints[0]).length>offset:
#            mir_crv.Reverse()
#        new_crvs.append(mir_crv)
#    return new_crvs
#
#mirror_crvs_region_left = mirror_curves(proj_crvs_region_left, 0.320)
#mirror_crvs_region_right = mirror_curves(proj_crvs_region_right, 0.328)
#mirror_crvs_region_top = mirror_curves(proj_crvs_region_top, 0.328)

def layers_from_curves(curves, div, mir_curves=None, alternate=False, reversed=False):
    layers = []
    for j, crv in enumerate(curves):
        nodes = []
        crv_length = ghcomp.Length(crv)
        div_sections = int(crv_length/div)
        (pts, tans, pars) = ghcomp.DivideCurve(crv, div_sections, False)
        
        for i,pt in enumerate(pts):
            frame = Frame(pt, -rg.Vector3d(tans[i].X, 0, tans[i].Z), -Vector.Yaxis())
            nodes.append(Node(frame, radius=max_r))
        if not reversed:
            nodes.reverse()
        
        if mir_curves is not None:
            (mir_pts, mir_tans, mir_pars) = ghcomp.DivideCurve(mir_curves[j], div_sections, False)
            mir_nodes = []
            for i,pt in enumerate(mir_pts):
                frame = Frame(pt, -rg.Vector3d(tans[i].X, 0, tans[i].Z), -Vector.Yaxis())
                mir_nodes.append(Node(frame, radius=max_r))
            if reversed:
                mir_nodes.reverse()
            nodes.extend(mir_nodes)
        if alternate and j%2==0:
            nodes.reverse()
        layers.append(Layer.from_nodes(nodes))
    return layers

#layers_left = layers_from_curves(proj_crvs_region_left, mirror_crvs_region_left, div_length)
#layers_right = layers_from_curves(proj_crvs_region_right, mirror_crvs_region_right, div_length, reversed=True)
#layers_top = layers_from_curves(proj_crvs_region_top, mirror_crvs_region_top, div_length)

def create_closed_curves(crvs, mir_crvs, offset):
    new_crvs = []
    for i,crv in enumerate(crvs):
        crv_endpoints = ghcomp.EndPoints(crv)
        mir_crv_endpoints = ghcomp.EndPoints(mir_crvs[i])
        #if Vector.from_start_end(crv_endpoints[0], mir_crv_endpoints[0]).length>offset:
        #    mir_crv_endpoints.reverse()
        transverse_0 = rg.Line(mir_crv_endpoints[0], crv_endpoints[0])
        transverse_1 = rg.Line(crv_endpoints[1], mir_crv_endpoints[1])
        closed_crv = ghcomp.JoinCurves([crv, transverse_1, mir_crvs[i], transverse_0], False)
        new_crvs.append(closed_crv)
    return new_crvs

def get_lengths(curves):
    length = 0
    for crv in curves:
        length += crv.GetLength()*scale
    return length

#closed_crvs_region_left = create_closed_curves(proj_crvs_region_left, mirror_crvs_region_left, 0.328)
#closed_crvs_region_right = create_closed_curves(proj_crvs_region_right, mirror_crvs_region_right, 0.328)
#closed_crvs_region_top = create_closed_curves(proj_crvs_region_top, mirror_crvs_region_top, 0.328)

if double_layer:
    proj_crvs_region_left = project_crvs(crvs_region_left, front_mesh)
    proj_crvs_region_right = project_crvs(crvs_region_right, front_mesh, reversed=True)
    proj_crvs_region_top = project_crvs(crvs_region_top, front_mesh)
    
    back_vector = -rg.Vector3d.YAxis
    proj_crvs_region_left_back = project_crvs(crvs_region_left, back_mesh, direction=back_vector, offset=0.08)
    proj_crvs_region_right_back = project_crvs(crvs_region_right, back_mesh, direction=back_vector, offset=0.08, reversed=True)
    proj_crvs_region_top_back = project_crvs(crvs_region_top, back_mesh, direction=back_vector, offset=0.08)

    layers_left = layers_from_curves(proj_crvs_region_left, div_length, mir_curves=proj_crvs_region_left_back)
    layers_right = layers_from_curves(proj_crvs_region_right, div_length, mir_curves=proj_crvs_region_right_back, reversed=True)
    layers_top = layers_from_curves(proj_crvs_region_top, div_length, mir_curves=proj_crvs_region_top_back)
    
    path_crvs_region_left = create_closed_curves(proj_crvs_region_left, proj_crvs_region_left_back, 0.328)
    path_crvs_region_right = create_closed_curves(proj_crvs_region_right, proj_crvs_region_right_back, 0.328)
    path_crvs_region_top = create_closed_curves(proj_crvs_region_top, proj_crvs_region_top_back, 0.328)
    
    path_length_left = get_lengths(path_crvs_region_left)
    path_length_right = get_lengths(path_crvs_region_right)
    path_length_top = get_lengths(path_crvs_region_top)
    
else:
    path_crvs_region_left = project_crvs(crvs_region_left, front_mesh)
    path_crvs_region_right = project_crvs(crvs_region_right, front_mesh, reversed=True)
    path_crvs_region_top = project_crvs(crvs_region_top, front_mesh)
    
    layers_left = layers_from_curves(path_crvs_region_left, div_length, alternate=True)
    layers_right = layers_from_curves(path_crvs_region_right, div_length, alternate=True, reversed=True)
    layers_top = layers_from_curves(path_crvs_region_top, div_length, alternate=True)
    
    path_length_left = get_lengths(path_crvs_region_left)
    path_length_right = get_lengths(path_crvs_region_right)
    path_length_top = get_lengths(path_crvs_region_top)
# ---------- end layer_def ----------
generate_assembly_2 = GhPythonScript(
    create=create_2,
    centerplane=xy,
    scale=list_7,
    layers_left=layer_def.layers_left,
    layers_right=layer_def.layers_right,
    layers_top=layer_def.layers_top)  # -> am_model; inputs layers_left: list, layers_right: list, layers_top: list
# ---------- generate_assembly_2: Python ----------
import Rhino.Geometry as rg
import math
from scriptcontext import sticky as st


from compas.geometry import Frame
from compas.geometry import Transformation
from compas.geometry import Scale
from compas.geometry import Point

from compas_ghpython import draw_frame

from am_information_model.model import AMModel
from am_information_model.model import Layer

import Rhino.Geometry as rg

# initialize an empty assembly class

if "am_model" not in st:
    st["am_model"] = None

cp = centerplane
cf = Frame(cp.Origin, cp.XAxis, cp.YAxis)

S = Scale.from_factors([scale]*3, Frame.worldXY())
T = Transformation.from_frame_to_frame(Frame.worldXY(), cf)

def add_layers_to_am_model(amm, layers):
    for layer in layers:
        new_layer = layer.transformed(S)
        new_layer.transform(T)
        amm.add_layer(new_layer)

if create:
    new_amm = AMModel()
    add_layers_to_am_model(new_amm, layers_left)
    add_layers_to_am_model(new_amm, layers_right)
    add_layers_to_am_model(new_amm, layers_top)
    st["am_model"] = new_amm

am_model = st["am_model"]
# ---------- end generate_assembly_2 ----------

data_2 = Data(generate_assembly_2)
panel_4 = Panel(layer_def.path_length_right)
panel_5 = Panel(layer_def.path_length_top)
panel_6 = Panel(layer_def.path_length_left)

# ---- group: Visualise
counter = CountThroughList(am_model=generate_assembly, start=start, stop=stop, step=step, step_back=back, reset=reset, full=full, interval=list)  # -> item, counter; inputs start: Boolean, stop: Boolean, step_back: Boolean
# ---------- counter: Python ----------
from scriptcontext import sticky as st
from compas_ghpython import update_component


L = list(am_model.layers())
# store data in component
guid = str(ghenv.Component.InstanceGuid)
counter_key = "counter_" + guid
running_key = "running_" + guid

if counter_key not in st:
    st[counter_key] = 0

if running_key not in st:
    st[running_key] = False
    

if st[running_key]:
    if st[counter_key] < len(L) - 1:
        st[counter_key] += 1
        update_component(ghenv, interval)
    else:
        st[counter_key] = 0
        st[running_key] = False
    
    
if start:
    st[running_key] = True

if stop:
    st[running_key] = False

if step:
    if st[counter_key] < len(L) - 1:
        st[counter_key] += 1

if step_back:
    if st[counter_key] < len(L) - 1:
        st[counter_key] -= 1

if reset:
    st[counter_key] = 0

if full:
    st[counter_key] = len(L)-1

if len(L):
    item = L[st[counter_key]]



#st["visualisation_counter"] = st[counter_key]
counter = st[counter_key]
# ---------- end counter ----------
show = BooleanToggle(True)
show_2 = BooleanToggle(False)
idx = Panel(counter.counter)
draw = PythonScript(am_model=generate_assembly, show_all=show, show_counter=show_2, counter=idx)  # -> G, tool_planes_WCS, current_tool_plane, current_layer_planes; inputs counter: Int32
# ---------- draw: Python ----------
import os
import sys

import math

from compas_ghpython.artists import MeshArtist
from compas_ghpython import draw_frame

#from assembly_information_model.artist import AssemblyArtist


G = []

key_index = am_model.network.key_index()
keys = [key_index[key] for key in am_model.network.nodes()]
layers = [am_model.layer(key) for key in keys] 

tool_planes_WCS = [draw_frame(layer.node(0).frame) for layer in layers]

current_tool_plane = tool_planes_WCS[counter]
current_layer_planes = [draw_frame(frame) for frame in layers[counter].path]

if show_all and not show_counter:
    for layer in layers:
        for key, node in layer.nodes():
            plane = draw_frame(node.frame)
            G.append(plane)

if show_counter:
    for layer in layers[0:counter+1]:
        for key, node in layer.nodes():
            plane = draw_frame(node.frame)
            G.append(plane)
# ---------- end draw ----------
geo = Geometry(draw.G)
pln = Plane(draw.current_tool_plane)
pln_2 = Plane(draw.tool_planes_WCS)
pln_3 = Plane(draw.current_layer_planes)
preview_4 = CustomPreview(Geometry=geo, Shader=ColourSwatch(SwatchColor=RGBA(255, 186, 220, 146)))

# Layer visualization
counter_2 = CountThroughList(
    am_model=generate_assembly_2,
    start=start_2,
    stop=stop_2,
    step=step_2,
    step_back=back_2,
    reset=reset_2,
    full=full_2,
    interval=list_2)  # -> item, counter; inputs start: Boolean, stop: Boolean, step_back: Boolean
# ---------- counter_2: Python ----------
from scriptcontext import sticky as st
from compas_ghpython import update_component


L = list(am_model.layers())
# store data in component
guid = str(ghenv.Component.InstanceGuid)
counter_key = "counter_" + guid
running_key = "running_" + guid

if counter_key not in st:
    st[counter_key] = 0

if running_key not in st:
    st[running_key] = False
    

if st[running_key]:
    if st[counter_key] < len(L) - 1:
        st[counter_key] += 1
        update_component(ghenv, interval)
    else:
        st[counter_key] = 0
        st[running_key] = False
    
    
if start:
    st[running_key] = True

if stop:
    st[running_key] = False

if step:
    if st[counter_key] < len(L) - 1:
        st[counter_key] += 1

if step_back:
    if st[counter_key] > 0:
        st[counter_key] -= 1

if reset:
    st[counter_key] = 0

if full:
    st[counter_key] = len(L)-1

if len(L):
    item = L[st[counter_key]]



#st["visualisation_counter"] = st[counter_key]
counter = st[counter_key]
# ---------- end counter_2 ----------
show_3 = BooleanToggle(True)
show_4 = BooleanToggle(False)
idx_2 = Panel(counter_2.counter)
draw_2 = PythonScript(am_model=generate_assembly_2, show_all=show_3, show_counter=show_4, counter=idx_2)  # -> G, tool_planes_WCS, current_tool_plane, current_layer_planes; inputs counter: Int32; same code as draw
geo_2 = Geometry(draw_2.G)
pln_4 = Plane(draw_2.tool_planes_WCS)
pln_5 = Plane(draw_2.current_tool_plane)
pln_6 = Plane(draw_2.current_layer_planes)
# ToDo
# Wall Positioning
# JASON File
# Fabrication to ABB
preview_5 = CustomPreview(Geometry=geo_2, Shader=ColourSwatch(SwatchColor=RGBA(255, 186, 220, 146)))

# ----
# Robot Model
# Load robot from local package
panel_7 = Panel("abb_fabtory.urdf")
list_8 = ValueList({"abb_fabtory"}, selected="abb_fabtory")
py_4 = PythonScript()  # -> packages
# ---------- py_4: Python ----------
packages = ["abb_irb6700_support", "abb_end_effectors", "abb_fabtory"]
# ---------- end py_4 ----------
py_5 = PythonScript(path=path.ROBOT_DESCRIPTION, packages=py_4)  # -> loaders; inputs packages: list
# ---------- py_5: Python ----------
from compas.robots import LocalPackageMeshLoader

loaders = []
print packages


for package in packages:
    loaders.append(LocalPackageMeshLoader(path, package))
# ---------- end py_5 ----------
load = Button()
units = ValueList({"m": 1, "cm": 100, "mm": 1000}, selected="m")
py_6 = PythonScript(path=path.ROBOT_DESCRIPTION, package=list_8, urdf_name=panel_7, srdf_name="abb_fabtory.srdf")  # -> package_path, urdf_filename, srdf_filename
# ---------- py_6: Python ----------
import os

package_path = os.path.join(path, package)
print(package_path)

urdf_filename = os.path.join(package_path, "urdf", urdf_name)
srdf_filename = os.path.join(package_path, srdf_name)

assert os.path.isfile(urdf_filename)
assert os.path.isfile(srdf_filename)
# ---------- end py_6 ----------
create_3 = PythonScript(loaders=py_5, urdf_filename=py_6.urdf_filename, srdf_filename=py_6.srdf_filename, scale_factor=units, load=load)  # -> out, robot; inputs loaders: list
# ---------- create_3: Python ----------
import os
from scriptcontext import sticky as st

import compas

from compas.robots import RobotModel
from compas.robots import LocalPackageMeshLoader

from compas_fab.robots import Robot
from compas_fab.robots import RobotSemantics

from compas_fab.ghpython import RobotArtist

compas.PRECISION = '12f'

# store robot in component
guid = str(ghenv.Component.InstanceGuid)
robot_key = "robot_" + guid

if robot_key not in st:
    st[robot_key] = None

print loaders

if load:
    model = RobotModel.from_urdf_file(urdf_filename)
    
    model.load_geometry(*loaders)
    artist = RobotArtist(model)
    semantics = RobotSemantics.from_srdf_file(srdf_filename, model)
    robot = Robot(model, artist, semantics, client=None)
    
    st[robot_key] = robot

robot = st[robot_key]


if robot:
    robot.scale(scale_factor)
# ---------- end create_3 ----------
robot = Data(create_3.robot)

# ----
# Tool
panel_8 = Panel("Attach a custom tool")
list_9 = ValueList({"measurement_tool": 0, "area_grip": 1, "concrete_extruder": 2}, selected="concrete_extruder")
tools = Tools(G=list_9)
remove = Button()
add = Button()
attach_remove = PythonScript(robot=robot, tool=tools, attach=add, remove=remove)  # -> out, bang
# ---------- attach_remove: Python ----------
if attach:
    robot.attach_tool(tool)
if remove:
    robot.detach_tool()
# ---------- end attach_remove ----------

info = PythonScript(robot=robot)  # -> out, main_group_name
# ---------- info: Python ----------
if robot:
    robot.info()
    main_group_name = robot.main_group_name
# ---------- end info ----------
panel_9 = Panel(info.out)

# ----
# Configuration
number_slider_2 = Slider(0, range=0..4.2)
jp = GhPythonScript()  # -> configuration_values
# ---------- jp: Python ----------
import math
joint_values = [-3.136, -0.328, -1.218, 3.129, 0.852, 0.008]
#joint_positions = [0] * 6

cart = 0
j_values = [0,0,0,0,0,0]

configuration_values = [cart] + j_values
# ---------- end jp ----------
forward_kinematics = PythonScript(
    robot=robot,
    reset_configuration=Button(),
    configuration_values=jp,
    a_cart=number_slider_2,
    a_a1=Slider(0, range=-180..180),
    a_a2=Slider(0, range=-90..150),
    a_a3=Slider(0, range=-180..180),
    a_a4=Slider(0, range=-400..400),
    a_a5=Slider(0, range=-125..120),
    a_a6=Slider(0, range=-400..400))  # -> full_configuration; inputs reset_configuration: Boolean, configuration_values: list
# ---------- forward_kinematics: Python ----------
import math
import Grasshopper
import copy
from compas.robots import Joint
from compas_fab.robots import Configuration

if reset_configuration:
    j = 0
    for i in range(ghenv.Component.Params.Input.Count):
        nslider = ghenv.Component.Params.Input[i].Sources[0]
        if nslider.GetType() == Grasshopper.Kernel.Special.GH_NumberSlider:
            nslider.TrySetSliderValue(configuration_values[j])
            j += 1

    
if robot:
    #a_cyl = a_a2 * -0.25
    #a_piston = math.radians(a_a2) * 0.15
    #joint_positions = [a_cart, a_a1, a_a2, a_cyl, a_a3, a_a4, a_a5, a_a6, a_piston]
    joint_positions = [a_cart, a_a1, a_a2, a_a3, a_a4, a_a5, a_a6]
    joint_positions_degrees = copy.deepcopy(joint_positions)
    joint_types = robot.get_configurable_joint_types()
    print(joint_types)
    for i, joint_type in enumerate(joint_types):
        if joint_type == Joint.REVOLUTE:
            joint_positions[i] = math.radians(joint_positions[i])
        if joint_type == Joint.PRISMATIC:
            joint_positions[i] = joint_positions[i]
    full_configuration = Configuration(joint_positions, joint_types)
# ---------- end forward_kinematics ----------

# ----
# Send to Robot Studio
send_7 = Button()
robotstudioexample = GhPythonScript(full_configuration=forward_kinematics, send=send_7)  # -> out; inputs send: Boolean
# ---------- robotstudioexample: Python ----------
import compas_rrc as rrc
from compas.robots import Joint
from compas_fab.robots import Configuration
import math
"""
Instructions:
    1: Start Docker
    2: Open the Robot Studio File and press Start in the Simulation Tab
    3: Press the "Send" Button
    4: The Simulation will now run in Robot Studio and the component
    freezes until it has finished
"""

robot_joint_positions = []

for i, joint_type in enumerate(full_configuration.joint_types):
    if joint_type == Joint.REVOLUTE:
        robot_joint_positions.append(math.degrees(full_configuration.joint_values[i]))
    if joint_type == Joint.PRISMATIC:
        robot_track_position = full_configuration.joint_values[i]*1000


if __name__ == '__main__' and send==True:

    # Create Ros Client
    ros = rrc.RosClient()
    ros.run()

    # Create ABB Client
    abb = rrc.AbbClient(ros, '/rob1')
    print('Connected.')

    # Print text on FlexPenant
    abb.send(rrc.PrintText('Welcome AFAB to COMPAS_RRC ;)'))

    # Define robot joint positions
    robot_pos_joints_park = [-90.0, -30.0, 70.0, 0.0, 50.0, 0.0]
    #robot_pos_joints_start = [-135.0, 30.0, 20.0, 0.0, 30.0, 0.0]    
    robot_pos_joints_start = robot_joint_positions
    
    # Define track joint positions 
    track_pos_joint_park = [0.0]
    track_pos_joint_start = [robot_track_position]
    
    # Set speed [mm/s]
    speed = 1000
    
    # Move to start position 
    done = abb.send_and_wait(rrc.MoveToJoints(robot_pos_joints_start, track_pos_joint_start, speed, rrc.Zone.FINE))

    # Move to park position
    done = abb.send_and_wait(rrc.MoveToJoints(robot_pos_joints_park, track_pos_joint_park, speed, rrc.Zone.FINE))

    # Print feedback 
    print('Feedback = ', done)

    # End of Code
    print('Finished')

    # Close client
    ros.close()
    ros.terminate()

if send:
    abb_script.send_script()
print abb_script
# ---------- end robotstudioexample ----------
panel_10 = Panel(robotstudioexample)

# ----
# Visualisation
toggle_2 = BooleanToggle(True)
robot_visualize = RobotVisualize(
    robot=robot,
    configuration=forward_kinematics,
    redraw=attach_remove.bang,
    show_visual=toggle_2,
    show_collision=Toggle(False),
    show_frames=Toggle(False),
    show_base_frame=Toggle(False),
    show_end_effector_frame=Toggle(True),
    show_acm=Toggle(False))  # -> visual, collision, attached_meshes, frames, base_frame, ee_frame; inputs redraw: list, show_visual: Boolean, show_collision: Boolean, show_frames: Boolean, show_base_frame: Boolean, show_end_effector_frame: Boolean, show_acm: Boolean
#   port group: The planning group used for end-effector and base visualization.
#   port configuration: The robot's full configuration.
#   port redraw: A list of attached collision meshes.
#   port show_visual: Whether or not to show the robot's visual meshes.
#   port show_collision: Whether or not to show the robot's collision meshes.
#   port show_frames: Whether or not to show the robot's joint frames.
#   port show_base_frame: Whether or not to show the robot's base frame.
#   port show_end_effector_frame: Whether or not to show the robot's end-effector frame.
#   port show_acm: Whether or not to show the attached collision meshes (if any).
#   port visual: The robot's visual Rhino meshes (if any).
#   port collision: The robot's collision Rhino meshes (if any).
#   port attached_meshes: The attached collision Rhino meshes (if any).
#   port frames: The robot's joint frames as Rhino planes (if any).
#   port base_frame: The robot's base frame as a Rhino plane (if any).
#   port ee_frame: The robot's end-effector frame as a Rhino plane (if any).
# ---------- robot_visualize: Python ----------
"""
Visualizes the robot.

COMPAS FAB v0.19.1
"""
from compas.geometry import Frame
from compas.geometry import Transformation
from compas_ghpython.artists import FrameArtist
from compas_ghpython.artists import MeshArtist
from ghpythonlib.componentbase import executingcomponent as component


class RobotVisualize(component):
    def RunScript(self, robot, group, configuration, attached_collision_meshes, show_visual, show_collision,
                  show_frames, show_base_frame, show_end_effector_frame, show_acm):

        visual = None
        collision = None
        attached_meshes = None
        frames = None
        base_frame = None
        ee_frame = None

        if robot:
            show_visual = True if show_visual is None else show_visual
            configuration = configuration or robot.zero_configuration()

            robot.update(configuration, visual=show_visual, collision=show_collision)
            compas_frames = robot.transformed_frames(configuration, group)

            if show_visual:
                visual = robot.artist.draw_visual()

            if show_collision:
                collision = robot.artist.draw_collision()

            if show_base_frame:
                base_compas_frame = compas_frames[0]
                artist = FrameArtist(base_compas_frame)
                base_frame = artist.draw()

            if show_end_effector_frame:
                ee_compas_frame = robot.forward_kinematics(configuration, group, options=dict(solver='model'))
                if robot.attached_tool:
                    ee_compas_frame = robot.from_t0cf_to_tcf([ee_compas_frame])[0]
                artist = FrameArtist(ee_compas_frame)
                ee_frame = artist.draw()

            if show_frames:
                frames = []
                for compas_frame in compas_frames[1:]:
                    artist = FrameArtist(compas_frame)
                    frame = artist.draw()
                    frames.append(frame)

            if show_acm:
                attached_meshes = []
                for acm in attached_collision_meshes:
                    frame = robot.forward_kinematics(configuration, options=dict(solver='model', link_name=acm.link_name))
                    T = Transformation.from_frame_to_frame(Frame.worldXY(), frame)
                    mesh = acm.collision_mesh.mesh.transformed(T)
                    attached_meshes.append(MeshArtist(mesh).draw())

        return (visual, collision, attached_meshes, frames, base_frame, ee_frame)
# ---------- end robot_visualize ----------
geo_3 = Geometry(robot_visualize.collision)
geo_4 = Geometry(robot_visualize.visual)
geo_5 = Geometry(robot_visualize.attached_meshes)
preview_6 = CustomPreview(Geometry=geo_5, Shader=ColourSwatch(SwatchColor=RGB(92, 115, 130)))
draw_3 = GhPythonScript(frames=[robot_visualize.frames, robot_visualize.base_frame, robot_visualize.ee_frame], scale=Slider(0.1, range=0..1))  # -> P, V, C, W; inputs frames: list
# ---------- draw_3: Python ----------
from System.Drawing import Color
from compas_ghpython.utilities import draw_frame

red = Color.FromArgb(255, 0, 0)
green = Color.FromArgb(0, 255, 0)
blue = Color.FromArgb(0, 0, 255)

P = []
V = []
C = []

scale = float(scale)

for frame in frames:
    if not frame:
        continue
    #plane = draw_frame(frame)
    #P += [plane.Origin] * 3
    #V.append(plane.XAxis * scale)
    #V.append(plane.YAxis * scale)
    #V.append(plane.ZAxis * scale)
    C += [red, green, blue]

W = 3
# ---------- end draw_3 ----------
preview_7 = CustomPreview(Geometry=geo_4, Shader=ColourSwatch(SwatchColor=RGB(105, 105, 105)))
vdisex_2 = VectorDisplayEx(Point=draw_3.P, Vector=draw_3.V, Colour=draw_3.C, Width=draw_3.W)

# ----
# Continuous fabrication
ur_speed = Slider(0.012, range=0..1)
ext_speed = Slider(1600, range=0..4000)
ext_accel = Slider(4000, range=0..4000)
Z = UnitZ(Factor=Slider(0.6, range=0..1))
pln_7 = Plane(Plane(origin=(-0.5813372945, -0.04765815763, -0.449495498), x=(-0.01795929223, -0.9998379119, 0.001270365803), y=(-0.9997696103, 0.0179729749, 0.01173449636)))
include_extruder = BooleanToggle(True)
move = Move(Geometry=pln_7, Motion=Z)  # -> Geometry, Transform
create_tasks = Button()
send_data = Button()
stop_5 = Button()
start_3 = Button()
timer = Timer(Interval=1000, TimerInterval=1000, Target=continuous_operation_multiple_layers)  # disabled
continuous_operation_multiple_layers = GhPythonScript(
    fabrication=fabrication.fabrication,
    am_model=generate_assembly,
    am_safety_plane=move.Geometry,
    robot=robot,
    ur_speed=ur_speed,
    ext_speed=ext_speed,
    ext_maxspeed=ext_accel,
    create_tasks=create_tasks,
    send_extruder_data=send_data,
    include_extruder=include_extruder,
    start=start_3,
    stop=stop_5,
    skip_task=skip_task,
    undo_task=undo_task)  # -> out, msgs, states, tasks, exit_msgs, current_task, task_key_current, fabrication
# ---------- continuous_operation_multiple_layers: Python ----------
from scriptcontext import sticky as st

import sys, os
am_hackathon_path = os.path.abspath(os.path.join(ghdoc.Path,"../../src"))
if am_hackathon_path not in sys.path:
    sys.path.append(am_hackathon_path)

from compas.geometry import Frame
from compas.geometry import Translation
from compas.geometry import Transformation
from compas.geometry import Vector
from compas_ghpython import update_component
from mobile_additive_manufacturing.control import URScript_Extrusion
from mobile_additive_manufacturing.control import set_extruder_data
from ur_fabrication_control.direct_control import URScript
from ur_fabrication_control.direct_control.mixins.airpick_mixins import AirpickMixins
from ur_fabrication_control.direct_control.fabrication_process import Fabrication

ur_ip = st["ur_ip"]
ur_port = st["ur_port"]
server_ip = st["server_address"]
server_port = st["server_port"]
ext_ip = st["ext_ip"]
ext_port = st["ext_port"]


def create_tasks_from_am_model(am_model):
    for key, layer in am_model.layers():
        if key == 0:
            toggle_extruder = True
        elif key == am_model.number_of_layers()-1:
            toggle_extruder = False
        else:
            toggle_extruder = None
        exit_message = "Layer{}_completed".format(key)
        layer_urscript = get_layer_ur_script(layer, toggle_extruder, exit_message)
        fabrication.add_task(layer_urscript, exit_message)

def get_frames_in_RCS(frames):
    return [robot.to_local_coordinates(frame) for frame in frames]

def get_layer_ur_script(layer, toggle_extruder, exit_message):
    ur_script = URScript_Extrusion(ur_ip=ur_ip, ur_port=ur_port, ext_ip=ext_ip, ext_port=ext_port)
    tool_angle_axis = list(robot.attached_tool.frame.point) + list(robot.attached_tool.frame.axis_angle_vector)
    
    ur_script.start()
    ur_script.set_tcp(tool_angle_axis)
    RCS_frames = get_frames_in_RCS([node.frame for key, node in layer.nodes()])
    first = False
    for key, node in layer.nodes():
        if key in [0]:
            ur_script.move_linear(robot.to_local_coordinates(node.frame), velocity=ur_speed, radius=node.radius)
            if (toggle_extruder == True) and (toggle_extruder != None) and include_extruder:
                toggle_extrusion(ur_script, 1)
        else:
            ur_script.move_process(robot.to_local_coordinates(node.frame), ur_speed, node.radius)
    else:
        if (toggle_extruder == False) and (toggle_extruder != None) and include_extruder:
            toggle_extrusion(ur_script, 0)
    # Signify ready
    ur_script.socket_open(server_ip, server_port, "Feedbackserver")
    ur_script.socket_send_line_string(exit_message, socket_name="Feedbackserver")
    ur_script.socket_close(name="Feedbackserver")
    #Finalize script
    ur_script.end()
    ur_script.generate()
    return ur_script

def get_stop_ur_script(safety_plane):
    safety_frame_WCS = Frame(safety_plane.Origin, safety_plane.XAxis, safety_plane.YAxis)
    safety_frame_RCS = robot.to_local_coordinates(safety_frame_WCS)
    
    ur_script = URScript_Extrusion(ur_ip=ur_ip, ur_port=ur_port, ext_ip=ext_ip, ext_port=ext_port)
    tool_angle_axis = list(robot.attached_tool.frame.point) + list(robot.attached_tool.frame.axis_angle_vector)
    
    ur_script.start()
    ur_script.set_tcp(tool_angle_axis)
    if include_extruder:
        toggle_extrusion(ur_script, 0)
    ur_script.move_linear(safety_frame_RCS, velocity=ur_speed, radius=0)
    ur_script.end()
    ur_script.generate()
    return ur_script

def toggle_extrusion(ur_script, state):
    ur_script.open_socket_extruder()
    if state==1:
        ur_script.toggle_fan(state=state)
    ur_script.toggle_air(state=state)
    ur_script.set_extruder_data(state=state, max_speed=ext_maxspeed, speed=ext_speed)
    ur_script.close_socket_extruder()

if create_tasks:
    fabrication.current_task = 0
    fabrication.clear_tasks()
    fabrication.stop_task = get_stop_ur_script(am_safety_plane)
    create_tasks_from_am_model(am_model)

if send_extruder_data:
    set_extruder_data(ur_ip, ur_port, ext_ip, ext_port, 0, ext_maxspeed, ext_speed)

if stop:
    fabrication.stop()

if start:
    fabrication.start()

if skip_task:
    skip_key = fabrication.get_next_task()
    fabrication.tasks[skip_key]["state"] = "completed"
    fabrication.current_task+=1

if undo_task:
    undo_key = fabrication.get_next_task()-1
    fabrication.tasks[undo_key]["state"] = "waiting"
    if fabrication.current_task != 0:
        fabrication.current_task-=1

try:
    fab = fabrication
except NameError:
    fabrication = None
else:
    task_dict = fabrication.tasks.values()
    if fabrication.tasks_available():
        if fabrication.current_task == None:
            task_key_current = fabrication.get_next_task()
        else:
            task_key_current = fabrication.current_task
        current_task = task_dict[task_key_current]["task"].script
    tasks = []
    states = []
    exit_msgs = []
    for task in task_dict:
        tasks.append(task["task"])
        states.append(task["state"])
        exit_msgs.append(task["exit_message"])
    msgs = fabrication.server.msgs.values()
# ---------- end continuous_operation_multiple_layers ----------
server_messages = Panel(continuous_operation_multiple_layers.msgs)
states = Panel(continuous_operation_multiple_layers.states)
current_task = Panel(continuous_operation_multiple_layers.current_task)
tasks = Panel(continuous_operation_multiple_layers.tasks)
exit_message = Panel(continuous_operation_multiple_layers.exit_msgs)

idx_3 = Panel(continuous_operation_multiple_layers.task_key_current)

# ==== cluster Tools

# ---- group: area grip tool
geo = Geometry(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)
mesh = Mesh(geo)
mjoin = MeshJoin(Meshes=mesh)
zaxis_line = Curve(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)
xaxis_line = Curve(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)
tool = PythonScript(rhmesh=mjoin, xline=xaxis_line, zline=zaxis_line)  # -> tool; inputs rhmesh: Mesh
# ---------- tool: Python ----------
import Rhino.Geometry as rg
import os, math
from compas.geometry import Frame, Rotation
from compas.datastructures import Mesh
from compas_ghpython.artists import MeshArtist
from compas_fab.robots import Tool
from compas_rhino.geometry import RhinoMesh

xaxis = rg.Line(xline.PointAtStart, xline.PointAtEnd)
zaxis = rg.Line(zline.PointAtStart, zline.PointAtEnd)

if xaxis.From.DistanceTo(zaxis.From) < 0.01:
    origin = xaxis.From
    xaxis = xaxis.Direction
    zaxis = zaxis.Direction
elif xaxis.To.DistanceTo(zaxis.To) < 0.01:
    origin = xaxis.To
    xaxis = -xaxis.Direction
    zaxis = -zaxis.Direction
elif xaxis.From.DistanceTo(zaxis.To) < 0.01:
    origin = xaxis.From
    xaxis = xaxis.Direction
    zaxis = -zaxis.Direction
elif xaxis.To.DistanceTo(zaxis.From) < 0.01:
    origin = xaxis.To
    xaxis = -xaxis.Direction
    zaxis = zaxis.Direction

xaxis.Unitize()
zaxis.Unitize()

ee_frame = Frame(origin, xaxis, zaxis)
ee_mesh = RhinoMesh.from_geometry(rhmesh).to_compas()

tool = Tool(ee_mesh, ee_frame)
# ---------- end tool ----------

# ---- group: measurement tool
geo_2 = Geometry(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)
mesh_2 = Mesh(geo_2)
mjoin_2 = MeshJoin(Meshes=mesh_2)
xaxis_line_2 = Curve(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)
yaxis_line = Curve(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)
tool_2 = PythonScript(rhmesh=mjoin_2, xline=xaxis_line_2, yline=yaxis_line)  # -> tool; inputs rhmesh: Mesh
# ---------- tool_2: Python ----------
import Rhino.Geometry as rg
import os, math
from compas.geometry import Frame, Rotation
from compas.datastructures import Mesh
from compas_ghpython.artists import MeshArtist
from compas_fab.robots import Tool
from compas_rhino.geometry import RhinoMesh

xaxis = rg.Line(xline.PointAtStart, xline.PointAtEnd)
yaxis = rg.Line(yline.PointAtStart, yline.PointAtEnd)

if xaxis.From.DistanceTo(yaxis.From) < 0.01:
    origin = xaxis.From
    xaxis = xaxis.Direction
    yaxis = yaxis.Direction
elif xaxis.To.DistanceTo(yaxis.To) < 0.01:
    origin = xaxis.To
    xaxis = -xaxis.Direction
    yaxis = -yaxis.Direction
elif xaxis.From.DistanceTo(yaxis.To) < 0.01:
    origin = xaxis.From
    xaxis = xaxis.Direction
    yaxis = -yaxis.Direction
elif xaxis.To.DistanceTo(yaxis.From) < 0.01:
    origin = xaxis.To
    xaxis = -xaxis.Direction
    yaxis = yaxis.Direction

xaxis.Unitize()
yaxis.Unitize()

ee_frame = Frame(origin, xaxis, yaxis)
ee_mesh = RhinoMesh.from_geometry(rhmesh).to_compas()

tool = Tool(ee_mesh, ee_frame)
# ---------- end tool_2 ----------

# ---- group: area grip tool
geo_3 = Geometry(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)
mesh_3 = Mesh(geo_3)
mjoin_3 = MeshJoin(Meshes=mesh_3)
yaxis_line_2 = Curve(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)
xaxis_line_3 = Curve(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)
tool_3 = PythonScript(rhmesh=mjoin_3, xline=xaxis_line_3, yline=yaxis_line_2)  # -> tool; inputs rhmesh: Mesh; same code as tool_2

# ----
G = ClusterInput()
filter = StreamFilter(Gate=G, Stream0=tool_2, Stream1=tool_3, Stream2=tool)
s_2 = ClusterOutput(filter)
