# Grasshopper definition fabtory_simulation_control_extension.ghx (Grasshopper 1.0.7)

reload = Button()
path = PythonScript()  # -> HERE, DATA, ROBOT_DESCRIPTION
# ---------- path: Python ----------
import os

HERE = os.path.dirname(ghdoc.Path)
DATA = os.path.abspath(os.path.join(HERE, "..", "data"))
ROBOT_DESCRIPTION = os.path.abspath(os.path.join(DATA, "robot_description"))

print(HERE)
print(DATA)
print(ROBOT_DESCRIPTION)
# ---------- end path ----------
py = PythonScript(reload=reload)
# ---------- py: Python ----------
if reload:
    from compas_ghpython import unload_modules
    unload_modules('compas')
    unload_modules("compas_fab")
    unload_modules("fabtory_fabrication_control")
# ---------- end py ----------

# ----
# Robot Model
# Load robot from local package
panel = Panel("abb_fabtory.urdf")
list = ValueList({"abb_fabtory"}, selected="abb_fabtory")
py_2 = PythonScript()  # -> packages
# ---------- py_2: Python ----------
packages = ["abb_irb6700_support", "abb_end_effectors", "abb_fabtory"]
# ---------- end py_2 ----------
py_3 = PythonScript(path=path.ROBOT_DESCRIPTION, package=list, urdf_name=panel, srdf_name="abb_fabtory.srdf")  # -> package_path, urdf_filename, srdf_filename
# ---------- py_3: Python ----------
import os

package_path = os.path.join(path, package)
print(package_path)

urdf_filename = os.path.join(package_path, "urdf", urdf_name)
srdf_filename = os.path.join(package_path, srdf_name)

assert os.path.isfile(urdf_filename)
assert os.path.isfile(srdf_filename)
# ---------- end py_3 ----------
py_4 = PythonScript(path=path.ROBOT_DESCRIPTION, packages=py_2)  # -> loaders; inputs packages: list
# ---------- py_4: Python ----------
from compas.robots import LocalPackageMeshLoader

loaders = []
print packages


for package in packages:
    loaders.append(LocalPackageMeshLoader(path, package))
# ---------- end py_4 ----------
load = Button()
units = ValueList({"m": 1, "cm": 100, "mm": 1000}, selected="m")
create = PythonScript(loaders=py_4, urdf_filename=py_3.urdf_filename, srdf_filename=py_3.srdf_filename, scale_factor=units, load=load)  # -> out, robot; inputs loaders: list
# ---------- create: Python ----------
import os
from scriptcontext import sticky as st

import compas

from compas.robots import RobotModel
from compas.robots import LocalPackageMeshLoader

from compas_fab.robots import Robot
from compas_fab.robots import RobotSemantics

from compas_fab.ghpython import RobotArtist

compas.PRECISION = '12f'

# store robot in component
guid = str(ghenv.Component.InstanceGuid)
robot_key = "robot_" + guid

if robot_key not in st:
    st[robot_key] = None

print loaders

if load:
    model = RobotModel.from_urdf_file(urdf_filename)
    
    model.load_geometry(*loaders)
    artist = RobotArtist(model)
    semantics = RobotSemantics.from_srdf_file(srdf_filename, model)
    robot = Robot(model, artist, semantics, client=None)
    
    st[robot_key] = robot

robot = st[robot_key]


if robot:
    robot.scale(scale_factor)
# ---------- end create ----------
robot = Data(create.robot)

# ----
# Tool
panel_2 = Panel("Attach a custom tool")
list_2 = ValueList({"measurement_tool": 0, "area_grip": 1, "concrete_extruder": 2}, selected="concrete_extruder")
tools = Tools(G=list_2)
remove = Button()
add = Button()
attach_remove = PythonScript(robot=robot, tool=tools, attach=add, remove=remove)  # -> out, bang
# ---------- attach_remove: Python ----------
if attach:
    robot.attach_tool(tool)
if remove:
    robot.detach_tool()
# ---------- end attach_remove ----------

toggle = BooleanToggle(True)

# ----
# ROS & ABB client
ip = ValueList({"192.168.125.1", "127.0.0.1"}, selected="127.0.0.1")
robot_port = ValueList({"9090", "30101"}, selected="9090")
ros = ROSConnect(ip=ip, port=robot_port, connect=toggle)  # -> ros_client, is_connected; inputs port: Int32, connect: Boolean
#   port ip: The ip address ROS. Defaults to 127.0.0.1.
#   port port: The port of ROS. Defaults to 9090.
#   port connect: If True, connects to ROS. If False, disconnects from ROS. Defaults to False.
#   port ros_client: The ROS client.
#   port is_connected: True if connection established.
# ---------- ros: Python ----------
"""
Connect or disconnect to ROS.

COMPAS FAB v0.19.1
"""
from ghpythonlib.componentbase import executingcomponent as component
from scriptcontext import sticky as st

from compas_fab.backends import RosClient
from compas_fab.ghpython.components import create_id


class ROSConnect(component):
    def RunScript(self, ip, port, connect):
        ros_client = None

        ip = ip or '127.0.0.1'
        port = port or 9090

        key = create_id(self, 'ros_client')
        ros_client = st.get(key, None)

        if ros_client:
            st[key].close()
        if connect:
            st[key] = RosClient(ip, port)
            st[key].run(5)

        ros_client = st.get(key, None)
        is_connected = ros_client.is_connected if ros_client else False
        return (ros_client, is_connected)
# ---------- end ros ----------
abb = GhPythonScript(ros_client=ros.ros_client, connect=toggle)  # -> out, abb_client; inputs connect: Boolean
# ---------- abb: Python ----------
import compas_rrc as rrc

if ros_client:
    if ros_client.is_connected and connect: 
        # Create ABB Client
        abb_client = rrc.AbbClient(ros_client, '/rob1')
# ---------- end abb ----------
is_connected = Panel(ros.is_connected)
set = PythonScript(robot=robot, ros_client=ros.ros_client, abb_client=abb.abb_client)  # -> robot
# ---------- set: Python ----------
if robot and ros_client and abb_client:
    robot.ros_client = ros_client
    robot.abb_client = abb_client
# ---------- end set ----------
robot_2 = Data(set)
info = PythonScript(robot=robot_2)  # -> out, main_group_name
# ---------- info: Python ----------
if robot:
    robot.info()
    main_group_name = robot.main_group_name
# ---------- end info ----------

# ----
# Configuration
number_slider = Slider(-59, range=-180..180)
jp = GhPythonScript()  # -> configuration_values
# ---------- jp: Python ----------
import math
joint_values = [-3.136, -0.328, -1.218, 3.129, 0.852, 0.008]
#joint_values = [math.degrees(j) for j in joint_values]
#joint_positions = [0] * 6

cart = 0
joint_values = [0,0,0,0,0,0]

configuration_values = [cart] + joint_values
# ---------- end jp ----------
forward_kinematics = PythonScript(
    robot=robot_2,
    reset_configuration=Button(),
    configuration_values=jp,
    a_cart=Slider(0, range=0..4.2),
    a_a1=number_slider,
    a_a2=Slider(40.2, range=-90..150),
    a_a3=Slider(17.9, range=-180..180),
    a_a4=Slider(21.5, range=-400..400),
    a_a5=Slider(0, range=-125..120),
    a_a6=Slider(0, range=-400..400))  # -> full_configuration; inputs reset_configuration: Boolean, configuration_values: list
# ---------- forward_kinematics: Python ----------
import math
import Grasshopper
import copy
from compas.robots import Joint
from compas_fab.robots import Configuration

if reset_configuration:
    j = 0
    for i in range(ghenv.Component.Params.Input.Count):
        nslider = ghenv.Component.Params.Input[i].Sources[0]
        if nslider.GetType() == Grasshopper.Kernel.Special.GH_NumberSlider:
            nslider.TrySetSliderValue(configuration_values[j])
            j += 1

    
if robot:
    #a_cyl = a_a2 * -0.25
    #a_piston = math.radians(a_a2) * 0.15
    #joint_positions = [a_cart, a_a1, a_a2, a_cyl, a_a3, a_a4, a_a5, a_a6, a_piston]
    joint_positions = [a_cart, a_a1, a_a2, a_a3, a_a4, a_a5, a_a6]
    joint_positions_degrees = copy.deepcopy(joint_positions)
    joint_types = robot.get_configurable_joint_types()
    print(joint_types)
    for i, joint_type in enumerate(joint_types):
        if joint_type == Joint.REVOLUTE:
            joint_positions[i] = math.radians(joint_positions[i])
        if joint_type == Joint.PRISMATIC:
            joint_positions[i] = joint_positions[i]
    full_configuration = [Configuration(joint_positions, joint_types)]
# ---------- end forward_kinematics ----------

# ----
# Inverse Kinematics
x_axis = Curve(<curve referenced from the Rhino model>)
y_axis = Curve(<curve referenced from the Rhino model>)
x_axis_2 = Curve(<curve referenced from the Rhino model>)
y_axis_2 = Curve(<curve referenced from the Rhino model>)
x_axis_3 = Curve(<curve referenced from the Rhino model>)
y_axis_3 = Curve(<curve referenced from the Rhino model>)
x_axis_4 = Curve(<curve referenced from the Rhino model>)
y_axis_4 = Curve(<curve referenced from the Rhino model>)
plane = PythonScript(plane_axes=[x_axis, y_axis])  # -> plane; inputs plane_axes: list of Curve
# ---------- plane: Python ----------
import Rhino.Geometry as rg

x_axis, y_axis = plane_axes

x_axis = rg.Line(x_axis.PointAtStart, x_axis.PointAtEnd)
y_axis = rg.Line(y_axis.PointAtStart, y_axis.PointAtEnd)

if x_axis.From.DistanceTo(y_axis.From) < 0.01:
    origin = x_axis.From
    xvec = x_axis.Direction
    yvec = y_axis.Direction
elif x_axis.To.DistanceTo(y_axis.To) < 0.01:
    origin = x_axis.To
    xvec = -x_axis.Direction
    yvec = -y_axis.Direction
elif x_axis.From.DistanceTo(y_axis.To) < 0.01:
    origin = x_axis.From
    xvec = x_axis.Direction
    yvec = -y_axis.Direction
elif x_axis.To.DistanceTo(y_axis.From) < 0.01:
    origin = x_axis.To
    xvec = -x_axis.Direction
    yvec = y_axis.Direction

plane = rg.Plane(origin, xvec, yvec)
# ---------- end plane ----------
plane_2 = PythonScript(plane_axes=[x_axis_2, y_axis_2])  # -> plane; inputs plane_axes: list of Curve; same code as plane
plane_3 = PythonScript(plane_axes=[x_axis_3, y_axis_3])  # -> plane; inputs plane_axes: list of Curve; same code as plane
plane_4 = PythonScript(plane_axes=[x_axis_4, y_axis_4])  # -> plane; inputs plane_axes: list of Curve; same code as plane
compute = Button()
avoid_collisions = BooleanToggle(True)
inverse_kinematics = GhPythonScript(
    enabled=compute,
    robot=robot_2,
    group=info.main_group_name,
    planes=[plane, plane_2, plane_3, plane_4],
    avoid_collisions=avoid_collisions)  # -> out, group_configurations, full_configurations_ik, path_frames; inputs planes: list of Plane
# ---------- inverse_kinematics: Python ----------
"""Calculate the robot's inverse kinematic for a given plane.
    Inputs:
        robot: The robot
        group: str, optional
            The planning group used for calculation. Defaults to the robot's
            main planning group.
        plane: The plane in world coordinate frame to calculate the inverse for.
        start_configuration: :class:`compas_fab.robots.Configuration`, optional
            If passed, the inverse will be calculated such that the calculated
            joint positions differ the least from the start_configuration.
            Defaults to the init configuration.
        avoid_collisions: bool, optional
            Whether or not to avoid collisions. Defaults to True.
    Output:
        group_configuration: The group configuration
        full_configuration: The full configuration
"""
from __future__ import print_function
import logging
from compas.geometry import Frame
from scriptcontext import sticky as st

LOGGER = logging.getLogger('roslibpy')

path_frames = []

if robot and robot.ros_client and enabled:
    group_configurations = []
    full_configurations_ik = []
    
    if robot.attached_tool:
        tool_attached = True
    else:
        tool_attached = False
        
    robot.client = robot.ros_client
    if robot.ros_client.is_connected:
        for plane in planes:
            frame = Frame(plane.Origin, plane.XAxis, plane.YAxis)
            if tool_attached:
                frame = robot.from_tcf_to_t0cf([frame])[0]
            path_frames.append(frame)
            full_configuration_ik = robot.inverse_kinematics(frame,
                                                          start_configuration,
                                                          group=group,
                                                          options={
                                                            'avoid_collisions':avoid_collisions,
                                                            'return_full_configuration':True,
                                                          })        
            group_configuration = robot.get_group_configuration(group, full_configuration_ik)
            full_configurations_ik.append(full_configuration_ik)
            group_configurations.append(group_configuration)
        st["full_configurations_ik"] = full_configurations_ik
        st["path_frames"] = path_frames
    else:
        print("Robot client is not connected")
    


full_configurations_ik = st["full_configurations_ik"]
path_frames = st["path_frames"]



print(full_configurations_ik)
# ---------- end inverse_kinematics ----------
panel_3 = Panel(inverse_kinematics.out)

# ----
# Visualisation
toggle_2 = BooleanToggle(True)
list_3 = ValueList({"0 forward_kinematics": 0, "1 inverse_kinematics": 1}, selected="0 forward_kinematics")
filter = StreamFilter(Gate=list_3, Stream0=forward_kinematics, Stream1=inverse_kinematics.full_configurations_ik)
step = Slider(0, range=0..5)
step_2 = GhPythonScript(full_configuration=filter, step=step)  # -> out, configuration; inputs full_configuration: list, step: Int32
# ---------- step_2: Python ----------
__author__ = "julia"
__version__ = "2021.11.26"

import rhinoscriptsyntax as rs

if step > len(full_configuration)-1:
    step = len(full_configuration)-1
    print("Warning: Exceeded number of configurations")
configuration = full_configuration[step]
# ---------- end step_2 ----------
robot_visualize = RobotVisualize(
    robot=robot_2,
    group=info.main_group_name,
    configuration=step_2.configuration,
    redraw=inverse_kinematics.full_configurations_ik,
    show_visual=toggle_2,
    show_collision=Toggle(False),
    show_frames=Toggle(False),
    show_base_frame=Toggle(False),
    show_end_effector_frame=Toggle(False),
    show_acm=Toggle(False))  # -> visual, collision, attached_meshes, frames, base_frame, ee_frame; inputs redraw: list, show_visual: Boolean, show_collision: Boolean, show_frames: Boolean, show_base_frame: Boolean, show_end_effector_frame: Boolean, show_acm: Boolean
#   port group: The planning group used for end-effector and base visualization.
#   port configuration: The robot's full configuration.
#   port redraw: A list of attached collision meshes.
#   port show_visual: Whether or not to show the robot's visual meshes.
#   port show_collision: Whether or not to show the robot's collision meshes.
#   port show_frames: Whether or not to show the robot's joint frames.
#   port show_base_frame: Whether or not to show the robot's base frame.
#   port show_end_effector_frame: Whether or not to show the robot's end-effector frame.
#   port show_acm: Whether or not to show the attached collision meshes (if any).
#   port visual: The robot's visual Rhino meshes (if any).
#   port collision: The robot's collision Rhino meshes (if any).
#   port attached_meshes: The attached collision Rhino meshes (if any).
#   port frames: The robot's joint frames as Rhino planes (if any).
#   port base_frame: The robot's base frame as a Rhino plane (if any).
#   port ee_frame: The robot's end-effector frame as a Rhino plane (if any).
# ---------- robot_visualize: Python ----------
"""
Visualizes the robot.

COMPAS FAB v0.19.1
"""
from compas.geometry import Frame
from compas.geometry import Transformation
from compas_ghpython.artists import FrameArtist
from compas_ghpython.artists import MeshArtist
from ghpythonlib.componentbase import executingcomponent as component


class RobotVisualize(component):
    def RunScript(self, robot, group, configuration, attached_collision_meshes, show_visual, show_collision,
                  show_frames, show_base_frame, show_end_effector_frame, show_acm):

        visual = None
        collision = None
        attached_meshes = None
        frames = None
        base_frame = None
        ee_frame = None

        if robot:
            show_visual = True if show_visual is None else show_visual
            configuration = configuration or robot.zero_configuration()

            robot.update(configuration, visual=show_visual, collision=show_collision)
            compas_frames = robot.transformed_frames(configuration, group)

            if show_visual:               
                visual = robot.artist.draw_visual()
                

            if show_collision:
                collision = robot.artist.draw_collision()

            if show_base_frame:
                base_compas_frame = compas_frames[0]
                artist = FrameArtist(base_compas_frame)
                base_frame = artist.draw()

            if show_end_effector_frame:
                ee_compas_frame = robot.forward_kinematics(configuration, group, options=dict(solver='model'))
                if robot.attached_tool:
                    ee_compas_frame = robot.from_t0cf_to_tcf([ee_compas_frame])[0]
                artist = FrameArtist(ee_compas_frame)
                ee_frame = artist.draw()

            if show_frames:
                frames = []
                for compas_frame in compas_frames[1:]:
                    artist = FrameArtist(compas_frame)
                    frame = artist.draw()
                    frames.append(frame)

            if show_acm:
                attached_meshes = []
                for acm in attached_collision_meshes:
                    frame = robot.forward_kinematics(configuration, options=dict(solver='model', link_name=acm.link_name))
                    T = Transformation.from_frame_to_frame(Frame.worldXY(), frame)
                    mesh = acm.collision_mesh.mesh.transformed(T)
                    attached_meshes.append(MeshArtist(mesh).draw())

        return (visual, collision, attached_meshes, frames, base_frame, ee_frame)
# ---------- end robot_visualize ----------
geo = Geometry(robot_visualize.collision)
geo_2 = Geometry(robot_visualize.visual)
geo_3 = Geometry(robot_visualize.attached_meshes)
preview = CustomPreview(Geometry=geo_3, Shader=ColourSwatch(SwatchColor=RGB(92, 115, 130)))
draw = GhPythonScript(planes=[robot_visualize.frames, robot_visualize.base_frame, robot_visualize.ee_frame], scale=Slider(0.2, range=0..1))  # -> P, V, C, W; inputs planes: list
# ---------- draw: Python ----------
from System.Drawing import Color
from compas_ghpython.artists import FrameArtist

red = Color.FromArgb(255, 0, 0)
green = Color.FromArgb(0, 255, 0)
blue = Color.FromArgb(0, 0, 255)

P = []
V = []
C = []

scale = float(scale)

for plane in planes:
    if not plane:
        continue
    P += [plane.Origin] * 3
    V.append(plane.XAxis * scale)
    V.append(plane.YAxis * scale)
    V.append(plane.ZAxis * scale)
    C += [red, green, blue]

W = 3
# ---------- end draw ----------
panel_4 = Panel(step_2.out)
vdisex = VectorDisplayEx(Point=draw.P, Vector=draw.V, Colour=draw.C, Width=draw.W)

# ----
# Control
send = Button()
send_joint_command = GhPythonScript(robot=robot_2, full_configurations=filter, send=send)  # -> out; inputs full_configurations: list, send: Boolean
# ---------- send_joint_command: Python ----------
import compas_rrc as rrc
from compas.robots import Joint
from compas_fab.robots import Configuration
import math

"""
Instructions:
    1: Start Docker
    2: Open the Robot Studio File and press Start in the Simulation Tab
    3: Press the "Send" Button
    4: The Simulation will now run in Robot Studio and the component
    freezes until it has finished
"""


if __name__ == '__main__' and send==True:
    # Define the configuration
    robot_configurations =  []
    for configuration in full_configurations:
        robot_joint_positions = []
        for i, joint_type in enumerate(configuration.joint_types):
            if joint_type == Joint.REVOLUTE:
                robot_joint_positions.append(math.degrees(configuration.joint_values[i]))
            if joint_type == Joint.PRISMATIC:
                robot_track_position = configuration.joint_values[i]*1000
        robot_configurations.append({"joint_positions": robot_joint_positions, "track_position": robot_track_position})

    # Print text on FlexPenant
    robot.abb_client.send(rrc.PrintText('Welcome AFAB to COMPAS_RRC ;) !!!'))
    
    
    # Define robot joint positions
    robot_pos_joints_park = [-90.0, -30.0, 70.0, 0.0, 50.0, 0.0]    
    # Define track joint positions 
    track_pos_joint_park = [0.0]
    
    # Set speed [mm/s]
    speed = 1000
    """
    # Move to target positions
    for configuration in robot_configurations:
        print(configuration["joint_positions"])
        print(configuration["track_position"])
        done = robot.abb_client.send(rrc.MoveToJoints(configuration["joint_positions"],
            [configuration["track_position"]], speed, rrc.Zone.FINE))
    """
    # Move to park position
    done = robot.abb_client.send(rrc.MoveToJoints(robot_pos_joints_park, track_pos_joint_park, speed, rrc.Zone.FINE))
# ---------- end send_joint_command ----------

# ----
# Control
send_2 = Button()
send_joint_command_2 = GhPythonScript(robot=robot_2, full_configurations=filter, path_frames=inverse_kinematics.path_frames, send=send_2)  # -> out; inputs full_configurations: list, path_frames: list, send: Boolean
# ---------- send_joint_command_2: Python ----------
import compas_rrc as rrc
from compas.robots import Joint
from compas_fab.robots import Configuration
from compas_rrc import FeedbackLevel, Motion
import math

"""
Instructions:
    1: Start Docker
    2: Open the Robot Studio File and press Start in the Simulation Tab
    3: Press the "Send" Button
    4: The Simulation will now run in Robot Studio and the component
    freezes until it has finished
"""
target_frame = path_frames[0]

print(target_frame)

if __name__ == '__main__' and send==True:
    # Define the configuration
    robot_configurations =  []
    for configuration in full_configurations:
        robot_joint_positions = []
        for i, joint_type in enumerate(configuration.joint_types):
            if joint_type == Joint.REVOLUTE:
                robot_joint_positions.append(math.degrees(configuration.joint_values[i]))
            if joint_type == Joint.PRISMATIC:
                robot_track_position = configuration.joint_values[i]*1000
        robot_configurations.append({"joint_positions": robot_joint_positions, "track_position": robot_track_position})

    # Print text on FlexPenant
    robot.abb_client.send(rrc.PrintText('Welcome AFAB to COMPAS_RRC ;) !!!'))
    
    
    # Define robot joint positions
    robot_pos_joints_park = [-90.0, -30.0, 70.0, 0.0, 50.0, 0.0]    
    # Define track joint positions 
    track_pos_joint_park = [0.0]
    
    # Set speed [mm/s]
    speed = 1000
    
    # Move to target positions
    done = robot.abb_client.send(rrc.MoveToFrame(target_frame, speed, rrc.Zone.FINE,
        motion_type=Motion.LINEAR, feedback_level=FeedbackLevel.DONE))

    # Move to park position
    #done = robot.abb_client.send(rrc.MoveToJoints(robot_pos_joints_park, track_pos_joint_park, speed, rrc.Zone.FINE))
# ---------- end send_joint_command_2 ----------

panel_5 = Panel(send_joint_command_2)

# ==== cluster Tools

# ---- group: area grip tool
geo = Geometry([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])
mesh = Mesh(geo)
mjoin = MeshJoin(Meshes=mesh)
zaxis_line = Curve(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)
xaxis_line = Curve(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)
tool = PythonScript(rhmesh=mjoin, xline=xaxis_line, zline=zaxis_line)  # -> tool; inputs rhmesh: Mesh
# ---------- tool: Python ----------
import Rhino.Geometry as rg
import os, math
from compas.geometry import Frame, Rotation
from compas.datastructures import Mesh
from compas_ghpython.artists import MeshArtist
from compas_fab.robots import Tool
from compas_rhino.geometry import RhinoMesh

xaxis = rg.Line(xline.PointAtStart, xline.PointAtEnd)
zaxis = rg.Line(zline.PointAtStart, zline.PointAtEnd)

if xaxis.From.DistanceTo(zaxis.From) < 0.01:
    origin = xaxis.From
    xaxis = xaxis.Direction
    zaxis = zaxis.Direction
elif xaxis.To.DistanceTo(zaxis.To) < 0.01:
    origin = xaxis.To
    xaxis = -xaxis.Direction
    zaxis = -zaxis.Direction
elif xaxis.From.DistanceTo(zaxis.To) < 0.01:
    origin = xaxis.From
    xaxis = xaxis.Direction
    zaxis = -zaxis.Direction
elif xaxis.To.DistanceTo(zaxis.From) < 0.01:
    origin = xaxis.To
    xaxis = -xaxis.Direction
    zaxis = zaxis.Direction

xaxis.Unitize()
zaxis.Unitize()


ee_frame = Frame(origin, xaxis, zaxis)
rmesh = RhinoMesh()
rmesh.from_geometry(rhmesh)
ee_mesh = rmesh.to_compas()

#ee_frame = Frame(origin, xaxis, yaxis)
#ee_mesh = RhinoMesh.from_geometry(rhmesh).to_compas()

tool = Tool(ee_mesh, ee_frame)
# ---------- end tool ----------

# ---- group: measurement tool
geo_2 = Geometry(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)
mesh_2 = Mesh(geo_2)
mjoin_2 = MeshJoin(Meshes=mesh_2)
xaxis_line_2 = Curve(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)
yaxis_line = Curve(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)
tool_2 = PythonScript(rhmesh=mjoin_2, xline=xaxis_line_2, yline=yaxis_line)  # -> tool; inputs rhmesh: Mesh
# ---------- tool_2: Python ----------
import Rhino.Geometry as rg
import os, math
from compas.geometry import Frame, Rotation
from compas.datastructures import Mesh
from compas_ghpython.artists import MeshArtist
from compas_fab.robots import Tool
from compas_rhino.geometry import RhinoMesh

xaxis = rg.Line(xline.PointAtStart, xline.PointAtEnd)
yaxis = rg.Line(yline.PointAtStart, yline.PointAtEnd)

if xaxis.From.DistanceTo(yaxis.From) < 0.01:
    origin = xaxis.From
    xaxis = xaxis.Direction
    yaxis = yaxis.Direction
elif xaxis.To.DistanceTo(yaxis.To) < 0.01:
    origin = xaxis.To
    xaxis = -xaxis.Direction
    yaxis = -yaxis.Direction
elif xaxis.From.DistanceTo(yaxis.To) < 0.01:
    origin = xaxis.From
    xaxis = xaxis.Direction
    yaxis = -yaxis.Direction
elif xaxis.To.DistanceTo(yaxis.From) < 0.01:
    origin = xaxis.To
    xaxis = -xaxis.Direction
    yaxis = yaxis.Direction

xaxis.Unitize()
yaxis.Unitize()

ee_frame = Frame(origin, xaxis, yaxis)
rmesh = RhinoMesh()
rmesh.from_geometry(rhmesh)
ee_mesh = rmesh.to_compas()
"""
ee_frame = Frame(origin, xaxis, yaxis)
ee_mesh = RhinoMesh.from_geometry(rhmesh).to_compas()
"""
tool = Tool(ee_mesh, ee_frame)
# ---------- end tool_2 ----------

# ---- group: area grip tool
geo_3 = Geometry(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)
mesh_3 = Mesh(geo_3)
mjoin_3 = MeshJoin(Meshes=mesh_3)
yaxis_line_2 = Curve(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)
xaxis_line_3 = Curve(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)
tool_3 = PythonScript(rhmesh=mjoin_3, xline=xaxis_line_3, yline=yaxis_line_2)  # -> tool; inputs rhmesh: Mesh
# ---------- tool_3: Python ----------
import Rhino.Geometry as rg
import os, math
from compas.geometry import Frame, Rotation
from compas.datastructures import Mesh
from compas_ghpython.artists import MeshArtist
from compas_fab.robots import Tool
from compas_rhino.geometry import RhinoMesh

xaxis = rg.Line(xline.PointAtStart, xline.PointAtEnd)
yaxis = rg.Line(yline.PointAtStart, yline.PointAtEnd)

if xaxis.From.DistanceTo(yaxis.From) < 0.01:
    origin = xaxis.From
    xaxis = xaxis.Direction
    yaxis = yaxis.Direction
elif xaxis.To.DistanceTo(yaxis.To) < 0.01:
    origin = xaxis.To
    xaxis = -xaxis.Direction
    yaxis = -yaxis.Direction
elif xaxis.From.DistanceTo(yaxis.To) < 0.01:
    origin = xaxis.From
    xaxis = xaxis.Direction
    yaxis = -yaxis.Direction
elif xaxis.To.DistanceTo(yaxis.From) < 0.01:
    origin = xaxis.To
    xaxis = -xaxis.Direction
    yaxis = yaxis.Direction

xaxis.Unitize()
yaxis.Unitize()

ee_frame = Frame(origin, xaxis, yaxis)
rmesh = RhinoMesh()
rmesh.from_geometry(rhmesh)
ee_mesh = rmesh.to_compas()

#ee_frame = Frame(origin, xaxis, yaxis)
#ee_mesh = RhinoMesh.from_geometry(rhmesh).to_compas()

tool = Tool(ee_mesh, ee_frame)
# ---------- end tool_3 ----------

# ----
G = ClusterInput()
filter = StreamFilter(Gate=G, Stream0=tool_2, Stream1=tool_3, Stream2=tool)
s_2 = ClusterOutput(filter)
