# Grasshopper definition robotic_setup_fabtory_artist.ghx (Grasshopper 1.0.7)

reload = Button()
py = PythonScript()  # -> HERE, DATA
# ---------- py: Python ----------
import os
import customized_clt_alte_schmiede

package_path = os.path.dirname(customized_clt_alte_schmiede.__file__)
DATA = os.path.abspath(os.path.join(package_path,"../../data"))

print(package_path)
print(DATA)
# ---------- end py ----------
panel = Panel(py.DATA)
data_path = Data(py.DATA)
py_2 = PythonScript(reload=reload)
# ---------- py_2: Python ----------
if reload:
    from compas_ghpython import unload_modules
    unload_modules('compas')
    unload_modules("compas_fab")
    unload_modules("ur_online_control")
# ---------- end py_2 ----------

# ---- group: area grip tool
geo = Geometry(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)
mesh = Mesh(geo)
mjoin = MeshJoin(Meshes=mesh)
yaxis_line = Curve(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)
xaxis_line = Curve(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)
tool = PythonScript(rhmesh=mjoin, xline=xaxis_line, yline=yaxis_line)  # -> tool; inputs rhmesh: Mesh
# ---------- tool: Python ----------
import Rhino.Geometry as rg
import os, math
from compas.geometry import Frame, Rotation
from compas.datastructures import Mesh
from compas_ghpython.artists import MeshArtist
from compas_fab.robots import Tool
from compas_rhino.geometry import RhinoMesh

xaxis = rg.Line(xline.PointAtStart, xline.PointAtEnd)
yaxis = rg.Line(yline.PointAtStart, yline.PointAtEnd)

if xaxis.From.DistanceTo(yaxis.From) < 0.01:
    origin = xaxis.From
    xaxis = xaxis.Direction
    yaxis = yaxis.Direction
elif xaxis.To.DistanceTo(yaxis.To) < 0.01:
    origin = xaxis.To
    xaxis = -xaxis.Direction
    yaxis = -yaxis.Direction
elif xaxis.From.DistanceTo(yaxis.To) < 0.01:
    origin = xaxis.From
    xaxis = xaxis.Direction
    yaxis = -yaxis.Direction
elif xaxis.To.DistanceTo(yaxis.From) < 0.01:
    origin = xaxis.To
    xaxis = -xaxis.Direction
    yaxis = yaxis.Direction

xaxis.Unitize()
yaxis.Unitize()

ee_frame = Frame(origin, xaxis, yaxis)
ee_mesh = RhinoMesh.from_geometry(rhmesh).to_compas()

tool = Tool(ee_mesh, ee_frame)
# ---------- end tool ----------

# ---- group: measurement tool
geo_2 = Geometry(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)
mesh_2 = Mesh(geo_2)
mjoin_2 = MeshJoin(Meshes=mesh_2)
xaxis_line_2 = Curve(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)
yaxis_line_2 = Curve(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)
tool_2 = PythonScript(rhmesh=mjoin_2, xline=xaxis_line_2, yline=yaxis_line_2)  # -> tool; inputs rhmesh: Mesh; same code as tool

# ----
# Robot Model
# Load robot from local package
panel_2 = Panel("abb_irb6700_linear_axis.urdf")
py_3 = PythonScript()  # -> ghfile_path
# ---------- py_3: Python ----------
import os

filepath = ghenv.Component.OnPingDocument().FilePath
ghfile_path = os.path.dirname(filepath)
# ---------- end py_3 ----------
list = ValueList({"abb_linear_axis"}, selected="abb_linear_axis")
py_4 = PythonScript(ghfile_path=py_3)  # -> robot_description
# ---------- py_4: Python ----------
import os

robot_description = os.path.join(ghfile_path, "..", "data", "robot_description")
robot_description = os.path.abspath(robot_description)

print robot_description
# ---------- end py_4 ----------
py_5 = PythonScript()  # -> packages
# ---------- py_5: Python ----------
packages = ["abb_irb6700_support", "abb_irb4600_40_255", "abb_end_effectors", "abb_linear_axis"]
# ---------- end py_5 ----------
py_6 = PythonScript(path=py_4, package=list, urdf_name=panel_2, srdf_name="abb_linear_axis.srdf")  # -> package_path, urdf_filename, srdf_filename
# ---------- py_6: Python ----------
import os

package_path = os.path.join(path, package)

urdf_filename = os.path.join(package_path, "urdf", urdf_name)
srdf_filename = os.path.join(package_path, srdf_name)

assert os.path.isfile(urdf_filename)
assert os.path.isfile(srdf_filename)
# ---------- end py_6 ----------
py_7 = PythonScript(path=py_4, packages=py_5)  # -> loaders; inputs packages: list
# ---------- py_7: Python ----------
from compas.robots import LocalPackageMeshLoader

loaders = []
print packages


for package in packages:
    loaders.append(LocalPackageMeshLoader(path, package))
# ---------- end py_7 ----------
load = Button()
units = ValueList({"m": 1, "cm": 100, "mm": 1000}, selected="m")
create = PythonScript(loaders=py_7, urdf_filename=py_6.urdf_filename, srdf_filename=py_6.srdf_filename, scale_factor=units, load=load)  # -> out, robot; inputs loaders: list
# ---------- create: Python ----------
import os
from scriptcontext import sticky as st

import compas

from compas.robots import RobotModel
from compas.robots import LocalPackageMeshLoader

from compas_fab.robots import Robot
from compas_fab.robots import RobotSemantics

from compas_fab.ghpython import RobotArtist

compas.PRECISION = '12f'

# store robot in component
guid = str(ghenv.Component.InstanceGuid)
robot_key = "robot_" + guid

if robot_key not in st:
    st[robot_key] = None

print loaders
if load:
    model = RobotModel.from_urdf_file(urdf_filename)
    
    model.load_geometry(*loaders)
    artist = RobotArtist(model)
    semantics = RobotSemantics.from_srdf_file(srdf_filename, model)
    robot = Robot(model, artist, semantics, client=None)
    
    st[robot_key] = robot

robot = st[robot_key]


if robot:
    robot.scale(scale_factor)
# ---------- end create ----------
robot = Data(create.robot)

# ----
# Tool
panel_3 = Panel("Attach a custom tool")
list_2 = ValueList({"measurement_tool": 0, "area_grip": 1}, selected="area_grip")
remove = Button()
filter = StreamFilter(Gate=list_2, Stream0=tool_2, Stream1=tool)
add = Button()
py_8 = PythonScript(robot=robot, tool=filter, attach=add, remove=remove)  # -> out, bang
# ---------- py_8: Python ----------
if attach:
    robot.attach_tool(tool)
if remove:
    robot.detach_tool()
# ---------- end py_8 ----------

# ----
# Configuration
number_slider = Slider(0, range=0..3.75)
jp = GhPythonScript()  # -> configuration_values
# ---------- jp: Python ----------
import math
joint_values = [-3.136, -0.328, -1.218, 3.129, 0.852, 0.008]
#joint_positions = [0] * 6

cart = 0
j_values = [0,0,0,0,0,0]

configuration_values = [cart] + j_values
# ---------- end jp ----------
forward_kinematics = PythonScript(
    robot=robot,
    reset_configuration=Button(),
    configuration_values=jp,
    a_cart=number_slider,
    a_a1=Slider(78.6, range=-180..180),
    a_a2=Slider(52.4, range=-90..150),
    a_a3=Slider(45.4, range=-180..180),
    a_a4=Slider(0, range=-400..400),
    a_a5=Slider(0, range=-125..120),
    a_a6=Slider(0, range=-400..400),
    bang=py_8.bang)  # -> full_configuration; inputs reset_configuration: Boolean, configuration_values: list
# ---------- forward_kinematics: Python ----------
import math
import Grasshopper
from compas.robots import Joint
from compas_fab.robots import Configuration


import math
import Grasshopper
from compas_fab.robots import Configuration

if reset_configuration:
    j = 0
    for i in range(ghenv.Component.Params.Input.Count):
        nslider = ghenv.Component.Params.Input[i].Sources[0]
        if nslider.GetType() == Grasshopper.Kernel.Special.GH_NumberSlider:
            nslider.TrySetSliderValue(configuration_values[j])
            j += 1

    
if robot:
    a_cyl = a_a2 * -0.25
    a_piston = math.radians(a_a2) * 0.15
    joint_positions = [a_cart, a_a1, a_a2, a_cyl, a_a3, a_a4, a_a5, a_a6, a_piston]
    joint_types = robot.get_configurable_joint_types()
    for i, joint_type in enumerate(joint_types):
        if joint_type == Joint.REVOLUTE:
            joint_positions[i] = math.radians(joint_positions[i])
    full_configuration = Configuration(joint_positions, joint_types)
# ---------- end forward_kinematics ----------

# ----
# Visualisation
# Select configuration input: from fk, ik, path, or from real robot
list_3 = ValueList({"0 forward_kinematics": 0, "1 inverse_kinematics": 1, "2 cartesian motion": 2, "3 free-space motion": 3}, selected="0 forward_kinematics")
filter_2 = StreamFilter(Gate=list_3)
show_end_effector_frame = BooleanToggle(True)
show_base_frame = BooleanToggle(True)
show_collision = BooleanToggle(False)
show_frames = BooleanToggle(True)
show_visual = BooleanToggle(True)
visualize = PythonScript(
    robot=robot,
    full_configuration=forward_kinematics,
    show_visual=show_visual,
    show_collision=show_collision,
    show_frames=show_frames,
    show_base_frame=show_base_frame,
    show_end_effector_frame=show_end_effector_frame)  # -> out, visual, collision, frames, base_frame_WCF, ee_frame_WCF
# ---------- visualize: Python ----------
"""Calculates a cartesian motion path (linear in tool space).
    Inputs:
        robot: The robot
        group: str
            The planning group used for visualisation
        full_configuration: :class:`compas_fab.robots.Configuration`
            The robot's full configuration to display.
        show_visual: bool
           Whether or not to show the robot's visual meshes.
        show_collision: bool
           Whether or not to show the robot's collision meshes.
        show_frames: bool
           Whether or not to show the robot's joint frames.
        show_base_frame: bool
           Whether or not to show the robot's base frame.
        show_end_effector_frame: bool
            Whether or not to show the robot's end-effector frame.
    Output:
        visual: The robot's visual meshes.
        collision: The robot's collision meshes.
        frames: The robot's joint frames.
        base_frame_WCF: The robot's base frame.
        ee_frame_WCF: The robot's end-effector frame.
"""
from __future__ import print_function
import ghpythonlib.components as ghcomp
#from compas_ghpython.geometry import xform_from_transformation


def update(configuration, visual=True, collision=True):
    """Triggers the update of the robot geometry.
    Parameters
    ----------
    configuration : :class:`compas_fab.robots.Configuration`
        Instance of the configuration (joint state) to move to.
    visual : bool, optional
        ``True`` if the visual geometry should be also updated, otherwise ``False``.
        Defaults to ``True``.
    collision : bool, optional
        ``True`` if the collision geometry should be also updated, otherwise ``False``.
        Defaults to ``True``.
    """
    positions = configuration.values
    names = configuration.joint_names or robot.model.get_configurable_joint_names()
    if len(names) != len(configuration.values):
        raise ValueError("Please pass a configuration with %d joint_names." % len(positions))
    joint_state = dict(zip(names, positions))
    transformations = robot.model.compute_transformations(joint_state)
    for j in robot.model.iter_joints():
        link = j.child_link
        for item in link.visual:
            robot.artist._apply_transformation_on_transformed_link(item, transformations[j.name])
        if collision:
            for item in link.collision:
                # some links have only collision geometry, not visual. These meshes have not been loaded.
                if item.native_geometry:
                    robot.artist._apply_transformation_on_transformed_link(item, transformations[j.name])
    
    if robot.attached_tool:
        name = 'joint_6'
        robot.artist._apply_transformation_on_transformed_link(robot.attached_tool, transformations[name])

if robot and full_configuration:
    #robot.update(full_configuration, visual=show_visual, collision=show_collision)
    update(full_configuration, visual=show_visual, collision=show_collision) #fast hack, because of a bug in compas_fab
    print(full_configuration)

    if show_visual:
        visual = robot.draw_visual()
        #print(len([v for v in visual]))
        #visual = ([v for v in visual])
        #T = robot.transformation_RCF_WCF()
        #visual = ghcomp.Transform(visual, xform_from_transformation(T))

    if show_collision:
        collision = robot.draw_collision()

    if show_frames:
        axes = robot.transformed_axes(full_configuration)
        frames = robot.transformed_frames(full_configuration)

    if show_base_frame:
        base_frame_WCF = robot.get_base_frame(group, full_configuration)

    if show_end_effector_frame:
        ee_frame_WCF = robot.get_end_effector_frame(group, full_configuration)
        if robot.attached_tool:
            ee_frame_WCF = robot.from_tool0_to_attached_tool([ee_frame_WCF])[0]
        print("End-effector", ee_frame_WCF)
# ---------- end visualize ----------
py_9 = PythonScript(robot=robot)  # -> scale
# ---------- py_9: Python ----------
if robot:
    scale = robot.scale_factor * 0.1
else:
    scale = 1.
# ---------- end py_9 ----------
draw = GhPythonScript(frames=[visualize.frames, visualize.ee_frame_WCF, visualize.base_frame_WCF], scale=py_9)  # -> P, V, C, W; inputs frames: list
# ---------- draw: Python ----------
from System.Drawing import Color
from compas_ghpython import draw_frame

red = Color.FromArgb(255, 0, 0)
green = Color.FromArgb(0, 255, 0)
blue = Color.FromArgb(0, 0, 255)

P = []
V = []
C = []

scale = float(scale)

for frame in frames:
    if not frame:
        continue
    plane = draw_frame(frame)
    P += [plane.Origin] * 3
    V.append(plane.XAxis * scale)
    V.append(plane.YAxis * scale)
    V.append(plane.ZAxis * scale)
    C += [red, green, blue]

W = 3
# ---------- end draw ----------
draw_2 = GhPythonScript(frames=visualize.base_frame_WCF, scale=py_9)  # -> P, V, C, W; inputs frames: list; same code as draw
geo_3 = Geometry(visualize.visual)
geo_4 = Geometry(visualize.collision)
preview = CustomPreview(Geometry=geo_3, Shader=ColourSwatch(SwatchColor=RGB(255, 163, 163)))
vdisex = VectorDisplayEx(Point=draw_2.P, Vector=draw_2.V, Colour=draw_2.C, Width=draw_2.W)
vdisex_2 = VectorDisplayEx(Point=draw.P, Vector=draw.V, Colour=draw.C, Width=draw.W)
