# Grasshopper definition robotic_setup_fabtory_tch.gh (Grasshopper 1.0.7)

pln = Plane(PlaneXY(0, 0, 0))
stack = VectorXYZ(XComponent=Slider(0, range=-10..10), YComponent=Slider(-1.1, range=-10..10), ZComponent=Slider(-0.49, range=-10..10))  # -> Vector, Length
pi = Pi(Factor=1)
number_slider = Slider(0, range=0..9)
move = Move(Geometry=pln, Motion=stack.Vector)  # -> Geometry, Transform
multiplication = Multiplication(A=pi, B=Slider(1.5, range=0..9))
pln_2 = Plane(PlaneXY(0, 0, 0))
stack_2 = VectorXYZ(XComponent=Slider(3.8, range=-10..10), YComponent=Slider(0.7, range=-10..10), ZComponent=Slider(1.3, range=-10..10))  # -> Vector, Length
number_slider_2 = Slider(0, range=0..9)
move_2 = Move(Geometry=pln_2, Motion=stack_2.Vector)  # -> Geometry, Transform
rotate = Rotate(Geometry=move.Geometry, Angle=multiplication, Plane=move.Geometry)  # -> Geometry, Transform
deplane = DeconstructPlane(Plane=rotate.Geometry)  # -> Origin, XAxis, YAxis, ZAxis
pi_2 = Pi(Factor=1)
rev = Reverse(Vector=deplane.YAxis)
multiplication_2 = Multiplication(A=pi_2, B=Slider(0.5, range=0..9))
pl = ConstructPlane(Origin=deplane.Origin, XAxis=deplane.XAxis, YAxis=rev)
rotate_2 = Rotate(Geometry=move_2.Geometry, Angle=multiplication_2, Plane=move_2.Geometry)  # -> Geometry, Transform
bending_factor = Slider(0.6, range=0..1)
safe_level_distance_flipped = Slider(3, range=0..3)
tool_width_bending = Slider(0.5, range=0..1)
safe_level_distance = Slider(0.4, range=0..1)
safe_level_distance_glue = Slider(0.05, range=0..1.8)
bending_calc_for_lines = BooleanToggle(True)
snakelines = BooleanToggle(False)
dryrun = BooleanToggle(False)
gluestation_plane = Plane(rotate_2.Geometry)
stack_plane = Plane(pl)

# ----
# layer_no = 5
# gap_min = 4.0
# primary_length = 450.0
# secondary_length = 840.0
# omnidirectional = True
# primary_board_width_outside = 6.0
# primary_board_height_outside = 4.0
# primary_board_width_inside = 6.0
# primary_board_height_inside = 4.0
# 
# 
# secondary_board_width = 4.0
# secondary_board_height = 4.0
# 
# 
# primary_interval = 12.0
# primary_falloff = 150.0
# primary_dedensification = 3.0
# secondary_interval = 40.0
# secondary_interval_development = .9
# skip_centrals = True
# 
# primary_direction = 1
# secondary_direction = 0
number_slider_3 = Slider(-0.45, range=-10..10)
# Geometry
number_slider_4 = Slider(3, range=-10..10)
pln_3 = Plane(PlaneXY(0, 0, 0))
slab = VectorXYZ(XComponent=number_slider_4, YComponent=Slider(1.6, range=-10..10), ZComponent=number_slider_3)  # -> Vector, Length
number_slider_5 = Slider(0, range=0..9)
move_3 = Move(Geometry=pln_3, Motion=slab.Vector)  # -> Geometry, Transform
pi_3 = Pi(Factor=1)
division = Division(A=pi_3, B=Slider(2, range=0..9))
rotate_3 = Rotate(Geometry=move_3.Geometry, Angle=division, Plane=move_3.Geometry)  # -> Geometry, Transform
primary_board_height = Slider(4, range=0..12)
primary_board_width = Slider(6, range=0..12)
vertical_support_interlock = Slider(6, range=0..16)
clay_addon = Slider(5, range=0..12)
vertical_support_width = Slider(9, range=0..16)
width_gluepath = Slider(1.5, range=0..3)
vertical_support_secondary = BooleanToggle(False)
vertical_support_primary = BooleanToggle(True)
assembly_planning = BooleanToggle(True)
omnidirectional = BooleanToggle(False)
skip_centrals = BooleanToggle(True)
advanced = BooleanToggle(False)
baseplane = Plane(rotate_3.Geometry)
slab_2 = GhPythonScript(
    layer_no=Slider(5, range=1..13),
    gap_min=Slider(0, range=0..12),
    input_plane=baseplane,
    primary_length=Slider(300, range=0..1200),
    secondary_length=Slider(50, range=0..1200),
    omnidirectional=omnidirectional,
    primary_board_width_outside=primary_board_width,
    primary_board_height_outside=primary_board_height,
    primary_board_width_inside=primary_board_width,
    primary_board_height_inside=primary_board_height,
    secondary_board_width=primary_board_width,
    secondary_board_height=primary_board_height,
    primary_interval=Slider(12, range=0..30),
    primary_dedensification=Slider(3, range=0..20),
    secondary_interval=Slider(24, range=0..90),
    secondary_interval_development=Slider(1.3, range=0.3..6),
    skip_centrals=skip_centrals,
    primary_falloff=Slider(180, range=0..300),
    momentum_support_length=Slider(140, range=0..1200),
    shear_support_length=Slider(80, range=0..1200),
    advanced=advanced,
    vert_support_prim=vertical_support_primary,
    vert_support_sec=vertical_support_secondary,
    vert_support_width=vertical_support_width,
    vert_support_interlock=vertical_support_interlock,
    stack_frame=stack_plane,
    clay_filling_no_layers=Slider(0, range=-1..8),
    clay_density=Slider(1900, range=0..2000),
    clay_addon=clay_addon,
    glue=assembly_planning,
    glue_path_width=width_gluepath,
    safe_level_distance=safe_level_distance,
    safe_level_distance_glue=safe_level_distance_glue,
    safe_level_distance_flipped=safe_level_distance_flipped,
    snakelines=snakelines,
    dryrun=dryrun,
    gluestation_plane=gluestation_plane,
    tool_width_bending=tool_width_bending,
    bending_factor=bending_factor,
    bending_calc_includes_lines=bending_calc_for_lines)  # -> out, visual, lines, points, total_weight, weight_per_m2, area, timber_volume, clay_volume, mySystem; inputs layer_no: Int32, input_plane: Plane, omnidirectional: Boolean, skip_centrals: Boolean, advanced: Boolean, vert_support_prim: Boolean, clay_filling_no_layers: Int32, clay_density: Int32, glue: Boolean
# ---------- slab_2: Python ----------
__author__ = "JulianKlaus"
__version__ = "2020.09.10"

import rhinoscriptsyntax as rs
import math
import Rhino.Geometry as rg
import ghpythonlib as gh
from compas.geometry import Point, Box, Frame, Vector, scale_vector, normalize_vector
from compas_ghpython.artists import MeshArtist
from assembly_information_model.assembly import Element, Assembly
from AIM_TCH_forAssembly2 import floorslab_creation, gluepoints, advanced_floorslab_setup, weight_calculator, stack_creator
from compas.datastructures import Mesh
from compas_rhino.artists import MeshArtist, BoxArtist


if clay_filling_no_layers == -1:
    clay_filling_no_layers = None

origin_point = input_plane[0]
origin_vector_primary = normalize_vector(input_plane[2])
origin_vector_secondary = normalize_vector(input_plane[1])
origin_frame = Frame(origin_point, origin_vector_primary, origin_vector_secondary)
# secondary_span_interval_development: 1 = constant, <1: denser in the centre, >1: denser on the edges
# operable range approximately 0.6/6


primary_direction = 0
secondary_direction = 1

Slabassembly = Assembly()
Slabassembly.layer_no = layer_no
Slabassembly.gap_min = gap_min/100
Slabassembly.primary_length = primary_length/100
Slabassembly.secondary_length = secondary_length/100
Slabassembly.omnidirectional = omnidirectional
Slabassembly.primary_board_width_outside = primary_board_width_outside/100
Slabassembly.primary_board_height_outside = primary_board_height_outside/100
Slabassembly.primary_board_width_inside = primary_board_width_inside/100
Slabassembly.primary_board_height_inside = primary_board_height_inside/100
Slabassembly.primary_board_outside_dimensions = [Slabassembly.primary_board_width_outside,
                                                 Slabassembly.primary_board_height_outside, Slabassembly.primary_length]
Slabassembly.primary_board_inside_dimensions = [Slabassembly.primary_board_width_inside,
                                                Slabassembly.primary_board_height_inside, Slabassembly.primary_length]
Slabassembly.secondary_board_width = secondary_board_width/100
Slabassembly.secondary_board_height = secondary_board_height/100
Slabassembly.secondary_board_dimensions = [Slabassembly.secondary_board_width, Slabassembly.secondary_board_height,
                                           Slabassembly.secondary_length]
Slabassembly.primary_interval = primary_interval/100
if Slabassembly.omnidirectional:
    Slabassembly.primary_falloff = primary_falloff/100
    Slabassembly.primary_dedensification = primary_dedensification
else:
    Slabassembly.primary_falloff = 0.0
    Slabassembly.primary_dedensification = 0
Slabassembly.secondary_interval = secondary_interval/100
Slabassembly.secondary_interval_development = secondary_interval_development
Slabassembly.skipping = skip_centrals
Slabassembly.primary_direction = 0
Slabassembly.secondary_direction = 1
Slabassembly.origin_fr = origin_frame
Slabassembly.origin_pt = origin_frame[0]
Slabassembly.prim_dir = origin_frame[1]
Slabassembly.sec_dir = origin_frame[2]
Slabassembly.sec_fr = Frame(Slabassembly.origin_pt, Slabassembly.sec_dir, Slabassembly.prim_dir)
Slabassembly.flip_toolframe_prim = False
Slabassembly.flip_toolframe_sec = True

Slabassembly.timberboards = []
Slabassembly.setup_done = False

Slabassembly.prim_vert_sup = vert_support_prim
Slabassembly.sec_vert_sup = vert_support_sec
Slabassembly.gluepathwidth = glue_path_width/100
Slabassembly.vertical_support_width = vert_support_width/100
Slabassembly.vertical_support_interlock = vert_support_interlock/100
Slabassembly.vert_sup_lengths = None
Slabassembly.vert_sup_gap_tolerance = 0.002
Slabassembly.vert_sup_gap_min = 0.005


# ADVANCED PARAMETERS
Slabassembly.advanced_setup = advanced
if advanced:
    advanced_floorslab_setup(Slabassembly, shear_support_length, momentum_support_length)

mySystem = floorslab_creation(Slabassembly)


def grasshopper_draw(system):
    def box_update(elmnt):
        elmnt.board_frame = Frame(elmnt.centre_point, elmnt.length_vector, elmnt.width_vector)
        elmnt.box = Box(elmnt.board_frame, elmnt.length, elmnt.width, elmnt.height)

        if elmnt.stack_center_frame:
            stack_box = Box(elmnt.stack_center_frame, elmnt.length, elmnt.width, elmnt.height)
            return 4, elmnt.board_frame, elmnt.box, stack_box
        else:
            return 3, elmnt.board_frame, elmnt.box

    visualisations = []
    
    
    for brd in system.elements():
        board = brd[1]
        # visualise all the boards
        box_creation = box_update(board)
        my_frame_count = box_creation[0]
        
        for i in range (2, my_frame_count):
            my_box = box_creation[i]
            myartist = BoxArtist(my_box)
            myvisualisation = myartist.draw()
            visualisations.append(myvisualisation)
            
        if my_frame_count == 3:
            print("stack not found")
    return visualisations
    
def gluedraw(system):
    
    def compas_to_rg(pt):
        return rg.Point3d(pt[0], pt[1], pt[2])
    
    points = []
    lines = []
    for brd in system.elements():
        board = brd[1]
        gluepts = board.glue_paths        
        if len(gluepts) == 0:
            continue
        
        for path in gluepts:
            if len(path) > 1:
                for i in range(0,len(path)-1):
                    mypt = compas_to_rg(path[i])
                    nextpt = compas_to_rg(path[i+1])                    
                    myLine = rg.Line(mypt, nextpt)
                    points.append(mypt)
                    lines.append(myLine)
            else:
                mypt = compas_to_rg(path[0])
                points.append(mypt)

    return [lines, points]


my_stack_frame = Frame(stack_frame[0], -stack_frame[2], stack_frame[1])
stack_creator(Slabassembly, my_stack_frame, distance_between_stacks = 0.25)

vis = grasshopper_draw(mySystem)
visual = gh.treehelpers.list_to_tree(vis, True, [0])

#def gluepoints(system, snake = False, glue_station_default_frame = None, safety_distance = None, safety_distance_gluepoints = None, dryrun = False,#
#               flipped_dropframe_distance = None, sorting_direction = 1, sorting_flipped = False, bending_behaviour=None):


gluegun_station_frame = Frame(gluestation_plane[0], gluestation_plane[1], gluestation_plane[2])
if glue:
    mySystem = gluepoints(Slabassembly, snake=snakelines,
        glue_station_default_frame=gluegun_station_frame,
        safety_distance=safe_level_distance,
        safety_distance_gluepoints=safe_level_distance_glue,
        flipped_dropframe_distance = safe_level_distance_flipped, dryrun = dryrun,
        bending_behaviour=[tool_width_bending, bending_factor, bending_calc_includes_lines])
    
    lines = gluedraw(mySystem)[0]
    points = gluedraw(mySystem)[1]

weights = weight_calculator(mySystem, protective_clay_height=clay_addon,
    density_clay = clay_density, fill_limit=clay_filling_no_layers)

total_weight = weights[0]
weight_per_m2 = weights[1]
area = weights[2]
timber_volume = weights[4]
clay_volume = weights[5]
# ---------- end slab_2 ----------
area_m2 = Panel(slab_2.area)
clay_volume_m3 = Panel(slab_2.clay_volume)
total_weight_kg = Panel(slab_2.total_weight)
weight_m2 = Panel(slab_2.weight_per_m2)
timber_volume_m3 = Panel(slab_2.timber_volume)
line = Line(slab_2.lines)
preview = CustomPreview(Geometry=slab_2.visual, Material=ColourSwatch(SwatchColor=RGB(125, 116, 102)))
len = Length(Curve=line)
ma = MassAddition(Input=len)  # -> Result, PartialResults
division_2 = Division(A=ma.Result, B=100)
gluelinelength = Panel(division_2)

cyl = Cylinder(Base=gluestation_plane, Radius=Slider(0.05, range=0..1), Length=Slider(0.3, range=0..1))

reload = Button()
py = PythonScript()  # -> HERE, DATA
# ---------- py: Python ----------
import os

HERE = os.path.dirname(ghdoc.Path)
DATA = os.path.abspath(os.path.join(HERE, "..", "data"))
print(HERE)
print(DATA)
# ---------- end py ----------
panel = Panel(py.DATA)
data_path = Data(py.DATA)
py_2 = PythonScript(reload=reload)
# ---------- py_2: Python ----------
if reload:
    from compas_ghpython import unload_modules
    unload_modules('compas')
    unload_modules("compas_fab")
    unload_modules("ur_online_control")
# ---------- end py_2 ----------

# ---- group: area grip tool
geo = Geometry([<brep referenced from the Rhino model> x3])
mesh = Mesh(geo)
xaxis_line = Curve(<curve referenced from the Rhino model>)
yaxis_line = Curve(<curve referenced from the Rhino model>)
mjoin = MeshJoin(Meshes=mesh)
tool = PythonScript(rhmesh=mjoin, xline=xaxis_line, yline=yaxis_line)  # -> tool, ee_mesh, ee_plane; inputs rhmesh: Mesh
# ---------- tool: Python ----------
import Rhino.Geometry as rg
import os, math
from compas.geometry import Frame, Rotation
from compas.datastructures import Mesh
from compas_ghpython.artists import MeshArtist
from compas_fab.robots import Tool
from compas_rhino.geometry import RhinoMesh

xaxis = rg.Line(xline.PointAtStart, xline.PointAtEnd)
yaxis = rg.Line(yline.PointAtStart, yline.PointAtEnd)

if xaxis.From.DistanceTo(yaxis.From) < 0.01:
    origin = xaxis.From
    xaxis = xaxis.Direction
    yaxis = yaxis.Direction
elif xaxis.To.DistanceTo(yaxis.To) < 0.01:
    origin = xaxis.To
    xaxis = -xaxis.Direction
    yaxis = -yaxis.Direction
elif xaxis.From.DistanceTo(yaxis.To) < 0.01:
    origin = xaxis.From
    xaxis = xaxis.Direction
    yaxis = -yaxis.Direction
elif xaxis.To.DistanceTo(yaxis.From) < 0.01:
    origin = xaxis.To
    xaxis = -xaxis.Direction
    yaxis = yaxis.Direction

xaxis.Unitize()
yaxis.Unitize()

ee_frame = Frame(origin, xaxis, yaxis)
ee_plane = rg.Plane(origin, xaxis, yaxis)
ee_mesh = RhinoMesh.from_geometry(rhmesh).to_compas()
print(ee_mesh)
tool = Tool(ee_mesh, ee_frame)
print(ee_frame)
# ---------- end tool ----------

# ---- group: measurement tool
geo_2 = Geometry(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)
mesh_2 = Mesh(geo_2)
mjoin_2 = MeshJoin(Meshes=mesh_2)
xaxis_line_2 = Curve(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)
yaxis_line_2 = Curve(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)
tool_2 = PythonScript(rhmesh=mjoin_2, xline=xaxis_line_2, yline=yaxis_line_2)  # -> tool, ee_mesh, ee_plane; inputs rhmesh: Mesh
# ---------- tool_2: Python ----------
import Rhino.Geometry as rg
import os, math
from compas.geometry import Frame, Rotation
from compas.datastructures import Mesh
from compas_ghpython.artists import MeshArtist
from compas_fab.robots import Tool
from compas_rhino.geometry import RhinoMesh

xaxis = rg.Line(xline.PointAtStart, xline.PointAtEnd)
yaxis = rg.Line(yline.PointAtStart, yline.PointAtEnd)

if xaxis.From.DistanceTo(yaxis.From) < 0.01:
    origin = xaxis.From
    xaxis = xaxis.Direction
    yaxis = yaxis.Direction
elif xaxis.To.DistanceTo(yaxis.To) < 0.01:
    origin = xaxis.To
    xaxis = -xaxis.Direction
    yaxis = -yaxis.Direction
elif xaxis.From.DistanceTo(yaxis.To) < 0.01:
    origin = xaxis.From
    xaxis = xaxis.Direction
    yaxis = -yaxis.Direction
elif xaxis.To.DistanceTo(yaxis.From) < 0.01:
    origin = xaxis.To
    xaxis = -xaxis.Direction
    yaxis = yaxis.Direction

xaxis.Unitize()
yaxis.Unitize()

ee_frame = Frame(origin, xaxis, yaxis)
ee_plane = rg.Plane(origin, xaxis, yaxis)
ee_mesh = RhinoMesh.from_geometry(rhmesh).to_compas()

tool = Tool(ee_mesh, ee_frame)
# ---------- end tool_2 ----------

# ---- group: ROS client
disconnect = Button()
connect = Button()
restart = Button()
ros = PythonScript(ip="127.0.0.1", restart=restart)  # -> out, ros_client
# ---------- ros: Python ----------
import sys
import time
import logging
import scriptcontext as sc

from compas_fab.backends import RosClient

from System import TimeSpan
from System.Threading import ManualResetEventSlim

LOGGER = logging.getLogger('roslibpy')

key = 'rosclient_%s' % str(ghenv.Component.InstanceGuid)
previous_client = sc.sticky.get(key, None)
if previous_client:
    previous_client.terminate()

ros_client = RosClient(ip, 9090)
sc.sticky[key] = ros_client

waitLock = ManualResetEventSlim(False)

ros_client.on_ready(lambda: waitLock.Set())

if not waitLock.Wait(TimeSpan.FromSeconds(5)):
    raise Exception('Unable to connect to ROS')

LOGGER.info('ROS connection opened')
# ---------- end ros ----------
connect_2 = PythonScript(ros_client=ros.ros_client, connect=connect, disconnect=disconnect)  # -> out, ros_client
# ---------- connect_2: Python ----------
import logging
from System import TimeSpan
from System.Threading import ManualResetEventSlim

LOGGER = logging.getLogger('roslibpy')

if connect:
    if not ros_client.is_connected:
        LOGGER.debug('Connecting...')
        waitLock = ManualResetEventSlim(False)
        ros_client.on_ready(lambda: waitLock.Set())
        ros_client.connect()

        if not waitLock.Wait(TimeSpan.FromSeconds(5)):
            raise Exception('Unable to connect to ROS')
        LOGGER.debug('Reconnected')

if disconnect:
    if ros_client.is_connected:
        ros_client.terminate()
        LOGGER.debug('Terminated')

print ros_client.is_connected
# ---------- end connect_2 ----------
is_connected = Panel(connect_2.out)

# ----
# Robot Model
# Load robot from local package
panel_2 = Panel("abb_irb6700_linear_axis.srdf")
py_3 = PythonScript()  # -> ghfile_path
# ---------- py_3: Python ----------
import os

filepath = ghenv.Component.OnPingDocument().FilePath
ghfile_path = os.path.dirname(filepath)
# ---------- end py_3 ----------
list = ValueList({"abb_linear_axis"}, selected="abb_linear_axis")
py_4 = PythonScript(ghfile_path=py_3)  # -> robot_description
# ---------- py_4: Python ----------
import os

robot_description = os.path.join(ghfile_path, "..", "data", "robot_description")
robot_description = os.path.abspath(robot_description)

print robot_description
# ---------- end py_4 ----------
py_5 = PythonScript()  # -> packages
# ---------- py_5: Python ----------
packages = ["abb_irb6700_support", "abb_irb4600_40_255", "abb_end_effectors", "abb_linear_axis"]
# ---------- end py_5 ----------
py_6 = PythonScript(path=py_4, package=list, urdf_name="abb_irb6700_linear_axis.urdf", srdf_name=panel_2)  # -> package_path, urdf_filename, srdf_filename
# ---------- py_6: Python ----------
import os

package_path = os.path.join(path, package)

urdf_filename = os.path.join(package_path, "urdf", urdf_name)
srdf_filename = os.path.join(package_path, srdf_name)

assert os.path.isfile(urdf_filename)
assert os.path.isfile(srdf_filename)
# ---------- end py_6 ----------
py_7 = PythonScript(path=py_4, packages=py_5)  # -> loaders; inputs packages: list
# ---------- py_7: Python ----------
from compas.robots import LocalPackageMeshLoader

loaders = []
print packages


for package in packages:
    loaders.append(LocalPackageMeshLoader(path, package))
# ---------- end py_7 ----------
load = Button()
units = ValueList({"m": 1, "cm": 100, "mm": 1000}, selected="m")
create = PythonScript(loaders=py_7, urdf_filename=py_6.urdf_filename, srdf_filename=py_6.srdf_filename, scale_factor=units, load=load)  # -> out, robot; inputs loaders: list
# ---------- create: Python ----------
import os
from scriptcontext import sticky as st

import compas

from compas.robots import RobotModel
from compas.robots import LocalPackageMeshLoader

from compas_fab.robots import Robot
from compas_fab.robots import RobotSemantics

from compas_fab.ghpython import RobotArtist

compas.PRECISION = '12f'

# store robot in component
guid = str(ghenv.Component.InstanceGuid)
robot_key = "robot_" + guid

if robot_key not in st:
    st[robot_key] = None

print loaders
if load:
    model = RobotModel.from_urdf_file(urdf_filename)
    
    model.load_geometry(*loaders)
    artist = RobotArtist(model)
    semantics = RobotSemantics.from_srdf_file(srdf_filename, model)
    robot = Robot(model, artist, semantics, client=None)
    
    st[robot_key] = robot

robot = st[robot_key]


if robot:
    robot.scale(scale_factor)
# ---------- end create ----------
set = PythonScript(robot=create.robot, client=connect_2.ros_client)  # -> robot
# ---------- set: Python ----------
if robot and client:
    robot.client = client
# ---------- end set ----------
robot = Data(set)
scene = PythonScript(robot=robot)  # -> scene
# ---------- scene: Python ----------
from scriptcontext import sticky as st

from compas_fab.robots import PlanningScene

# store scene in component
guid = str(ghenv.Component.InstanceGuid)
scene_key = "scene_" + guid

if scene_key not in st:
    st[scene_key] = None

if robot:
    st[scene_key] = PlanningScene(robot)

scene = st[scene_key]
# ---------- end scene ----------

# ----
# Tool
panel_3 = Panel("Attach a custom tool")
list_2 = ValueList({"measurement_tool": 0, "area_grip": 1}, selected="area_grip")
remove = Button()
tool_3 = StreamFilter(Gate=list_2, Stream0=tool_2.tool, Stream1=tool.tool)
add = Button()
mesh_3 = StreamFilter(Gate=list_2, Stream0=tool_2.ee_mesh, Stream1=tool.ee_mesh)
attacher = PythonScript(robot=robot, tool=tool_3, attach=add, remove=remove)  # -> out, bang
# ---------- attacher: Python ----------
if attach:
    robot.attach_tool(tool)
if remove:
    robot.detach_tool()
# ---------- end attacher ----------

# ----
# Select link name to attach
# Select the links the object is allowed to touch
number_slider_6 = Slider(10, range=0..10)
idxs = Data([3, 4, 5, 6, 7, 8, 9, 10])
link_names = PythonScript(robot=robot, idx=number_slider_6)  # -> link_name; inputs idx: Int32
# ---------- link_names: Python ----------
if robot:
    link_names = robot.get_link_names()
    #print link_names
    link_name = link_names[idx]
# ---------- end link_names ----------
py_8 = PythonScript(robot=robot, idxs=idxs)  # -> touch_links; inputs idxs: list of Int32
# ---------- py_8: Python ----------
if robot:
    link_names = robot.get_link_names()
    touch_links = [link_names[i] for i in idxs]
# ---------- end py_8 ----------
scale = BooleanToggle(False)
panel_4 = Panel(link_names)
panel_5 = Panel(py_8)
attachedcollisionmesh = PythonScript(
    scene=scene,
    compas_mesh=mesh_3,
    scale=scale,
    id="endeffector",
    link_name=link_names,
    touch_links=py_8,
    add=add,
    remove=remove)  # -> acm, out; inputs touch_links: list
# ---------- attachedcollisionmesh: Python ----------
from compas_fab.robots import CollisionMesh
from compas_fab.robots import AttachedCollisionMesh

cm = CollisionMesh(compas_mesh, id)
acm = AttachedCollisionMesh(cm, link_name, touch_links)

if scene:
    if add:
        scene.add_attached_collision_mesh(acm, scale)
    if remove:
        scene.remove_attached_collision_mesh(id)
        scene.remove_collision_mesh(id)
# ---------- end attachedcollisionmesh ----------

pt = Point(slab_2.points)  # disabled
panel_6 = Panel(attacher.out)

reset = Button()
# Stepping
start = Button()
step = Button()
back = Button()
stop = Button()
counter = CountThroughList(AIM=slab_2.mySystem, start=start, stop=stop, step=step, back=back, reset=reset, interval=1)  # -> tool_frame_pick, tool_frame_drop, tool_frame_glue, tool_frames_combined, collision, collision_line_x, collision_line_y, count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; inputs start: Boolean, stop: Boolean
# ---------- counter: Python ----------
from scriptcontext import sticky as st
from compas_ghpython.utilities import update_component
from compas.geometry import Frame
from time import sleep
import Rhino.Geometry as rg
from compas.datastructures import Mesh
from compas_rhino.artists import MeshArtist, BoxArtist

if not interval:
    interval = 5

total_length = len(AIM.network.node)

# store data in component
guid = str(ghenv.Component.InstanceGuid)
counter_key = "counter_" + guid
running_key = "running_" + guid

if counter_key not in st or reset:
    st[counter_key] = 0

if running_key not in st:
    st[running_key] = False

if start:
    st[running_key] = True
    recompute = True

if stop:
    st[running_key] = False
    recompute = False

if step:
    if st[counter_key] < total_length - 1:
        st[counter_key] += 1

if back:
    if st[counter_key] > 1:
        st[counter_key] -= 1

board = AIM.network.node[st[counter_key]]["element"]
tool_frame_drop = board.tool_frame
tool_frame_pick = board.stack_pick_frame
if len(board.final_glue_frames) > 0:
    tool_frame_glue = board.final_glue_frames[0][0]
board_mesh = board.box
tool_frames_combined = board.assembly_path
print(len(board.assembly_path))

plane_sequence = []
for entry in tool_frames_combined:
    #my_plane = rg.Plane(rg.Point3d(frame[0][0],frame[0][1],frame[0][2]),
    #    rg.Vector3d(frame[1][0],frame[1][1],frame[1][2]),
    #    rg.Vector3d(frame[2][0],frame[2][1],frame[2][2]))
    my_plane = rg.Point3d(entry[0][0][0],entry[0][0][1],entry[0][0][2])
    plane_sequence.append(my_plane)

# an attempt to integrate collisions for the attached board, didn't work that way
myartist = BoxArtist(board_mesh)
collision = myartist.draw()
origin_pt = rg.Point3d(tool_frame_pick[0][0], tool_frame_pick[0][1], tool_frame_pick[0][2])
vec_x = rg.Vector3d(tool_frame_pick[1][0], tool_frame_pick[1][1], tool_frame_pick[1][2])
vec_y = rg.Vector3d(tool_frame_pick[2][0], tool_frame_pick[2][1], tool_frame_pick[2][2])
x_pt = origin_pt + vec_x
y_pt = origin_pt + vec_y

collision_line_x = rg.Line(origin_pt, x_pt)
collision_line_y = rg.Line(origin_pt, y_pt)


# just for visualisation/troubleshooting
my_frame = tool_frame_drop

tool_plane_orig = rg.Point3d(my_frame[0][0], my_frame[0][1], my_frame[0][2])
tool_vec1 = rg.Vector3d(my_frame[1][0], my_frame[1][1], my_frame[1][2])
tool_vec2 = rg.Vector3d(my_frame[2][0], my_frame[2][1], my_frame[2][2])
tool_plane = rg.Plane(tool_plane_orig, xDirection=tool_vec1, yDirection=tool_vec2)
tool_pt_reference = tool_plane_orig + tool_plane[2]*3
tool_line = rg.Line(tool_plane_orig, tool_pt_reference)
tool_circle = rg.Circle(tool_plane, 0.05)
tool_cylinder = rg.Cylinder(tool_circle, -0.9)

if st[running_key]:
    recompute = True
    if st[counter_key] < total_length - 1:
        st[counter_key] += 1
        update_component(ghenv, interval)
    else:
        st[counter_key] = 0
        st[running_key] = False
        recompute = False


count = st[counter_key]
# ---------- end counter ----------
recompute = Data([reset, back, step, stop, start, counter.recompute])

collisions_avoid = BooleanToggle(False)
id = Slider(10, range=0..30)
freemotion = BooleanToggle(True)
compute = Button()
panel_7 = Panel("default: RRT")
toggle = BooleanToggle(True)
list_3 = ValueList({"RRT", "RRT*": "RRTStar", "EST", "PRM": "RPM", "PRM*": "RPMStar", "SPARS"}, selected="RRT")

# ----
# Info
info = PythonScript(robot=robot)  # -> out, main_group_name
# ---------- info: Python ----------
if robot:
    robot.info()
    main_group_name = robot.main_group_name
# ---------- end info ----------
panel_8 = Panel(info.out)

step_may_be_inactive = Slider(12, range=0..25)
tool_4 = PythonScript(rhmesh=counter.collision, xaxis=counter.collision_line_x, yaxis=counter.collision_line_y)  # -> tool, col_mesh, ee_plane; inputs rhmesh: Mesh
# ---------- tool_4: Python ----------
import Rhino.Geometry as rg
import os, math
from compas.geometry import Frame, Rotation
from compas.datastructures import Mesh
from compas_ghpython.artists import MeshArtist
from compas_fab.robots import Tool
from compas_rhino.geometry import RhinoMesh
from compas_fab.robots import CollisionMesh

if xaxis.From.DistanceTo(yaxis.From) < 0.01:
    origin = xaxis.From
    xaxis = xaxis.Direction
    yaxis = yaxis.Direction
elif xaxis.To.DistanceTo(yaxis.To) < 0.01:
    origin = xaxis.To
    xaxis = -xaxis.Direction
    yaxis = -yaxis.Direction
elif xaxis.From.DistanceTo(yaxis.To) < 0.01:
    origin = xaxis.From
    xaxis = xaxis.Direction
    yaxis = -yaxis.Direction
elif xaxis.To.DistanceTo(yaxis.From) < 0.01:
    origin = xaxis.To
    xaxis = -xaxis.Direction
    yaxis = yaxis.Direction

xaxis.Unitize()
yaxis.Unitize()

ee_frame = Frame(origin, xaxis, yaxis)
ee_plane = rg.Plane(origin, xaxis, yaxis)
ee_mesh = RhinoMesh.from_geometry(rhmesh).to_compas()
col_mesh = CollisionMesh(rhmesh, "tip")


tool = Tool(ee_mesh, ee_frame)
# ---------- end tool_4 ----------
pt_2 = Point(counter.plane_sequence)
idx = Slider(169, range=0..234)
panel_9 = Panel("-1")
compute_2 = Button()
compute_3 = Button()

# ----
# Configuration
number_slider_7 = Slider(0.41, range=0..5)
jp = GhPythonScript()  # -> configuration_values
# ---------- jp: Python ----------
import math
joint_values = [-3.136, -0.328, -1.218, 3.129, 0.852, 0.008]
#joint_positions = [0] * 6

cart = 0
j_values = [0,0,0,0,0,0]

configuration_values = [cart] + j_values
# ---------- end jp ----------
reset_2 = Button()
forward_kinematics = PythonScript(
    robot=robot,
    reset_configuration=reset_2,
    configuration_values=jp,
    a_cart=number_slider_7,
    a_a1=Slider(0, range=-180..180),
    a_a2=Slider(10.4, range=-90..150),
    a_a3=Slider(46.6, range=-180..180),
    a_a4=Slider(0, range=-400..400),
    a_a5=Slider(33.3, range=-125..120),
    a_a6=Slider(0, range=-400..400),
    bang=attacher.bang)  # -> full_configuration; inputs reset_configuration: Boolean, configuration_values: list
# ---------- forward_kinematics: Python ----------
import math
import Grasshopper
from compas.robots import Joint
from compas_fab.robots import Configuration


import math
import Grasshopper
from compas_fab.robots import Configuration

if reset_configuration:
    j = 0
    for i in range(ghenv.Component.Params.Input.Count):
        nslider = ghenv.Component.Params.Input[i].Sources[0]
        if nslider.GetType() == Grasshopper.Kernel.Special.GH_NumberSlider:
            nslider.TrySetSliderValue(configuration_values[j])
            j += 1

    
if robot:
    a_cyl = a_a2 * -0.25
    a_piston = math.radians(a_a2) * 0.15
    joint_positions = [a_cart, a_a1, a_a2, a_cyl, a_a3, a_a4, a_a5, a_a6, a_piston]
    joint_types = robot.get_configurable_joint_types()
    for i, joint_type in enumerate(joint_types):
        if joint_type == Joint.REVOLUTE:
            joint_positions[i] = math.radians(joint_positions[i])
    #full_configuration = Configuration(joint_positions, joint_types)
    print(joint_positions)
    #this can save the issue with the forward kinematics in the main motion planner
    joint_names = robot.get_configurable_joint_names()
    full_configuration = Configuration(joint_positions, joint_types, joint_names)
# ---------- end forward_kinematics ----------

manual_configuration = Data(forward_kinematics)
robot_motion_planner = GhPythonScript(
    compute=toggle,
    sample=toggle,
    sample_index=id,
    my_system=slab_2.mySystem,
    robot=robot,
    group=info.main_group_name,
    default_configuration=manual_configuration,
    scene=scene,
    planner_id=list_3,
    tolerance_position=Slider(0.001, range=0..0.001),
    tolerance_xaxis_deg=Slider(2, range=1..360),
    tolerance_yaxis_deg=Slider(2, range=1..360),
    tolerance_zaxis_deg=Slider(2, range=1..360),
    max_step=Slider(0.05, range=0..1),
    collisions_avoid=collisions_avoid,
    freemotion=freemotion)  # -> out, last_trajectory, last_configurations, frames; inputs sample_index: Int32, collisions_avoid: Boolean
# ---------- robot_motion_planner: Python ----------
__author__ = "julian"
__version__ = "2021.01.01"

import rhinoscriptsyntax as rs
import sys
import math
import copy
from compas.geometry import Vector, Box
from compas.geometry import Frame
from compas.geometry import Transformation
from compas.datastructures import Mesh
from compas_fab.backends import RosClient
from compas_fab.robots import PlanningScene
from compas_fab.robots import Configuration
from compas_fab.robots import Tool
from compas_fab.robots import AttachedCollisionMesh
from compas_fab.robots import CollisionMesh
from compas_fab.backends import BackendError
from compas_fab.robots.constraints import Constraint
from assembly_information_model.assembly import Assembly
from assembly_information_model.assembly import Element

import scriptcontext as sc

guid = str(ghenv.Component.InstanceGuid)
response_key = "response_" + guid
if response_key not in sc.sticky:
    sc.sticky[response_key] = None


tolerance_axes = [math.radians(tolerance_xaxis_deg), math.radians(tolerance_yaxis_deg), math.radians(tolerance_zaxis_deg)]

# dirty fix attempt: appends two unnecessary values to the configuration
def configuration_correct(old_values):
    vals = []
    types = []
    for i in range(0,9):
        if i==0 or i==8:
            types.append(2)
        else:
            types.append(0)
        if i < 3:
            vals.append(old_values[i])
        elif i == 3 or i == 8:
            vals.append(0.0)
        else:
            vals.append(old_values[i-1])
    return Configuration(vals, types)

def plan_motion2(rob, goal_constraints, start_configuration=None, group=None, options=None, collision_avoidance = False):
        options = options or {}
        path_constraints = options.get('path_constraints')
        attached_collision_meshes = options.get('attached_collision_meshes', [])
        rob.ensure_client()
        if not group:
            group = rob.main_group_name
        # NOTE: start_configuration has to be a full robot configuration, such
        # that all configurable joints of the whole robot are defined for planning.
        start_configuration, start_configuration_scaled = rob._check_full_configuration_and_scale(start_configuration)

        goal_constraints_WCF_scaled = []
        for c in goal_constraints:
            cp = c.copy()
            if c.type == Constraint.JOINT:
                joint = rob.get_joint_by_name(c.joint_name)
                if joint.is_scalable():
                    cp.scale(1. / rob.scale_factor)
            else:
                cp.scale(1. / rob.scale_factor)
            goal_constraints_WCF_scaled.append(cp)

        # Transform path constraints to RCF and scale
        if path_constraints:
            path_constraints_WCF_scaled = []
            for c in path_constraints:
                cp = c.copy()
                if c.type == Constraint.JOINT:
                    joint = rob.get_joint_by_name(c.joint_name)
                    if joint.is_scalable():
                        cp.scale(1. / rob.scale_factor)
                else:
                    cp.scale(1. / rob.scale_factor)
                path_constraints_WCF_scaled.append(cp)
        else:
            path_constraints_WCF_scaled = None
        
        
        if rob.attached_tool and collision_avoidance:
            attached_collision_meshes.extend(rob.attached_tool.attached_collision_meshes)
        
        options['attached_collision_meshes'] = attached_collision_meshes
        options['path_constraints'] = path_constraints_WCF_scaled

        trajectory = rob.client.plan_motion(
            robot=rob,
            goal_constraints=goal_constraints_WCF_scaled,
            start_configuration=start_configuration_scaled,
            group=group,
            options=options,
        )

        # Scale everything back to robot's scale
        for pt in trajectory.points:
            pt.scale(rob.scale_factor)

        trajectory.start_configuration.scale(rob.scale_factor)

        return trajectory

def box_update(elmnt, input_frame):
        elmnt.board_frame = Frame(elmnt.centre_point, elmnt.length_vector, elmnt.width_vector)
        elmnt.box = Box(elmnt.board_frame, elmnt.length, elmnt.width, elmnt.height)
        return elmnt.box

if compute:
    for key, brd in enumerate(my_system.elements()):        
        if sample==True and key!=sample_index:
            if key > sample_index:
                break
            else:
                continue
        
        current_board = brd[1]
        current_board.trajectory = []
        
        print(current_board.assembly_path)
        for i, path_entry in enumerate(current_board.assembly_path):
            
            path_frame = path_entry[0]
            options = path_entry[1]
            if i == 0:
                last_configuration = default_configuration.copy()
                
                # attach the collision mesh
                attached_tool_frame = robot.forward_kinematics(default_configuration, group)
                mesh = box_update(current_board, attached_tool_frame)
                cm = CollisionMesh(mesh, 'tip')
                group = robot.main_group_name
                
            
            elif i == len(current_board.assembly_path):
                scene.remove_attached_collision_mesh('tip')

            # if we have cartesian motion
            for j in range(10):
                try:                   
                    # CARTESIAN PART
                    if "cart" in options and not freemotion:
                        # because of the tolerances, we have to recalculate the starting frame via forward kinematics
                        my_configuration = Configuration(last_configuration.values, last_configuration.types, robot.get_configurable_joint_names())
                        corrected_last_frame = robot.forward_kinematics(my_configuration, group)
                        print(corrected_last_frame)
                        frames = [corrected_last_frame, path_frame]
                        frames_tool0 = robot.from_tcf_to_t0cf(frames)
                        
                        # actual procedure
                        trajectory = robot.plan_cartesian_motion(frames_tool0,
                                                                      last_configuration,
                                                                      group=group,
                                                                      options={
                                                                        'planner_id': str(planner_id),
                                                                        'max_step': float(max_step),
                                                                        'avoid_collisions': bool(collisions_avoid)                                                                        
                                                                      })
                        if trajectory.fraction == 1:                            
                            last_configuration = configuration_correct(trajectory.points[-1].values)
                            last_frame = frames[1]
                            print("cartesian success")
                            break                            
                        else:
                            print("cartesian failed")
                            raise BackendError("Cartesian path not working")
                            
                    # FREE MOTION PART
                    elif "free" in options or freemotion:                        
                        path_frame_tool0 = robot.from_tcf_to_t0cf([path_frame])[0]                        
                        goal_constraints = robot.constraints_from_frame(path_frame_tool0,
                                                            tolerance_position,
                                                            tolerance_axes)
                        trajectory = plan_motion2(robot, goal_constraints,
                                              last_configuration,
                                              group, collision_avoidance = collisions_avoid,
                                              options={
                                                'planner_id': str(planner_id),
                                                'num_planning_attempts': 20,
                                                'allowed_planning_time': 10
                                              })                        
                        if trajectory.fraction == 1:                         
                            last_configuration = configuration_correct(trajectory.points[-1].values)
                            last_frame = path_frame_tool0
                            print("freemotion_success")
                            break
                        #last_configuration = robot.inverse_kinematics(
                        #path_frame, last_configuration, group, True)
                        else:
                            raise BackendError("Free motion path not working")
                    else:
                        print("Major Error: Invalid Motion Type in the path {}".format(motion_type))
                except BackendError:
                    print("Trying the %d. time" % (j + 2))
                    continue
            else:
                raise BackendError("NOT FOUND")            
            current_board.trajectory.append(trajectory)
        my_system.network.node_attribute(key, 'is_planned', True)
        sc.sticky[response_key] = current_board.trajectory
last_trajectory = [sc.sticky[response_key]]



"""
if trajectory:
    configurations = trajectory.points
    full_configurations = [robot.merge_group_with_full_configuration(c, trajectory.start_configuration, group) for c in configurations]
    start_configuration = trajectory.start_configuration
    print(start_configuration)
    fraction = trajectory.fraction
    time = trajectory.time_from_start



from __future__ import print_function
import logging
import scriptcontext as sc


guid = str(ghenv.Component.InstanceGuid)
response_key = "response_" + guid
print(response_key)
if response_key not in sc.sticky:
    sc.sticky[response_key] = None

LOGGER = logging.getLogger('roslibpy')

if attached_collision_mesh:

    scene.attach_collision_mesh_to_robot_end_effector(attached_collision_mesh, group=group)


if robot and robot.client and start_configuration and compute:
    if robot.client.is_connected:
        
        sc.sticky[response_key] = robot.plan_motion(goal_constraints,
                                                    start_configuration,
                                                    group,
                                                    options={
                                                        'planner_id': str(planner_id),
                                                        'attached_collision_meshes': attached_collision_mesh,
                                                    })
    else:
        print("Robot client is not connected.")

trajectory = sc.sticky[response_key]
"""
# ---------- end robot_motion_planner ----------
panel_10 = Panel(robot_motion_planner.last_trajectory)
panel_11 = Panel(robot_motion_planner.out)
# Plan motion
group = Data(info.main_group_name)
py_9 = PythonScript(robot=robot, group=group, trajectories=robot_motion_planner.last_trajectory, id=step_may_be_inactive)  # -> configurations, full_configurations, full_configurations_collected, fraction, time; inputs id: Int32
# ---------- py_9: Python ----------
full_configurations_col = []


if trajectories:
    for i in range(len(trajectories)):
        trajectory = trajectories[i]
        configurations = trajectory.points
        # we can probably already merge at this point!
        full_configurations = [robot.merge_group_with_full_configuration(c, trajectory.start_configuration, group) for c in configurations]
        start_configuration = trajectory.start_configuration        
        fraction = trajectory.fraction
        time = trajectory.time_from_start
        full_configurations_col.append(full_configurations)
        

full_configurations_collected = [full_configurations_col]

"""
if trajectories:
    trajectory = trajectories[id]
    configurations = trajectory.points
    full_configurations = [robot.merge_group_with_full_configuration(c, trajectory.start_configuration, group) for c in configurations]
    start_configuration = trajectory.start_configuration
    print(start_configuration)
    fraction = trajectory.fraction
    time = trajectory.time_from_start"""
# ---------- end py_9 ----------
panel_12 = Panel(py_9.full_configurations)
animate = PythonScript(
    robot=robot,
    group=group,
    configurations=py_9.full_configurations,
    full_configurations=py_9.full_configurations_collected,
    idx=idx)  # -> configuration, slider_max; inputs configurations: list, idx: Int32
# ---------- animate: Python ----------
import Grasshopper
from compas_fab.utilities import map_range
from compas_fab.robots import Configuration


#for i in range(len(full_configurations)):
lengths = []
for config in full_configurations:
    lengths.append(len(config))

slider_max = sum(lengths) - 1

for i in range(ghenv.Component.Params.Input.Count):
    nslider = ghenv.Component.Params.Input[i].Sources[0]
    if nslider.GetType() == Grasshopper.Kernel.Special.GH_NumberSlider and nslider.NickName == 'idx':
        nslider.Slider.Maximum = sum(lengths) - 1
        nslider.Slider.Minimum = 0


if robot and full_configurations[0][0] != None:
    count = -1
    total_length = 0
    while total_length <= idx:
        my_total_length = total_length
        total_length = sum(lengths[:count+2])        
        count += 1
    
    item = idx - my_total_length
    print(count)
    print(item)
    print(my_total_length)
    configuration = full_configurations[count][item]
# ---------- end animate ----------
configuration = Data(animate.configuration)
panel_13 = Panel(animate.slider_max)
list_4 = ValueList({"don't use attached collision mesh": 0, "use attached collision mesh": 1}, selected="don't use attached collision mesh")
list_5 = ValueList({"Start Plane": 0, "Manual Configuration": 1}, selected="Manual Configuration")
standard = PythonScript(robot=robot)  # -> configuration
# ---------- standard: Python ----------
from compas_fab.robots import Configuration

if robot:
    types = robot.get_configurable_joint_types()
    values = [0] * len(types)

    configuration = Configuration(values, types)
    print configuration
# ---------- end standard ----------
goal_constraints = PythonScript(
    robot=robot,
    group=group,
    tolerance_position=Slider(0.001, range=0..0.001),
    tolerance_xaxis_deg=Slider(1, range=1..360),
    tolerance_yaxis_deg=Slider(1, range=1..360),
    tolerance_zaxis_deg=Slider(1, range=1..360))  # -> goal_constraints
# ---------- goal_constraints: Python ----------
import math
from compas.geometry import Frame

frame = goal_plane

if robot.attached_tool:
    frame = robot.from_tcf_to_t0cf([frame])[0]
    print("hello")


tolerances_axes = [math.radians(tolerance_xaxis_deg), math.radians(tolerance_yaxis_deg), math.radians(tolerance_zaxis_deg)]

if robot:

    goal_constraints = robot.constraints_from_frame(frame, tolerance_position, tolerances_axes, group)

print(goal_constraints)
# ---------- end goal_constraints ----------

# ---- group: inverse kinematics
py_10 = PythonScript(robot=robot)  # -> configuration
# ---------- py_10: Python ----------
from compas_fab.robots import Configuration

if robot:
    types = robot.get_configurable_joint_types()
    print(types)
    values = [0] * len(types)
    configuration = Configuration(values, types)
    print configuration
    print robot.get_configurable_joint_names()
    print configuration.joint_names
# ---------- end py_10 ----------
manual_configuration_2 = Data(forward_kinematics)
avoid_collisions = BooleanToggle(False)
list_6 = ValueList({"0", "1"}, selected="0")
what = StreamFilter(Gate=list_6, Stream0=manual_configuration_2, Stream1=py_10)
inverse = GhPythonScript(robot=robot, group=info.main_group_name, start_configuration=what, avoid_collisions=avoid_collisions)  # -> out, group_configuration, full_configuration
# ---------- inverse: Python ----------
"""Calculate the robot's inverse kinematic for a given plane.
    Inputs:
        robot: The robot
        group: str, optional
            The planning group used for calculation. Defaults to the robot's
            main planning group.
        plane: The plane in world coordinate frame to calculate the inverse for.
        start_configuration: :class:`compas_fab.robots.Configuration`, optional
            If passed, the inverse will be calculated such that the calculated
            joint positions differ the least from the start_configuration.
            Defaults to the init configuration.
        avoid_collisions: bool, optional
            Whether or not to avoid collisions. Defaults to True.
    Output:
        group_configuration: The group configuration
        full_configuration: The full configuration
"""
from __future__ import print_function
import logging

from compas.geometry import Frame

LOGGER = logging.getLogger('roslibpy')

if robot.attached_tool:
    print(frame)
    frame = robot.from_tcf_to_t0cf([frame])[0]
    print(frame)

#print(frame)

if robot and robot.client:
    if robot.client.is_connected:
        
        full_configuration = robot.inverse_kinematics(frame,
                                                      start_configuration,
                                                      group=group,                                                      
                                                      return_full_configuration = True
                                                      )
        group_configuration = robot.get_group_configuration(group, full_configuration)
        print(group_configuration)
    else:
        print("Robot client is not connected")
        
print(full_configuration)
# ---------- end inverse ----------
panel_16 = Panel(inverse.out)

# ----
start_plane_configuration = Data(inverse.full_configuration)
filter = StreamFilter(Gate=list_4)
panel_17 = Panel()
filter_2 = StreamFilter(Gate=list_5, Stream0=start_plane_configuration, Stream1=standard)
plan_motion = PythonScript(
    scene=scene,
    robot=robot,
    group=group,
    start_configuration=filter_2,
    goal_constraints=goal_constraints,
    planner_id=list_3,
    attached_collision_mesh=filter,
    compute=compute_2)  # -> out, trajectory; inputs goal_constraints: list, attached_collision_mesh: list
# ---------- plan_motion: Python ----------
"""Calculates a motion path.
    Inputs:
        robot: The robot
        group: str, optional
            The planning group used for calculation. Defaults to the robot's
            main planning group.
        start_configuration: :class:`compas_fab.robots.Configuration`, optional
            The robot's full configuration, i.e. values for all configurable
            joints of the entire robot cell, at the starting position. Defaults
            to the all-zero configuration.
        goal_constraints: list of :class:`compas_fab.robots.Constraint`
            The goal to be achieved, defined in a set of constraints.
            Constraints can be very specific, for example defining value domains
            for each joint, such that the goal configuration is included,
            or defining a volume in space, to which a specific robot link (e.g.
            the end-effector) is required to move to.
        planner_id: str
            The name of the algorithm used for path planning. Defaults to 'RRT'.
        attached_collision_meshes: list of :class:`compas_fab.robots.AttachedCollisionMesh`
            Defaults to None.
        compute: bool
            Press to calculate solution.
    Output:
        :class:`compas_fab.robots.JointTrajectory`
            The calculated trajectory.
"""
from __future__ import print_function
import logging
import scriptcontext as sc


guid = str(ghenv.Component.InstanceGuid)
response_key = "response_" + guid
print(response_key)
if response_key not in sc.sticky:
    sc.sticky[response_key] = None

LOGGER = logging.getLogger('roslibpy')

if attached_collision_mesh:

    scene.attach_collision_mesh_to_robot_end_effector(attached_collision_mesh, group=group)


if robot and robot.client and start_configuration and compute:
    if robot.client.is_connected:
        print(goal_constraints)
        sc.sticky[response_key] = robot.plan_motion(goal_constraints,
                                                    start_configuration,
                                                    group,
                                                    options={
                                                        'planner_id': str(planner_id),
                                                        'attached_collision_meshes': attached_collision_mesh,
                                                    })
    else:
        print("Robot client is not connected.")

trajectory = sc.sticky[response_key]
# ---------- end plan_motion ----------
# If you specify the tolerance vector with [360, 1, 1], it means that
#     the frame's y-axis and z-axis are allowed to rotate about the x-axis by an
#     angle of 360 degrees, whereas the x-axis can only change 1 degree.
panel_18 = Panel(plan_motion.out)
vis = PythonScript(response=plan_motion.trajectory)  # -> P, V, A, time
# ---------- vis: Python ----------
from compas_ghpython import list_to_ghtree

if response:

    positions = []
    velocities = []
    accelerations = []
    time_from_start = []

    for p in response.points:
        positions.append(p.positions)
        velocities.append(p.velocities)
        accelerations.append(p.accelerations)
        time_from_start.append(p.time_from_start.seconds)

    P = list_to_ghtree(list(zip(*positions)))
    V = list_to_ghtree(list(zip(*velocities)))
    A = list_to_ghtree(list(zip(*accelerations)))

    time = time_from_start[-1]
    print time
# ---------- end vis ----------
time_s = Panel(vis.time)
lng = ListLength(List=panel_17)

# ---- group: plan motion
# Plan motion Combination Experiment
number_slider_8 = Slider(1, range=1..360)
group_2 = Data(info.main_group_name)
list_7 = ValueList({"don't use attached collision mesh": 0, "use attached collision mesh": 1}, selected="don't use attached collision mesh")
list_8 = ValueList({"Start Plane": 0, "Manual Configuration": 1}, selected="Start Plane")
standard_2 = PythonScript(robot=robot)  # -> configuration; same code as standard
start_plane_configuration_2 = Data(inverse.full_configuration)
goal_constraints_2 = PythonScript(
    robot=robot,
    group=group_2,
    tolerance_position=Slider(0.001, range=0..0.001),
    tolerance_xaxis_deg=Slider(1, range=1..360),
    tolerance_yaxis_deg=number_slider_8,
    tolerance_zaxis_deg=Slider(1, range=1..360))  # -> goal_constraint_list; inputs goal_plane: list
# ---------- goal_constraints_2: Python ----------
import math
from compas.geometry import Frame

goal_constraint_list = []
print(len(goal_plane))
for pathpoint in range(len(goal_plane)):
    frame = goal_plane[pathpoint]
    print(frame)
    
    if robot.attached_tool:
        frame = robot.from_tcf_to_t0cf([frame])[0]
        print("hello")
    
    
    tolerances_axes = [math.radians(tolerance_xaxis_deg), math.radians(tolerance_yaxis_deg), math.radians(tolerance_zaxis_deg)]
    
    if robot:
    
        goal_constraints = robot.constraints_from_frame(frame, tolerance_position, tolerances_axes, group)
    
    goal_constraint_list.append(goal_constraints)
    
print(goal_constraint_list)
# ---------- end goal_constraints_2 ----------
list_9 = ValueList({"RRT", "RRT*": "RRTStar", "EST", "PRM": "RPM", "PRM*": "RPMStar", "SPARS"}, selected="RRT")
filter_3 = StreamFilter(Gate=list_7)
filter_4 = StreamFilter(Gate=list_8, Stream0=start_plane_configuration_2, Stream1=standard_2)
plan_motion_2 = PythonScript(
    scene=scene,
    robot=robot,
    group=group_2,
    start_configuration=filter_4,
    goal_constraint_list=goal_constraints_2,
    planner_id=list_9,
    attached_collision_mesh=filter_3,
    compute=compute_3,
    id=Slider(1, range=0..10))  # -> out, trajectories, constraints; inputs goal_constraint_list: list, attached_collision_mesh: list, id: Int32
# ---------- plan_motion_2: Python ----------
from __future__ import print_function
import logging
import scriptcontext as sc

constraints = []
trajectories = []
for i in range(len(goal_constraint_list)):
    goal_constraints = goal_constraint_list[i]
    constraints.append(goal_constraints)
    guid = str(ghenv.Component.InstanceGuid)
    response_key = "response_" + guid
    if response_key not in sc.sticky:
        sc.sticky[response_key] = None
    
    LOGGER = logging.getLogger('roslibpy')
    
    if attached_collision_mesh:
    
        scene.attach_collision_mesh_to_robot_end_effector(attached_collision_mesh, group=group)
    
    
    if robot and robot.client and start_configuration and compute:
        if robot.client.is_connected:
            
            sc.sticky[response_key] = robot.plan_motion(goal_constraints,
                                                        start_configuration,
                                                        group,
                                                        options={
                                                            'planner_id': str(planner_id),
                                                            'attached_collision_meshes': attached_collision_mesh,
                                                        })
        else:
            print("Robot client is not connected.")
    
    trajectory = sc.sticky[response_key]
    trajectories.append(trajectory)
    start_configuration = goal_constraints

"""
print(trajectories)
trajectory_points_combined = []
my_fraction = trajectories[0].fraction
my_joint_names = trajectories[0].joint_names
for trajectory in trajectories:
    for path_point in trajectory.points:
        trajectory_points_combined.append(path_point)
final_trajectory = compas_fab.robots.JointTrajectory(trajectory_points, my_joint_names, 
    start_configuration, my_fraction)
"""

"""Calculates a motion path.
    Inputs:
        robot: The robot
        group: str, optional
            The planning group used for calculation. Defaults to the robot's
            main planning group.
        start_configuration: :class:`compas_fab.robots.Configuration`, optional
            The robot's full configuration, i.e. values for all configurable
            joints of the entire robot cell, at the starting position. Defaults
            to the all-zero configuration.
        goal_constraints: list of :class:`compas_fab.robots.Constraint`
            The goal to be achieved, defined in a set of constraints.
            Constraints can be very specific, for example defining value domains
            for each joint, such that the goal configuration is included,
            or defining a volume in space, to which a specific robot link (e.g.
            the end-effector) is required to move to.
        planner_id: str
            The name of the algorithm used for path planning. Defaults to 'RRT'.
        attached_collision_meshes: list of :class:`compas_fab.robots.AttachedCollisionMesh`
            Defaults to None.
        compute: bool
            Press to calculate solution.
    Output:
        :class:`compas_fab.robots.JointTrajectory`
            The calculated trajectory.
"""
# ---------- end plan_motion_2 ----------
panel_19 = Panel(plan_motion_2.out)
vis_2 = PythonScript(response=plan_motion_2.trajectories)  # -> P, V, A, time; same code as vis
time_s_2 = Panel(vis_2.time)
prismatic = QuickGraph(vis_2.P, SortOrder=0)
py_11 = PythonScript(robot=robot, group=group_2, trajectory=plan_motion_2.trajectories)  # -> configurations, full_configurations, fraction, time
# ---------- py_11: Python ----------
if trajectory:
    configurations = trajectory.points
    full_configurations = [robot.merge_group_with_full_configuration(c, trajectory.start_configuration, group) for c in configurations]
    start_configuration = trajectory.start_configuration
    fraction = trajectory.fraction
    time = trajectory.time_from_start
# ---------- end py_11 ----------
panel_20 = Panel("positions")
idx_2 = Slider(1, range=0..1)
graph = QuickGraph(vis_2.V, SortOrder=0)
graph_2 = QuickGraph(vis_2.A, SortOrder=0)
panel_21 = Panel("velocities")
panel_22 = Panel("accelerations")
path = GhPythonScript(robot=robot, full_configurations=py_11.full_configurations)  # -> frames, P; inputs full_configurations: list
# ---------- path: Python ----------
import Rhino.Geometry as rg

frames = []

if robot:
    for c in full_configurations:
        if c:
            frame_WCF = robot.forward_kinematics(c, group, options={'backend':'model'})

            frames.append(frame_WCF)

    P = [rg.Point3d(*list(frame.point)) for frame in frames]
# ---------- end path ----------
fraction = Panel(py_11.fraction)
animate_2 = PythonScript(robot=robot, group=group_2, configurations=py_11.full_configurations, idx=idx_2)  # -> configuration; inputs configurations: list, idx: Int32
# ---------- animate_2: Python ----------
import Grasshopper
from compas_fab.utilities import map_range
from compas_fab.robots import Configuration

count = len(configurations)

for i in range(ghenv.Component.Params.Input.Count):
    nslider = ghenv.Component.Params.Input[i].Sources[0]
    if nslider.GetType() == Grasshopper.Kernel.Special.GH_NumberSlider and nslider.NickName == 'idx':
        nslider.Slider.Maximum = max(count - 1, 1)

        nslider.Slider.Minimum = 0

if count and robot and configurations[0] != None:
    configuration = configurations[idx]
# ---------- end animate_2 ----------
time_s_3 = Panel(py_11.time)
pline = PolyLine(Vertices=path.P, Closed=False)
preview_2 = CustomPreview(Geometry=[path.P, pline], Material=ColourSwatch(SwatchColor=RGB(59, 161, 95)))

# ----
py_12 = PythonScript(robot=robot, group=group, trajectory=plan_motion.trajectory)  # -> configurations, full_configurations, fraction, time
# ---------- py_12: Python ----------
if trajectory:
    configurations = trajectory.points
    full_configurations = [robot.merge_group_with_full_configuration(c, trajectory.start_configuration, group) for c in configurations]
    start_configuration = trajectory.start_configuration
    print(start_configuration)
    fraction = trajectory.fraction
    time = trajectory.time_from_start
# ---------- end py_12 ----------
prismatic_2 = QuickGraph(vis.P, SortOrder=0)
idx_3 = Slider(0, range=0..1)
fraction_2 = Panel(py_12.fraction)
graph_3 = QuickGraph(vis.A, SortOrder=0)
graph_4 = QuickGraph(vis.V, SortOrder=0)
no_points = Panel(lng)
path_2 = GhPythonScript(robot=robot, full_configurations=py_12.full_configurations)  # -> frames, P; inputs full_configurations: list; same code as path
animate_3 = PythonScript(robot=robot, group=group, configurations=py_12.full_configurations, idx=idx_3)  # -> configuration; inputs configurations: list, idx: Int32; same code as animate_2
time_s_4 = Panel(py_12.time)
pline_2 = PolyLine(Vertices=path_2.P, Closed=False)
preview_3 = CustomPreview(Geometry=[path_2.P, pline_2], Material=ColourSwatch(SwatchColor=RGB(59, 161, 95)))
panel_26 = Panel(plan_motion_2.constraints)

# ---- group: cartesian motion
# Plan cartesian motion
list_10 = ValueList({"don't use attached collision mesh": 0, "use attached collision mesh": 1}, selected="don't use attached collision mesh")
compute_4 = Button()
group_3 = Data(info.main_group_name)
py_13 = PythonScript(robot=robot)  # -> configuration; same code as standard
start_configuration = Data(inverse.full_configuration)
list_11 = ValueList({"0", "1"}, selected="0")
avoid_collisions_2 = BooleanToggle(True)
filter_5 = StreamFilter(Gate=list_10)
filter_6 = StreamFilter(Gate=list_11, Stream0=start_configuration, Stream1=py_13)
plan_cartesian_motion = PythonScript(
    robot=robot,
    group=group_3,
    planes=counter.tool_frame_glue,
    start_configuration=filter_6,
    max_step=Slider(0.19, range=0..0.6),
    avoid_collisions=avoid_collisions_2,
    attached_collision_meshes=filter_5,
    compute=compute_4)  # -> out, trajectory; inputs planes: list, avoid_collisions: Boolean, attached_collision_meshes: list
# ---------- plan_cartesian_motion: Python ----------
"""Calculates a cartesian motion path (linear in tool space).
    Inputs:
        robot: The robot
        group: str, optional
            The planning group used for calculation. Defaults to the robot's
            main planning group.
        planes: The planes in world coordinate frame through which the path is defined.
        start_configuration: :class:`compas_fab.robots.Configuration`, optional
            The robot's full configuration, i.e. values for all configurable
            joints of the entire robot cell, at the starting position. Defaults
            to the all-zero configuration.
        max_step: float
            The approximate distance between the calculated points. (Defined in
            the robot's units)
        avoid_collisions: bool, optional
            Whether or not to avoid collisions. Defaults to True.
        attached_collision_meshes: list of :class:`compas_fab.robots.AttachedCollisionMesh`
            Defaults to None.
        compute: bool
            Press to calculate solution.
    Output:
        :class:`compas_fab.robots.JointTrajectory`
            The calculated trajectory.
"""
from __future__ import print_function
import logging
import scriptcontext as sc

from compas.geometry import Frame

LOGGER = logging.getLogger('roslibpy')

guid = str(ghenv.Component.InstanceGuid)
response_key = "response_" + guid
if response_key not in sc.sticky:
    sc.sticky[response_key] = None

print(planes)
frames = [Frame(plane[0], plane[1], plane[2]) for plane in planes]

if robot.attached_tool:
    frames = [robot.from_attached_tool_to_tool0([frame])[0] for frame in frames]


if robot and robot.client and start_configuration and compute:
    if robot.client.is_connected:
        sc.sticky[response_key] = robot.plan_cartesian_motion(frames,
                                                              start_configuration=start_configuration,
                                                              group=group,
                                                              options={
                                                                'max_step': float(max_step),
                                                                'avoid_collisions': bool(avoid_collisions),
                                                                'attached_collision_meshes': list(attached_collision_meshes),
                                                              })
    else:
        print("Robot client is not connected")

trajectory = sc.sticky[response_key]
print(trajectory.points)
# ---------- end plan_cartesian_motion ----------
vis_3 = PythonScript(response=plan_cartesian_motion.trajectory)  # -> P, V, A
# ---------- vis_3: Python ----------
from compas_ghpython import list_to_ghtree

if response:
    #print response.points
    positions = []
    velocities = []
    accelerations = []

    for p in response.points:
        positions.append(p.positions)
        velocities.append(p.velocities)
        accelerations.append(p.accelerations)
    #print positions
    P = list_to_ghtree(list(zip(*positions)))
    V = list_to_ghtree(list(zip(*velocities)))
    A = list_to_ghtree(list(zip(*accelerations)))
# ---------- end vis_3 ----------
prismatic_3 = QuickGraph(vis_3.P, SortOrder=0)
py_14 = PythonScript(robot=robot, group=group_3, trajectory=plan_cartesian_motion.trajectory)  # -> configurations, full_configurations, fraction, time; same code as py_11
fraction_3 = Panel(py_14.fraction)
time_s_5 = Panel(py_14.time)
graph_5 = QuickGraph(vis_3.V, SortOrder=0)
graph_6 = QuickGraph(vis_3.A, SortOrder=0)
path_3 = GhPythonScript(robot=robot, group=group_3, full_configurations=py_14.full_configurations)  # -> frames, P; inputs full_configurations: list
# ---------- path_3: Python ----------
import Rhino.Geometry as rg

frames = []

if robot:
    for c in full_configurations:
        
        if c:
            frame_WCF = robot.forward_kinematics(c, group, options={'backend':'model'})
            frames.append(frame_WCF)

    P = [rg.Point3d(*list(frame.point)) for frame in frames]
# ---------- end path_3 ----------
idx_4 = Slider(1, range=0..1)
animate_4 = PythonScript(robot=robot, group=group_3, configurations=py_14.full_configurations, idx=idx_4)  # -> configuration; inputs configurations: list, idx: Int32
# ---------- animate_4: Python ----------
import Grasshopper
from compas_fab.utilities import map_range
from compas_fab.robots import Configuration

count = len(configurations)

for i in range(ghenv.Component.Params.Input.Count):
    nslider = ghenv.Component.Params.Input[i].Sources[0]
    if nslider.GetType() == Grasshopper.Kernel.Special.GH_NumberSlider and nslider.NickName == 'idx':
        nslider.Slider.Maximum = max(count - 1, 1)
        nslider.Slider.Minimum = 0


if count and robot and configurations[0] != None:
    configuration = configurations[idx]
# ---------- end animate_4 ----------
pline_3 = PolyLine(Vertices=path_3.P, Closed=False)
preview_4 = CustomPreview(Geometry=[path_3.P, pline_3], Material=ColourSwatch(SwatchColor=RGB(59, 137, 161)))

# ----
# Visualisation
# Select configuration input: from fk, ik, path, or from real robot
list_12 = ValueList({"0 forward_kinematics": 0, "1 inverse_kinematics": 1, "2 cartesian motion": 2, "3 free-space motion": 3, "4 combined motion": 4}, selected="4 combined motion")
filter_7 = StreamFilter(
    Gate=list_12,
    Stream0=forward_kinematics,
    Stream1=inverse.full_configuration,
    Stream2=animate_4,
    Stream3=animate_3,
    Stream4=configuration)
show_end_effector_frame = BooleanToggle(True)
show_base_frame = BooleanToggle(True)
show_collision = BooleanToggle(False)
show_frames = BooleanToggle(True)
show_visual = BooleanToggle(True)
visualize = PythonScript(
    robot=robot,
    full_configuration=filter_7,
    show_visual=show_visual,
    show_collision=show_collision,
    show_frames=show_frames,
    show_base_frame=show_base_frame,
    show_end_effector_frame=show_end_effector_frame)  # -> out, visual, collision, frames, base_frame_WCF, ee_frame_WCF
# ---------- visualize: Python ----------
"""Calculates a cartesian motion path (linear in tool space).
    Inputs:
        robot: The robot
        group: str
            The planning group used for visualisation
        full_configuration: :class:`compas_fab.robots.Configuration`
            The robot's full configuration to display.
        show_visual: bool
           Whether or not to show the robot's visual meshes.
        show_collision: bool
           Whether or not to show the robot's collision meshes.
        show_frames: bool
           Whether or not to show the robot's joint frames.
        show_base_frame: bool
           Whether or not to show the robot's base frame.
        show_end_effector_frame: bool
            Whether or not to show the robot's end-effector frame.
    Output:
        visual: The robot's visual meshes.
        collision: The robot's collision meshes.
        frames: The robot's joint frames.
        base_frame_WCF: The robot's base frame.
        ee_frame_WCF: The robot's end-effector frame.
"""
from __future__ import print_function
import ghpythonlib.components as ghcomp
from compas.geometry import Transformation, Frame
#from compas_ghpython.geometry import xform_from_transformation


def update(configuration, visual=True, collision=True):
    """Triggers the update of the robot geometry.
    Parameters
    ----------
    configuration : :class:`compas_fab.robots.Configuration`
        Instance of the configuration (joint state) to move to.
    visual : bool, optional
        ``True`` if the visual geometry should be also updated, otherwise ``False``.
        Defaults to ``True``.
    collision : bool, optional
        ``True`` if the collision geometry should be also updated, otherwise ``False``.
        Defaults to ``True``.
    """
    positions = configuration.values
    names = configuration.joint_names or robot.model.get_configurable_joint_names()

    if len(names) != len(configuration.values):
        raise ValueError("Please pass a configuration with %d joint_names." % len(positions))
    joint_state = dict(zip(names, positions))
    transformations = robot.model.compute_transformations(joint_state)
    for j in robot.model.iter_joints():
        link = j.child_link
        for item in link.visual:
            robot.artist._apply_transformation_on_transformed_link(item, transformations[j.name])
        if collision:
            for item in link.collision:
                # some links have only collision geometry, not visual. These meshes have not been loaded.
                if item.native_geometry:
                    robot.artist._apply_transformation_on_transformed_link(item, transformations[j.name])
    
    if robot.attached_tool:
        name = 'joint_6'
        # original line, caused an error probably because of a version change
        # robot.artist._apply_transformation_on_transformed_link(robot.attached_tool, transformations[name])
        
        # the following two lines are slightly experimental copied from Workshop Munich
        frame = robot.forward_kinematics(configuration, options=dict(solver='model', link_name=robot.attached_tool.link_name))
        robot.artist.update_tool(visual=visual, collision=collision, transformation=Transformation.from_frame_to_frame(Frame.worldXY(), frame))

if robot and full_configuration:
    #robot.update(full_configuration, visual=show_visual, collision=show_collision)
    update(full_configuration, visual=show_visual, collision=show_collision) #fast hack, because of a bug in compas_fab
    print(full_configuration)

    if show_visual:
        visual = robot.draw_visual()
        #print(len([v for v in visual]))
        #visual = ([v for v in visual])
        #T = robot.transformation_RCF_WCF()
        #visual = ghcomp.Transform(visual, xform_from_transformation(T))

    if show_collision:
        collision = robot.draw_collision()

    if show_frames:
        axes = robot.transformed_axes(full_configuration)
        frames = robot.transformed_frames(full_configuration)

    if show_base_frame:
        base_frame_WCF = robot.get_base_frame(group, full_configuration)

    if show_end_effector_frame:
        ee_frame_WCF = robot.get_end_effector_frame(group, full_configuration)
        if robot.attached_tool:
            ee_frame_WCF = robot.from_tcf_to_t0cf([ee_frame_WCF])[0]           
            
        print("End-effector", ee_frame_WCF)
# ---------- end visualize ----------
py_15 = PythonScript(robot=robot)  # -> scale
# ---------- py_15: Python ----------
if robot:
    scale = robot.scale_factor * 0.1
else:
    scale = 1.
# ---------- end py_15 ----------
draw = GhPythonScript(frames=visualize.base_frame_WCF, scale=py_15)  # -> P, V, C, W; inputs frames: list
# ---------- draw: Python ----------
from System.Drawing import Color
from compas_ghpython import draw_frame

red = Color.FromArgb(255, 0, 0)
green = Color.FromArgb(0, 255, 0)
blue = Color.FromArgb(0, 0, 255)

P = []
V = []
C = []

scale = float(scale)

for frame in frames:
    if not frame:
        continue
    plane = draw_frame(frame)
    P += [plane.Origin] * 3
    V.append(plane.XAxis * scale)
    V.append(plane.YAxis * scale)
    V.append(plane.ZAxis * scale)
    C += [red, green, blue]

W = 3
# ---------- end draw ----------
geo_3 = Geometry(visualize.collision)
geo_4 = Geometry(visualize.visual)
draw_2 = GhPythonScript(frames=visualize.ee_frame_WCF, scale=py_15)  # -> P, V, C, W; inputs frames: list; same code as draw
vdisex = VectorDisplayEx(Point=draw.P, Vector=draw.V, Colour=draw.C, Width=draw.W)
vdisex_2 = VectorDisplayEx(Point=draw_2.P, Vector=draw_2.V, Colour=draw_2.C, Width=draw_2.W)
preview_5 = CustomPreview(Geometry=geo_4, Shader=ColourSwatch(SwatchColor=RGB(255, 163, 163)))

panel_30 = Panel(plan_cartesian_motion.out)
