# Grasshopper definition robotic_setup_fabtory_tch4.gh (Grasshopper 1.0.7)

# Please add an absolute path here.
panel = Panel()

# ----
# Geometry
# Two advanced parameters; buggy and will probably be removed anyway
number_slider = Slider(5, range=-10..10)
primary_board_width = Slider(0.06, range=0..0.2)
primary_board_height = Slider(0.04, range=0..0.2)
skip_centrals = Slider(2, range=0..20)
vertical_support_width = Slider(0.06, range=0..0.5)
vertical_support_interlock = Slider(0.06, range=0..0.5)
vertical_support_secondary = BooleanToggle(True)
vertical_support_primary = BooleanToggle(True)
omnidirectional = BooleanToggle(False)
advanced = BooleanToggle(False)
define_base_plane = DefineBasePlane(X=number_slider, Y=Slider(1.2, range=-10..10), Z=Slider(-0.3, range=-10..10))
compute = BooleanToggle(True)
geometry_compute = BooleanToggle(True)
slab_geometry_parameter_setup = GhPythonScript(
    assembly_path=panel,
    compute=compute,
    layer_no=Slider(5, range=1..13),
    gap_min=Slider(0, range=0..0.1),
    input_plane=define_base_plane,
    primary_length=Slider(5.2, range=0..8),
    secondary_length=Slider(2.9, range=0..8),
    omnidirectional=omnidirectional,
    primary_board_width_outside=primary_board_width,
    primary_board_height_outside=primary_board_height,
    primary_board_width_inside=primary_board_width,
    primary_board_height_inside=primary_board_height,
    secondary_board_width=primary_board_width,
    secondary_board_height=primary_board_height,
    primary_interval=Slider(0.16, range=0..0.3),
    primary_dedensification=Slider(3, range=0..20),
    secondary_interval=Slider(0.31, range=0..0.6),
    secondary_interval_development=Slider(1.35, range=0.3..6),
    skip_centrals=skip_centrals,
    primary_falloff=Slider(1, range=0..3),
    momentum_support_length=Slider(0, range=0..3),
    shear_support_length=Slider(0, range=0..3),
    advanced=advanced,
    vert_support_prim=vertical_support_primary,
    vert_support_sec=vertical_support_secondary,
    vert_support_width=vertical_support_width,
    vert_support_interlock=vertical_support_interlock)  # -> out, visual, lines, points, total_weight, weight_per_m2, area, timber_volume, clay_volume, my_floorslab; inputs compute: Boolean, layer_no: Int32, input_plane: Plane, omnidirectional: Boolean, skip_centrals: Int32, advanced: Boolean, vert_support_prim: Boolean
# ---------- slab_geometry_parameter_setup: Python ----------
__author__ = "JulianKlaus"
__version__ = "2020.09.10"
import rhinoscriptsyntax as rs
import math
import Rhino.Geometry as rg
import ghpythonlib as gh
from compas.geometry import Point, Box, Frame, Vector, scale_vector, normalize_vector
from compas_ghpython.artists import MeshArtist
from assembly_information_model.assembly import Element, Assembly
from compas.datastructures import Mesh
from compas_rhino.artists import MeshArtist, BoxArtist
import sys
if not "C:\\Users\\julia\\workspace\\projects\\timber_clay_hybrid\\src\\timber_clay_hybrid\\assembly" in sys.path:
    sys.path.append("C:\\Users\\julia\\workspace\\projects\\timber_clay_hybrid\\src\\timber_clay_hybrid\\assembly")
if '"C:\\\\Users\\\\julia\\\\workspace\\\\projects\\\\timber_clay_hybrid\\\\src\\\\timber_clay_hybrid\\\\assembly"' in sys.path:
    sys.path.remove('"C:\\\\Users\\\\julia\\\\workspace\\\\projects\\\\timber_clay_hybrid\\\\src\\\\timber_clay_hybrid\\\\assembly"')
print(sys.path)
from assembly_TCH import TCHAssembly
if compute:
    origin_point = input_plane[0]
    origin_vector_primary = normalize_vector(input_plane[2])
    origin_vector_secondary = normalize_vector(input_plane[1])
    origin_frame = Frame(origin_point, origin_vector_primary, origin_vector_secondary)
    
    grid_dictionary = {"layer_no": layer_no, "primary_length": primary_length,
        "secondary_length": secondary_length, "primary_interval": primary_interval,
        "secondary_interval": secondary_interval, "secondary_interval_development":
        secondary_interval_development, "skip_centrals": skip_centrals, "gap_min": gap_min}
    
    boards_dictionary = {"prim_board_outside_dimensions": 
        [primary_board_width_outside, primary_board_height_outside],
        "sec_board_inside_dimensions": [secondary_board_width, secondary_board_height],
        "prim_board_inside_dimensions": [primary_board_width_inside, primary_board_height_inside]}
    
    verts_dictionary = {"prim_vert_sup": vert_support_prim,
        "sec_vert_sup": vert_support_sec, "vertical_support_width": vert_support_width,
        "vertical_support_interlock": vert_support_interlock}
    
    omni_dictionary = {"primary_falloff": primary_falloff, 
        "primary_dedensification": primary_dedensification}
    
    baseplane_dictionary = {"origin_frame": origin_frame}
    
    advanced_dictionary = {"momentum_support_length": momentum_support_length, 
        "shear_support_length": shear_support_length}
    
    
    my_floorslab = TCHAssembly()
    my_floorslab.set_grid_parameters(grid_dictionary)
    my_floorslab.set_board_formats(boards_dictionary)
    if vert_support_prim or vert_support_sec:
        my_floorslab.set_vertical_support(verts_dictionary)
    if omnidirectional:
        my_floorslab.set_omnidirectionality(omni_dictionary)
    my_floorslab.set_base_plane(baseplane_dictionary)
    if advanced:
        my_floorslab.set_advanced_parameters(advanced_dictionary)
# ---------- end slab_geometry_parameter_setup ----------
create_assembly_geometry = GhPythonScript(compute=geometry_compute, my_floorslab=slab_geometry_parameter_setup.my_floorslab)  # -> out, my_floorslab; inputs compute: Boolean
# ---------- create_assembly_geometry: Python ----------
__author__ = "julia"
__version__ = "2021.02.11"

import rhinoscriptsyntax as rs
if compute:
    my_floorslab.create_assembly_geometry()
# ---------- end create_assembly_geometry ----------

# ----
# Fabrication Setup
number_slider_2 = Slider(1.3, range=-10..10)
tool_width_bending = Slider(0.5, range=0..1)
safe_level_distance_flipped = Slider(2, range=0..3)
bending_factor = Slider(0.6, range=0..1)
safe_level_distance_glue = Slider(0.05, range=0..1.8)
safe_level_distance = Slider(0.8, range=0..1)
width_gluepath = Slider(0.005, range=0..0.1)
bending_calc_for_lines = BooleanToggle(True)
cluster = Cluster_2(X=Slider(5.5, range=-10..10), Y=Slider(0.2, range=-10..10), Z=number_slider_2)
snakelines = BooleanToggle(False)
cluster_2 = Cluster(X=Slider(-0.4, range=-10..10), Y=Slider(-1.1, range=-10..10), Z=Slider(-0.3, range=-10..10))
dryrun = BooleanToggle(True)
cyl = Cylinder(Base=cluster, Radius=Slider(0.05, range=0..1), Length=Slider(0.3, range=0..1))
assembly_sequence_parameters = GhPythonScript(
    my_floorslab=create_assembly_geometry.my_floorslab,
    stack_plane=cluster_2,
    glue_path_width=width_gluepath,
    safe_level_distance=safe_level_distance,
    safe_level_distance_glue=safe_level_distance_glue,
    safe_level_distance_flipped=safe_level_distance_flipped,
    snakelines=snakelines,
    dryrun=dryrun,
    gluestation_plane=cluster,
    tool_width_bending=tool_width_bending,
    bending_factor=bending_factor,
    bending_calc_includes_lines=bending_calc_for_lines)  # -> out, my_floorslab
# ---------- assembly_sequence_parameters: Python ----------
__author__ = "JulianKlaus"
__version__ = "2020.09.10"

import rhinoscriptsyntax as rs
import math
import Rhino.Geometry as rg
import ghpythonlib as gh
from compas.geometry import Point, Box, Frame, Vector, scale_vector, normalize_vector
from compas_ghpython.artists import MeshArtist
from assembly_information_model.assembly import Element, Assembly
from compas.datastructures import Mesh
from compas_rhino.artists import MeshArtist, BoxArtist


gluestation_frame = Frame(gluestation_plane[0], 
    gluestation_plane[1], gluestation_plane[2])
stack_origin_frame = Frame(stack_plane[0], stack_plane[1], stack_plane[2])

assembly_stack_dic = {"stack_origin_frame": stack_origin_frame}
assembly_glue_dic = {"safety_distance": 0.5,
    "glue_path_width": glue_path_width, "safe_level_distance": safe_level_distance,
    "safety_distance_gluepoints": safe_level_distance_glue,
    "flipped_dropframe_distance": safe_level_distance_flipped,
    "snakelines": snakelines, "dryrun": dryrun, "glue_station_default_frame": gluestation_frame,
    "tool_width_bending": tool_width_bending, "bending_factor": bending_factor,
    "bending_calc_includes_lines": bending_calc_includes_lines}

my_floorslab.set_assembly_stack_parameters(assembly_stack_dic)
my_floorslab.set_assembly_glue_parameters(assembly_glue_dic)
# ---------- end assembly_sequence_parameters ----------
sequence_compute = BooleanToggle(True)
assembly_sequence_calc = GhPythonScript(my_floorslab=assembly_sequence_parameters.my_floorslab, enabled=sequence_compute)  # -> out, my_floorslab, sequence_up_to_date; inputs enabled: Boolean
# ---------- assembly_sequence_calc: Python ----------
__author__ = "JulianKlaus"
__version__ = "2020.09.10"

import rhinoscriptsyntax as rs
import math
import Rhino.Geometry as rg
import ghpythonlib as gh
from compas.geometry import Point, Box, Frame, Vector, scale_vector, normalize_vector
from compas_ghpython.artists import MeshArtist
from assembly_information_model.assembly import Element, Assembly
#from AIM_TCH_forAssembly2 import floorslab_creation, gluepoints, advanced_floorslab_setup, weight_calculator, stack_creator


if enabled:
    my_floorslab.create_assembly_sequence()
    sequence_up_to_date = True
else:
    sequence_up_to_date = False
# ---------- end assembly_sequence_calc ----------

# ----
# Analysis
clay_protection_layer = Slider(0, range=0..10)
analysis = BooleanToggle(True)
weight_calculation = GhPythonScript(
    my_floorslab_geometry=slab_geometry_parameter_setup.my_floorslab,
    protective_layer_height_cm=clay_protection_layer,
    layers_filled=Slider(0, range=0..5),
    enabled=analysis)  # -> out, total_weight, relative_weight, area, total_volume, timber_volume, timber_relative_weight, clay_volume, void_volume; inputs enabled: Boolean
# ---------- weight_calculation: Python ----------
__author__ = "JulianKlaus"
__version__ = "2020.09.10"

import rhinoscriptsyntax as rs
import math
import Rhino.Geometry as rg
import ghpythonlib as gh
from compas.geometry import Point, Box, Frame, Vector, scale_vector, normalize_vector
from compas_ghpython.artists import MeshArtist
from assembly_information_model.assembly import Element, Assembly
from compas.datastructures import Mesh
from compas_rhino.artists import MeshArtist, BoxArtist



if enabled:
    if not layers_filled:
        layers_filled = my_floorslab_geometry.layer_no
    weights = my_floorslab_geometry.calculate_weight(fill_limit = layers_filled,
        protective_clay_height = protective_layer_height_cm)
    total_weight = weights[0]
    relative_weight = weights[1]
    area = weights[2]
    total_volume = weights[3]
    timber_volume = weights[4]
    timber_relative_weight = (timber_volume * 460) / area
    clay_volume = weights[5]
    void_volume = weights[6]
# ---------- end weight_calculation ----------
total_weight_kg = Panel(weight_calculation.total_weight)
relative_weight_kg_m2 = Panel(weight_calculation.relative_weight)
area_m2 = Panel(weight_calculation.area)
total_volume_m3 = Panel(weight_calculation.total_volume)
swatch = ColourSwatch(SwatchColor=RGB(125, 116, 102))
timber_volume_m3 = Panel(weight_calculation.timber_volume)
timber_weight_kg_m2 = Panel(weight_calculation.timber_relative_weight)
clay_volume_m3 = Panel(weight_calculation.clay_volume)
void_volume_m3 = Panel(weight_calculation.void_volume)

# ----
# Geometry Visualisation
visualize = BooleanToggle(True)
visualization = GhPythonScript(
    my_floorslab_geometry=slab_geometry_parameter_setup.my_floorslab,
    my_floorslab_sequence=assembly_sequence_calc.my_floorslab,
    enabled=visualize,
    sequence_up_to_date=assembly_sequence_calc.sequence_up_to_date)  # -> out, visual, glue_lines, glue_points, my_floorslab; inputs enabled: Boolean
# ---------- visualization: Python ----------
__author__ = "JulianKlaus"
__version__ = "2020.09.10"

import rhinoscriptsyntax as rs
import math
import Rhino.Geometry as rg
import ghpythonlib as gh
from compas.geometry import Point, Box, Frame, Vector, scale_vector, normalize_vector
from compas_ghpython.artists import MeshArtist
from assembly_information_model.assembly import Element, Assembly
from compas.datastructures import Mesh
from compas_rhino.artists import MeshArtist, BoxArtist


def gluedraw(system):
    
    def compas_to_rg(pt):
        return rg.Point3d(pt[0], pt[1], pt[2])
    
    points = []
    lines = []
    for brd in system.elements():
        board = brd[1]
        gluepts = board.glue_paths        
        if len(gluepts) == 0:
            continue
        
        for path in gluepts:
            if len(path) > 1:
                for i in range(0,len(path)-1):
                    mypt = compas_to_rg(path[i])
                    nextpt = compas_to_rg(path[i+1])                    
                    myLine = rg.Line(mypt, nextpt)
                    points.append(mypt)
                    lines.append(myLine)
            else:
                mypt = compas_to_rg(path[0])
                points.append(mypt)

    return [lines, points]

def grasshopper_draw(system):
    def box_update(elmnt):
        elmnt.board_frame = Frame(elmnt.centre_point, elmnt.length_vector, elmnt.width_vector)
        elmnt.box = Box(elmnt.board_frame, elmnt.length, elmnt.width, elmnt.height)

        if elmnt.stack_center_frame:
            stack_box = Box(elmnt.stack_center_frame, elmnt.length, elmnt.width, elmnt.height)
            return 4, elmnt.board_frame, elmnt.box, stack_box
        else:
            return 3, elmnt.board_frame, elmnt.box

    visualisations = []
    
    
    for brd in system.elements():
        board = brd[1]
        # visualise all the boards
        box_creation = box_update(board)
        my_frame_count = box_creation[0]
        
        for i in range (2, my_frame_count):
            my_box = box_creation[i]
            myartist = BoxArtist(my_box)
            myvisualisation = myartist.draw()
            visualisations.append(myvisualisation)
            
        if my_frame_count == 3:
            print("stack not found")
    return visualisations
    
if my_floorslab_sequence and sequence_up_to_date:
    my_floorslab = my_floorslab_sequence
    print("visualizing whole sequence")
else:
    my_floorslab = my_floorslab_geometry
    print("visualizing just the geometry")

if enabled:
    vis = grasshopper_draw(my_floorslab)
    visual = gh.treehelpers.list_to_tree(vis, True, [0])
    glue_lines = gluedraw(my_floorslab)[0]
    glue_points = gluedraw(my_floorslab)[1]
# ---------- end visualization ----------
line = Line(visualization.glue_lines)
pt = Point(visualization.glue_points)
preview = CustomPreview(Geometry=visualization.visual, Material=swatch)

reload = Button()
py = PythonScript()  # -> HERE, DATA
# ---------- py: Python ----------
import os

HERE = os.path.dirname(ghdoc.Path)
DATA = os.path.abspath(os.path.join(HERE, "..", "data"))
print(HERE)
print(DATA)
# ---------- end py ----------
panel_2 = Panel(py.DATA)
data_path = Data(py.DATA)
py_2 = PythonScript(reload=reload)
# ---------- py_2: Python ----------
if reload:
    from compas_ghpython import unload_modules
    unload_modules('compas')
    unload_modules("compas_fab")
    unload_modules("ur_online_control")
# ---------- end py_2 ----------

# ---- group: ROS client
disconnect = Button()
connect = Button()
restart = Button()
ros = PythonScript(ip="127.0.0.1", restart=restart)  # -> out, ros_client
# ---------- ros: Python ----------
import sys
import time
import logging
import scriptcontext as sc

from compas_fab.backends import RosClient

from System import TimeSpan
from System.Threading import ManualResetEventSlim

LOGGER = logging.getLogger('roslibpy')

key = 'rosclient_%s' % str(ghenv.Component.InstanceGuid)
previous_client = sc.sticky.get(key, None)
if previous_client:
    previous_client.terminate()

ros_client = RosClient(ip, 9090)
sc.sticky[key] = ros_client

waitLock = ManualResetEventSlim(False)

ros_client.on_ready(lambda: waitLock.Set())

if not waitLock.Wait(TimeSpan.FromSeconds(5)):
    raise Exception('Unable to connect to ROS')

LOGGER.info('ROS connection opened')
# ---------- end ros ----------
connect_2 = PythonScript(ros_client=ros.ros_client, connect=connect, disconnect=disconnect)  # -> out, ros_client
# ---------- connect_2: Python ----------
import logging
from System import TimeSpan
from System.Threading import ManualResetEventSlim

LOGGER = logging.getLogger('roslibpy')

if connect:
    if not ros_client.is_connected:
        LOGGER.debug('Connecting...')
        waitLock = ManualResetEventSlim(False)
        ros_client.on_ready(lambda: waitLock.Set())
        ros_client.connect()

        if not waitLock.Wait(TimeSpan.FromSeconds(5)):
            raise Exception('Unable to connect to ROS')
        LOGGER.debug('Reconnected')

if disconnect:
    if ros_client.is_connected:
        ros_client.terminate()
        LOGGER.debug('Terminated')

print ros_client.is_connected
# ---------- end connect_2 ----------
is_connected = Panel(connect_2.out)

# ----
# Robot Model
# Load robot from local package
panel_3 = Panel("abb_irb6700_linear_axis.srdf")
py_3 = PythonScript()  # -> ghfile_path
# ---------- py_3: Python ----------
import os

filepath = ghenv.Component.OnPingDocument().FilePath
ghfile_path = os.path.dirname(filepath)
# ---------- end py_3 ----------
list = ValueList({"abb_linear_axis"}, selected="abb_linear_axis")
py_4 = PythonScript(ghfile_path=py_3)  # -> robot_description
# ---------- py_4: Python ----------
import os

robot_description = os.path.join(ghfile_path, "..", "data", "robot_description")
robot_description = os.path.abspath(robot_description)

print robot_description
# ---------- end py_4 ----------
py_5 = PythonScript()  # -> packages
# ---------- py_5: Python ----------
packages = ["abb_irb6700_support", "abb_irb4600_40_255", "abb_end_effectors", "abb_linear_axis"]
# ---------- end py_5 ----------
py_6 = PythonScript(path=py_4, package=list, urdf_name="abb_irb6700_linear_axis.urdf", srdf_name=panel_3)  # -> package_path, urdf_filename, srdf_filename
# ---------- py_6: Python ----------
import os

package_path = os.path.join(path, package)

urdf_filename = os.path.join(package_path, "urdf", urdf_name)
srdf_filename = os.path.join(package_path, srdf_name)

assert os.path.isfile(urdf_filename)
assert os.path.isfile(srdf_filename)
# ---------- end py_6 ----------
py_7 = PythonScript(path=py_4, packages=py_5)  # -> loaders; inputs packages: list
# ---------- py_7: Python ----------
from compas.robots import LocalPackageMeshLoader

loaders = []
print packages


for package in packages:
    loaders.append(LocalPackageMeshLoader(path, package))
# ---------- end py_7 ----------
load = Button()
units = ValueList({"m": 1, "cm": 100, "mm": 1000}, selected="m")
create = PythonScript(loaders=py_7, urdf_filename=py_6.urdf_filename, srdf_filename=py_6.srdf_filename, scale_factor=units, load=load)  # -> out, robot; inputs loaders: list
# ---------- create: Python ----------
import os
from scriptcontext import sticky as st

import compas

from compas.robots import RobotModel
from compas.robots import LocalPackageMeshLoader

from compas_fab.robots import Robot
from compas_fab.robots import RobotSemantics

from compas_fab.ghpython import RobotArtist

compas.PRECISION = '12f'

# store robot in component
guid = str(ghenv.Component.InstanceGuid)
robot_key = "robot_" + guid

if robot_key not in st:
    st[robot_key] = None

print loaders
if load:
    model = RobotModel.from_urdf_file(urdf_filename)
    
    model.load_geometry(*loaders)
    artist = RobotArtist(model)
    semantics = RobotSemantics.from_srdf_file(srdf_filename, model)
    robot = Robot(model, artist, semantics, client=None)
    
    st[robot_key] = robot

robot = st[robot_key]


if robot:
    robot.scale(scale_factor)
# ---------- end create ----------
set = PythonScript(robot=create.robot, client=connect_2.ros_client)  # -> robot
# ---------- set: Python ----------
if robot and client:
    robot.client = client
# ---------- end set ----------
robot = Data(set)
scene = PythonScript(robot=robot)  # -> scene
# ---------- scene: Python ----------
from scriptcontext import sticky as st

from compas_fab.robots import PlanningScene

# store scene in component
guid = str(ghenv.Component.InstanceGuid)
scene_key = "scene_" + guid

if scene_key not in st:
    st[scene_key] = None

if robot:
    st[scene_key] = PlanningScene(robot)

scene = st[scene_key]
# ---------- end scene ----------

geo = Geometry([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])
mesh = Mesh(geo)
mjoin = MeshJoin(Meshes=mesh)
xaxis_line = Curve(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)
yaxis_line = Curve(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)
tool = PythonScript(rhmesh=mjoin, xline=xaxis_line, yline=yaxis_line)  # -> tool, ee_mesh, ee_plane; inputs rhmesh: Mesh
# ---------- tool: Python ----------
import Rhino.Geometry as rg
import os, math
from compas.geometry import Frame, Rotation
from compas.datastructures import Mesh
from compas_ghpython.artists import MeshArtist
from compas_fab.robots import Tool
from compas_rhino.geometry import RhinoMesh

xaxis = rg.Line(xline.PointAtStart, xline.PointAtEnd)
yaxis = rg.Line(yline.PointAtStart, yline.PointAtEnd)

if xaxis.From.DistanceTo(yaxis.From) < 0.01:
    origin = xaxis.From
    xaxis = xaxis.Direction
    yaxis = yaxis.Direction
elif xaxis.To.DistanceTo(yaxis.To) < 0.01:
    origin = xaxis.To
    xaxis = -xaxis.Direction
    yaxis = -yaxis.Direction
elif xaxis.From.DistanceTo(yaxis.To) < 0.01:
    origin = xaxis.From
    xaxis = xaxis.Direction
    yaxis = -yaxis.Direction
elif xaxis.To.DistanceTo(yaxis.From) < 0.01:
    origin = xaxis.To
    xaxis = -xaxis.Direction
    yaxis = yaxis.Direction

xaxis.Unitize()
yaxis.Unitize()

ee_frame = Frame(origin, xaxis, yaxis)
ee_plane = rg.Plane(origin, xaxis, yaxis)
ee_mesh = RhinoMesh.from_geometry(rhmesh).to_compas()

tool = Tool(ee_mesh, ee_frame)
# ---------- end tool ----------

# ----
# Tool
remove = Button()
add = Button()
attacher = PythonScript(robot=robot, tool=tool.tool, attach=add, remove=remove)  # -> out, bang
# ---------- attacher: Python ----------
if attach:
    robot.attach_tool(tool)
if remove:
    robot.detach_tool()
# ---------- end attacher ----------
panel_4 = Panel(attacher.out)

# ----
# Select link name to attach
# Select the links the object is allowed to touch
number_slider_3 = Slider(10, range=0..10)
idxs = Data([3, 4, 5, 6, 7, 8, 9, 10])
link_names = PythonScript(robot=robot, idx=number_slider_3)  # -> link_name; inputs idx: Int32
# ---------- link_names: Python ----------
if robot:
    link_names = robot.get_link_names()
    #print link_names
    link_name = link_names[idx]
# ---------- end link_names ----------
py_8 = PythonScript(robot=robot, idxs=idxs)  # -> touch_links; inputs idxs: list of Int32
# ---------- py_8: Python ----------
if robot:
    link_names = robot.get_link_names()
    touch_links = [link_names[i] for i in idxs]
# ---------- end py_8 ----------
scale = BooleanToggle(False)
panel_5 = Panel(link_names)
panel_6 = Panel(py_8)
attachedcollisionmesh = PythonScript(
    scene=scene,
    compas_mesh=tool.ee_mesh,
    scale=scale,
    id="endeffector",
    link_name=link_names,
    touch_links=py_8,
    add=add,
    remove=remove)  # -> acm, out; inputs touch_links: list
# ---------- attachedcollisionmesh: Python ----------
from compas_fab.robots import CollisionMesh
from compas_fab.robots import AttachedCollisionMesh

cm = CollisionMesh(compas_mesh, id)
acm = AttachedCollisionMesh(cm, link_name, touch_links)

if scene:
    if add:
        scene.add_attached_collision_mesh(acm, scale)
    if remove:
        scene.remove_attached_collision_mesh(id)
        scene.remove_collision_mesh(id)
# ---------- end attachedcollisionmesh ----------

# ----
# Info
info = PythonScript(robot=robot)  # -> out, main_group_name
# ---------- info: Python ----------
if robot:
    robot.info()
    main_group_name = robot.main_group_name
# ---------- end info ----------
panel_7 = Panel(info.out)

# ----
# Forward Kinematics
number_slider_4 = Slider(0.41, range=0..5)
jp = GhPythonScript()  # -> configuration_values
# ---------- jp: Python ----------
import math
joint_values = [-3.136, -0.328, -1.218, 3.129, 0.852, 0.008]
#joint_positions = [0] * 6

cart = 0
j_values = [0,0,0,0,0,0]

configuration_values = [cart] + j_values
# ---------- end jp ----------
reset = Button()
forward_kinematics = PythonScript(
    robot=robot,
    reset_configuration=reset,
    configuration_values=jp,
    a_cart=number_slider_4,
    a_a1=Slider(40.1, range=-180..180),
    a_a2=Slider(29.5, range=-90..150),
    a_a3=Slider(26, range=-180..180),
    a_a4=Slider(0, range=-400..400),
    a_a5=Slider(33.3, range=-125..120),
    a_a6=Slider(0, range=-400..400),
    bang=attacher.bang)  # -> full_configuration; inputs reset_configuration: Boolean, configuration_values: list
# ---------- forward_kinematics: Python ----------
import math
import Grasshopper
from compas.robots import Joint
from compas_fab.robots import Configuration


import math
import Grasshopper
from compas_fab.robots import Configuration

if reset_configuration:
    j = 0
    for i in range(ghenv.Component.Params.Input.Count):
        nslider = ghenv.Component.Params.Input[i].Sources[0]
        if nslider.GetType() == Grasshopper.Kernel.Special.GH_NumberSlider:
            nslider.TrySetSliderValue(configuration_values[j])
            j += 1

    
if robot:
    a_cyl = a_a2 * -0.25
    a_piston = math.radians(a_a2) * 0.15
    joint_positions = [a_cart, a_a1, a_a2, a_cyl, a_a3, a_a4, a_a5, a_a6, a_piston]
    joint_types = robot.get_configurable_joint_types()
    for i, joint_type in enumerate(joint_types):
        if joint_type == Joint.REVOLUTE:
            joint_positions[i] = math.radians(joint_positions[i])
    #full_configuration = Configuration(joint_positions, joint_types)
    print(joint_positions)
    #this can save the issue with the forward kinematics in the main motion planner
    joint_names = robot.get_configurable_joint_names()
    full_configuration = Configuration(joint_positions, joint_types, joint_names)
# ---------- end forward_kinematics ----------

reset_2 = Button()
# Assembly Sequence
start = Button()
step = Button()
back = Button()
stop = Button()
collisions_avoid = BooleanToggle(False)
board = Slider(25, range=0..60)
freemotion = BooleanToggle(True)
counter = CountThroughList(AIM=assembly_sequence_parameters.my_floorslab, start=start, stop=stop, step=step, back=back, reset=reset_2, interval=1)  # -> board; inputs start: Boolean, stop: Boolean
# ---------- counter: Python ----------
from scriptcontext import sticky as st
from compas_ghpython.utilities import update_component
from compas.geometry import Frame
from time import sleep
import Rhino.Geometry as rg


def path_appender(my_path, key):
    for i, point in enumerate(board.path[key]):
        if i == 0:
            print(my_path)
            my_path.append((point, ["free"]))
        else:
            my_path.append((point, ["cart"]))
    return my_path

if not interval:
    interval = 5

total_length = len(AIM.network.node)

# store data in component
guid = str(ghenv.Component.InstanceGuid)
counter_key = "counter_" + guid
running_key = "running_" + guid

if counter_key not in st or reset:
    st[counter_key] = 0

if running_key not in st:
    st[running_key] = False

if start:
    st[running_key] = True
    recompute = True

if stop:
    st[running_key] = False
    recompute = False

if step:
    if st[counter_key] < total_length - 1:
        st[counter_key] += 1

if back:
    if st[counter_key] > 1:
        st[counter_key] -= 1



if st[running_key]:
    recompute = True
    if st[counter_key] < total_length - 1:
        st[counter_key] += 1
        update_component(ghenv, interval)
    else:
        st[counter_key] = 0
        st[running_key] = False
        recompute = False


count = st[counter_key]
# ---------- end counter ----------
compute_2 = BooleanToggle(False)
list_2 = ValueList({"RRT", "RRT*": "RRTStar", "EST", "PRM": "RPM", "PRM*": "RPMStar", "SPARS"}, selected="RRT")
manual_configuration = Data(forward_kinematics)
list_3 = ValueList({"Stepper": 0, "Slider": 1}, selected="Slider")
board_2 = StreamFilter(Gate=list_3, Stream0=counter, Stream1=board)
robot_motion_planner = GhPythonScript(
    compute=compute_2,
    sample=compute_2,
    sample_index=board_2,
    my_system=slab_geometry_parameter_setup.my_floorslab,
    robot=robot,
    group=info.main_group_name,
    default_configuration=manual_configuration,
    scene=scene,
    planner_id=list_2,
    tolerance_position=Slider(0.001, range=0..0.001),
    tolerance_xaxis_deg=Slider(1, range=1..360),
    tolerance_yaxis_deg=Slider(2, range=1..360),
    tolerance_zaxis_deg=Slider(2, range=1..360),
    max_step=Slider(0.05, range=0..1),
    collisions_avoid=collisions_avoid,
    freemotion=freemotion)  # -> out, last_trajectory, last_configurations, frames, acm; inputs sample_index: Int32, collisions_avoid: Boolean
# ---------- robot_motion_planner: Python ----------
__author__ = "julian"
__version__ = "2021.01.01"

import rhinoscriptsyntax as rs
import sys
import math
import copy
from compas.geometry import Vector, Box
from compas.geometry import Frame
from compas.geometry import Transformation
from compas.datastructures import Mesh
from compas_fab.backends import RosClient
from compas_fab.robots import PlanningScene
from compas_fab.robots import Configuration
from compas_fab.robots import Tool
from compas_fab.robots import AttachedCollisionMesh
from compas_fab.robots import CollisionMesh
from compas_fab.backends import BackendError
from compas_fab.robots.constraints import Constraint
from assembly_information_model.assembly import Assembly
from assembly_information_model.assembly import Element

import scriptcontext as sc

guid = str(ghenv.Component.InstanceGuid)
response_key = "response_" + guid
if response_key not in sc.sticky:
    sc.sticky[response_key] = None


tolerance_axes = [math.radians(tolerance_xaxis_deg), math.radians(tolerance_yaxis_deg), math.radians(tolerance_zaxis_deg)]
default_toolframe = robot.forward_kinematics(default_configuration, group)

# dirty fix attempt: appends two unnecessary values to the configuration
def configuration_correct(old_values, list_output=False):
    vals = []
    types = []
    for i in range(0,9):
        if i==0 or i==8:
            types.append(2)
        else:
            types.append(0)
        if i < 3:
            vals.append(old_values[i])
        elif i == 3 or i == 8:
            vals.append(0.0)
        else:
            vals.append(old_values[i-1])
    if not list_output: 
        return Configuration(vals, types)
    else:
        return vals

def plan_motion2(rob, goal_constraints, start_configuration=None, group=None, options=None, collision_avoidance = False):
        options = options or {}
        path_constraints = options.get('path_constraints')
        attached_collision_meshes = options.get('attached_collision_meshes', [])
        rob.ensure_client()
        if not group:
            group = rob.main_group_name
        # NOTE: start_configuration has to be a full robot configuration, such
        # that all configurable joints of the whole robot are defined for planning.
        start_configuration, start_configuration_scaled = rob._check_full_configuration_and_scale(start_configuration)

        goal_constraints_WCF_scaled = []
        for c in goal_constraints:
            cp = c.copy()
            if c.type == Constraint.JOINT:
                joint = rob.get_joint_by_name(c.joint_name)
                if joint.is_scalable():
                    cp.scale(1. / rob.scale_factor)
            else:
                cp.scale(1. / rob.scale_factor)
            goal_constraints_WCF_scaled.append(cp)

        # Transform path constraints to RCF and scale
        if path_constraints:
            path_constraints_WCF_scaled = []
            for c in path_constraints:
                cp = c.copy()
                if c.type == Constraint.JOINT:
                    joint = rob.get_joint_by_name(c.joint_name)
                    if joint.is_scalable():
                        cp.scale(1. / rob.scale_factor)
                else:
                    cp.scale(1. / rob.scale_factor)
                path_constraints_WCF_scaled.append(cp)
        else:
            path_constraints_WCF_scaled = None
        
        
        if rob.attached_tool and collision_avoidance:
            attached_collision_meshes.extend(rob.attached_tool.attached_collision_meshes)
        
        options['attached_collision_meshes'] = attached_collision_meshes
        options['path_constraints'] = path_constraints_WCF_scaled

        trajectory = rob.client.plan_motion(
            robot=rob,
            goal_constraints=goal_constraints_WCF_scaled,
            start_configuration=start_configuration_scaled,
            group=group,
            options=options,
        )

        # Scale everything back to robot's scale
        for pt in trajectory.points:
            pt.scale(rob.scale_factor)

        trajectory.start_configuration.scale(rob.scale_factor)

        return trajectory

def box_update(elmnt, input_frame):
        elmnt.board_frame = Frame(elmnt.centre_point, elmnt.length_vector, elmnt.width_vector)
        elmnt.box = Box(elmnt.board_frame, elmnt.length, elmnt.width, elmnt.height)
        return elmnt.box

def path_appender(my_path, key):
    for i, point in enumerate(current_board.path[key]):
        if i == 0:
            
            my_path.append((point, ["free"]))
        else:
            my_path.append((point, ["cart"]))
    return my_path

if compute:    
    for key, brd in enumerate(my_system.elements()):        
        if sample==True and key!=sample_index:
            if key > sample_index:
                break
            else:                
                continue
        
        current_board = brd[1]
        
        board_geometry = current_board.box
        box_mesh = board_geometry.to_vertices_and_faces()
        acm = Mesh.from_vertices_and_faces(box_mesh[0], box_mesh[1])
        current_board.trajectory = []
        assembly_path = path_appender([], "pick_points")
        assembly_path = path_appender(assembly_path, "glue_points")
        if current_board.path["safety_glue_point"]:
            assembly_path.append((current_board.path["safety_glue_point"], ["free"]))
        else:
            print("no_safety_glue_frame")
        assembly_path = path_appender(assembly_path, "drop_points")
        #assembly_path.append((default_toolframe, ["free"]))
        for i, path_entry in enumerate(assembly_path):
            
            path_frame = path_entry[0]
            options = path_entry[1]
            if i == 0:
                last_configuration = default_configuration.copy()                
                # attach the collision mesh
                attached_tool_frame = robot.forward_kinematics(default_configuration, group)
                mesh = box_update(current_board, attached_tool_frame)
                cm = CollisionMesh(mesh, 'tip')
                group = robot.main_group_name                
            
            elif i == len(assembly_path):
                scene.remove_attached_collision_mesh('tip')

            # if we have cartesian motion
            for j in range(10):
                try:                   
                    # CARTESIAN PART
                    if "cart" in options and not freemotion:
                        print("cartesian try")
                        # because of the tolerances, we have to recalculate the starting frame via forward kinematics
                        my_configuration = Configuration(last_configuration.values, last_configuration.types, robot.get_configurable_joint_names())
                        corrected_last_frame = robot.forward_kinematics(my_configuration, group)
                        frames = [corrected_last_frame, path_frame]
                        frames_tool0 = robot.from_tcf_to_t0cf(frames)
                        
                        # actual procedure
                        trajectory = robot.plan_cartesian_motion(frames_tool0,
                                                                      last_configuration,
                                                                      group=group,
                                                                      options={
                                                                        'planner_id': str(planner_id),
                                                                        'max_step': float(max_step),
                                                                        'avoid_collisions': bool(collisions_avoid)                                                                        
                                                                      })
                        if trajectory.fraction == 1:                            
                            last_configuration = configuration_correct(trajectory.points[-1].values)
                            last_frame = frames[1]
                            for i in range(len(trajectory.points)):
                                trajectory.points[i] = configuration_correct(trajectory.points[i].values)
                            print("cartesian success")
                            break                            
                        else:
                            print("cartesian failed")
                            raise BackendError("Cartesian path not working")
                            
                    # FREE MOTION PART
                    elif "free" in options or freemotion:                       
                        path_frame_tool0 = robot.from_tcf_to_t0cf([path_frame])[0]                        
                        goal_constraints = robot.constraints_from_frame(path_frame_tool0,
                                                            tolerance_position,
                                                            tolerance_axes)
                        
                        trajectory = plan_motion2(robot, goal_constraints,
                                              last_configuration,
                                              group, collision_avoidance = False,
                                              options={
                                                'planner_id': str(planner_id),
                                                'num_planning_attempts': 5,
                                                'allowed_planning_time': 5
                                              })                        
                        if trajectory.fraction == 1:                    
                            last_configuration = configuration_correct(trajectory.points[-1].values)                       
                            for i in range(len(trajectory.points)):
                                trajectory.points[i] = configuration_correct(trajectory.points[i].values)
                            last_frame = path_frame_tool0
                            break
                        else:
                            raise BackendError("Free motion path not working")
                    else:
                        print("Major Error: Invalid Motion Type in the path {}".format(motion_type))
                except BackendError:
                    print("Trying the %d. time" % (j + 2))
                    continue
            else:
                raise BackendError("NOT FOUND")
            current_board.trajectory.append(trajectory)
        
        my_last_configuration = copy.deepcopy(default_configuration)
        my_last_configuration.values.pop(7)
        my_last_configuration.values.pop(5)
        my_last_configuration.types.pop(7)
        my_last_configuration.types.pop(5)
        very_last_configuration = Configuration(my_last_configuration.values, my_last_configuration.types)
        goal_constraints = robot.constraints_from_configuration(very_last_configuration,
                                                            [math.radians(1)] * 7,
                                                            [math.radians(1)] * 7)
        for i in range(10):
            trajectory = plan_motion2(robot, goal_constraints,
                                              last_configuration,
                                              group, collision_avoidance = False,
                                              options={
                                                'planner_id': str(planner_id),
                                                'num_planning_attempts': 5,
                                                'allowed_planning_time': 5
                                              })                        
            if trajectory.fraction == 1:                    
                last_configuration = configuration_correct(trajectory.points[-1].values)                       
                for i in range(len(trajectory.points)):
                    trajectory.points[i] = configuration_correct(trajectory.points[i].values)
                last_frame = path_frame_tool0
                break
        current_board.trajectory.append(trajectory)
        my_system.network.node_attribute(key, 'is_planned', True)
        sc.sticky[response_key] = current_board.trajectory
        print("current_board")
        
last_trajectory = [sc.sticky[response_key]]
# ---------- end robot_motion_planner ----------
py_9 = PythonScript(robot=robot, trajectories=robot_motion_planner.last_trajectory)  # -> configurations, full_configurations, full_configurations_collected, fraction, time
# ---------- py_9: Python ----------
full_configurations_col = []


if trajectories:
    for i in range(len(trajectories)):        
        trajectory = trajectories[i]
        print(trajectory.points[1])
        configurations = trajectory.points
        # we can probably already merge at this point!
        full_configurations = [robot.merge_group_with_full_configuration(c, trajectory.start_configuration, group) for c in configurations]
        start_configuration = trajectory.start_configuration        
        fraction = trajectory.fraction
        # there was a little bug there
        #time = trajectory.time_from_start
        time = i
        full_configurations_col.append(full_configurations)
        

full_configurations_collected = [full_configurations_col]
# ---------- end py_9 ----------
idx = Slider(0, range=0..1)
animate = PythonScript(robot=robot, configurations=py_9.full_configurations, full_configurations=py_9.full_configurations_collected, idx=idx)  # -> configuration, slider_max, attach, detach, count, item, board_placed, board_picked, vis_enabled; inputs configurations: list, idx: Int32; disabled
# ---------- animate: Python ----------
import Grasshopper
from compas_fab.utilities import map_range
from compas_fab.robots import Configuration

lengths = []
for config in full_configurations:
    lengths.append(len(config))

slider_max = sum(lengths) - 1
attach = False
detach = False

# there was a bug here, I hope it is resolved this way
for i in range(ghenv.Component.Params.Input.Count):
    try:
        nslider = ghenv.Component.Params.Input[i].Sources[0]
    except:
        continue
    if nslider.GetType() == Grasshopper.Kernel.Special.GH_NumberSlider and nslider.NickName == 'idx':
        nslider.Slider.Maximum = slider_max
        nslider.Slider.Minimum = 0

board_picked = False
board_placed = False
vis_enabled = False
print(full_configurations[4])
if robot and full_configurations[0][0] != None:
    count = -1
    total_length = 0
    while total_length <= idx:
        my_total_length = total_length
        total_length = sum(lengths[:count+2])        
        count += 1
    
    item = idx - my_total_length
    configuration = full_configurations[count][item]
    if (count == 0 and item == 0) or (count == 2 and item == 0) or (count == len(full_configurations) - 3 and item == 0):
        vis_enabled = True
        attach = True
    if count >= 2 and item >= 0:
        #attach = True
        board_picked = True
    if count < 2 or count > len(full_configurations) - 3:
        detach = True
    if count >= len(full_configurations) - 2 and item >= 0:
        board_placed = True
# ---------- end animate ----------
panel_8 = Panel(py_9.full_configurations)
configuration = Data(animate.configuration)

# ----
# Dynamic Geometry Visualisation
toggle = BooleanToggle(False)
visualization_2 = GhPythonScript(my_floorslab_sequence=assembly_sequence_calc.my_floorslab, active=toggle, idx=board)  # -> out, visual, my_floorslab, vis
# ---------- visualization_2: Python ----------
__author__ = "JulianKlaus"
__version__ = "2020.09.10"

import rhinoscriptsyntax as rs
import math
import Rhino.Geometry as rg
import ghpythonlib as gh
from compas.geometry import Point, Box, Frame, Vector, scale_vector, normalize_vector
from compas_ghpython.artists import MeshArtist
from assembly_information_model.assembly import Element, Assembly
from compas.datastructures import Mesh
from compas_rhino.artists import MeshArtist, BoxArtist
import scriptcontext as sc
guid = str(ghenv.Component.InstanceGuid)
response_key = "response_" + guid
if response_key not in sc.sticky:
    sc.sticky[response_key] = None

def grasshopper_draw(system):
    def box_update(elmnt):
        elmnt.board_frame = Frame(elmnt.centre_point, elmnt.length_vector, elmnt.width_vector)
        elmnt.box = Box(elmnt.board_frame, elmnt.length, elmnt.width, elmnt.height)

        if elmnt.stack_center_frame:
            stack_box = Box(elmnt.stack_center_frame, elmnt.length, elmnt.width, elmnt.height)
            return 4, elmnt.board_frame, elmnt.box, stack_box
        else:
            return 3, elmnt.board_frame, elmnt.box

    visualisations = []
    
    
    for brd in system.elements():
        board = brd[1]
        if board.global_count <= idx_max_placed:            
            my_box = board.box
            myartist = BoxArtist(my_box)
            myvisualisation = myartist.draw()
            visualisations.append(myvisualisation)
        
        if board.global_count >= idx_min_picked:
            my_box = Box(board.stack_center_frame, board.length, board.width, board.height)
            myartist = BoxArtist(my_box)
            myvisualisation = myartist.draw()
            visualisations.append(myvisualisation)
    return visualisations
    

my_floorslab = my_floorslab_sequence
idx_max_placed = idx-1
idx_min_picked = idx + 1


if active:
    vis = grasshopper_draw(my_floorslab)    
    visual = gh.treehelpers.list_to_tree(vis, True, [0])
    sc.sticky[response_key] = visual





"""
def grasshopper_draw(system):
    def box_update(elmnt):
        elmnt.board_frame = Frame(elmnt.centre_point, elmnt.length_vector, elmnt.width_vector)
        elmnt.box = Box(elmnt.board_frame, elmnt.length, elmnt.width, elmnt.height)

        if elmnt.stack_center_frame:
            stack_box = Box(elmnt.stack_center_frame, elmnt.length, elmnt.width, elmnt.height)
            return 4, elmnt.board_frame, elmnt.box, stack_box
        else:
            return 3, elmnt.board_frame, elmnt.box

    visualisations = []
    
    
    for brd in system.elements():
        board = brd[1]
        if board.global_count > idx_max:
            break
        # visualise all the boards
        box_creation = box_update(board)
        my_frame_count = box_creation[0]
        
        for i in range (2, my_frame_count):
            my_box = box_creation[i]
            myartist = BoxArtist(my_box)
            myvisualisation = myartist.draw()
            visualisations.append(myvisualisation)
            
        if my_frame_count == 3:
            print("stack not found")
    return visualisations
    """
# ---------- end visualization_2 ----------
visualization_3 = GhPythonScript(
    my_floorslab_sequence=assembly_sequence_calc.my_floorslab,
    active=Toggle(False),
    enabled=animate.vis_enabled,
    idx=board,
    board_picked=animate.board_picked,
    board_placed=animate.board_placed)  # -> out, visual, my_floorslab, vis; inputs enabled: Boolean
# ---------- visualization_3: Python ----------
__author__ = "JulianKlaus"
__version__ = "2020.09.10"

import rhinoscriptsyntax as rs
import math
import Rhino.Geometry as rg
import ghpythonlib as gh
from compas.geometry import Point, Box, Frame, Vector, scale_vector, normalize_vector
from compas_ghpython.artists import MeshArtist
from assembly_information_model.assembly import Element, Assembly
from compas.datastructures import Mesh
from compas_rhino.artists import MeshArtist, BoxArtist
import scriptcontext as sc
guid = str(ghenv.Component.InstanceGuid)
response_key = "response_" + guid
if response_key not in sc.sticky:
    sc.sticky[response_key] = None

def grasshopper_draw(system):
    def box_update(elmnt):
        elmnt.board_frame = Frame(elmnt.centre_point, elmnt.length_vector, elmnt.width_vector)
        elmnt.box = Box(elmnt.board_frame, elmnt.length, elmnt.width, elmnt.height)

        if elmnt.stack_center_frame:
            stack_box = Box(elmnt.stack_center_frame, elmnt.length, elmnt.width, elmnt.height)
            return 4, elmnt.board_frame, elmnt.box, stack_box
        else:
            return 3, elmnt.board_frame, elmnt.box
    visualisations = []
    
    for brd in system.elements():
        board = brd[1]
        if board.global_count < idx:
            continue
        elif board.global_count > idx:
            break
        else:
            if board_placed:        
                my_box = board.box
                myartist = BoxArtist(my_box)
                myvisualisation = myartist.draw()
                visualisations.append(myvisualisation)
            
            if not board_picked:
                my_box = Box(board.stack_center_frame, board.length, board.width, board.height)
                myartist = BoxArtist(my_box)
                myvisualisation = myartist.draw()
                visualisations.append(myvisualisation)
    return visualisations
    

my_floorslab = my_floorslab_sequence


if active:
    vis = grasshopper_draw(my_floorslab)    
    visual = gh.treehelpers.list_to_tree(vis, True, [0])
    sc.sticky[response_key] = visual





"""
def grasshopper_draw(system):
    def box_update(elmnt):
        elmnt.board_frame = Frame(elmnt.centre_point, elmnt.length_vector, elmnt.width_vector)
        elmnt.box = Box(elmnt.board_frame, elmnt.length, elmnt.width, elmnt.height)

        if elmnt.stack_center_frame:
            stack_box = Box(elmnt.stack_center_frame, elmnt.length, elmnt.width, elmnt.height)
            return 4, elmnt.board_frame, elmnt.box, stack_box
        else:
            return 3, elmnt.board_frame, elmnt.box

    visualisations = []
    
    
    for brd in system.elements():
        board = brd[1]
        if board.global_count > idx_max:
            break
        # visualise all the boards
        box_creation = box_update(board)
        my_frame_count = box_creation[0]
        
        for i in range (2, my_frame_count):
            my_box = box_creation[i]
            myartist = BoxArtist(my_box)
            myvisualisation = myartist.draw()
            visualisations.append(myvisualisation)
            
        if my_frame_count == 3:
            print("stack not found")
    return visualisations
    """
# ---------- end visualization_3 ----------
preview_2 = CustomPreview(Geometry=visualization_2.visual, Material=swatch)
panel_9 = Panel(visualization_3.out)
preview_3 = CustomPreview(Geometry=visualization_3.visual, Material=swatch)

panel_10 = Panel(animate.count)
panel_11 = Panel(animate.item)
geo_2 = Geometry(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)
mesh_2 = Mesh(geo_2)
mesh_3 = PythonScript(mesh=mesh_2)  # -> compas_mesh
# ---------- mesh_3: Python ----------
from compas_rhino.geometry import RhinoMesh

compas_mesh = RhinoMesh.from_geometry(mesh).to_compas()
# ---------- end mesh_3 ----------

# ----
# Attached Collision Mesh
# Select link name to attach
number_slider_5 = Slider(7, range=0..9)
py_10 = PythonScript(robot=robot, idx=number_slider_5)  # -> link_name; inputs idx: Int32
# ---------- py_10: Python ----------
if robot:
    link_names = robot.get_link_names()
    link_name = link_names[idx]
# ---------- end py_10 ----------
scale_2 = BooleanToggle(True)
attached = PythonScript(scene=scene, compas_mesh=mesh_3, scale=scale_2, id="tip", link_name=py_10, add=animate.attach, remove=animate.detach)  # -> acm, show_acm; inputs touch_links: list
# ---------- attached: Python ----------
from compas_fab.robots import CollisionMesh
from compas_fab.robots import AttachedCollisionMesh

cm = CollisionMesh(compas_mesh, 'tip')
acm = AttachedCollisionMesh(cm, link_name, touch_links)
show_acm = True

if scene:
    if add:        
        #scene.add_attached_collision_mesh(acm, scale)
        group = robot.main_group_name
        scene.attach_collision_mesh_to_robot_end_effector(cm, group=group)
        
    if remove:
        scene.remove_attached_collision_mesh(id)
        scene.remove_collision_mesh(id)
        acm = None
        show_acm = False

"""
    robot = Robot(client)
    scene = PlanningScene(robot)

    # create collison object
    mesh = Mesh.from_stl(compas_fab.get('planning_scene/cone.stl'))
    cm = CollisionMesh(mesh, 'tip')

    # attach it to the end-effector
    group = robot.main_group_name
    scene.attach_collision_mesh_to_robot_end_effector(cm, group=group)
    """
# ---------- end attached ----------

# ----
# Robot Visualisation
# Select configuration input: from fk, ik, path, or from real robot
list_4 = ValueList({"0 forward_kinematics": 0, "1 assembly": 1}, selected="1 assembly")
show_end_effector_frame = BooleanToggle(True)
filter = StreamFilter(Gate=list_4, Stream0=forward_kinematics, Stream1=configuration)
show_base_frame = BooleanToggle(True)
show_collision = BooleanToggle(False)
show_frames = BooleanToggle(True)
show_visual = BooleanToggle(True)
visualize_2 = PythonScript(
    robot=robot,
    full_configuration=filter,
    show_visual=show_visual,
    show_collision=show_collision,
    show_frames=show_frames,
    show_base_frame=show_base_frame,
    show_end_effector_frame=show_end_effector_frame,
    show_acm=attached.show_acm,
    attached_collision_meshes=attached.acm)  # -> out, visual, collision, frames, base_frame_WCF, ee_frame_WCF, attached_meshes; inputs show_acm: Boolean, attached_collision_meshes: list
# ---------- visualize_2: Python ----------
"""Calculates a cartesian motion path (linear in tool space).
    Inputs:
        robot: The robot
        group: str
            The planning group used for visualisation
        full_configuration: :class:`compas_fab.robots.Configuration`
            The robot's full configuration to display.
        show_visual: bool
           Whether or not to show the robot's visual meshes.
        show_collision: bool
           Whether or not to show the robot's collision meshes.
        show_frames: bool
           Whether or not to show the robot's joint frames.
        show_base_frame: bool
           Whether or not to show the robot's base frame.
        show_end_effector_frame: bool
            Whether or not to show the robot's end-effector frame.
    Output:
        visual: The robot's visual meshes.
        collision: The robot's collision meshes.
        frames: The robot's joint frames.
        base_frame_WCF: The robot's base frame.
        ee_frame_WCF: The robot's end-effector frame.
"""
from __future__ import print_function
import ghpythonlib.components as ghcomp
from compas.geometry import Transformation, Frame
from compas_ghpython.artists import MeshArtist
#from compas_ghpython.geometry import xform_from_transformation


def update(configuration, visual=True, collision=True):
    """Triggers the update of the robot geometry.
    Parameters
    ----------
    configuration : :class:`compas_fab.robots.Configuration`
        Instance of the configuration (joint state) to move to.
    visual : bool, optional
        ``True`` if the visual geometry should be also updated, otherwise ``False``.
        Defaults to ``True``.
    collision : bool, optional
        ``True`` if the collision geometry should be also updated, otherwise ``False``.
        Defaults to ``True``.
    """
    positions = configuration.values
    names = configuration.joint_names or robot.model.get_configurable_joint_names()

    if len(names) != len(configuration.values):
        raise ValueError("Please pass a configuration with %d joint_names." % len(positions))
    joint_state = dict(zip(names, positions))
    transformations = robot.model.compute_transformations(joint_state)
    for j in robot.model.iter_joints():
        link = j.child_link
        for item in link.visual:
            robot.artist._apply_transformation_on_transformed_link(item, transformations[j.name])
        if collision:
            for item in link.collision:
                # some links have only collision geometry, not visual. These meshes have not been loaded.
                if item.native_geometry:
                    robot.artist._apply_transformation_on_transformed_link(item, transformations[j.name])
    
    if robot.attached_tool:
        name = 'joint_6'
        # original line, caused an error probably because of a version change
        # robot.artist._apply_transformation_on_transformed_link(robot.attached_tool, transformations[name])
        
        # the following two lines are slightly experimental copied from Workshop Munich
        frame = robot.forward_kinematics(configuration, options=dict(solver='model', link_name=robot.attached_tool.link_name))
        robot.artist.update_tool(visual=visual, collision=collision, transformation=Transformation.from_frame_to_frame(Frame.worldXY(), frame))

if robot and full_configuration:
    #robot.update(full_configuration, visual=show_visual, collision=show_collision)
    update(full_configuration, visual=show_visual, collision=show_collision) #fast hack, because of a bug in compas_fab
    print(full_configuration)

    if show_visual:
        visual = robot.draw_visual()
        #print(len([v for v in visual]))
        #visual = ([v for v in visual])
        #T = robot.transformation_RCF_WCF()
        #visual = ghcomp.Transform(visual, xform_from_transformation(T))

    if show_collision:
        collision = robot.draw_collision()

    if show_frames:
        axes = robot.transformed_axes(full_configuration)
        frames = robot.transformed_frames(full_configuration)

    if show_base_frame:
        base_frame_WCF = robot.get_base_frame(group, full_configuration)

    if show_end_effector_frame:
        ee_frame_WCF = robot.get_end_effector_frame(group, full_configuration)
        if robot.attached_tool:
            ee_frame_WCF = robot.from_tcf_to_t0cf([ee_frame_WCF])[0]           
            
        print("End-effector", ee_frame_WCF)
        
    if show_acm and attached_collision_meshes != None:
        M = []
        for acm in attached_collision_meshes:
            frame = robot.forward_kinematics(full_configuration, options=dict(solver='model', link_name=acm.link_name))
            T = Transformation.from_frame_to_frame(Frame.worldXY(), frame)
            mesh = acm.collision_mesh.mesh.transformed(T)
            M.append(MeshArtist(mesh).draw())
        attached_meshes = M
    else:
        attached_meshes = None
# ---------- end visualize_2 ----------
py_11 = PythonScript(robot=robot)  # -> scale
# ---------- py_11: Python ----------
if robot:
    scale = robot.scale_factor * 0.1
else:
    scale = 1.
# ---------- end py_11 ----------
geo_3 = Geometry(visualize_2.collision)
geo_4 = Geometry(visualize_2.visual)
draw = GhPythonScript(frames=visualize_2.ee_frame_WCF, scale=py_11)  # -> P, V, C, W; inputs frames: list
# ---------- draw: Python ----------
from System.Drawing import Color
from compas_ghpython import draw_frame

red = Color.FromArgb(255, 0, 0)
green = Color.FromArgb(0, 255, 0)
blue = Color.FromArgb(0, 0, 255)

P = []
V = []
C = []

scale = float(scale)

for frame in frames:
    if not frame:
        continue
    plane = draw_frame(frame)
    P += [plane.Origin] * 3
    V.append(plane.XAxis * scale)
    V.append(plane.YAxis * scale)
    V.append(plane.ZAxis * scale)
    C += [red, green, blue]

W = 3
# ---------- end draw ----------
draw_2 = GhPythonScript(frames=visualize_2.base_frame_WCF, scale=py_11)  # -> P, V, C, W; inputs frames: list; same code as draw
vdisex = VectorDisplayEx(Point=draw.P, Vector=draw.V, Colour=draw.C, Width=draw.W)
vdisex_2 = VectorDisplayEx(Point=draw_2.P, Vector=draw_2.V, Colour=draw_2.C, Width=draw_2.W)
preview_4 = CustomPreview(Geometry=geo_4, Shader=ColourSwatch(SwatchColor=RGB(255, 163, 163)))

geo_5 = Geometry(visualize_2.attached_meshes)

# ==== cluster DefineBasePlane
X = ClusterInput()
Y = ClusterInput()
Z = ClusterInput()
slab = VectorXYZ(XComponent=X, YComponent=Y, ZComponent=Z)  # -> Vector, Length
pln = Plane(PlaneXY(0, 0, 0))
number_slider = Slider(0, range=0..9)
move = Move(Geometry=pln, Motion=slab.Vector)  # -> Geometry, Transform
pi = Pi(Factor=1)
division = Division(A=pi, B=Slider(2, range=0..9))
rotate = Rotate(Geometry=move.Geometry, Angle=division, Plane=move.Geometry)  # -> Geometry, Transform
baseplane = Plane(rotate.Geometry)
baseplane_2 = ClusterOutput(baseplane)

# ==== cluster Cluster
X = ClusterInput()
Y = ClusterInput()
Z = ClusterInput()
stack = VectorXYZ(XComponent=X, YComponent=Y, ZComponent=Z)  # -> Vector, Length
pln = Plane(PlaneXY(0, 0, 0))
pi = Pi(Factor=1)
number_slider = Slider(0, range=0..9)
move = Move(Geometry=pln, Motion=stack.Vector)  # -> Geometry, Transform
multiplication = Multiplication(A=pi, B=Slider(0, range=0..9))
rotate = Rotate(Geometry=move.Geometry, Angle=multiplication, Plane=move.Geometry)  # -> Geometry, Transform
deplane = DeconstructPlane(Plane=rotate.Geometry)  # -> Origin, XAxis, YAxis, ZAxis
rev = Reverse(Vector=deplane.YAxis)
pl = ConstructPlane(Origin=deplane.Origin, XAxis=deplane.XAxis, YAxis=rev)
stack_plane = Plane(pl)
stack_plane_2 = ClusterOutput(stack_plane)

# ==== cluster Cluster_2
X = ClusterInput()
Y = ClusterInput()
Z = ClusterInput()
pln = Plane(PlaneXY(0, 0, 0))
stack = VectorXYZ(XComponent=X, YComponent=Y, ZComponent=Z)  # -> Vector, Length
number_slider = Slider(0, range=0..9)
move = Move(Geometry=pln, Motion=stack.Vector)  # -> Geometry, Transform
pi = Pi(Factor=1)
multiplication = Multiplication(A=pi, B=Slider(0.5, range=0..9))
rotate = Rotate(Geometry=move.Geometry, Angle=multiplication, Plane=move.Geometry)  # -> Geometry, Transform
gluestation_plane = Plane(rotate.Geometry)
gluestation_plane_2 = ClusterOutput(gluestation_plane)
